# Grasshopper definition InfinityExtend.gh (Grasshopper 1.0.8)
# plug-ins: Pufferfish, Wombat

brepinspect_py = Python3Script()  # -> out; inputs brepToTest: Brep
# ---------- brepinspect_py: Python ----------
# This file represents a stub for a GhPython component in Grasshopper.
# It sets up the environment to import and use the splintcommon or other external modules.

from pathlib import Path
import sys
from importlib import reload #FOR DEV ONLY
import time

# In normal GH doc
ghFileDir = None
try:
    ghFileDir = str(Path.joinpath(Path(ghenv.Component.OnPingDocument().FilePath).resolve().parents[0], "src"))
except:
    # In GH Cluster
    ghFileDir = str(Path.joinpath(Path(ghenv.Component.OnPingDocument().Owner.OnPingDocument().FilePath).resolve().parents[0], "src"))

print(f"{ghFileDir=}")

if ghFileDir not in sys.path:
    print("ghFileDir needed to be included")
    sys.path.append(ghFileDir)

import splintcommon
reload(splintcommon) #FOR DEV ONLY

#splintcommon module is now available for use in this GhPython component
splintcommon.log(f'GhPython Node initialized at {time.ctime()}')

import BrepInspect
reload(BrepInspect)

BrepInspect.inspect_solid_brep(brepToTest)
# ---------- end brepinspect_py ----------
panel = Panel(brepinspect_py)
vizplane = VizPlane(plane=PlaneXY(0, 0, 0))  # -> tip_2, line_2, annotation_dot_2
ext_ln_pts = ExtLnPts()
vizvector = VizVector(direction=Vector(0, 0, 1))  # -> cone_2, line, annotation_dot_2
vizplane_2 = VizPlane(plane=PlaneXY(0, 0, 0))  # -> tip_2, line_2, annotation_dot_2
axial_band_thickness_mm = Panel("Before 5/7/26: 1.50")

# ---- group: Internal Parameters
central_band_strap_width_mm = Panel("8.5")
extent_band_strap_width_mm = Panel("5.0")
mid_joint_rise_factor = Panel("1.0")
axial_band_thickness_mm_2 = Panel("1.75")

# ----
toggle_job_make_it_go = BooleanToggle(False)
# InfinityExtend
geo_algorithm_name = Panel("InfinityExtend")
geo_algorithm_name_2 = Panel("InfinityExtend")
factoryautomatorpy = Python3Script(geo_algorithm_name=geo_algorithm_name, toggleJob=toggle_job_make_it_go)  # -> out, inter_phalanx_distance_mm, root_circumference_mm, mid_circumference_mm, tip_circumference_mm, flexion_degrees, root_filename, output_dir, objectID, raw_data; inputs toggleJob: Boolean
# ---------- factoryautomatorpy: Python ----------
from pathlib import Path
import sys
from importlib import reload #FOR DEV
import time

ghFileDir = str(Path.joinpath(Path(ghenv.Component.OnPingDocument().FilePath).resolve().parents[0], "src"))
print(f"{ghFileDir=}")

if ghFileDir not in sys.path:
    print("ghFileDir needed to be included")
    sys.path.append(ghFileDir)

import splintcommon
reload(splintcommon) #FOR DEV
from splintcommon import mark_generation_start
mark_generation_start()
splintcommon.log(f'FactoryAutomatorPY Running at: ({time.strftime("%H:%M:%S", time.localtime())})')
# ==================== Component Code ===========================

def float_range(start, stop, count):
    current = start
    step = (stop - start) / (count - 1)
    result_range = []
    for c in range(count):
        result_range.append(start + (step * c))
    return result_range

is_production_mode = True
job_data, objectID, root_filename, output_dir, raw_data = splintcommon.load_job_data(is_production_mode, geo_algorithm_name)

# This mapping must match the schema of the data in the DB for this geometry type
inter_phalanx_distance_mm = job_data["inter_phalanx_distance_mm"]
root_circumference_mm = job_data["root_circumference_mm"]
mid_circumference_mm = job_data["mid_circumference_mm"]
tip_circumference_mm = job_data["tip_circumference_mm"]

# Special Case, this splint can do a contraction version
if "flexion_degrees" in job_data:
    flexion_degrees = job_data["flexion_degrees"]
else:
    try:
        contracture_flexion_start = job_data["contracture_flexion_start"]
        contracture_flexion_end = job_data["contracture_flexion_end"]
        contracture_flexion_count = job_data["contracture_flexion_count"]

        flexion_degrees = float_range(contracture_flexion_start, contracture_flexion_end, contracture_flexion_count)
    except:
        raise Exception("The required flexion parameters are not present for a contracture splint")


splintcommon.log(f"Result data {geo_algorithm_name=} {objectID=} {inter_phalanx_distance_mm=} {root_circumference_mm=} {mid_circumference_mm=} {tip_circumference_mm=}")
# ---------- end factoryautomatorpy ----------
panel_2 = Panel(factoryautomatorpy.raw_data)
panel_3 = Panel(factoryautomatorpy.root_filename)
panel_4 = Panel(factoryautomatorpy.out)

# ----
# Local Value Override
# NOTE: Red Canvas Background Indicates that local overrides are in use. File should not be left with local overrides enabled
use_local_values = BooleanToggle(False)
inter_phalanx_distance = Number(factoryautomatorpy.inter_phalanx_distance_mm)
local_warning_py = Python3Script(localOverride=use_local_values)  # -> out
# ---------- local_warning_py: Python ----------
import Rhino
import Grasshopper
from System.Drawing import Color

# Set the viewport background color
# col = Grasshopper.GUI.Canvas.GH_Skin.canvas_back
# print(f"{col=}")

if localOverride:
    Grasshopper.GUI.Canvas.GH_Skin.canvas_back = Color.FromArgb(255, 255, 0, 0);
else:
    Grasshopper.GUI.Canvas.GH_Skin.canvas_back = Color.FromArgb(255, 212, 208, 200);

# Redraw the view to see the update instantly
Rhino.RhinoDoc.ActiveDoc.Views.Redraw()
# ---------- end local_warning_py ----------
flexion_degrees = Number(factoryautomatorpy.flexion_degrees)
root_circ = Number(factoryautomatorpy.root_circumference_mm)
override = Panel("50")
mid_circ = Number(factoryautomatorpy.mid_circumference_mm)
override_2 = Panel("120")
tip_circ = Number(factoryautomatorpy.tip_circumference_mm)
override_3 = Panel("40")
override_4 = Panel("""20
40""")
override_5 = Panel("32")
stream_filter = StreamFilter(Gate=use_local_values, Stream0=root_circ, Stream1=override)
stream_filter_2 = StreamFilter(Gate=use_local_values, Stream0=mid_circ, Stream1=override_2)
stream_filter_3 = StreamFilter(Gate=use_local_values, Stream0=tip_circ, Stream1=override_3)
stream_filter_4 = StreamFilter(Gate=use_local_values, Stream0=inter_phalanx_distance, Stream1=override_5)
stream_filter_5 = StreamFilter(Gate=use_local_values, Stream0=flexion_degrees, Stream1=override_4)

# ----
# Finger Preform Solid
# Notes: The infinity_flex is not specific to one joint, but we will model it surrounding the pip joint
# inter_phalanx_distance spans half of the proximal phalanx and half of the middle phalanx and so we will use half of it for the model's proximal_len and middle_len
root_circ_2 = Number(stream_filter)
mid_circ_2 = Number(stream_filter_2)
inter_phalanx_distance_2 = Number(stream_filter_4)
flexion_degrees_2 = Number(stream_filter_5)
axial_band_thickness_mm_3 = Number(axial_band_thickness_mm_2)
tip_circ_2 = Number(stream_filter_3)
extent_band_width = Number(extent_band_strap_width_mm)
fingermodel_py = Python3Script(
    toggle=Toggle(True),
    shell_thickness=axial_band_thickness_mm_3,
    root_circ=root_circ_2,
    mid_circ=mid_circ_2,
    tip_circ=tip_circ_2,
    flexion_degrees=flexion_degrees_2,
    inter_phalanx_distance=inter_phalanx_distance_2,
    extent_band_width=extent_band_width)  # -> out, cFinger_brep, cCenterline, cComponents, sCenterline, sFinger_brep, sComponents, splintBlank, splintBlankCenterline, py_finger_model
# ---------- fingermodel_py: Python ----------
# This file represents a stub for a GhPython component in Grasshopper.
# It sets up the environment to import and use the splintcommon or other external modules.

from pathlib import Path
import sys
from importlib import reload #FOR DEV ONLY
import time

# In normal GH doc
ghFileDir = None
try:
    ghFileDir = str(Path.joinpath(Path(ghenv.Component.OnPingDocument().FilePath).resolve().parents[0], "src"))
except:
    # In GH Cluster
    ghFileDir = str(Path.joinpath(Path(ghenv.Component.OnPingDocument().Owner.OnPingDocument().FilePath).resolve().parents[0], "src"))

print(f"{ghFileDir=}")

if ghFileDir not in sys.path:
    print("ghFileDir needed to be included")
    sys.path.append(ghFileDir)

import splintcommon
reload(splintcommon) #FOR DEV ONLY

#splintcommon module is now available for use in this GhPython component
splintcommon.log(f'GhPython Node initialized at {time.ctime()}')


from importlib import reload
import FingerModel
reload(FingerModel)

from FingerModel import create_finger_model, FingerParams, create_finger_model_result
from dataclasses import replace

import BrepDifference
reload(BrepDifference) #FOR DEV ONLY
from BrepDifference import robust_brep_difference

# Refresher, order of elements:
# metacarpel numb, mcp, proximal, pip, middle, dip, distal

# input values to work with:
# shell_thickness
# root_circ ~= mcp_circ 
# mid_circ ~=
# tip_circ
# flexion_degrees
# inter_phalanx_distance
# extent_band_width

# The model input values that we need to provide or compute:

trimDistAroundPIP = (inter_phalanx_distance/2) + (extent_band_width/2)


# Must do linear interpolation on outer joints
min_linear_int = 2.0

mcp_circ_calc = root_circ - (mid_circ - root_circ)
mcp_circ_calc = mcp_circ_calc if mcp_circ_calc > min_linear_int else min_linear_int

dip_circ_calc = tip_circ - (mid_circ - tip_circ)
dip_circ_calc = dip_circ_calc if dip_circ_calc > min_linear_int else min_linear_int


coreParams = FingerParams(
    # Segment range - generate full finger or subset
    start_at="proximal",
    end_at="middle",

    # Joint circumferences (mm)
    mcp_circ=mcp_circ_calc,
    proximal_mid_circ=root_circ,
    pip_circ=mid_circ,
    middle_mid_circ=tip_circ,
    dip_circ=dip_circ_calc,
    # distal_mid_circ=60.0,
    # tip_circ=45.0,

    # Metacarpal stub length
    metacarpal_len=20.0,

    # Phalanx lengths (mm)
    proximal_len=inter_phalanx_distance,
    middle_len=inter_phalanx_distance,
    # distal_len=None,
    
    # Joint angles (degrees) - positive = curl toward palm
    # mcp_flex=0.0,
    pip_flex=flexion_degrees,
    # dip_flex=0.0,

    # mcp_lateral=0.0,
    # pip_lateral=0.0,
    # dip_lateral=0.0,   
)

# Create the central, core finger model
c_result_finger_model = create_finger_model_result(
    coreParams,
    tolerance=None,      # Use document tolerance
)
cCenterline, cFinger_brep, cComponents, cJointPositions = (c_result_finger_model.centerline, c_result_finger_model.finger_brep,
            c_result_finger_model.components, c_result_finger_model.joint_positions)
py_finger_model = [c_result_finger_model] #list is necessary for passing it through grasshopper

# Create the shell params
shellParams = replace(coreParams, shell_thickness=shell_thickness, start_at="proximal", end_at="middle")
shellParams.trim_start=("pip", -1 * trimDistAroundPIP)  # 10mm before MCP joint
shellParams.trim_end=("pip", trimDistAroundPIP)

# Create the shell model
sCenterline, sFinger_brep, sComponents, sJointPositions = create_finger_model(
    shellParams,
    tolerance=None,      # Use document tolerance
    return_parts=True    # Return individual components
)

# Subtract inner from shell to create hollow splint
splintBlank, success, method = robust_brep_difference(
    minuend=sFinger_brep,      # subtract FROM this (larger)
    subtrahend=cFinger_brep,   # subtract this (smaller)
    base_tolerance=0.001
)

splintBlankCenterline = sCenterline

if success:
    print(f"Hollow splint created via {method}")
    # result_brep is now a hollow shell
else:
    print(f"Difference failed: {method}")
# ---------- end fingermodel_py ----------
circ2rad = Python3Script(circumference=mid_circ_2)  # -> radius
# ---------- circ2rad: Python ----------
from math import pi

radius = circumference / (2 * pi)

print(f"{circumference=} {radius=}")
# ---------- end circ2rad ----------
inner_shell_brep = Brep(fingermodel_py.cFinger_brep)
outer_shell_brep = Brep(fingermodel_py.sFinger_brep)
material_shell_brep = Brep(fingermodel_py.splintBlank)
mid_splint_radius = Number(circ2rad)
py_finger_model = Data(fingermodel_py.py_finger_model)
splint_centerline = Curve(fingermodel_py.splintBlankCenterline)
scomponents = Geometry(fingermodel_py.sComponents)

# ----
# Central Finger Line Geometry
splint_centerline_2 = Curve(splint_centerline)
explode = Explode(Curve=splint_centerline_2, Recursive=True)  # -> Segments, Vertices
list_item = ListItem(List=explode.Segments, Index="0", Wrap=False)
list_item_2 = ListItem(List=explode.Segments, Index="1", Wrap=False)
unit_vector = UnitVector(Vector=list_item)
end_points = EndPoints(Curve=list_item_2)  # -> Start, End
end_points_2 = EndPoints(Curve=list_item)  # -> Start, End
firstsegmentdirection = Vector(flatten(unit_vector))
secondsegmentline = Line(flatten(list_item_2))
secondsegmentend = Point(flatten(end_points.End))
firstsegmentstart = Point(flatten(end_points_2.Start))
firstsegmentline = Line(flatten(list_item))
firstsegmentend = Point(flatten(end_points_2.End))

axial_band_thickness_mm_4 = Number(axial_band_thickness_mm_2)
objectid = Text(factoryautomatorpy.objectID)

# ----
# Alignment Work
secondsegmentend_2 = Point(secondsegmentend)
firstsegmentstart_2 = Point(firstsegmentstart)
line = Line(StartPoint=firstsegmentstart_2, EndPoint=secondsegmentend_2)
average_center_line = Line(line)

panel_5 = Panel(fingermodel_py.out)
orientation_override = Panel("0.0")
number_slider = Slider(0, range=0..5)
random = Random(Range=Domain(1, 99999), Number=1, Seed=Slider(594, range=0..999))
create_material = CreateMaterial(Diffuse=RGB(255, 131, 193), Specular=RGB(255, 254, 255), Emission=RGB(0, 0, 0), Transparency=0, Shine=0)
model_material = ModelMaterial()  # -> Material, Name, Shader

# ----
# Preform Orientation Adjustment
firstsegmentdirection_2 = Vector(firstsegmentdirection)
secondsegmentline_2 = Line(secondsegmentline)
firstsegmentstart_3 = Point(firstsegmentstart)
firstsegmentend_2 = Point(firstsegmentend)
firstsegmentline_2 = Line(firstsegmentline)
average_center_line_2 = Line(average_center_line)
secondsegmentend_3 = Point(secondsegmentend)
material_shell_brep_2 = Brep(material_shell_brep)
inner_shell_brep_2 = Brep(inner_shell_brep)
scomponents_2 = Geometry(scomponents)
outer_shell_brep_2 = Brep(outer_shell_brep)
xz_plane = XZPlane(Origin=Point(0, 0, 0))
angle = Angle(VectorA=average_center_line_2, VectorB=firstsegmentdirection_2, Plane=xz_plane)  # -> Angle, Reflex
finger_model_rotate = Rotate(Geometry=material_shell_brep_2, Angle=angle.Angle, Plane=xz_plane)  # -> Geometry, Transform
outer_barrel_transform = Transform(Geometry=outer_shell_brep_2, Transform=finger_model_rotate.Transform)
inner_barrel_transform = Transform(Geometry=inner_shell_brep_2, Transform=finger_model_rotate.Transform)
center_line_transform = Transform(Geometry=average_center_line_2, Transform=finger_model_rotate.Transform)
root_line_transform = Transform(Geometry=firstsegmentline_2, Transform=finger_model_rotate.Transform)
tip_line_transform = Transform(Geometry=secondsegmentline_2, Transform=finger_model_rotate.Transform)
first_orientation_shift_transform = Transform(finger_model_rotate.Transform)
firstsegmentline_3 = Line(root_line_transform)
secondsegmentline_3 = Line(tip_line_transform)
average_center_line_3 = Line(center_line_transform)
inner_shell_brep_3 = Brep(inner_barrel_transform)
outer_shell_brep_3 = Brep(outer_barrel_transform)

list_item_3 = ListItem(List=scomponents_2, Index="1", Wrap=True)
volume = Volume(Geometry=list_item_3)  # -> Volume, flatten(Centroid)

scomponents_transform = Transform(Geometry=volume.Centroid, Transform=finger_model_rotate.Transform)
joint_centroid = Point(flatten(scomponents_transform))

# ----
# Top Center Band Creation
# Band Moved To Center
# Create band line in space
outer_shell_brep_4 = Brep(outer_shell_brep_3)
joint_centroid_2 = Point(flatten(joint_centroid))
central_band_strap_width_mm_2 = Panel(central_band_strap_width_mm)
unit_x = UnitX(Factor=1)
ref_nudge = Panel("75")
unit_z = UnitZ(Factor=ref_nudge)
box_center_slice_py = Python3Script(target_brep=outer_shell_brep_4, view_vector=unit_x)  # -> out, slice_surface; inputs target_brep: Brep, view_vector: Vector3d
# ---------- box_center_slice_py: Python ----------
# This file represents a stub for a GhPython component in Grasshopper.
# It sets up the environment to import and use the splintcommon or other external modules.

from pathlib import Path
import sys
from importlib import reload #FOR DEV
import time

# In normal GH doc
ghFileDir = None
try:
    ghFileDir = str(Path.joinpath(Path(ghenv.Component.OnPingDocument().FilePath).resolve().parents[0], "src"))
except:
    # In GH Cluster
    ghFileDir = str(Path.joinpath(Path(ghenv.Component.OnPingDocument().Owner.OnPingDocument().FilePath).resolve().parents[0], "src"))

print(f"{ghFileDir=}")

if ghFileDir not in sys.path:
    print("ghFileDir needed to be included")
    sys.path.append(ghFileDir)

import splintcommon
reload(splintcommon) #FOR DEV

#splintcommon module is now available for use in this GhPython component
splintcommon.log(f'GhPython Node initialized at {time.ctime()}')

import FeatureIdentification
reload(FeatureIdentification) #FOR DEV
from FeatureIdentification import box_center_slice

import Rhino.Geometry as rg

# Get a slice plane at the center, facing +Y direction
slice_surface = box_center_slice(
    target_brep=target_brep,
    bbox_plane=rg.Plane.WorldXY,
    choose_side_vector=view_vector
)
# ---------- end box_center_slice_py ----------
deconstruct = Deconstruct(Point=joint_centroid_2)  # -> XComponent, YComponent, ZComponent
move = Move(Geometry=joint_centroid_2, Motion=unit_z)  # -> Geometry, Transform
area = Area(Geometry=box_center_slice_py.slice_surface)  # -> Area, Centroid
center_ref_point = Point(move.Geometry)
deconstruct_2 = Deconstruct(Point=area.Centroid)  # -> XComponent, YComponent, ZComponent
construct_point = ConstructPoint(XCoordinate=deconstruct.XComponent, YCoordinate=deconstruct_2.YComponent, ZCoordinate=deconstruct_2.ZComponent)
xy_plane = XYPlane(Origin=Point(0, 0, 0))
unit_x_2 = UnitX(Factor=1)
move_to_point = MoveToPoint(Geometry=box_center_slice_py.slice_surface, PointA=area.Centroid, PointB=construct_point)  # -> Moved, Vector, Transform
line_sdl = LineSDL(Start=xy_plane, Direction=unit_x_2, Length=central_band_strap_width_mm_2)
brep_plane = BrepPlane(Brep=outer_shell_brep_4, Plane=move_to_point.Moved)  # -> flatten(Curves), Points
panel_6 = Panel(brep_plane.Curves)
curve_middle = CurveMiddle(Curve=line_sdl)
curve_closest_point = CurveClosestPoint(Point=center_ref_point, Curve=brep_plane.Curves)  # -> Point, Parameter, Distance
move_to_point_2 = MoveToPoint(Geometry=line_sdl, PointA=curve_middle, PointB=curve_closest_point.Point)  # -> Moved, Vector, Transform
nudge = Panel("100")
unit_z_2 = UnitZ(Factor=nudge)
output_nudge_motion = Panel("0, 0, 3")
band_line = Curve(move_to_point_2.Moved)
unit_z_3 = UnitZ(Factor="-1")
move_2 = Move(Geometry=band_line, Motion=unit_z_2)  # -> Geometry, Transform
vector = Vector(output_nudge_motion)
pull_line_to_brep_py = Python3Script(
    input_line=move_2.Geometry,
    input_brep=outer_shell_brep_4,
    input_line_sample_count="5",
    move_direction=unit_z_3,
    output_nudge_motion=vector)  # -> out, result_line; inputs input_line: Curve, input_brep: Brep, input_line_sample_count: Int32, move_direction: Vector3d, output_nudge_motion: Vector3d
# ---------- pull_line_to_brep_py: Python ----------
# GRASSHOPPER COMPONENT: NudgeLineToBrep
#
# INPUTS:
#   input_line              - Curve  - The LineCurve to move
#   input_brep              - Brep   - The brep to move toward
#   input_line_sample_count - Int    - Number of division intervals along the line
#   move_direction          - Vector - Direction to shoot rays (pointing toward brep)
#   output_nudge_motion     - Vector - Additional offset applied after moving to brep
#
# OUTPUTS:
#   result_line - Curve - Moved and nudged copy of input_line

from pathlib import Path
import sys
from importlib import reload  # FOR DEV
import time

doc = ghenv.Component.OnPingDocument()
while not doc.FilePath and doc.Owner:
    doc = doc.Owner.OnPingDocument()
ghFileDir = str(Path(doc.FilePath).resolve().parent / "src")

if ghFileDir not in sys.path:
    sys.path.append(ghFileDir)

import splintcommon
reload(splintcommon)  # FOR DEV
from splintcommon import mark_generation_start
mark_generation_start()

import FeatureIdentification
reload(FeatureIdentification)  # FOR DEV
from FeatureIdentification import nudge_line_to_brep

splintcommon.log('NudgeLineToBrep: started at {}'.format(time.ctime()))

result_line = nudge_line_to_brep(
    input_line,
    input_brep,
    int(input_line_sample_count),
    move_direction,
    output_nudge_motion,
)
# ---------- end pull_line_to_brep_py ----------
center_band = Curve(pull_line_to_brep_py.result_line)
entwine = Entwine(Branch00=outer_shell_brep_4, Branch01=center_band, Branch02=center_ref_point, FlattenInputs=True)
cluster = Cluster_2(base_move_vector="-50, 0, 0", geo_data=entwine)  # -> geometry, out

# ----
# (OLD) Outer Bottom Bands Creation
outer_band_width_mm = Panel(extent_band_strap_width_mm)  # disabled
outer_shell_brep_5 = Brep(outer_shell_brep_3)  # disabled
mid_circumference = Number(mid_circ_2)  # disabled
circ2rad_2 = Python3Script(circumference=mid_circumference)  # -> radius; disabled; same code as circ2rad
panel_7 = Panel("-1")  # disabled
unit_y = UnitY(Factor=1)  # disabled
multiplication = Multiplication(A=circ2rad_2, B=panel_7)  # disabled
unit_z_4 = UnitZ(Factor=multiplication)  # disabled
box_center_slice_py_2 = Python3Script(target_brep=outer_shell_brep_5, view_vector=unit_y)  # -> out, slice_surface; inputs target_brep: Brep, view_vector: Vector3d; disabled; same code as box_center_slice_py
move_3 = Move(Geometry=box_center_slice_py_2.slice_surface, Motion=unit_z_4)  # -> Geometry, Transform; disabled
box_center_slice_py_3 = Python3Script(target_brep=outer_shell_brep_5, slice_surface=move_3.Geometry)  # -> out, result_curves, result_points; inputs target_brep: Brep, slice_surface: Surface; disabled
# ---------- box_center_slice_py_3: Python ----------
# This file represents a stub for a GhPython component in Grasshopper.
# It sets up the environment to import and use the splintcommon or other external modules.

from pathlib import Path
import sys
from importlib import reload #FOR DEV
import time

# In normal GH doc
ghFileDir = None
try:
    ghFileDir = str(Path.joinpath(Path(ghenv.Component.OnPingDocument().FilePath).resolve().parents[0], "src"))
except:
    # In GH Cluster
    ghFileDir = str(Path.joinpath(Path(ghenv.Component.OnPingDocument().Owner.OnPingDocument().FilePath).resolve().parents[0], "src"))

print(f"{ghFileDir=}")

if ghFileDir not in sys.path:
    print("ghFileDir needed to be included")
    sys.path.append(ghFileDir)

import splintcommon
reload(splintcommon) #FOR DEV

#splintcommon module is now available for use in this GhPython component
splintcommon.log(f'GhPython Node initialized at {time.ctime()}')

import FeatureIdentification
reload(FeatureIdentification) #FOR DEV
from FeatureIdentification import intersect_with_reference

import Rhino.Geometry as rg

result_curves, result_points = intersect_with_reference(
    target_brep = target_brep, 
    slice_surface = slice_surface, 
    view_direction = rg.Vector3d.YAxis, 
    up_vector=rg.Vector3d.ZAxis
)
# ---------- end box_center_slice_py_3 ----------
panel_8 = Panel("2")  # disabled
panel_9 = Panel("3")  # disabled
list_item_4 = ListItem(List=box_center_slice_py_3.result_points, Index=panel_8, Wrap=False)  # -> flatten(Item); disabled
list_item_5 = ListItem(List=box_center_slice_py_3.result_points, Index=panel_9, Wrap=False)  # -> flatten(Item); disabled
unit_x_3 = UnitX(Factor=1)  # disabled
panel_10 = Panel("-1")  # disabled
unit_x_4 = UnitX(Factor=panel_10)  # disabled
nudge_2 = Panel("-2")  # disabled
unit_z_5 = UnitZ(Factor=nudge_2)  # disabled
left_band_guide = LineSDL(Start=list_item_5, Direction=unit_x_3, Length=outer_band_width_mm)  # disabled
right_band_guide = LineSDL(Start=list_item_4, Direction=unit_x_4, Length=outer_band_width_mm)  # disabled
move_4 = Move(Geometry=right_band_guide, Motion=unit_z_5)  # -> Geometry, Transform; disabled
move_5 = Move(Geometry=left_band_guide, Motion=unit_z_5)  # -> Geometry, Transform; disabled
panel_11 = Panel("-50, 0, 0")  # disabled
root_outer_band = Curve(move_5.Geometry)  # disabled
tip_outer_band = Curve(move_4.Geometry)  # disabled
entwine_2 = Entwine(Branch00=outer_shell_brep_5, Branch01=root_outer_band, Branch02=tip_outer_band, FlattenInputs=True)  # disabled
cluster_2 = Cluster_2(base_move_vector=panel_11, geo_data=entwine_2)  # -> geometry, out; disabled

# ----
# Outer Bottom Bands Creation
# 1. Move the top bands into place
# 2. Connect the ends of the top bands to create a v shaped mask to intersect with the preform
north_start_nudge = Panel("0, 0, -1")
extent_band_strap_width_mm_2 = Panel(extent_band_strap_width_mm)
outer_shell_brep_6 = Brep(outer_shell_brep_3)
north_star_point = Panel("300, 0, -100")
north_star = Panel("-200, 0, -100")
point = Point(north_star_point)
point_2 = Point(north_star)
construct_domain = ConstructDomain(DomainStart="0", DomainEnd="-90")
xz_plane_2 = XZPlane(Origin=Point(0, 0, 0))
brep_ref_point_cl = BrepRefPointCL(nudge_amount=north_start_nudge, north_star_pt=north_star, brep=outer_shell_brep_6)  # -> result_point_2, distance
brep_ref_point_cl_2 = BrepRefPointCL(nudge_amount=north_start_nudge, north_star_pt=north_star_point, brep=outer_shell_brep_6)  # -> result_point_2, distance
unit_x_5 = UnitX(Factor=1)
unit_x_6 = UnitX(Factor="-1")
range = Range(Domain=construct_domain, Steps="10")
left_band_guide_line = LineSDL(Start=brep_ref_point_cl.result_point_2, Direction=unit_x_5, Length=extent_band_strap_width_mm_2)
right_band_guide_line = LineSDL(Start=brep_ref_point_cl_2.result_point_2, Direction=unit_x_6, Length=extent_band_strap_width_mm_2)
rotation_check_angles = Number(range)
negative = Negative(Value=rotation_check_angles)
find_band_align_py = Python3Script(
    input_brep=outer_shell_brep_6,
    input_curve=right_band_guide_line,
    rotation_origin_point=brep_ref_point_cl_2.result_point_2,
    rotation_plane=xz_plane_2,
    test_rotation_degrees=negative)  # -> out, result_curve; inputs input_brep: Brep, input_curve: Curve, rotation_origin_point: Point3d, rotation_plane: Plane, test_rotation_degrees: list of Double
# ---------- find_band_align_py: Python ----------
# GRASSHOPPER COMPONENT: FindNonIntersectingCurveRotation
#
# INPUTS:
#   input_brep            - Brep    - The brep to test intersections against
#   input_curve           - Curve   - The curve to rotate and test
#   rotation_origin_point - Point   - Centre of rotation
#   rotation_plane        - Plane   - Plane whose normal defines the rotation axis
#   test_rotation_degrees - Number  - List of degree values to try, in order (set to List Access)
#
# OUTPUTS:
#   result_curve  - Curve  - First rotated curve that clears the brep, or None

from pathlib import Path
import sys
from importlib import reload  # FOR DEV
import time

# Walk up through nested clusters to find the root GH document
doc = ghenv.Component.OnPingDocument()
while not doc.FilePath and doc.Owner:
    doc = doc.Owner.OnPingDocument()
ghFileDir = str(Path(doc.FilePath).resolve().parent / "src")

if ghFileDir not in sys.path:
    sys.path.append(ghFileDir)

import splintcommon
reload(splintcommon)  # FOR DEV
from splintcommon import mark_generation_start
mark_generation_start()

import FeatureIdentification
reload(FeatureIdentification)  # FOR DEV
from FeatureIdentification import find_non_intersecting_curve_rotation

splintcommon.log('FindNonIntersectingCurveRotation: started at {}'.format(time.ctime()))

result_curve = find_non_intersecting_curve_rotation(
    input_brep,
    input_curve,
    rotation_origin_point,
    rotation_plane,
    test_rotation_degrees,
)
# ---------- end find_band_align_py ----------
plane_origin = PlaneOrigin(Base=xz_plane_2, Origin=brep_ref_point_cl.result_point_2)
find_band_align_py_2 = Python3Script(
    input_brep=outer_shell_brep_6,
    input_curve=left_band_guide_line,
    rotation_origin_point=brep_ref_point_cl.result_point_2,
    rotation_plane=xz_plane_2,
    test_rotation_degrees=rotation_check_angles)  # -> out, result_curve; inputs input_brep: Brep, input_curve: Curve, rotation_origin_point: Point3d, rotation_plane: Plane, test_rotation_degrees: list of Double; same code as find_band_align_py
plane_origin_2 = PlaneOrigin(Base=xz_plane_2, Origin=brep_ref_point_cl_2.result_point_2)
rotate = Rotate(Geometry=left_band_guide_line, Angle=degrees(rotation_check_angles), Plane=plane_origin)  # -> Geometry, Transform
rotate_2 = Rotate(Geometry=right_band_guide_line, Angle=degrees(negative), Plane=plane_origin_2)  # -> Geometry, Transform
root_outer_band_2 = Curve(find_band_align_py_2.result_curve)
list_item_6 = ListItem(List=rotate.Geometry, Index="0", Wrap=True)
tip_outer_band_2 = Curve(find_band_align_py.result_curve)
list_item_7 = ListItem(List=rotate_2.Geometry, Index="0", Wrap=True)

# ----
# Side Cutter Profile
bottom_band_width_mm = Panel(central_band_strap_width_mm)
mid_joint_rise_factor_2 = Panel(mid_joint_rise_factor)
root_top_band = Curve(root_outer_band_2)
outer_shell_brep_7 = Brep(outer_shell_brep_3)
bottom_band = Curve(center_band)
tip_top_band = Curve(tip_outer_band_2)
multiplication_2 = Multiplication(A=bottom_band_width_mm, B=mid_joint_rise_factor_2)
midpoint = Midpoint(Curve=bottom_band)
negative_2 = Negative(Value=multiplication_2)
unit_z_6 = UnitZ(Factor=negative_2)
move_6 = Move(Geometry=midpoint, Motion=unit_z_6)  # -> Geometry, Transform
end_points_3 = EndPoints(Curve=bottom_band)  # -> Start, End
end_points_4 = EndPoints(Curve=root_top_band)  # -> Start, End
end_points_5 = EndPoints(Curve=tip_top_band)  # -> Start, End
top_right_band_right_pt = Point(end_points_5.Start)
bottom_right_pt = Point(end_points_3.End)
bottom_left_pt = Point(end_points_3.Start)
top_left_band_left_pt = Point(end_points_4.Start)
top_left_band_right_pt = Point(end_points_4.End)
central_pt = Point(move_6.Geometry)
top_right_band_left_pt = Point(end_points_5.End)
line_2 = Line(StartPoint=top_left_band_right_pt, EndPoint=central_pt)
line_3 = Line(StartPoint=central_pt, EndPoint=top_right_band_left_pt)
midpoint_2 = Midpoint(Curve=line_2)
midpoint_3 = Midpoint(Curve=line_3)
tip_slant_line = Line(StartPoint=top_right_band_right_pt, EndPoint=bottom_right_pt)
line_4 = Line(StartPoint=bottom_right_pt, EndPoint=bottom_left_pt)
line_5 = Line(StartPoint=bottom_left_pt, EndPoint=top_left_band_left_pt)
line_6 = Line(StartPoint=top_left_band_left_pt, EndPoint=top_left_band_right_pt)
line_7 = Line(StartPoint=top_right_band_left_pt, EndPoint=top_right_band_right_pt)
line_8 = Line(StartPoint=top_left_band_right_pt, EndPoint=midpoint_2)
line_9 = Line(StartPoint=midpoint_3, EndPoint=top_right_band_left_pt)
entwine_3 = Entwine(
    Branch00=line_4,
    Branch01=line_5,
    Branch02=line_6,
    Branch03=line_8,
    Branch04=line_9,
    Branch05=line_7,
    Branch06=tip_slant_line,
    FlattenInputs=True)
transpose_py = Python3Script(data=entwine_3)  # -> out, result; inputs data: tree of GeometryBase; same code as transpose_py
join_curves = JoinCurves(Curves=transpose_py.result, Preserve=False)  # -> flatten(Curves)
connect_curves = ConnectCurves(Curves=graft(join_curves), Continuity=2, Close=True, Bulge=Slider(0.6, range=0..2))  # -> flatten(Curve)
merge = Merge(Data1=line_4, Data2=line_5, Data3=line_6, Data4=line_8, Data5=line_9, Data6=line_7, Data7=tip_slant_line)
entwine_4 = Entwine(
    Branch00=outer_shell_brep_7,
    Branch01=line_4,
    Branch02=line_5,
    Branch03=line_6,
    Branch04=line_8,
    Branch05=line_9,
    Branch06=line_7,
    Branch07=tip_slant_line,
    Branch08=bottom_band,
    Branch09=root_top_band,
    Branch010=tip_top_band,
    FlattenInputs=True)
close_curve = CloseCurve(Curve=connect_curves, Tolerance=0)
xz_plane_3 = XZPlane(Origin=Point(0, 0, 0))
unit_y_2 = UnitY(Factor="-30")
cluster_3 = Cluster_2(base_move_vector="-100, 0, 0", geo_data=entwine_4)  # -> geometry, out
project = Project(Geometry=connect_curves, Plane=xz_plane_3)  # -> Geometry, Transform
planar = Planar(Curve=project.Geometry)  # -> Planar, Plane, Deviation
move_7 = Move(Geometry=project.Geometry, Motion=unit_y_2)  # -> Geometry, Transform
geometry = Geometry(cluster_3.geometry)
tip_slant_line_2 = Line(flatten(tip_slant_line))
cutter_curve = Curve(flatten(move_7.Geometry))
panel_12 = Panel(planar.Planar)

# ----
# Side Cutter Applied
cutter_curve_2 = Curve(cutter_curve)
panel_13 = Panel(cutter_curve_2)
unit_y_3 = UnitY(Factor="60")
boundary_surfaces = BoundarySurfaces(Edges=cutter_curve_2)
extrude = Extrude(Base=boundary_surfaces, Direction=unit_y_3)
inner_shell_brep_4 = Brep(inner_shell_brep_3)
side_cutter_volume = Brep(graft(extrude))
preform_tube_brep = Brep(graft(finger_model_rotate.Geometry))
solid_intersection = SolidIntersection(BrepsA=preform_tube_brep, BrepsB=side_cutter_volume)  # -> flatten(Result)
entwine_5 = Entwine(Branch00=solid_intersection, FlattenInputs=True)  # disabled
panel_14 = Panel("-50, 0, 0")  # disabled
cluster_4 = Cluster_2(base_move_vector=panel_14, geo_data=entwine_5)  # -> geometry, out; disabled
side_cutter_volume_2 = Brep(flatten(side_cutter_volume))
splint_brep = Brep(solid_intersection)
side_cutter_surface = Surface(boundary_surfaces)

# ----
# ID Embossing Gun
text_size = Slider(3.3, range=2.5..6)  # disabled
finishedsplintbrep = Brep(splint_brep)  # disabled
mid_splint_radius_2 = Number(mid_splint_radius)  # disabled
wall_thickness_mm = Number(axial_band_thickness_mm_4)  # disabled
objectid_text = Text(objectid)  # disabled
side_projection_angle = Panel("32")  # disabled
object_text_py = Python3Script(breps=finishedsplintbrep, objectId=objectid_text)  # -> out, textOutput; inputs breps: list of Brep, objectId: String; disabled
# ---------- object_text_py: Python ----------
"""Grasshopper Script"""
a = "Hello Python 3 in Grasshopper!"
print(a)

brepCount = 0
if breps is not None:
    brepCount = len(breps)




if brepCount <= 1:
    textOutput = f"-\n{objectId}"
else:
    indexRange = reversed(range(1, brepCount + 1))
    textOutput = [f"{i}\n{objectId}" for i in indexRange]

print(f"{textOutput=}")
# ---------- end object_text_py ----------
unit_z_7 = UnitZ(Factor=1)  # disabled
unit_y_4 = UnitY(Factor=1)  # disabled
yz_plane = YZPlane(Origin=Point(0, 0, 0))  # disabled
panel_15 = Panel(objectid_text)  # disabled
bounding_box = BoundingBox(Content=finishedsplintbrep, Plane=PlaneXY(0, 0, 0))  # -> Box, Box_2; disabled
objectid_w_index_text = Text(reverse(object_text_py.textOutput))  # disabled
intersection_z_offset = Panel("1.25")  # disabled
number_slider_2 = Slider(4, range=0..10)  # disabled
volume_2 = Volume(Geometry=bounding_box.Box)  # -> Volume, Centroid; disabled
rotate_3 = Rotate(Geometry=unit_y_4, Angle=degrees(side_projection_angle), Plane=yz_plane)  # -> Geometry, Transform; disabled
transform = Transform(Geometry=unit_z_7, Transform=rotate_3.Transform)  # disabled
panel_16 = Panel("4")  # disabled
negative_3 = Negative(Value=mid_splint_radius_2)  # disabled
added_rotation = Panel("90")  # disabled
box_center_slice_py_4 = Python3Script(target_brep=finishedsplintbrep, view_vector=rotate_3.Geometry)  # -> out, slice_surface; inputs target_brep: Brep, view_vector: Vector3d; disabled; same code as box_center_slice_py
multiplication_3 = Multiplication(A=negative_3, B=intersection_z_offset)  # disabled
addition = Addition(A=side_projection_angle, B=added_rotation)  # disabled
panel_17 = Panel("0.25")  # disabled
panel_18 = Panel("proj")  # disabled
unit_z_8 = UnitZ(Factor=multiplication_3)  # disabled
boolean_toggle = BooleanToggle(False)  # disabled
line_sdl_2 = LineSDL(Start=volume_2.Centroid, Direction=rotate_3.Geometry, Length=number_slider_2)  # disabled
panel_19 = Panel("up")  # disabled
centroid = Point(volume_2.Centroid)  # disabled
vizvector_2 = VizVector(start=volume_2.Centroid, direction=transform, arrowlen=panel_16, text=panel_19)  # -> cone_2, line, annotation_dot_2; disabled
vizvector_3 = VizVector(start=volume_2.Centroid, direction=rotate_3.Geometry, arrowlen=panel_16, text=panel_18)  # -> cone_2, line, annotation_dot_2; disabled
move_8 = Move(Geometry=box_center_slice_py_4.slice_surface, Motion=unit_z_8)  # -> Geometry, Transform; disabled
unit_y_5 = UnitY(Factor=1)  # disabled
yz_plane_2 = YZPlane(Origin=centroid)  # disabled
unit_z_9 = UnitZ(Factor=1)  # disabled
tip = Brep(vizvector_2.cone_2)  # disabled
line_10 = Line(vizvector_2.line)  # disabled
annotation_dot = AnnotationDot(vizvector_2.annotation_dot_2)  # disabled
rotate_4 = Rotate(Geometry=move_8.Geometry, Angle=degrees(addition), Plane=yz_plane_2)  # -> Geometry, Transform; disabled
transform_2 = Transform(Geometry=unit_y_5, Transform=rotate_4.Transform)  # disabled
transform_3 = Transform(Geometry=unit_z_9, Transform=rotate_4.Transform)  # disabled
box_center_slice_py_5 = Python3Script(target_brep=finishedsplintbrep, slice_surface=rotate_4.Geometry, view_direction=transform_2, up_vector=transform_3)  # -> out, result_curves, result_points; inputs target_brep: Brep, slice_surface: Surface, view_direction: Vector3d, up_vector: Vector3d; disabled
# ---------- box_center_slice_py_5: Python ----------
# This file represents a stub for a GhPython component in Grasshopper.
# It sets up the environment to import and use the splintcommon or other external modules.

from pathlib import Path
import sys
from importlib import reload #FOR DEV
import time

# In normal GH doc
ghFileDir = None
try:
    ghFileDir = str(Path.joinpath(Path(ghenv.Component.OnPingDocument().FilePath).resolve().parents[0], "src"))
except:
    # In GH Cluster
    ghFileDir = str(Path.joinpath(Path(ghenv.Component.OnPingDocument().Owner.OnPingDocument().FilePath).resolve().parents[0], "src"))

print(f"{ghFileDir=}")

if ghFileDir not in sys.path:
    print("ghFileDir needed to be included")
    sys.path.append(ghFileDir)

import splintcommon
reload(splintcommon) #FOR DEV

#splintcommon module is now available for use in this GhPython component
splintcommon.log(f'GhPython Node initialized at {time.ctime()}')

import FeatureIdentification
reload(FeatureIdentification) #FOR DEV
from FeatureIdentification import intersect_with_reference

import Rhino.Geometry as rg

result_curves, result_points = intersect_with_reference(
    target_brep = target_brep, 
    slice_surface = slice_surface, 
    view_direction = view_direction, 
    up_vector=up_vector
)
# ---------- end box_center_slice_py_5 ----------
join_curves_2 = JoinCurves(Curves=box_center_slice_py_5.result_curves, Preserve=False)  # -> flatten(Curves); disabled
centroid_2 = Point(volume_2.Centroid)  # disabled
area_2 = Area(Geometry=join_curves_2)  # -> Area, Centroid; disabled
deconstruct_3 = Deconstruct(Point=area_2.Centroid)  # -> XComponent, YComponent, ZComponent; disabled
deconstruct_4 = Deconstruct(Point=centroid_2)  # -> XComponent, YComponent, ZComponent; disabled
panel_20 = Panel("-50, 0, 0")  # disabled
panel_21 = Panel("-100, 0, 0")  # disabled
construct_point_2 = ConstructPoint(XCoordinate=deconstruct_3.XComponent, YCoordinate=deconstruct_4.YComponent, ZCoordinate=deconstruct_4.ZComponent)  # disabled
textgun_py = Python3Script(
    splint_brep=finishedsplintbrep,
    object_id=objectid_w_index_text,
    text_up_vector=transform,
    wall_thickness_mm=wall_thickness_mm,
    text_size=text_size,
    text_projection_vector=rotate_3.Geometry,
    extrusion_depth_factor=panel_17,
    projection_origin=construct_point_2,
    x=boolean_toggle)  # -> out, embossedBrep, originalTextBreps, final_text_plane, projected_letters; inputs splint_brep: Brep, object_id: String, text_up_vector: Vector3d, text_size: Double, text_projection_vector: Vector3d, extrusion_depth_factor: Double, projection_origin: Point3d; disabled
# ---------- textgun_py: Python ----------
# This file represents a stub for a GhPython component in Grasshopper.
# It sets up the environment to import and use the splintcommon or other external modules.

from pathlib import Path
import sys
from importlib import reload #FOR DEV ONLY
import time

# In normal GH doc
ghFileDir = None
try:
    ghFileDir = str(Path.joinpath(Path(ghenv.Component.OnPingDocument().FilePath).resolve().parents[0], "src"))
except:
    # In GH Cluster
    ghFileDir = str(Path.joinpath(Path(ghenv.Component.OnPingDocument().Owner.OnPingDocument().FilePath).resolve().parents[0], "src"))

print(f"{ghFileDir=}")

if ghFileDir not in sys.path:
    print("ghFileDir needed to be included")
    sys.path.append(ghFileDir)

import splintcommon
reload(splintcommon) #FOR DEV

#splintcommon module is now available for use in this GhPython component
splintcommon.log(f'GhPython Node initialized at {time.ctime()}')

import TextGun
reload(TextGun) #FOR DEV
from TextGun import emboss_text

embossedBrep, originalTextBreps, projected_letters, final_text_plane = emboss_text(
    target_brep=splint_brep,
    text_content=object_id,
    wall_thickness_mm=wall_thickness_mm,
    text_size=text_size,
    text_up_vector=text_up_vector,
    text_projection_vector=text_projection_vector,
    extrusion_depth_factor=extrusion_depth_factor,
    projection_origin=projection_origin,
    emboss_inside=True,
    align_to_surface_normal=True
)
# ---------- end textgun_py ----------
plane = Plane(textgun_py.final_text_plane)  # disabled
vizplane_3 = VizPlane(plane=plane)  # -> tip_2, line_2, annotation_dot_2; disabled
tip_2 = Brep(vizplane_3.tip_2)  # disabled
line_11 = Line(vizplane_3.line_2)  # disabled
annotation_dot_2 = AnnotationDot(vizplane_3.annotation_dot_2)  # disabled
panel_22 = Panel(textgun_py.out)  # disabled
plane_2 = Plane(textgun_py.final_text_plane)  # disabled
brep = Brep(textgun_py.originalTextBreps)  # disabled
splint_with_embossed_id = Brep(textgun_py.embossedBrep)  # disabled
brep_2 = Brep(graft(textgun_py.projected_letters))  # disabled
panel_23 = Panel(brep_2)  # disabled
entwine_input = Entwine(
    Branch00=finishedsplintbrep,
    Branch01=rotate_4.Geometry,
    Branch02=area_2.Centroid,
    Branch03=construct_point_2,
    Branch04=textgun_py.projected_letters,
    FlattenInputs=True)  # disabled
entwine_output = Entwine(Branch00=splint_with_embossed_id, Branch01=rotate_4.Geometry, FlattenInputs=True)  # disabled
cluster_5 = Cluster_2(base_move_vector=panel_20, geo_data=entwine_input)  # -> geometry, out; disabled
cluster_6 = Cluster_2(base_move_vector=panel_20, geo_data=brep_2)  # -> geometry, out; disabled
cluster_7 = Cluster_2(base_move_vector=panel_21, geo_data=entwine_output)  # -> geometry, out; disabled
splint_with_embossed_id_2 = Brep(textgun_py.embossedBrep)  # disabled
splint_with_embossed_id_3 = Brep(textgun_py.embossedBrep)  # disabled

# ----
# ID Embossing Gun
wall_thickness_mm_2 = Number(axial_band_thickness_mm_4)
finishedsplintbrep_2 = Brep(splint_brep)
joint_centroid_3 = Point(joint_centroid)
objectid_text_2 = Text(objectid)
mid_r = Number(mid_splint_radius)
unit_x_7 = UnitX(Factor=1)
projection_centroid = Point(joint_centroid_3)
text_size_2 = Slider(2.7, range=2.5..6)
multiplication_4 = Multiplication(A=mid_r, B=Slider(0.3, range=-1..1))
box_center_slice_py_6 = Python3Script(target_brep=finishedsplintbrep_2, view_vector=unit_x_7)  # -> out, slice_surface; inputs target_brep: Brep, view_vector: Vector3d; same code as box_center_slice_py
object_text_py_2 = Python3Script(breps=finishedsplintbrep_2, objectId=objectid_text_2)  # -> out, textOutput; inputs breps: list of Brep, objectId: String; same code as object_text_py
unit_z_10 = UnitZ(Factor=1)
unit_z_11 = UnitZ(Factor=multiplication_4)
move_9 = Move(Geometry=projection_centroid, Motion=unit_z_11)  # -> Geometry, Transform
area_3 = Area(Geometry=box_center_slice_py_6.slice_surface)  # -> Area, Centroid
lip_adjustment_angle = Panel("30")
north_star_nudge = Panel("100")
north_star_nudge_2 = Panel("-100")
objectid_text_3 = Text(reverse(object_text_py_2.textOutput))
text_size_3 = Number(text_size_2)
deconstruct_5 = Deconstruct(Point=area_3.Centroid)  # -> XComponent, YComponent, ZComponent
projection_centroid_2 = Point(projection_centroid)
deconstruct_6 = Deconstruct(Point=projection_centroid_2)  # -> XComponent, YComponent, ZComponent
construct_point_3 = ConstructPoint(XCoordinate=deconstruct_6.XComponent, YCoordinate=deconstruct_5.YComponent, ZCoordinate=deconstruct_5.ZComponent)
construct_point_4 = ConstructPoint(XCoordinate=deconstruct_6.XComponent, YCoordinate=north_star_nudge, ZCoordinate=north_star_nudge_2)
yz_plane_3 = YZPlane(Origin=Point(0, 0, 0))
unit_y_6 = UnitY(Factor=1)

scale = Scale(Geometry=box_center_slice_py_6.slice_surface, Center=area_3.Centroid, Factor="2")  # -> Geometry, Transform
finishedsplintbrep_3 = Brep(graft(finishedsplintbrep_2))

move_to_point_3 = MoveToPoint(Geometry=scale.Geometry, PointA=area_3.Centroid, PointB=construct_point_3)  # -> graft(Moved), Vector, Transform
brep_brep = BrepBrep(BrepA=finishedsplintbrep_3, BrepB=move_to_point_3.Moved)  # -> flatten(Curves), Points
curve_closest_point_2 = CurveClosestPoint(Point=construct_point_4, Curve=brep_brep.Curves)  # -> Point, Parameter, Distance
line_12 = Line(StartPoint=projection_centroid_2, EndPoint=curve_closest_point_2.Point)
angle_2 = Angle(VectorA=unit_y_6, VectorB=line_12)  # -> Angle, Reflex
degrees = Degrees(Radians=angle_2.Angle)
addition_2 = Addition(A=lip_adjustment_angle, B=degrees)
rotate_5 = Rotate(Geometry=unit_y_6, Angle=degrees(addition_2), Plane=yz_plane_3)  # -> Geometry, Transform
transform_text_up = Transform(Geometry=unit_z_10, Transform=rotate_5.Transform)
angle_3 = Angle(VectorA=unit_y_6, VectorB=rotate_5.Geometry)  # -> Angle, Reflex
textgun_py_2 = Python3Script(
    splint_brep=finishedsplintbrep_2,
    object_id=objectid_text_3,
    text_up_vector=transform_text_up,
    wall_thickness_mm=wall_thickness_mm_2,
    text_size=text_size_3,
    text_projection_vector=rotate_5.Geometry,
    extrusion_depth_factor="0.5",
    projection_origin=projection_centroid,
    x=Toggle(False))  # -> out, embossedBrep, originalTextBreps, final_text_plane, projected_letters; inputs splint_brep: Brep, object_id: String, text_up_vector: Vector3d, text_size: Double, text_projection_vector: Vector3d, extrusion_depth_factor: Double, projection_origin: Point3d; same code as textgun_py
degrees_2 = Degrees(Radians=angle_3.Angle)
vizplane_4 = VizPlane(plane=rotate_5.Geometry)  # -> tip_2, line_2, annotation_dot_2
vizvector_4 = VizVector(start=projection_centroid_2, direction=rotate_5.Geometry, arrowlen="5")  # -> cone_2, line, annotation_dot_2
vizvector_5 = VizVector(start=projection_centroid_2, direction=transform_text_up, arrowlen="5")  # -> cone_2, line, annotation_dot_2
negative_4 = Negative(Value=degrees)
splint_with_embossed_id_4 = Brep(textgun_py_2.embossedBrep)
brep_3 = Brep(textgun_py_2.projected_letters)

panel_24 = Panel(brep_brep.Curves)

# ----
# Comfort Top Lip Trimmers
unit_y_7 = UnitY(Factor=1)
chamfer_side_limit_angle = Slider(-74, range=-90..90)
chamfer_edge_parameter = Slider(0.7, range=0..1)
mid_splint_radius_3 = Number(mid_splint_radius)
splint_brep_2 = Brep(splint_with_embossed_id_4)
box_center_slice_py_7 = Python3Script(target_brep=splint_brep_2, view_vector=unit_y_7)  # -> out, slice_surface; inputs target_brep: Brep, view_vector: Vector3d; same code as box_center_slice_py
multiplication_5 = Multiplication(A=mid_splint_radius_3, B=Slider(1.29, range=0.75..2))
area_4 = Area(Geometry=box_center_slice_py_7.slice_surface)  # -> Area, Centroid
xy_plane_2 = XYPlane(Origin=area_4.Centroid)
unit_z_12 = UnitZ(Factor=multiplication_5)
scale_nu = ScaleNU(Geometry=box_center_slice_py_7.slice_surface, Plane=xy_plane_2, ScaleX=Slider(1, range=0.1..1.1), ScaleY=1, ScaleZ=1)  # -> Geometry, Transform
move_10 = Move(Geometry=scale_nu.Geometry, Motion=unit_z_12)  # -> Geometry, Transform
box_center_slice_py_8 = Python3Script(target_brep=splint_brep_2, slice_surface=move_10.Geometry)  # -> out, result_curves, result_points; inputs target_brep: Brep, slice_surface: Surface; same code as box_center_slice_py_3
splint_center_point = Point(area_4.Centroid)
chamfer_side_limit_angle_2 = Number(chamfer_side_limit_angle)
splint_with_embossed_id_5 = Brep(splint_brep_2)
point_3 = Point(box_center_slice_py_8.result_points)
mid_radius = Number(multiplication_5)
curve = Curve(box_center_slice_py_8.result_curves)
yz_plane_4 = YZPlane(Origin=Point(0, 0, 0))
xy_plane_3 = XYPlane(Origin=Point(0, 0, 0))
unit_y_8 = UnitY(Factor=1)
mid_radius_2 = Number(mid_radius)
negative_5 = Negative(Value=chamfer_side_limit_angle_2)
rotate_6 = Rotate(Geometry=unit_y_8, Angle=degrees(negative_5), Plane=yz_plane_4)  # -> Geometry, Transform
transform_4 = Transform(Geometry=xy_plane_3, Transform=rotate_6.Transform)
rotate_7 = Rotate(Geometry=unit_y_8, Angle=degrees(chamfer_side_limit_angle_2), Plane=yz_plane_4)  # -> Geometry, Transform
transform_5 = Transform(Geometry=xy_plane_3, Transform=rotate_7.Transform)
box_center_slice_py_9 = Python3Script(target_brep=splint_with_embossed_id_5, bbox_plane=transform_5, view_vector=rotate_7.Geometry)  # -> out, slice_surface; inputs target_brep: Brep, bbox_plane: Plane, view_vector: Vector3d
# ---------- box_center_slice_py_9: Python ----------
# This file represents a stub for a GhPython component in Grasshopper.
# It sets up the environment to import and use the splintcommon or other external modules.

from pathlib import Path
import sys
from importlib import reload #FOR DEV
import time

# In normal GH doc
ghFileDir = None
try:
    ghFileDir = str(Path.joinpath(Path(ghenv.Component.OnPingDocument().FilePath).resolve().parents[0], "src"))
except:
    # In GH Cluster
    ghFileDir = str(Path.joinpath(Path(ghenv.Component.OnPingDocument().Owner.OnPingDocument().FilePath).resolve().parents[0], "src"))

print(f"{ghFileDir=}")

if ghFileDir not in sys.path:
    print("ghFileDir needed to be included")
    sys.path.append(ghFileDir)

import splintcommon
reload(splintcommon) #FOR DEV

#splintcommon module is now available for use in this GhPython component
splintcommon.log(f'GhPython Node initialized at {time.ctime()}')

import FeatureIdentification
reload(FeatureIdentification) #FOR DEV
from FeatureIdentification import box_center_slice

import Rhino.Geometry as rg

# Get a slice plane at the center, facing +Y direction
slice_surface = box_center_slice(
    target_brep=target_brep,
    bbox_plane=bbox_plane,
    choose_side_vector=view_vector
)
# ---------- end box_center_slice_py_9 ----------
deconstruct_plane = DeconstructPlane(Plane=transform_4)  # -> Origin, XAxis, YAxis, ZAxis
box_center_slice_py_10 = Python3Script(target_brep=splint_with_embossed_id_5, bbox_plane=transform_4, view_vector=rotate_6.Geometry)  # -> out, slice_surface; inputs target_brep: Brep, bbox_plane: Plane, view_vector: Vector3d; same code as box_center_slice_py_9
deconstruct_plane_2 = DeconstructPlane(Plane=transform_5)  # -> Origin, XAxis, YAxis, ZAxis
tl_point = ListItem(List=point_3, Index="0", Wrap=True)
bl_point = ListItem(List=point_3, Index="3", Wrap=True)
tr_point = ListItem(List=point_3, Index="1", Wrap=True)
br_point = ListItem(List=point_3, Index="2", Wrap=True)
multiplication_6 = Multiplication(A=deconstruct_plane.ZAxis, B=mid_radius_2)
line_13 = Line(StartPoint=tl_point, EndPoint=bl_point)
chamfer_edge_parameter_2 = Number(chamfer_edge_parameter)
line_14 = Line(StartPoint=tr_point, EndPoint=br_point)
multiplication_7 = Multiplication(A=deconstruct_plane_2.ZAxis, B=mid_radius)
move_11 = Move(Geometry=box_center_slice_py_10.slice_surface, Motion=multiplication_6)  # -> Geometry, Transform
move_12 = Move(Geometry=box_center_slice_py_9.slice_surface, Motion=multiplication_7)  # -> Geometry, Transform
splint_center_point_2 = Point(splint_center_point)
reparameterize_curve = ReparameterizeCurve(Curve=line_14)  # -> Reparameterized, Original
reparameterize_curve_2 = ReparameterizeCurve(Curve=line_13)  # -> Reparameterized, Original
box_center_slice_py_11 = Python3Script(target_brep=splint_with_embossed_id_5, slice_surface=move_11.Geometry)  # -> out, result_curves, result_points; inputs target_brep: Brep, slice_surface: Surface; same code as box_center_slice_py_3
box_center_slice_py_12 = Python3Script(target_brep=splint_with_embossed_id_5, slice_surface=move_12.Geometry)  # -> out, result_curves, result_points; inputs target_brep: Brep, slice_surface: Surface; same code as box_center_slice_py_3
evaluate_curve = EvaluateCurve(Curve=reparameterize_curve.Reparameterized, Parameter=chamfer_edge_parameter_2)  # -> Point, Tangent, Angle
evaluate_curve_2 = EvaluateCurve(Curve=reparameterize_curve_2.Reparameterized, Parameter=chamfer_edge_parameter_2)  # -> Point, Tangent, Angle
curve_2 = Curve(box_center_slice_py_12.result_curves)
righ_top_mid_lip = Point(evaluate_curve.Point)
left_top_mid_lip = Point(evaluate_curve_2.Point)
point_4 = Point(box_center_slice_py_12.result_points)
curve_3 = Curve(box_center_slice_py_11.result_curves)
point_5 = Point(box_center_slice_py_11.result_points)
splint_with_embossed_id_6 = Brep(graft(splint_brep_2))
tl_point_2 = ListItem(List=point_4, Index="3", Wrap=True)
left_bottom_mid_lip = Point(left_top_mid_lip)
righ_bottom_mid_lip = Point(righ_top_mid_lip)
tl_point_3 = ListItem(List=point_5, Index="3", Wrap=True)
tr_point_2 = ListItem(List=point_5, Index="2", Wrap=True)
tr_point_3 = ListItem(List=point_4, Index="2", Wrap=True)
conecreator = ConeCreator(list=splint_center_point_2, point_a=tr_point_3, point_b=righ_bottom_mid_lip, point_c=tr_point_2)
conecreator_2 = ConeCreator(list=splint_center_point_2, point_a=tl_point_3, point_b=left_bottom_mid_lip, point_c=tl_point_2)
panel_25 = Panel("-50, 0, 0")  # disabled
solid_difference = SolidDifference(BrepsA=splint_with_embossed_id_6, BrepsB=conecreator)  # -> simplify(Result)
solid_difference_2 = SolidDifference(BrepsA=solid_difference, BrepsB=conecreator_2)
entwine_6 = Entwine(Branch00=solid_difference_2, FlattenInputs=True)  # disabled
cluster_8 = Cluster_2(base_move_vector=panel_25, geo_data=entwine_6)  # -> geometry, out; disabled
comfort_trimmed_splint_brep = Brep(solid_difference_2)

# ----
# Comfort Bottom Lip Trimmers
mid_splint_radius_4 = Number(mid_splint_radius)
unit_y_9 = UnitY(Factor=1)
chamfer_side_limit_angle_3 = Slider(-74, range=-90..90)
chamfer_edge_parameter_3 = Slider(0.7, range=0..1)
splint_brep_3 = Brep(comfort_trimmed_splint_brep)
negative_6 = Negative(Value=mid_splint_radius_4)
box_center_slice_py_13 = Python3Script(target_brep=splint_brep_3, view_vector=unit_y_9)  # -> out, slice_surface; inputs target_brep: Brep, view_vector: Vector3d; same code as box_center_slice_py
multiplication_8 = Multiplication(A=negative_6, B=Slider(1.29, range=0.75..2))
area_5 = Area(Geometry=box_center_slice_py_13.slice_surface)  # -> Area, Centroid
xy_plane_4 = XYPlane(Origin=area_5.Centroid)
unit_z_13 = UnitZ(Factor=multiplication_8)
scale_nu_2 = ScaleNU(Geometry=box_center_slice_py_13.slice_surface, Plane=xy_plane_4, ScaleX=Slider(1, range=0.1..1.1), ScaleY=1, ScaleZ=1)  # -> Geometry, Transform
move_13 = Move(Geometry=scale_nu_2.Geometry, Motion=unit_z_13)  # -> Geometry, Transform
box_center_slice_py_14 = Python3Script(target_brep=splint_brep_3, slice_surface=move_13.Geometry)  # -> out, result_curves, result_points; inputs target_brep: Brep, slice_surface: Surface; same code as box_center_slice_py_3
splint_center_point_3 = Point(area_5.Centroid)
mid_radius_3 = Number(multiplication_8)
chamfer_side_limit_angle_4 = Number(chamfer_side_limit_angle_3)
splint_with_embossed_id_7 = Brep(splint_brep_3)
point_6 = Point(box_center_slice_py_14.result_points)
curve_4 = Curve(box_center_slice_py_14.result_curves)
yz_plane_5 = YZPlane(Origin=Point(0, 0, 0))
xy_plane_5 = XYPlane(Origin=Point(0, 0, 0))
unit_y_10 = UnitY(Factor=1)
mid_radius_4 = Number(mid_radius_3)
negative_7 = Negative(Value=chamfer_side_limit_angle_4)
rotate_8 = Rotate(Geometry=unit_y_10, Angle=degrees(negative_7), Plane=yz_plane_5)  # -> Geometry, Transform
transform_6 = Transform(Geometry=xy_plane_5, Transform=rotate_8.Transform)
rotate_9 = Rotate(Geometry=unit_y_10, Angle=degrees(chamfer_side_limit_angle_4), Plane=yz_plane_5)  # -> Geometry, Transform
transform_7 = Transform(Geometry=xy_plane_5, Transform=rotate_9.Transform)
box_center_slice_py_15 = Python3Script(target_brep=splint_with_embossed_id_7, bbox_plane=transform_7, view_vector=rotate_9.Geometry)  # -> out, slice_surface; inputs target_brep: Brep, bbox_plane: Plane, view_vector: Vector3d; same code as box_center_slice_py_9
deconstruct_plane_3 = DeconstructPlane(Plane=transform_6)  # -> Origin, XAxis, YAxis, ZAxis
box_center_slice_py_16 = Python3Script(target_brep=splint_with_embossed_id_7, bbox_plane=transform_6, view_vector=rotate_8.Geometry)  # -> out, slice_surface; inputs target_brep: Brep, bbox_plane: Plane, view_vector: Vector3d; same code as box_center_slice_py_9
deconstruct_plane_4 = DeconstructPlane(Plane=transform_7)  # -> Origin, XAxis, YAxis, ZAxis
tl_point_4 = ListItem(List=point_6, Index="0", Wrap=True)
bl_point_2 = ListItem(List=point_6, Index="3", Wrap=True)
tr_point_4 = ListItem(List=point_6, Index="1", Wrap=True)
br_point_2 = ListItem(List=point_6, Index="2", Wrap=True)
line_15 = Line(StartPoint=tl_point_4, EndPoint=bl_point_2)  # -> simplify(Line)
multiplication_9 = Multiplication(A=deconstruct_plane_3.ZAxis, B=mid_radius_4)
line_16 = Line(StartPoint=tr_point_4, EndPoint=br_point_2)  # -> simplify(Line)
chamfer_edge_parameter_4 = Number(chamfer_edge_parameter_3)
multiplication_10 = Multiplication(A=deconstruct_plane_4.ZAxis, B=mid_radius_3)
number_slider_3 = Slider(0, range=0..5)  # disabled
move_14 = Move(Geometry=box_center_slice_py_16.slice_surface, Motion=multiplication_9)  # -> Geometry, Transform
move_15 = Move(Geometry=box_center_slice_py_15.slice_surface, Motion=multiplication_10)  # -> Geometry, Transform
reparameterize_curve_3 = ReparameterizeCurve(Curve=line_16)  # -> Reparameterized, Original
reparameterize_curve_4 = ReparameterizeCurve(Curve=line_15)  # -> Reparameterized, Original
panel_26 = Panel("2")  # disabled
panel_27 = Panel("2")  # disabled
box_center_slice_py_17 = Python3Script(target_brep=splint_with_embossed_id_7, slice_surface=move_14.Geometry)  # -> out, result_curves, result_points; inputs target_brep: Brep, slice_surface: Surface; same code as box_center_slice_py_3
box_center_slice_py_18 = Python3Script(target_brep=splint_with_embossed_id_7, slice_surface=move_15.Geometry)  # -> out, result_curves, result_points; inputs target_brep: Brep, slice_surface: Surface; same code as box_center_slice_py_3
evaluate_curve_3 = EvaluateCurve(Curve=reparameterize_curve_3.Reparameterized, Parameter=chamfer_edge_parameter_4)  # -> Point, Tangent, Angle
evaluate_curve_4 = EvaluateCurve(Curve=reparameterize_curve_4.Reparameterized, Parameter=chamfer_edge_parameter_4)  # -> Point, Tangent, Angle
panel_28 = Panel("{0}")  # disabled
construct_path = ConstructPath(Indices=number_slider_3)  # disabled
trim_rectangles = Rectangle([move_15.Geometry, move_14.Geometry])
righ_top_mid_lip_2 = Point(flatten(evaluate_curve_3.Point))
righ_bottom_mid_lip_2 = Point(simplify(graft(righ_top_mid_lip_2)))  # disabled
point_7 = Point(simplify(box_center_slice_py_18.result_points))
tr_point_5 = ListItem(List=point_7, Index=panel_26, Wrap=True)  # disabled
left_top_mid_lip_2 = Point(flatten(evaluate_curve_4.Point))
point_8 = Point(simplify(box_center_slice_py_17.result_points))
tr_point_6 = ListItem(List=point_8, Index=panel_27, Wrap=True)  # disabled
curve_5 = Curve(box_center_slice_py_18.result_curves)
curve_6 = Curve(box_center_slice_py_17.result_curves)
tree_branch = TreeBranch(Tree=trim_rectangles, Path=construct_path, MaintainPaths=True)  # disabled
tree_branch_2 = TreeBranch(Tree=tr_point_5, Path=construct_path, MaintainPaths=True)  # disabled
tree_branch_3 = TreeBranch(Tree=righ_bottom_mid_lip_2, Path=construct_path, MaintainPaths=True)  # disabled
tree_branch_4 = TreeBranch(Tree=tr_point_6, Path=construct_path, MaintainPaths=True)  # disabled
left_bottom_mid_lip_2 = Point(simplify(graft(left_top_mid_lip_2)))
righ_bottom_mid_lip_3 = Point(simplify(graft(righ_top_mid_lip_2)))
panel_29 = Panel(tr_point_6)  # disabled
outerbarreltrimmer_cl = OuterBarrelTrimmer_CL(trim_rectangles=tree_branch, point_a=tree_branch_2, point_b=tree_branch_3, point_c=tree_branch_4)  # -> graft(trimmer_brep_2), graft(trim_surface_2); disabled
tr_point_7 = ListItem(List=point_7, Index="2", Wrap=True)  # -> simplify(graft(Item))
tr_point_8 = ListItem(List=point_8, Index="2", Wrap=True)  # -> simplify(graft(Item))
tl_point_5 = ListItem(List=point_8, Index="3", Wrap=True)  # -> simplify(graft(Item))
tl_point_6 = ListItem(List=point_7, Index="3", Wrap=True)  # -> simplify(graft(Item))
splint_brep_4 = Brep(splint_brep_3)
splint_brep_5 = Brep(splint_brep_4)  # disabled
tree_branch_5 = TreeBranch(Tree=splint_brep_5, Path=construct_path, MaintainPaths=True)  # -> graft(Branch); disabled
outerbarreltrimmer_cl_2 = OuterBarrelTrimmer_CL(trim_rectangles=trim_rectangles, point_a=tr_point_7, point_b=righ_bottom_mid_lip_3, point_c=tr_point_8)  # -> simplify(graft(trimmer_brep_2)), trim_surface_2
outerbarreltrimmer_cl_3 = OuterBarrelTrimmer_CL(trim_rectangles=trim_rectangles, point_a=tl_point_5, point_b=left_bottom_mid_lip_2, point_c=tl_point_6)  # -> simplify(graft(trimmer_brep_2)), trim_surface_2
entwine_7 = Entwine(Branch00=tree_branch_5, FlattenInputs=True)  # disabled
panel_30 = Panel("-50, 0, 0")  # disabled
cluster_9 = Cluster_2(base_move_vector=panel_30, geo_data=entwine_7)  # -> geometry, out; disabled
solid_difference_3 = SolidDifference(BrepsA=splint_brep_4, BrepsB=outerbarreltrimmer_cl_2.trimmer_brep_2)
entwine_8 = Entwine(Branch00=solid_difference_3, Branch01=outerbarreltrimmer_cl_3.trimmer_brep_2, FlattenInputs=True)  # disabled
solid_difference_4 = SolidDifference(BrepsA=solid_difference_3, BrepsB=outerbarreltrimmer_cl_3.trimmer_brep_2)
panel_31 = Panel(solid_difference_4)
cluster_10 = Cluster_2(base_move_vector="-50, 0, 0", geo_data=entwine_8)  # -> geometry, out; disabled
comfort_trimmed_splint_brep_2 = Brep(flatten(solid_difference_4))
panel_32 = Panel(comfort_trimmed_splint_brep_2)

entwine_input_2 = Entwine(Branch00=vizvector_4.cone_2, Branch01=vizvector_4.line, Branch02=vizvector_4.annotation_dot_2, FlattenInputs=True)
entwine_output_2 = Entwine(Branch00=splint_with_embossed_id_4, FlattenInputs=True)
cluster_11 = Cluster_2(base_move_vector="-50, 0, 0", geo_data=entwine_input_2)  # -> geometry, out
cluster_12 = Cluster_2(base_move_vector="-100, 0, 0", geo_data=entwine_output_2)  # -> geometry, out

# ----
# Direction Indicator
splint_body = Brep(comfort_trimmed_splint_brep_2)
wall_thickness = Number(axial_band_thickness_mm_4)
mid_splint_radius_5 = Number(mid_splint_radius)
unit_y_11 = UnitY(Factor=1)
box_center_slice_py_19 = Python3Script(target_brep=splint_body, view_vector=unit_y_11)  # -> out, slice_surface; inputs target_brep: Brep, view_vector: Vector3d; same code as box_center_slice_py
ball_r_to_wall_ratio = Slider(0.68, range=0.6..1)
box_center_slice_py_20 = Python3Script(target_brep=splint_body, slice_surface=box_center_slice_py_19.slice_surface)  # -> out, result_curves, result_points; inputs target_brep: Brep, slice_surface: Surface; same code as box_center_slice_py_3
multiplication_11 = Multiplication(A=wall_thickness, B=ball_r_to_wall_ratio)
list_item_8 = ListItem(List=box_center_slice_py_20.result_points, Index="2", Wrap=False)  # -> flatten(Item)
xy_plane_6 = XYPlane(Origin=list_item_8)
scale_nu_3 = ScaleNU(Geometry=box_center_slice_py_19.slice_surface, Plane=xy_plane_6, ScaleX="0.75", ScaleY=1, ScaleZ="0.75")  # -> Geometry, Transform
nub_radius = Panel(multiplication_11)
xy_plane_7 = XYPlane(Origin=Point(0, 0, 0))
ball_r_to_wall_ratio_2 = Slider(0.67, range=0.6..1)
sphere = Sphere(Base=xy_plane_7, Radius=nub_radius)
multiplication_12 = Multiplication(A=wall_thickness, B=ball_r_to_wall_ratio_2, C="-1")
unit_z_14 = UnitZ(Factor=multiplication_12)
panel_33 = Panel("-50, 0, 0")  # disabled

panel_34 = Panel(box_center_slice_py_20.result_points)
panel_35 = Panel(list_item_8)
multiplication_13 = Multiplication(A=mid_splint_radius_5, B="0.55")
negative_8 = Negative(Value=multiplication_13)
vector_xyz = VectorXYZ(XComponent=multiplication_13, YComponent=0, ZComponent=negative_8)  # -> Vector, Length

panel_36 = Panel(vector_xyz.Vector)
move_16 = Move(Geometry=scale_nu_3.Geometry, Motion=panel_36)  # -> Geometry, Transform
box_center_slice_py_21 = Python3Script(target_brep=splint_body, slice_surface=move_16.Geometry)  # -> out, result_curves, result_points; inputs target_brep: Brep, slice_surface: Surface; same code as box_center_slice_py_3

join_curves_3 = JoinCurves(Curves=box_center_slice_py_21.result_curves, Preserve=False)  # -> flatten(Curves)

area_6 = Area(Geometry=join_curves_3)  # -> Area, Centroid
move_17 = Move(Geometry=area_6.Centroid, Motion=unit_z_14)  # -> Geometry, Transform
move_to_point_4 = MoveToPoint(Geometry=sphere, PointA=xy_plane_7, PointB=move_17.Geometry)  # -> Moved, Vector, Transform
solid_difference_5 = SolidDifference(BrepsA=splint_body, BrepsB=move_to_point_4.Moved)
entwine_9 = Entwine(Branch00=solid_difference_5, FlattenInputs=True)  # disabled
cluster_13 = Cluster_2(base_move_vector=panel_33, geo_data=entwine_9)  # -> geometry, out; disabled
splints_w_direction_indicator = Brep(solid_difference_5)

panel_37 = Panel(join_curves_3)

# ----
# Wall Probe Data
splints_w_direction_indicator_2 = Brep(solid_difference_5)
py_finger_model_2 = Data(flatten(py_finger_model))
inner_shell_brep_5 = Brep(inner_shell_brep_3)
wall_probe_data = Python3Script(py_finger_models=py_finger_model_2, splints=splints_w_direction_indicator_2)  # -> out, preview_geo, py_wall_probe_data; inputs py_finger_models: list, splints: list
# ---------- wall_probe_data: Python ----------
# This file represents a stub for a GhPython component in Grasshopper.
# It sets up the environment to import and use the splintcommon or other external modules.

from pathlib import Path
import sys
from importlib import reload #FOR DEV
import time

# Walk up through nested clusters to find the root GH document (necessary for use in nested clusters)
doc = ghenv.Component.OnPingDocument()
while not doc.FilePath and doc.Owner:
    doc = doc.Owner.OnPingDocument()
ghFileDir = str(Path(doc.FilePath).resolve().parent / "src")

print(f"{ghFileDir=}")

if ghFileDir not in sys.path:
    print("ghFileDir needed to be included")
    sys.path.append(ghFileDir)

import splintcommon
reload(splintcommon) #FOR DEV
from splintcommon import mark_generation_start
mark_generation_start()

#splintcommon module is now available for use in this GhPython component
splintcommon.log(f'GhPython Node initialized at {time.ctime()}')

#Component code here

import splintmeasurement
reload(splintmeasurement)
from splintmeasurement import measure_thickness_probes_batch #measure_thickness_probes
import math

# Define probes relevant to this splint type
#  the probe direction is in the perp frame's local coordinates, not world coordinates. 
#The perp frame is constructed at each joint/phalanx location with:
# XAxis = lateral (perpendicular to finger, sideways)
# YAxis = dorsal (perpendicular to finger, toward back of hand)
# ZAxis = finger centerline direction
# So (0, 1, 0) means "along the perp frame's YAxis" which is dorsal -- but that's dorsal 
# relative to the finger segment at that location. When the finger is flexed, the perp frame 
# rotates with it, so dorsal at PIP points in a different world direction than dorsal at MCP.
# If your finger is posed flat on a table along +X with palm down (-Z), then at the MCP: 
# XAxis ~ +Y (lateral), YAxis ~ +Z (dorsal/up), ZAxis ~ +X (finger direction). 
# That matches world XY expectations. But if MCP is flexed, the downstream frames rotate accordingly.

PROBES = [
    # Straight up at MCP
    ("pip_dorsal", "pip", 0.0, (0, 1, 0)),
    # 30 deg from dorsal toward medial (right) at MCP
    ("pip_dorsal_medial_30", "pip", 0.0, (-math.sin(math.radians(30)), math.cos(math.radians(30)), 0)),
    # which is: (-0.5, 0.866, 0.0)
]

# finger_result is your FingerModelResult from create_finger_model_result()
# splint_mesh is the meshed shell after boolean difference (outer - inner)
probe_thicknesses, preview_geo = measure_thickness_probes_batch(py_finger_models, splints, PROBES)

print(f"{probe_thicknesses=}")
print(f"{preview_geo=}")

py_wall_probe_data = [probe_thicknesses] #necessary for passing py data
# ---------- end wall_probe_data ----------
geometry_2 = Geometry(wall_probe_data.preview_geo)
panel_38 = Panel(wall_probe_data.py_wall_probe_data)
panel_39 = Panel(wall_probe_data.out)
py_wall_probe_data = Data(wall_probe_data.py_wall_probe_data)
list_item_9 = ListItem(List=geometry_2, Index=Slider(0, range=0..4), Wrap=False)

# ----
# Orienting To Build Plate
# Tip Slant Line, describes the angle necessary to bring the front cut line of the splint down to the build platform.
tip_slant_line_3 = Line(tip_slant_line_2)
finishedsplint = Brep(splints_w_direction_indicator)
unit_x_8 = UnitX(Factor=1)
xz_plane_4 = XZPlane(Origin=Point(0, 0, 0))
end_points_6 = EndPoints(Curve=tip_slant_line_3)  # -> Start, End
angle_4 = Angle(VectorA=tip_slant_line_3, VectorB=unit_x_8, Plane=xz_plane_4)  # -> Angle, Reflex
point_9 = Point(end_points_6.End)
point_10 = Point(end_points_6.Start)
negative_9 = Negative(Value=angle_4.Angle)
plane_origin_3 = PlaneOrigin(Base=xz_plane_4, Origin=point_9)
rotate_10 = Rotate(Geometry=finishedsplint, Angle=angle_4.Angle, Plane=plane_origin_3)  # -> Geometry, Transform
entwine_10 = Entwine(Branch00=rotate_10.Geometry, FlattenInputs=True)  # disabled
transform_8 = Transform(Geometry=tip_slant_line_3, Transform=rotate_10.Transform)
panel_40 = Panel("-50, 0, 0")  # disabled
cluster_14 = Cluster_2(base_move_vector=panel_40, geo_data=entwine_10)  # -> geometry, out; disabled
curve_middle_2 = CurveMiddle(Curve=transform_8)
deconstruct_7 = Deconstruct(Point=curve_middle_2)  # -> XComponent, YComponent, ZComponent
negative_10 = Negative(Value=deconstruct_7.ZComponent)
unit_z_15 = UnitZ(Factor=negative_10)
move_18 = Move(Geometry=rotate_10.Geometry, Motion=unit_z_15)  # -> Geometry, Transform
move_19 = Move(Geometry=curve_middle_2, Motion=move_18.Transform)  # -> Geometry, Transform
# Radial Arrangement
oriented_flat_splint = Brep(move_18.Geometry)
floor_centroid = Point(move_19.Geometry)
list_length = ListLength(List=oriented_flat_splint)
xy_plane_8 = XYPlane(Origin=Point(0, 0, 0))
multiplication_14 = Multiplication(A=list_length, B="12")
circle = Circle(Plane=xy_plane_8, Radius=multiplication_14)
divide_curve = DivideCurve(Curve=circle, Count=list_length, Kinks=False)  # -> Points, Tangents, Parameters
move_to_point_5 = MoveToPoint(Geometry=oriented_flat_splint, PointA=floor_centroid, PointB=divide_curve.Points)  # -> Moved, Vector, Transform
radial_orientation_splint = Brep(move_to_point_5.Moved)
flatorientedsplint = Brep(oriented_flat_splint)

panel_41 = Panel(py_finger_model_2)
radial_floor_centroid = Point(divide_curve.Points)

# ----
# Final Meshing
# And Smoothing
# Bake Me
number_slider_4 = Slider(0.12, range=0.05..0.2)
orientedsplint = Brep(radial_orientation_splint)
shrinkwrap = ShrinkWrap(
    Geometry=orientedsplint,
    EdgeLength=number_slider_4,
    Offset=0,
    Smoothing=Slider(8, range=0..10),
    Optimization=10,
    FillHoles=True)
splint_smooth_mesh = Mesh(shrinkwrap)

# ----
# Preview Steps
inner_finger_form = Brep(inner_shell_brep_3)
preform_barrel = Brep(finger_model_rotate.Geometry)
side_cutter_surface_2 = Surface(side_cutter_surface)
side_cutter_volume_3 = Brep(side_cutter_volume_2)
comfort_trimmed_splint_brep_3 = Brep(comfort_trimmed_splint_brep_2)
splint_w_direction = Brep(splints_w_direction_indicator)
splint_body_oriented = Mesh(flatorientedsplint)
splint_body_smooth = Mesh(splint_smooth_mesh)
entwine_11 = Entwine(Branch00=preform_barrel, Branch01=side_cutter_surface_2, FlattenInputs=True)
entwine_12 = Entwine(Branch00=preform_barrel, Branch01=side_cutter_volume_3, FlattenInputs=True)
movecomplex_cl = MoveComplexCL(base_move_vector="60, 0, 0", geo_data=inner_finger_form)
movecomplex_cl_2 = MoveComplexCL(base_move_vector="180, 0, 0", geo_data=entwine_12)
movecomplex_cl_3 = MoveComplexCL(base_move_vector="240, 0, 0", geo_data=comfort_trimmed_splint_brep_3)
movecomplex_cl_4 = MoveComplexCL(base_move_vector="300, 0, 0", geo_data=splint_w_direction)
movecomplex_cl_5 = MoveComplexCL(base_move_vector="120, 0, 0", geo_data=entwine_11)
movecomplex_cl_6 = MoveComplexCL(base_move_vector="360, 0, 0", geo_data=splint_body_oriented)
movecomplex_cl_7 = MoveComplexCL(base_move_vector="500, 0, 0", geo_data=splint_body_smooth)
merge_2 = Merge(
    Data1=movecomplex_cl,
    Data2=movecomplex_cl_5,
    Data3=movecomplex_cl_2,
    Data4=movecomplex_cl_3,
    Data5=movecomplex_cl_4,
    Data6=movecomplex_cl_6,
    Data7=movecomplex_cl_7)  # -> flatten(Result)
random_color = RandomColor(Data=merge_2, Seed=random, FastMode=False)
custom_preview = CustomPreview(Geometry=merge_2, Material=random_color)

# ----
# Report Results
dev_activate_toggle = BooleanToggle(False)
axial_band_thickness_mm_5 = Number(axial_band_thickness_mm_4)
py_wall_probe_data_2 = Data(py_wall_probe_data)
root_filename_out = Text(factoryautomatorpy.root_filename)
output_dir_out = Text(factoryautomatorpy.output_dir)
splint_mesh = Mesh(splint_smooth_mesh)
savemeshpy = Python3Script(
    final_splint_mesh=splint_mesh,
    output_dir=output_dir_out,
    root_filename=root_filename_out,
    bool_activate=dev_activate_toggle,
    axial_band_thickness_mm=axial_band_thickness_mm_5,
    py_wall_probe_data=py_wall_probe_data_2)  # -> out; inputs final_splint_mesh: Mesh, axial_band_thickness_mm: Double
# ---------- savemeshpy: Python ----------
# This file represents a stub for a GhPython component in Grasshopper.
# It sets up the environment to import and use the splintcommon or other external modules.

from pathlib import Path
import sys
from importlib import reload #FOR DEV
import time

# Walk up through nested clusters to find the root GH document (necessary for use in nested clusters)
doc = ghenv.Component.OnPingDocument()
while not doc.FilePath and doc.Owner:
    doc = doc.Owner.OnPingDocument()
ghFileDir = str(Path(doc.FilePath).resolve().parent / "src")

print(f"{ghFileDir=}")

if ghFileDir not in sys.path:
    print("ghFileDir needed to be included")
    sys.path.append(ghFileDir)

import splintcommon
reload(splintcommon) #FOR DEV
from splintcommon import log, gh_decode

#splintcommon module is now available for use in this GhPython component
splintcommon.log(f'GhPython Node initialized at {time.ctime()}')

#Component code here

import splintmeshes
reload(splintmeshes)
from splintmeshes import save_job_output

wall_probe_data = gh_decode(py_wall_probe_data)

# With error handling
try:
    log(f"Logging to {output_dir=} {root_filename=}")
    #splintmeshes.save_mesh(final_splint_mesh, output_dir, root_filename, format_type="stl")

    save_job_output(final_splint_mesh, output_dir, root_filename, "3mf", custom_metadata={
        "wall_probe_data": wall_probe_data,
        "axial_band_thickness_mm": axial_band_thickness_mm,
    })
    log(f"Export succeeded: {output_dir=} {root_filename=}")
except splintmeshes.MeshExportError as e:
    log("Export failed: {}".format(e))
except ValueError as e:
    log("Bad input: {}".format(e))
# ---------- end savemeshpy ----------
panel_42 = Panel(savemeshpy)

list_item_10 = ListItem(List=preform_barrel, Index=number_slider, Wrap=False)
list_item_11 = ListItem(List=side_cutter_surface_2, Index=number_slider, Wrap=False)
panel_43 = Panel(py_wall_probe_data_2)
merge_3 = Merge(Data1=movecomplex_cl_7)  # -> flatten(Result)
custom_preview_2 = CustomPreview(Geometry=merge_3, Material=ColourSwatch(SwatchColor=RGB(253, 133, 35)))

# ==== cluster ExtLnPts
extensiondist = ClusterInput()
midpoint = ClusterInput()
startpoint = ClusterInput()
midpoint_2 = Point(midpoint)
startpoint_2 = Point(startpoint)
extensiondist_2 = Number(extensiondist)
line = Line(StartPoint=startpoint_2, EndPoint=midpoint_2)
extend_curve = ExtendCurve(Curve=line, Type=0, Start="0", End=extensiondist_2)
end_points = EndPoints(Curve=extend_curve)  # -> Start, End
endpoint = Point(end_points.End)
endpoint_2 = ClusterOutput(endpoint)

# ==== cluster VizVector
arrowlen = ClusterInput()
text = ClusterInput()
arrowlen_2 = Number(arrowlen)
text_2 = Text(text)
start = ClusterInput()
direction = ClusterInput()
division = Division(A=arrowlen_2, B="4")
line_sdl = LineSDL(Start=start, Direction=direction, Length=arrowlen_2)
end_points = EndPoints(Curve=line_sdl)  # -> Start, End
line = ClusterOutput(line_sdl)
plane_normal = PlaneNormal(Origin=end_points.End, ZAxis=line_sdl)
annotation_dot = AnnotationDot(Location=end_points.End, PrimaryText=text_2)  # -> AnnotationDot, Location, PrimaryText, TextHeight
cone = Cone(Base=plane_normal, Radius=division, Length=division)  # -> Cone, Tip
cone_2 = ClusterOutput(cone.Cone)
annotation_dot_2 = ClusterOutput(annotation_dot.AnnotationDot)

# ==== cluster VizPlane
plane = ClusterInput()
deconstruct_plane = DeconstructPlane(Plane=plane)  # -> Origin, XAxis, YAxis, ZAxis
arrow = VizVector(start=deconstruct_plane.Origin, direction=deconstruct_plane.XAxis, arrowlen="3", text="X")  # -> cone_2, line, annotation_dot_2
arrow_2 = VizVector(start=deconstruct_plane.Origin, direction=deconstruct_plane.YAxis, arrowlen="3", text="Y")  # -> cone_2, line, annotation_dot_2
arrow_3 = VizVector(start=deconstruct_plane.Origin, direction=deconstruct_plane.ZAxis, arrowlen="3", text="Z")  # -> cone_2, line, annotation_dot_2
tip = Brep([arrow.cone_2, arrow_2.cone_2, arrow_3.cone_2])
line = Line([arrow.line, arrow_2.line, arrow_3.line])
annotation_dot = AnnotationDot([arrow.annotation_dot_2, arrow_2.annotation_dot_2, arrow_3.annotation_dot_2])
tip_2 = ClusterOutput(tip)
line_2 = ClusterOutput(line)
annotation_dot_2 = ClusterOutput(annotation_dot)

# ==== cluster OuterBarrelTrimmer_CL
trim_rectangles = ClusterInput()
point_b = ClusterInput()
point_a = ClusterInput()
point_c = ClusterInput()
point_a_2 = Point(flatten(point_a))
point_b_2 = Point(flatten(point_b))
point_c_2 = Point(flatten(point_c))
trim_rectangles_2 = Rectangle(trim_rectangles)
circle_3pt = Circle3Pt(PointA=point_a_2, PointB=point_b_2, PointC=point_c_2)  # -> Circle, Plane, Radius
offset_curve = OffsetCurve(Curve=circle_3pt.Circle, Distance="10", Corners=1)  # -> flatten(Curve)
entwine = Entwine(Branch00=offset_curve, Branch01=circle_3pt.Circle, FlattenInputs=True)
transpose_py = Python3Script(data=entwine)  # -> out, result; inputs data: tree of GeometryBase; same code as transpose_py
boundary_surfaces = BoundarySurfaces(Edges=transpose_py.result)  # -> flatten(Surfaces)
area = Area(Geometry=trim_rectangles_2)  # -> Area, Centroid
input_surface_brep = Brep(graft(boundary_surfaces))
trim_face_plane = Plane(circle_3pt.Plane)
scale = Scale(Geometry=trim_rectangles_2, Center=area.Centroid, Factor="5")  # -> simplify(Geometry), Transform
list_length = ListLength(List=input_surface_brep)
input_surface_brep_2 = Brep(input_surface_brep)  # disabled
unit_z = UnitZ(Factor="-1")
deconstruct_plane = DeconstructPlane(Plane=trim_face_plane)  # -> Origin, XAxis, YAxis, ZAxis
repeat_data = RepeatData(Data=unit_z, Length=list_length)  # -> graft(Data)
entwine_2 = Entwine(Branch00=input_surface_brep_2, FlattenInputs=True)  # disabled
negative = Negative(Value=deconstruct_plane.ZAxis)
trim_surface = Python3Script(input_surface=input_surface_brep, trim_rectangles=scale.Geometry, keep_direction=repeat_data, x=Toggle(False))  # -> out, flatten(trim_surface); inputs input_surface: Brep, trim_rectangles: list of Brep, keep_direction: Vector3d
# ---------- trim_surface: Python ----------
# This file represents a stub for a GhPython component in Grasshopper.
# It sets up the environment to import and use the splintcommon or other external modules.

from pathlib import Path
import sys
from importlib import reload #FOR DEV
import time

# Walk up through nested clusters to find the root GH document (necessary for use in nested clusters)
doc = ghenv.Component.OnPingDocument()
while not doc.FilePath and doc.Owner:
    doc = doc.Owner.OnPingDocument()
ghFileDir = str(Path(doc.FilePath).resolve().parent / "src")
print(f"{ghFileDir=}")

if ghFileDir not in sys.path:
    print("ghFileDir needed to be included")
    sys.path.append(ghFileDir)

import splintcommon
reload(splintcommon) #FOR DEV

#splintcommon module is now available for use in this GhPython component
splintcommon.log(f'GhPython Node initialized at {time.ctime()}')

import Rhino.Geometry as rg
import FeatureIdentification as fi
reload(fi)

# Diagnostics: what did GH pass us this invocation?
print("--- DIAGNOSTICS ---")
print("trim_rectangles type: {}".format(type(trim_rectangles).__name__))
if hasattr(trim_rectangles, '__len__'):
    print("trim_rectangles len: {}".format(len(trim_rectangles)))
    for i, tr in enumerate(trim_rectangles):
        print("  [{}]: {}".format(i, type(tr).__name__))
else:
    print("trim_rectangles: single item {}".format(type(trim_rectangles).__name__))

print("input_surface type: {}".format(type(input_surface).__name__))
print("keep_direction type: {}".format(type(keep_direction).__name__))
print("keep_direction: ({}, {}, {})".format(keep_direction.X, keep_direction.Y, keep_direction.Z))
print("--- END DIAGNOSTICS ---")

trim_surface = fi.trim_surface_with_direction(
    trim_rectangles,
    input_surface,
    keep_direction
)
# ---------- end trim_surface ----------
panel = Panel("-50, 50, 0")  # disabled
multiplication = Multiplication(A=deconstruct_plane.ZAxis, B="7")
multiplication_2 = Multiplication(A=negative, B="20")
cluster = Cluster(base_move_vector=panel, geo_data=entwine_2)  # -> geometry, out; disabled
panel_2 = Panel(trim_surface.out)
extrude = Extrude(Base=trim_surface.trim_surface, Direction=multiplication_2)
move = Move(Geometry=extrude, Motion=multiplication)  # -> flatten(Geometry), Transform
panel_3 = Panel(scale.Geometry)
trimmer_brep = Brep(move.Geometry)
trim_surface_2 = ClusterOutput(trim_surface.trim_surface)
trimmer_brep_2 = ClusterOutput(trimmer_brep)
panel_4 = Panel(move.Geometry)

# ==== cluster ConeCreator
number_slider = Slider(0, range=0..5)
list = ClusterInput()
point_a = ClusterInput()
point_b = ClusterInput()
point_c = ClusterInput()
list_item = ListItem(List=flatten(list), Index=number_slider, Wrap=False)
list_item_2 = ListItem(List=flatten(point_a), Index=number_slider, Wrap=False)
list_item_3 = ListItem(List=flatten(point_c), Index=number_slider, Wrap=False)
list_item_4 = ListItem(List=flatten(point_b), Index=number_slider, Wrap=False)
splint_center_point = Point(flatten(list))
splint_center_point_2 = Point(flatten(splint_center_point))
point_a_2 = Point(flatten(point_a))
point_c_2 = Point(flatten(point_c))
point_b_2 = Point(flatten(point_b))
splint_center_point_3 = Point(flatten(splint_center_point))
ext_ln_pts = ExtLnPts(startpoint=splint_center_point_3, midpoint=point_a_2, extensiondist="-5")
ext_ln_pts_2 = ExtLnPts(startpoint=splint_center_point_3, midpoint=point_b_2, extensiondist="-5")
ext_ln_pts_3 = ExtLnPts(startpoint=splint_center_point_3, midpoint=point_c_2, extensiondist="-5")
ext_ln_pts_4 = ExtLnPts(startpoint=splint_center_point_2, midpoint=point_a_2, extensiondist="5")
ext_ln_pts_5 = ExtLnPts(startpoint=splint_center_point_2, midpoint=point_b_2, extensiondist="5")
ext_ln_pts_6 = ExtLnPts(startpoint=splint_center_point_2, midpoint=point_c_2, extensiondist="5")
point_ax = Point(ext_ln_pts_4)
point_bx = Point(ext_ln_pts_5)
point_cx = Point(ext_ln_pts_3)
point_cx_2 = Point(ext_ln_pts_6)
point_bx_2 = Point(ext_ln_pts_2)
point_ax_2 = Point(ext_ln_pts)
line = Line(StartPoint=splint_center_point_3, EndPoint=ext_ln_pts_4)
circle_3pt = Circle3Pt(PointA=point_cx, PointB=point_bx_2, PointC=point_ax_2)  # -> Circle, Plane, Radius
circle_3pt_2 = Circle3Pt(PointA=point_cx_2, PointB=point_bx, PointC=point_ax)  # -> Circle, Plane, Radius
entwine = Entwine(Branch0X=circle_3pt.Circle, Branch1X=circle_3pt_2.Circle, FlattenInputs=False)
merge = Merge(Data1=circle_3pt.Circle, Data2=circle_3pt_2.Circle)
transpose_py = Python3Script(data=entwine)  # -> out, result; inputs data: tree of GeometryBase; same code as transpose_py
loft_options = LoftOptions(Closed=False, Adjust=True, Rebuild=0, Refit=0, Type=2)
panel = Panel(transpose_py.result)
loft = Loft(Curves=transpose_py.result, Options=loft_options)
cap_holes = CapHoles(Brep=loft)
brep = ClusterOutput(cap_holes)

# ==== cluster MoveComplexCL
base_move_vector = ClusterInput()
geo_data = ClusterInput()
geo_data_2 = Geometry(geo_data)
base_move_vector_2 = Vector(base_move_vector)
transpose_py = Python3Script(data=geo_data_2)  # -> out, result; inputs data: tree of GeometryBase; same code as transpose_py
python_3_script = Python3Script(data=transpose_py.result, base_vector=base_move_vector_2, z_separation="40")  # -> out, vectors; inputs data: tree, base_vector: Vector3d, z_separation: Double; same code as python_3_script
move = Move(Geometry=transpose_py.result, Motion=python_3_script.vectors)  # -> Geometry, Transform
panel = Panel(python_3_script.out)
geometry = Geometry(move.Geometry)
geometry_2 = ClusterOutput(geometry)

# ==== cluster Cluster_2
base_move_vector = ClusterInput()
geo_data = ClusterInput()
base_move_vector_2 = Vector(base_move_vector)
geo_data_2 = Geometry(geo_data)
transpose_py = Python3Script(data=geo_data_2)  # -> out, result; inputs data: tree of GeometryBase; same code as transpose_py
python_3_script = Python3Script(data=transpose_py.result, base_vector=base_move_vector_2, z_separation="40")  # -> out, vectors; inputs data: tree, base_vector: Vector3d, z_separation: Double; same code as python_3_script
out = ClusterOutput(python_3_script.out)
move = Move(Geometry=transpose_py.result, Motion=python_3_script.vectors)  # -> Geometry, Transform
geometry = ClusterOutput(move.Geometry)

# ==== cluster BrepRefPointCL
nudge_amount = ClusterInput()
north_star_pt = ClusterInput()
brep = ClusterInput()
north_star_pt_2 = Point(north_star_pt)
brep_2 = Brep(brep)
nudge_amount_2 = Point(nudge_amount)
brep_closest_point = BrepClosestPoint(Point=north_star_pt_2, Brep=brep_2)  # -> Point, Normal, Distance
origin = Panel("0, 0, 0")
point = Point(origin)
distance = ClusterOutput(brep_closest_point.Distance)
move_to_point = MoveToPoint(Geometry=brep_closest_point.Point, PointA=point, PointB=nudge_amount_2)  # -> Moved, Vector, Transform
result_point = Point(move_to_point.Moved)
result_point_2 = ClusterOutput(result_point)

# ==== cluster Cluster
geo_data = ClusterInput()
base_move_vector = ClusterInput()
base_move_vector_2 = Vector(base_move_vector)
geo_data_2 = Geometry(geo_data)
panel = Panel(geo_data_2)
transpose_py = Python3Script(data=geo_data_2)  # -> out, result; inputs data: tree of GeometryBase
# ---------- transpose_py: Python ----------
# Input: data (Tree Access)
# Output: result

from Grasshopper import DataTree
from Grasshopper.Kernel.Data import GH_Path

branches = [list(data.Branch(i)) for i in range(data.BranchCount)]

print("Branch count: {}".format(data.BranchCount))
for i, b in enumerate(branches):
    print("  Branch {}: {} items, path {}".format(i, len(b), data.Path(i)))

count = min(len(b) for b in branches)
print("Transposing: {} branches x {} items".format(len(branches), count))

result = DataTree[object]()
for i in range(count):
    path = GH_Path(i)
    for b in branches:
        result.Add(b[i], path)

print("Output: {} branches x {} items each".format(result.BranchCount, result.Branch(0).Count if result.BranchCount > 0 else 0))
# ---------- end transpose_py ----------
python_3_script = Python3Script(data=transpose_py.result, base_vector=base_move_vector_2, z_separation="40")  # -> out, vectors; inputs data: tree, base_vector: Vector3d, z_separation: Double
# ---------- python_3_script: Python ----------
# This file represents a stub for a GhPython component in Grasshopper.
# It sets up the environment to import and use the splintcommon or other external modules.

from pathlib import Path
import sys
from importlib import reload #FOR DEV
import time

# Walk up through nested clusters to find the root GH document (necessary for use in nested clusters)
doc = ghenv.Component.OnPingDocument()
while not doc.FilePath and doc.Owner:
    doc = doc.Owner.OnPingDocument()
ghFileDir = str(Path(doc.FilePath).resolve().parent / "src")

print(f"{ghFileDir=}")

if ghFileDir not in sys.path:
    print("ghFileDir needed to be included")
    sys.path.append(ghFileDir)

import splintcommon
reload(splintcommon) #FOR DEV

#splintcommon module is now available for use in this GhPython component
splintcommon.log(f'GhPython Node initialized at {time.ctime()}')

#Your code here

# Inputs:
#   data         (Tree Access, type hint: ghdoc Object)
#   base_vector  (Item Access, type hint: Vector3d)
#   z_separation (Item Access, type hint: float)
# Output:
#   vectors

import Rhino.Geometry as rg
from Grasshopper import DataTree
from Grasshopper.Kernel.Data import GH_Path

branch_count = data.BranchCount
print("Branches: {}, z_separation: {}".format(branch_count, z_separation))

vectors = DataTree[rg.Vector3d]()

for i in range(branch_count):
    path = data.Path(i)
    item_count = data.Branch(i).Count
    vec = rg.Vector3d(base_vector.X, base_vector.Y, base_vector.Z + z_separation * i)
    print("  Branch {} ({}): {} items, vec Z={:.2f}".format(i, path, item_count, vec.Z))
    # One vector per item so the tree matches the geometry tree for Move
    for j in range(item_count):
        vectors.Add(vec, path)
# ---------- end python_3_script ----------
out = ClusterOutput(python_3_script.out)
move = Move(Geometry=transpose_py.result, Motion=python_3_script.vectors)  # -> Geometry, Transform
geometry = ClusterOutput(move.Geometry)
