# Grasshopper definition InfinityFlex_DEV_CONVERSION_NOTES.gh (Grasshopper 1.0.8)
# plug-ins: Pufferfish, Wombat

# ----
# Algorithm Inputs
# central-band-strap-width-mm: 7.0 was too wide for the flex version
toggle_job_make_it_go = BooleanToggle(False)
# InfinityFlex
geo_algorithm_name = Panel("InfinityFlex")
output_dir_test = Panel("/Users/jon/Desktop/gh_output/")
root_filename = Panel("infinitysplint_test")
file_input_extractor = Python3Script(geo_algorithm_name=geo_algorithm_name, toggleJob=toggle_job_make_it_go)  # -> out, inter_phalanx_distance_mm, root_circumference_mm, mid_circumference_mm, tip_circumference_mm, flexion_degrees, root_filename, output_dir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; inputs toggleJob: Boolean
# ---------- file_input_extractor: Python ----------
from pathlib import Path
import sys
from importlib import reload #FOR DEV
import time

ghFileDir = str(Path.joinpath(Path(ghenv.Component.OnPingDocument().FilePath).resolve().parents[0], "src"))
print(f"{ghFileDir=}")

if ghFileDir not in sys.path:
    print("ghFileDir needed to be included")
    sys.path.append(ghFileDir)

import splintcommon
reload(splintcommon) #FOR DEV
from splintcommon import mark_generation_start
mark_generation_start()

splintcommon.log(f'FactoryAutomatorPY Running at: ({time.strftime("%H:%M:%S", time.localtime())})')
# ==================== Component Code ===========================

is_production_mode = True
job_data, objectID, root_filename, output_dir, raw_data = splintcommon.load_job_data(is_production_mode, geo_algorithm_name)

print(f"{objectID=}")

# This mapping must match the schema of the data in the DB for this geometry type
inter_phalanx_distance_mm = job_data["inter_phalanx_distance_mm"]
root_circumference_mm = job_data["root_circumference_mm"]
mid_circumference_mm = job_data["mid_circumference_mm"]
tip_circumference_mm = job_data["tip_circumference_mm"]
flexion_degrees = job_data["flexion_degrees"]
include_slit = job_data.get("include_slit", False) #Added 6/2/26

splintcommon.log(f"Result data {geo_algorithm_name=} {objectID=} {inter_phalanx_distance_mm=} {root_circumference_mm=} {mid_circumference_mm=} {tip_circumference_mm=} {flexion_degrees=} {include_slit=}")
# ---------- end file_input_extractor ----------
panel = Panel(file_input_extractor.raw_data)

# ---- group: Internal Constants
central_band_strap_width_mm = Panel("4.0")
extent_band_strap_width_mm = Panel("4.0")
mid_joint_rise_factor = Panel("1.0")
axial_band_thickness_mm = Panel("1.2")

# ----
wall_thickness = Number(axial_band_thickness_mm)
root_filename_out = Text(file_input_extractor.root_filename)
output_dir_out = Text(file_input_extractor.output_dir)
panel_2 = Panel(file_input_extractor.out)

# ----
# Local Value Override
# NOTE: Red Canvas Background Indicates that local overrides are in use. File should not be left with local overrides enabled
use_local_values = BooleanToggle(True)
local_warning_py = Python3Script(localOverride=use_local_values)  # -> out
# ---------- local_warning_py: Python ----------
import Rhino
import Grasshopper
from System.Drawing import Color

# Set the viewport background color
# col = Grasshopper.GUI.Canvas.GH_Skin.canvas_back
# print(f"{col=}")

if localOverride:
    Grasshopper.GUI.Canvas.GH_Skin.canvas_back = Color.FromArgb(255, 255, 0, 0);
else:
    Grasshopper.GUI.Canvas.GH_Skin.canvas_back = Color.FromArgb(255, 212, 208, 200);

# Redraw the view to see the update instantly
Rhino.RhinoDoc.ActiveDoc.Views.Redraw()
# ---------- end local_warning_py ----------
override = BooleanToggle(False)
inter_phalanx_distance = Number(file_input_extractor.inter_phalanx_distance_mm)
override_2 = Panel("30")
override_3 = Panel("30")
include_slit = Boolean(file_input_extractor.include_slit)
override_4 = Panel("30")
flexion_degrees = Number(file_input_extractor.flexion_degrees)
override_5 = Panel("0")
objectid = Text(file_input_extractor.objectID)
root_circ = Number(file_input_extractor.root_circumference_mm)
override_6 = Panel("22")
mid_circ = Number(file_input_extractor.mid_circumference_mm)
tip_circ = Number(file_input_extractor.tip_circumference_mm)
override_7 = Panel("")
pick_n_choose = PickNChoose(Pattern=use_local_values, Stream0=mid_circ, Stream1=override_3)
pick_n_choose_2 = PickNChoose(Pattern=use_local_values, Stream0=root_circ, Stream1=override_2)
pick_n_choose_3 = PickNChoose(Pattern=use_local_values, Stream0=tip_circ, Stream1=override_4)
pick_n_choose_4 = PickNChoose(Pattern=use_local_values, Stream0=flexion_degrees, Stream1=override_5)
pick_n_choose_5 = PickNChoose(Pattern=use_local_values, Stream0=inter_phalanx_distance, Stream1=override_6)
pick_n_choose_6 = PickNChoose(Pattern=use_local_values, Stream0=include_slit, Stream1=override)

pick_n_choose_7 = PickNChoose(Pattern=use_local_values, Stream0=objectid, Stream1=override_7)
objectid_2 = Text(pick_n_choose_7)
include_slit_2 = Boolean(pick_n_choose_6)

# ----
# Finger Preform Solid
# Notes: The infinity_flex is not specific to one joint, but we will model it surrounding the pip joint
# inter_phalanx_distance spans half of the proximal phalanx and half of the middle phalanx and so we will use half of it for the model's proximal_len and middle_len
axial_band_thickness_mm_2 = Number(axial_band_thickness_mm)
root_circ_2 = Number(pick_n_choose_2)
mid_circ_2 = Number(pick_n_choose)
inter_phalanx_distance_2 = Number(pick_n_choose_5)
flexion_degrees_2 = Number(pick_n_choose_4)
tip_circ_2 = Number(pick_n_choose_3)
extent_band_width = Number(extent_band_strap_width_mm)
fingermodel_demo_py = Python3Script(
    toggle=Toggle(False),
    shell_thickness=axial_band_thickness_mm_2,
    root_circ=root_circ_2,
    mid_circ=mid_circ_2,
    tip_circ=tip_circ_2,
    flexion_degrees=flexion_degrees_2,
    inter_phalanx_distance=inter_phalanx_distance_2,
    extent_band_width=extent_band_width)  # -> out, cFinger_brep, cCenterline, cComponents, sCenterline, sFinger_brep, sComponents, splintBlank, splintBlankCenterline
# ---------- fingermodel_demo_py: Python ----------
# This file represents a stub for a GhPython component in Grasshopper.
# It sets up the environment to import and use the splintcommon or other external modules.

from pathlib import Path
import sys
from importlib import reload #FOR DEV ONLY
import time

# In normal GH doc
ghFileDir = None
try:
    ghFileDir = str(Path.joinpath(Path(ghenv.Component.OnPingDocument().FilePath).resolve().parents[0], "src"))
except:
    # In GH Cluster
    ghFileDir = str(Path.joinpath(Path(ghenv.Component.OnPingDocument().Owner.OnPingDocument().FilePath).resolve().parents[0], "src"))

print(f"{ghFileDir=}")

if ghFileDir not in sys.path:
    print("ghFileDir needed to be included")
    sys.path.append(ghFileDir)

import splintcommon
reload(splintcommon) #FOR DEV ONLY

#splintcommon module is now available for use in this GhPython component
splintcommon.log(f'GhPython Node initialized at {time.ctime()}')


from importlib import reload
import FingerModel
reload(FingerModel)

from FingerModel import create_finger_model, FingerParams
from dataclasses import replace

import BrepDifference
reload(BrepDifference) #FOR DEV ONLY
from BrepDifference import robust_brep_difference

# Refresher, order of elements:
# metacarpel numb, mcp, proximal, pip, middle, dip, distal

# input values to work with:
# shell_thickness
# root_circ ~= mcp_circ 
# mid_circ ~=
# tip_circ
# flexion_degrees
# inter_phalanx_distance
# extent_band_width

# The model input values that we need to provide or compute:

trimDistAroundPIP = (inter_phalanx_distance/2) + (extent_band_width/2)


# Must do linear interpolation on outer joints
min_linear_int = 2.0

mcp_circ_calc = root_circ - (mid_circ - root_circ)
mcp_circ_calc = mcp_circ_calc if mcp_circ_calc > min_linear_int else min_linear_int

dip_circ_calc = tip_circ - (mid_circ - tip_circ)
dip_circ_calc = dip_circ_calc if dip_circ_calc > min_linear_int else min_linear_int

print(f"{mcp_circ_calc=} {dip_circ_calc=}")

coreParams = FingerParams(
    # Segment range - generate full finger or subset
    start_at="proximal",
    end_at="middle",

    # Joint circumferences (mm)
    mcp_circ=mcp_circ_calc, #root_circ,
    proximal_mid_circ=root_circ,
    pip_circ=mid_circ,
    middle_mid_circ=tip_circ,
    dip_circ=dip_circ_calc,
    # distal_mid_circ=60.0,
    # tip_circ=45.0,

    # Metacarpal stub length
    metacarpal_len=20.0,

    # Phalanx lengths (mm)
    proximal_len=inter_phalanx_distance,
    middle_len=inter_phalanx_distance,
    # distal_len=None,
    
    # Joint angles (degrees) - positive = curl toward palm
    # mcp_flex=0.0,
    pip_flex=flexion_degrees,
    # dip_flex=0.0,

    # mcp_lateral=0.0,
    # pip_lateral=0.0,
    # dip_lateral=0.0,   
)

# Create the finger model
cCenterline, cFinger_brep, cComponents, cJointPositions = create_finger_model(
    coreParams,
    tolerance=None,      # Use document tolerance
    return_parts=True    # Return individual components
)

# Create the shell params
shellParams = replace(coreParams, shell_thickness=shell_thickness, start_at="proximal", end_at="middle")
shellParams.trim_start=("pip", -1 * trimDistAroundPIP)  # 10mm before MCP joint
shellParams.trim_end=("pip", trimDistAroundPIP)

# Create the shell model
sCenterline, sFinger_brep, sComponents, sJointPositions = create_finger_model(
    shellParams,
    tolerance=None,      # Use document tolerance
    return_parts=True    # Return individual components
)

# Subtract inner from shell to create hollow splint
splintBlank, success, method = robust_brep_difference(
    minuend=sFinger_brep,      # subtract FROM this (larger)
    subtrahend=cFinger_brep,   # subtract this (smaller)
    base_tolerance=0.001
)

splintBlankCenterline = sCenterline

if success:
    print(f"Hollow splint created via {method}")
    # result_brep is now a hollow shell
else:
    print(f"Difference failed: {method}")
# ---------- end fingermodel_demo_py ----------
circ2rad = Python3Script(circumference=mid_circ_2)  # -> radius
# ---------- circ2rad: Python ----------
from math import pi

radius = circumference / (2 * pi)

print(f"{circumference=} {radius=}")
# ---------- end circ2rad ----------
inner_shell_brep = Brep(fingermodel_demo_py.cFinger_brep)
outer_shell_brep = Brep(fingermodel_demo_py.sFinger_brep)
material_shell_brep = Brep(fingermodel_demo_py.splintBlank)
splint_centerline = Curve(fingermodel_demo_py.splintBlankCenterline)
scomponents = Geometry(fingermodel_demo_py.sComponents)
mid_r = Number(circ2rad)

# ----
# Central Finger Line Geometry
splint_centerline_2 = Curve(splint_centerline)
explode = Explode(Curve=splint_centerline_2, Recursive=True)  # -> Segments, Vertices
list_item = ListItem(List=explode.Segments, Index="0", Wrap=False)
list_item_2 = ListItem(List=explode.Segments, Index="1", Wrap=False)
unit_vector = UnitVector(Vector=list_item)
end_points = EndPoints(Curve=list_item_2)  # -> Start, End
end_points_2 = EndPoints(Curve=list_item)  # -> Start, End
firstsegmentdirection = Vector(unit_vector)
secondsegmentline = Line(list_item_2)
secondsegmentend = Point(end_points.End)
firstsegmentstart = Point(end_points_2.Start)
firstsegmentline = Line(list_item)
firstsegmentend = Point(end_points_2.End)

panel_3 = Panel(fingermodel_demo_py.out)
brepinspect_py = Python3Script()  # -> out; inputs brepToTest: Brep
# ---------- brepinspect_py: Python ----------
# This file represents a stub for a GhPython component in Grasshopper.
# It sets up the environment to import and use the splintcommon or other external modules.

from pathlib import Path
import sys
from importlib import reload #FOR DEV ONLY
import time

# In normal GH doc
ghFileDir = None
try:
    ghFileDir = str(Path.joinpath(Path(ghenv.Component.OnPingDocument().FilePath).resolve().parents[0], "src"))
except:
    # In GH Cluster
    ghFileDir = str(Path.joinpath(Path(ghenv.Component.OnPingDocument().Owner.OnPingDocument().FilePath).resolve().parents[0], "src"))

print(f"{ghFileDir=}")

if ghFileDir not in sys.path:
    print("ghFileDir needed to be included")
    sys.path.append(ghFileDir)

import splintcommon
reload(splintcommon) #FOR DEV ONLY

#splintcommon module is now available for use in this GhPython component
splintcommon.log(f'GhPython Node initialized at {time.ctime()}')

import BrepInspect
reload(BrepInspect)

BrepInspect.inspect_solid_brep(brepToTest)
# ---------- end brepinspect_py ----------

# ----
# Preform
# Orientation
# Adjustment
# Alignment Work
firstsegmentstart_2 = Point(firstsegmentstart)
firstsegmentend_2 = Point(firstsegmentend)
firstsegmentdirection_2 = Vector(firstsegmentdirection)
secondsegmentline_2 = Line(secondsegmentline)
firstsegmentline_2 = Line(firstsegmentline)
secondsegmentend_2 = Point(secondsegmentend)
material_shell_brep_2 = Brep(material_shell_brep)
outer_shell_brep_2 = Brep(outer_shell_brep)
inner_shell_brep_2 = Brep(inner_shell_brep)
scomponents_2 = Geometry(scomponents)
line = Line(StartPoint=firstsegmentstart_2, EndPoint=firstsegmentend_2)
xz_plane = XZPlane(Origin=Point(0, 0, 0))
average_center_line = Line(line)
angle = Angle(VectorA=average_center_line, VectorB=firstsegmentdirection_2, Plane=xz_plane)  # -> Angle, Reflex
finger_model_rotate = Rotate(Geometry=material_shell_brep_2, Angle=angle.Angle, Plane=xz_plane)  # -> Geometry, Transform
outer_barrel_transform = Transform(Geometry=outer_shell_brep_2, Transform=finger_model_rotate.Transform)
inner_barrel_transform = Transform(Geometry=inner_shell_brep_2, Transform=finger_model_rotate.Transform)
center_line_transform = Transform(Geometry=average_center_line, Transform=finger_model_rotate.Transform)
root_line_transform = Transform(Geometry=firstsegmentline_2, Transform=finger_model_rotate.Transform)
tip_line_transform = Transform(Geometry=secondsegmentline_2, Transform=finger_model_rotate.Transform)
tip_line_transform_2 = Transform(Geometry=scomponents_2, Transform=finger_model_rotate.Transform)
first_orientation_shift_transform = Transform(finger_model_rotate.Transform)
secondsegmentline_3 = Line(tip_line_transform)
firstsegmentline_3 = Line(root_line_transform)
material_shell_brep_3 = Brep(finger_model_rotate.Geometry)
scomponents_3 = Geometry(tip_line_transform_2)
inner_shell_brep_3 = Brep(inner_barrel_transform)
outer_shell_brep_3 = Brep(outer_barrel_transform)
list_item_3 = ListItem(List=scomponents_3, Index="1", Wrap=True)
volume = Volume(Geometry=list_item_3)  # -> Volume, Centroid
joint_centroid = Point(volume.Centroid)

reliable_union_cl = ReliableUnionCL()  # -> unionresult, unionreport; disabled
panel_4 = Panel(brepinspect_py)
joint_centroid_2 = Point(joint_centroid)
unit_x = UnitX(Factor=1)
deconstruct = Deconstruct(Point=joint_centroid_2)  # -> XComponent, YComponent, ZComponent

# ----
# Top Bands Creation
# 1. Move the top bands into place
# 2. Connect the ends of the top bands to create a v shaped mask to intersect with the preform
north_start_nudge = Panel("0, 0, 3")
outer_shell_brep_4 = Brep(outer_barrel_transform)
top_band_width_mm = Panel(extent_band_strap_width_mm)
north_star_point = Panel("300, 0, 100")
north_star = Panel("-200, 0, 100")
point = Point(north_star_point)
point_2 = Point(north_star)
construct_domain = ConstructDomain(DomainStart="0", DomainEnd="90")
xz_plane_2 = XZPlane(Origin=Point(0, 0, 0))
brep_ref_point_cl = BrepRefPointCL(nudge_amount=north_start_nudge, north_star_pt=north_star, brep=outer_shell_brep_4)  # -> result_point_2, distance
brep_ref_point_cl_2 = BrepRefPointCL(nudge_amount=north_start_nudge, north_star_pt=north_star_point, brep=outer_shell_brep_4)  # -> result_point_2, distance
unit_x_2 = UnitX(Factor=1)
unit_x_3 = UnitX(Factor="-1")
range = Range(Domain=construct_domain, Steps="10")
left_band_guide_line = LineSDL(Start=brep_ref_point_cl.result_point_2, Direction=unit_x_2, Length=top_band_width_mm)
right_band_guide_line = LineSDL(Start=brep_ref_point_cl_2.result_point_2, Direction=unit_x_3, Length=top_band_width_mm)
rotation_check_angles = Number(range)
negative = Negative(Value=rotation_check_angles)
find_band_align_py = Python3Script(
    input_brep=outer_shell_brep_4,
    input_curve=left_band_guide_line,
    rotation_origin_point=brep_ref_point_cl.result_point_2,
    rotation_plane=xz_plane_2,
    test_rotation_degrees=rotation_check_angles)  # -> out, result_curve; inputs input_brep: Brep, input_curve: Curve, rotation_origin_point: Point3d, rotation_plane: Plane, test_rotation_degrees: list of Double
# ---------- find_band_align_py: Python ----------
# GRASSHOPPER COMPONENT: FindNonIntersectingCurveRotation
#
# INPUTS:
#   input_brep            - Brep    - The brep to test intersections against
#   input_curve           - Curve   - The curve to rotate and test
#   rotation_origin_point - Point   - Centre of rotation
#   rotation_plane        - Plane   - Plane whose normal defines the rotation axis
#   test_rotation_degrees - Number  - List of degree values to try, in order (set to List Access)
#
# OUTPUTS:
#   result_curve  - Curve  - First rotated curve that clears the brep, or None

from pathlib import Path
import sys
from importlib import reload  # FOR DEV
import time

# Walk up through nested clusters to find the root GH document
doc = ghenv.Component.OnPingDocument()
while not doc.FilePath and doc.Owner:
    doc = doc.Owner.OnPingDocument()
ghFileDir = str(Path(doc.FilePath).resolve().parent / "src")

if ghFileDir not in sys.path:
    sys.path.append(ghFileDir)

import splintcommon
reload(splintcommon)  # FOR DEV
from splintcommon import mark_generation_start
mark_generation_start()

import FeatureIdentification
reload(FeatureIdentification)  # FOR DEV
from FeatureIdentification import find_non_intersecting_curve_rotation

splintcommon.log('FindNonIntersectingCurveRotation: started at {}'.format(time.ctime()))

result_curve = find_non_intersecting_curve_rotation(
    input_brep,
    input_curve,
    rotation_origin_point,
    rotation_plane,
    test_rotation_degrees,
)
# ---------- end find_band_align_py ----------
find_band_align_py_2 = Python3Script(
    input_brep=outer_shell_brep_4,
    input_curve=right_band_guide_line,
    rotation_origin_point=brep_ref_point_cl_2.result_point_2,
    rotation_plane=xz_plane_2,
    test_rotation_degrees=negative)  # -> out, result_curve; inputs input_brep: Brep, input_curve: Curve, rotation_origin_point: Point3d, rotation_plane: Plane, test_rotation_degrees: list of Double; same code as find_band_align_py
root_top_band = Curve(find_band_align_py.result_curve)
tip_top_band = Curve(find_band_align_py_2.result_curve)

output_nudge_motion = Panel("0, 0, -1")
mid_r_2 = Number(mid_r)
nub_sinking_factor = Panel("-0.2")
brep = Brep(<brep referenced from the Rhino model>)
bounding_box = BoundingBox(Content=brep, Plane=PlaneXY(0, 0, 0))  # -> Box, Box_2
volume_2 = Volume(Geometry=bounding_box.Box)  # -> Volume, Centroid
point_3 = Point("-40, -16.5, 7.3")
deconstruct_2 = Deconstruct(Point=volume_2.Centroid)  # -> XComponent, YComponent, ZComponent
dev_activate_toggle = BooleanToggle(True)
root_filename_out_2 = Text(root_filename_out)
output_dir_out_2 = Text(output_dir_out)
savemeshpy = Python3Script(output_file_dir=output_dir_out_2, jobname=root_filename_out_2, bool_activate=dev_activate_toggle)  # -> out; inputs geo_input: Mesh; disabled
# ---------- savemeshpy: Python ----------
# See: https://discourse.mcneel.com/t/how-to-optimise-ghpython-obj-export/87598/76

# This code is intended to be run inside a Grasshopper Python component
# It exports a given mesh to an OBJ or STL file using Rhino's export functionality
# Node inputs:
#   geo_input: The input mesh to be exported (Rhino.Geometry.Mesh)
#   output_file_dir: The directory where the exported file will be saved (string)
#   jobname: The base name for the exported file (string)

# Start standard gh python imports
from pathlib import Path
import sys
from importlib import reload #FOR DEV ONLY

ghFileDir = str(Path.joinpath(Path(ghenv.Component.OnPingDocument().FilePath).resolve().parents[0], "src"))
if ghFileDir not in sys.path:
    print("ghFileDir needed to be included")
    sys.path.append(ghFileDir)
import splintcommon
reload(splintcommon)
# End standard gh python imports

import time
splintcommon.log(f'Save Mesh Running at: ({time.strftime("%H:%M:%S", time.localtime())})')

import scriptcontext as sc
# import rhinoscriptsyntax as rs
import System
import Rhino
import random
import string
import os
import traceback

def add_layer(layer_name=None, layer_color=None):
    """Adds a new layer to the active Rhino document.
    
    Args:
      layer_name (str): An optional layer name.
      layer_color (System.Drawing.Color): An optional layer color.
    Returns:
      The index of the new layer.
    """
    sc.doc = Rhino.RhinoDoc.ActiveDoc
    if layer_name != None:
        # Check whether the layer name is valid
        if not Rhino.DocObjects.Layer.IsValidName(layer_name):
            raise ValueError("{} is not a valid layer name."\
                .format(layer_name))
        # Check whether a layer with the same name already exists
        layer_index = sc.doc.Layers.Find(layer_name, True)
        if layer_index >= 0:
            raise ValueError("A layer with the name {} already exists."\
                .format(layer_name))
    else:
        layer_name = sc.doc.Layers.GetUnusedLayerName(False)
    
    # Check whether the layer color is valid
    if layer_color != None:
        if not isinstance(layer_color, System.Drawing.Color):
            raise ValueError("{} is not a valid layer color."\
                .format(layer_color))
    else:
        layer_color = System.Drawing.Color.Black # default layer color
    
    # Add a new layer to the active document
    layer_index = sc.doc.Layers.Add(layer_name, layer_color)
    if layer_index < 0:
        raise ValueError("Unable to add layer {} to document."\
            .format(layer_name))
    return layer_index
    

def delete_layer(layer):
    """Deletes an existing layer from the active Rhino document. 
    The layer to be removed cannot be the current layer and 
    it will be deleted even if it contains objects.
    
    Args:
      layer (str\id): A name or id of an existing layer.
    Returns:
      True or False, indicating success or failure.
    """
    sc.doc = Rhino.RhinoDoc.ActiveDoc
    layer_index = sc.doc.Layers.Find(layer, True)
    if layer_index < 0:
        raise ValueError("The layer {} does not exist.".format(layer))
    rc = sc.doc.Layers.Purge(layer_index, True)
    sc.doc.Views.Redraw()
    return rc
    

def bake_mesh(layer, mesh, mesh_name=None):
    """Bakes a mesh object to the active Rhino document.
    
    Args:
      layer (str\id): The name or id of an existing layer.
      mesh (Rhino.Geometry.Mesh): A mesh object to bake.
      mesh_name (str): An optional mesh object name.
    Returns:
      The GUID of the baked mesh.
    """

    splintcommon.log(f"mesh type:{type(mesh)}")
    # mesh = rs.coercemesh(mesh)
    # splintcommon.log(f"mesh type:{type(mesh)}")

    sc.doc = Rhino.RhinoDoc.ActiveDoc
    # Check whether the mesh is a mesh object
    if mesh.ObjectType != Rhino.DocObjects.ObjectType.Mesh:
        raise ValueError("{} is not a mesh.".format(mesh))
    # Create the mesh object attributes
    attr = Rhino.DocObjects.ObjectAttributes()
    # Set the mesh object layer index attribute
    layer_index = sc.doc.Layers.Find(layer, True)
    if layer_index < 0:
        if layer == "Default":
            raise ValueError("The layer {} can't be baked to.".format(layer))
        else:
            raise ValueError("The layer {} does not exist.".format(layer))    
    else:
        attr.LayerIndex = layer_index
    # Set the mesh object name attribute
    if mesh_name != None:
        attr.Name = mesh_name
    # Bake the mesh to the active Rhino documemnt
    mesh_id = sc.doc.Objects.AddMesh(mesh, attr)
    return mesh_id

def get_obj_settings():
    splintcommon.log("Using OBJ mesh settings")
    """Returns the settings for the OBJ export command as a string."""
    # Formatting options
    cfg = "_Geometry=_Mesh "
    cfg += "_EndOfLine=CRLF "
    cfg += "_ExportRhinoObjectNames=_ExportObjectsAsOBJGroups "
    cfg += "_ExportMeshTextureCoordinates=_Yes "
    cfg += "_ExportMeshVertexNormals=_Yes "
    cfg += "_ExportMeshVertexColors=_Yes "
    cfg += "_CreateNGons=_No "
    cfg += "_ExportMaterialDefinitions=_No "
    cfg += "_YUp=_Yes "
    cfg += "_WrapLongLines=_No "
    cfg += "_VertexWelding=_Unmodified "
    cfg += "_WritePrecision=4 "
    cfg += "_Enter "
    # Detailed options
    cfg += "_DetailedOptions "
    cfg += "_JaggedSeams=_No "
    cfg += "_PackTextures=_No "
    cfg += "_Refine=_No "
    cfg += "_SimplePlane=_No "
    # Advanced options
    cfg += "_AdvancedOptions "
    cfg += "_Angle=0 "
    cfg += "_AspectRatio=0 "
    cfg += "_Distance=0.0 "
    cfg += "_Density=0.5 "
    cfg += "_Grid=0 "
    cfg += "_MaxEdgeLength=0 "
    cfg += "_MinEdgeLength=0.0001 "
    cfg += "_Enter _Enter" # remove the last _Enter to check if density is set
    return cfg, "obj"

def get_stl_settings_default():
    #[ANGLE,ASPECT RATIO,MAX DIST TO SRF,GRID,DENSITY,MAX EDGE LEN,MIN EDGE LEN]
    #Change list below as needed
    setting_list=[15,0,0.01,16,0,0,0.001]   
    return get_stl_settings(*setting_list)

def get_stl_settings(ang,ar,dist,grid,den,maxL=0,minL=.0001):
    splintcommon.log("Using STL mesh settings")
    e_str = "_ExportFileAs=_Binary "
    e_str+= "_ExportUnfinishedObjects=_Yes "
    e_str+= "_UseSimpleDialog=_No "
    e_str+= "_Enter _DetailedOptions "
    e_str+= "_JaggedSeams=_No "
    e_str+= "_PackTextures=_No "
    e_str+= "_Refine=_Yes "
    e_str+= "_SimplePlane=_Yes "
    # e_str+= "_AdvancedOptions "
    # e_str+= "_Angle={} ".format(ang)
    # e_str+= "_AspectRatio={} ".format(ar)
    # e_str+= "_Distance={} ".format(dist)
    # e_str+= "_Density={} ".format(den)
    # e_str+= "_Grid={} ".format(grid)
    # e_str+= "_MaxEdgeLength={} ".format(maxL)
    # e_str+= "_MinEdgeLength={} ".format(minL)
    e_str+= "_Enter _Enter"
    return e_str, "stl"

def export_mesh_files(meshes, path, filename, debug=False, asObj=True):
    """Exports a collection of meshes to an OBJ file.
    
    Args:
      meshes (list): A list of Rhino.Geometry.Mesh objects.
      path (str): An absolute path pointing to a directory.
      filename (str): A filename (without extension).
      debug (bool): Optional True to print debug information.
    Returns:
      True or False, indicating success or failure.
    """

    sc.doc = Rhino.RhinoDoc.ActiveDoc
    sc.doc.Views.RedrawEnabled = True # JG - False
    if debug: 
        now = time.process_time()
        elapsed = 0.0
        
    # Create a temporary layer
    splintcommon.log(f"export_mesh_files: Creating temp layer")
    layer = "".join(random.choice(string.ascii_uppercase) for _ in range(9))
    layer_index = add_layer(layer)
    if debug: 
        then, now = now, time.process_time()
        elapsed += now - then
        splintcommon.log("Creating temporary layer: {0:.4f} seconds".format(now-then))
        
    # Bake the temporary mesh(es)
    splintcommon.log(f"export_mesh_files: Baking temp mesh(es)")
    mesh_ids = [bake_mesh(layer, mesh) for mesh in meshes]
    if debug: 
        then, now = now, time.process_time()
        elapsed += now - then
        splintcommon.log("Creating temporary mesh(es): {0:.4f} seconds".format(now-then))
    
    # Unselect all objects in the scene
    sc.doc.Objects.UnselectAll()
    # Select the baked mesh object(s)
    for mid in mesh_ids:
        sc.doc.Objects.Select(mid)
    if debug: 
        then, now = now, time.process_time()
        elapsed += now - then
        splintcommon.log("Unselecting and selecting: {0:.4f} seconds".format(now-then))
    
    # Export the selected mesh object(s) to mesh file
    splintcommon.log(f"export_mesh_files: exporting to file")
    export_config, export_extension = get_obj_settings() if asObj else get_stl_settings_default()
    export_fname = "{}.{}".format(filename, export_extension)
    export_fpath = Path(os.path.join(path, export_fname))
    splintcommon.log(f"export_mesh_files: Export Values: {export_fname=} {export_fpath=}")
    
    if export_fpath.exists():
        splintcommon.log(f"export_mesh_files: REMOVING EXISTING MESH FILE: {export_fpath}")
        export_fpath.unlink()
        time.sleep(1.0)
        splintcommon.log(f"export_mesh_files: testing... MeshStillExists:{export_fpath.exists()}")

    splintcommon.log(f"export_mesh_files: exporting to file")

    cmd = '_-Export _Pause "{}" {} _Enter'.format(export_fpath, export_config) # _Enter
    # see: https://discourse.mcneel.com/t/export-command-line-options/87537/5
    splintcommon.log(f"export_mesh_files: RUNNING cmd: '{cmd}'")
    
    #start = Rhino.DocObjects.RhinoObject.NextRuntimeSerialNumber
    rc = Rhino.RhinoApp.RunScript(cmd, True)

    splintcommon.log(f"export_mesh_files: Completion {rc=}")

    #end = Rhino.DocObjects.RhinoObject.NextRuntimeSerialNumber
    #global __command_serial_numbers
    #__command_serial_numbers = None
    #if start != end:
        #__command_serial_numbers = (start, end)
    
    if debug: 
        then, now = now, time.process_time()
        elapsed += now - then
        splintcommon.log("Exporting Mesh Result: {0:.4f} seconds result={1}".format(now-then, rc))
    
    # Delete the temporary layer and meshes
    splintcommon.log(f"export_mesh_files: cleaning up temp layer")
    delete_layer(layer)
    
    if debug: 
        then, now = now, time.process_time()
        elapsed += now - then
        splintcommon.log("Cleaning up: {0:.4f} seconds\n".format(now-then))
        splintcommon.log("Total elapsed: {0:.4f} seconds".format(elapsed))

    sc.doc.Views.RedrawEnabled = True

    splintcommon.log(f"export_mesh_files: Returning result: {rc=}")

    return rc

def saveMeshToFile(inputMesh, directory, rootFilename):
    try:
        splintcommon.log(f"inputMesh type: {inputMesh}")
        splintcommon.log(f"{directory=}")
        splintcommon.log(f"{rootFilename=}")
        
        if inputMesh is None or directory is None or rootFilename is None:        
            raise ValueError("Missing required inputs for saving file")

        #TODO, Validate the path more completely
        if "." in directory or "." in rootFilename:
            raise ValueError(f"Path must not contain dot character: {directory}")

        result = export_mesh_files([inputMesh], directory, rootFilename, True, False)

        if not result:
            raise ValueError(f"FAIL: mesh export failed. {result=}")
        else:
            splintcommon.log(f'SUCCESS: Saved to {rootFilename} in {directory}')
            splintcommon.confirm_job_is_processed_and_exit(jobname, True, "mesh exported normally")

    except Exception as e:
        errMsg = f"Exception: {traceback.format_exc()}"
        splintcommon.log(errMsg)
        splintcommon.confirm_job_is_processed_and_exit(jobname, False, errMsg)

if geo_input is None:
    message = f"No mesh input To Process {geo_input=}"
    splintcommon.log(message)
    splintcommon.confirm_job_is_processed_and_exit(jobname, False, message)
else:
    saveMeshToFile(geo_input, output_file_dir, jobname)
# ---------- end savemeshpy ----------

# ----
# Bottom Center Band Creation
# Bottom Band Moved To Center
# Create bottom band line in space
bottom_band_width_mm = Panel(central_band_strap_width_mm)
outer_shell_brep_5 = Brep(outer_shell_brep_3)
ref_nudge = Panel("-75")
unit_z = UnitZ(Factor=ref_nudge)
move = Move(Geometry=joint_centroid_2, Motion=unit_z)  # -> Geometry, Transform
point_4 = Point(move.Geometry)
xy_plane = XYPlane(Origin=Point(0, 0, 0))
unit_x_4 = UnitX(Factor=1)
line_sdl = LineSDL(Start=xy_plane, Direction=unit_x_4, Length=bottom_band_width_mm)
curve_middle = CurveMiddle(Curve=line_sdl)
nudge = Panel("-100")
unit_z_2 = UnitZ(Factor=nudge)

box_center_slice_py = Python3Script(target_brep=outer_shell_brep_5, view_vector=unit_x)  # -> out, slice_surface; inputs target_brep: Brep, view_vector: Vector3d
# ---------- box_center_slice_py: Python ----------
# This file represents a stub for a GhPython component in Grasshopper.
# It sets up the environment to import and use the splintcommon or other external modules.

from pathlib import Path
import sys
from importlib import reload #FOR DEV
import time

# In normal GH doc
ghFileDir = None
try:
    ghFileDir = str(Path.joinpath(Path(ghenv.Component.OnPingDocument().FilePath).resolve().parents[0], "src"))
except:
    # In GH Cluster
    ghFileDir = str(Path.joinpath(Path(ghenv.Component.OnPingDocument().Owner.OnPingDocument().FilePath).resolve().parents[0], "src"))

print(f"{ghFileDir=}")

if ghFileDir not in sys.path:
    print("ghFileDir needed to be included")
    sys.path.append(ghFileDir)

import splintcommon
reload(splintcommon) #FOR DEV

#splintcommon module is now available for use in this GhPython component
splintcommon.log(f'GhPython Node initialized at {time.ctime()}')

import FeatureIdentification
reload(FeatureIdentification) #FOR DEV
from FeatureIdentification import box_center_slice

import Rhino.Geometry as rg

# Get a slice plane at the center, facing +Y direction
slice_surface = box_center_slice(
    target_brep=target_brep,
    bbox_plane=rg.Plane.WorldXY,
    choose_side_vector=view_vector
)
# ---------- end box_center_slice_py ----------
area = Area(Geometry=box_center_slice_py.slice_surface)  # -> Area, Centroid
deconstruct_3 = Deconstruct(Point=area.Centroid)  # -> XComponent, YComponent, ZComponent
construct_point = ConstructPoint(XCoordinate=deconstruct.XComponent, YCoordinate=deconstruct_3.YComponent, ZCoordinate=deconstruct_3.ZComponent)
move_to_point = MoveToPoint(Geometry=box_center_slice_py.slice_surface, PointA=area.Centroid, PointB=construct_point)  # -> Moved, Vector, Transform

brep_plane = BrepPlane(Brep=outer_shell_brep_5, Plane=move_to_point.Moved)  # -> Curves, Points
panel_5 = Panel(brep_plane.Curves)
curve_closest_point = CurveClosestPoint(Point=point_4, Curve=brep_plane.Curves)  # -> Point, Parameter, Distance
move_to_point_2 = MoveToPoint(Geometry=line_sdl, PointA=curve_middle, PointB=curve_closest_point.Point)  # -> Moved, Vector, Transform
bottom_band_line = Curve(move_to_point_2.Moved)
move_2 = Move(Geometry=bottom_band_line, Motion=unit_z_2)  # -> Geometry, Transform
line_to_brep_gravitation_cl = LineToBrepGravitationCL(input_line=move_2.Geometry, output_nudge_motion=output_nudge_motion, input_brep=outer_shell_brep_5)
bottom_band = Curve(line_to_brep_gravitation_cl)

# ----
# Side Cutter Profile
bottom_band_width_mm_2 = Panel(central_band_strap_width_mm)
mid_joint_rise_factor_2 = Panel(mid_joint_rise_factor)
root_top_band_2 = Curve(root_top_band)
tip_top_band_2 = Curve(tip_top_band)
bottom_band_2 = Curve(bottom_band)
multiplication = Multiplication(A=bottom_band_width_mm_2, B=mid_joint_rise_factor_2)
midpoint = Midpoint(Curve=bottom_band_2)
unit_z_3 = UnitZ(Factor=multiplication)
move_3 = Move(Geometry=midpoint, Motion=unit_z_3)  # -> Geometry, Transform
end_points_3 = EndPoints(Curve=bottom_band_2)  # -> Start, End
end_points_4 = EndPoints(Curve=root_top_band_2)  # -> Start, End
end_points_5 = EndPoints(Curve=tip_top_band_2)  # -> Start, End
top_right_band_right_pt = Point(end_points_5.Start)
bottom_left_pt = Point(end_points_3.Start)
top_left_band_left_pt = Point(end_points_4.Start)
top_left_band_right_pt = Point(end_points_4.End)
central_pt = Point(move_3.Geometry)
top_right_band_left_pt = Point(end_points_5.End)
bottom_right_pt = Point(end_points_3.End)
line_2 = Line(StartPoint=top_left_band_right_pt, EndPoint=central_pt)
line_3 = Line(StartPoint=central_pt, EndPoint=top_right_band_left_pt)
midpoint_2 = Midpoint(Curve=line_2)
midpoint_3 = Midpoint(Curve=line_3)
line_4 = Line(StartPoint=bottom_right_pt, EndPoint=bottom_left_pt)
line_5 = Line(StartPoint=bottom_left_pt, EndPoint=top_left_band_left_pt)
line_6 = Line(StartPoint=top_left_band_left_pt, EndPoint=top_left_band_right_pt)
tip_slant_line = Line(StartPoint=top_right_band_right_pt, EndPoint=bottom_right_pt)
line_7 = Line(StartPoint=top_left_band_right_pt, EndPoint=midpoint_2)
line_8 = Line(StartPoint=top_right_band_left_pt, EndPoint=top_right_band_right_pt)
line_9 = Line(StartPoint=midpoint_3, EndPoint=top_right_band_left_pt)
merge = Merge(Data1=line_4, Data2=line_5, Data3=line_6, Data4=line_7, Data6=line_9, Data7=line_8, Data8=tip_slant_line)  # -> flatten(Result)
join_curves = JoinCurves(Curves=merge, Preserve=False)
connect_curves = ConnectCurves(Curves=join_curves, Continuity=2, Close=True, Bulge=Slider(0.6, range=0..2))
close_curve = CloseCurve(Curve=connect_curves, Tolerance=0)
xz_plane_3 = XZPlane(Origin=Point(0, 0, 0))
project = Project(Geometry=close_curve, Plane=xz_plane_3)  # -> Geometry, Transform
planar = Planar(Curve=project.Geometry)  # -> Planar, Plane, Deviation
panel_6 = Panel(planar.Planar)
tip_slant_line_2 = Line(tip_slant_line)
tail_slant_line = Line(line_5)
cutter_curve = Curve(project.Geometry)

# ----
# Side Cutter Extrusions
cutter_curve_2 = Curve(cutter_curve)
tip_slant_line_3 = Line(tip_slant_line_2)
tail_slant_line_2 = Line(tail_slant_line)
outer_shell_brep_6 = Brep(outer_shell_brep_3)
panel_7 = Panel(cutter_curve_2)
inner_shell_brep_4 = Brep(inner_shell_brep_3)
unit_y = UnitY(Factor="-50")
move_4 = Move(Geometry=cutter_curve_2, Motion=unit_y)  # -> Geometry, Transform
transform = Transform(Geometry=tip_slant_line_3, Transform=move_4.Transform)
transform_2 = Transform(Geometry=tail_slant_line_2, Transform=move_4.Transform)
multiplication_2 = Multiplication(A="-50", B="-2")
boundary_surfaces = BoundarySurfaces(Edges=move_4.Geometry)
unit_y_2 = UnitY(Factor=multiplication_2)
tip_slant_extrude = Extrude(Base=transform, Direction=unit_y_2)
tail_slant_extrude = Extrude(Base=transform_2, Direction=unit_y_2)
extrude = Extrude(Base=boundary_surfaces, Direction=unit_y_2)
brep_brep = BrepBrep(BrepA=inner_shell_brep_4, BrepB=tail_slant_extrude)  # -> Curves, Points
brep_brep_2 = BrepBrep(BrepA=inner_shell_brep_4, BrepB=tip_slant_extrude)  # -> Curves, Points
brep_brep_3 = BrepBrep(BrepA=outer_shell_brep_6, BrepB=tip_slant_extrude)  # -> Curves, Points
brep_brep_4 = BrepBrep(BrepA=outer_shell_brep_6, BrepB=tail_slant_extrude)  # -> Curves, Points
side_cutter_volume = Brep(extrude)
side_cutter_surface = Surface(boundary_surfaces)
tail_outer_curve = Curve(brep_brep_4.Curves)
tail_inner_curve = Curve(brep_brep.Curves)
tip_inner_curve = Curve(brep_brep_2.Curves)
tip_outer_curve = Curve(brep_brep_3.Curves)

# ----
# Splint Body
preform_tube_brep = Brep(material_shell_brep_3)
solid_intersection = SolidIntersection(BrepsA=preform_tube_brep, BrepsB=side_cutter_volume)
splint_body = Brep(solid_intersection)

# ---- group: splint-nub
# Direction
# Indicator
splint_body_brep = Brep(splint_body)
tip_top_band_curve = Curve(tip_top_band)
ball_r_to_wall_ratio = Slider(0.65, range=0.6..1)
north_star_nudge = Panel("5")
wall_thickness_2 = Number(wall_thickness)
extend_curve = ExtendCurve(Curve=tip_top_band_curve, Type=0, Start=north_star_nudge, End=north_star_nudge)
multiplication_3 = Multiplication(A=wall_thickness_2, B=ball_r_to_wall_ratio)
end_points_6 = EndPoints(Curve=extend_curve)  # -> Start, End
nub_radius = Panel(multiplication_3)
brep_closest_point = BrepClosestPoint(Point=end_points_6.End, Brep=splint_body_brep)  # -> Point, Normal, Distance
brep_closest_point_2 = BrepClosestPoint(Point=end_points_6.Start, Brep=splint_body_brep)  # -> Point, Normal, Distance
line_10 = Line(StartPoint=brep_closest_point.Point, EndPoint=brep_closest_point_2.Point)
multiplication_4 = Multiplication(A=nub_radius, B=nub_sinking_factor)
nub_position_parameter = Panel("0.5")
reparameterize_curve = ReparameterizeCurve(Curve=line_10)  # -> Reparameterized, Original
evaluate_curve = EvaluateCurve(Curve=reparameterize_curve.Reparameterized, Parameter=nub_position_parameter)  # -> Point, Tangent, Angle
sphere = Sphere(Base=evaluate_curve.Point, Radius=nub_radius)

# ----
unit_z_4 = UnitZ(Factor=multiplication_4)
move_5 = Move(Geometry=sphere, Motion=unit_z_4)  # -> Geometry, Transform
merge_2 = Merge(Data1=splint_body_brep, Data2=move_5.Geometry)  # -> flatten(Result)

# ---- group: splint-nub (continued)
solid_union = SolidUnion(Breps=merge_2)
finishedsplintbrep = Brep(solid_union)

# ----
# Comfort Lip Trimmers
joint_centroid_3 = Point(joint_centroid)
tip_outer_curve_2 = Curve(tip_outer_curve)
tip_inner_curve_2 = Curve(tip_inner_curve)
tail_inner_curve_2 = Curve(tail_inner_curve)
tail_outer_curve_2 = Curve(tail_outer_curve)
splint_brep = Brep(finishedsplintbrep)
unit_y_3 = UnitY(Factor=1)
negative_2 = Negative(Value=mid_r_2)
chamfer_side_limit_angle = Slider(-74, range=-90..90)
box_center_slice_py_2 = Python3Script(target_brep=splint_brep, view_vector=unit_y_3)  # -> out, slice_surface; inputs target_brep: Brep, view_vector: Vector3d; same code as box_center_slice_py
multiplication_5 = Multiplication(A=negative_2, B=Slider(1.29, range=0.75..2))
area_2 = Area(Geometry=box_center_slice_py_2.slice_surface)  # -> Area, Centroid
unit_z_5 = UnitZ(Factor=multiplication_5)
xy_plane_2 = XYPlane(Origin=area_2.Centroid)
scale_nu = ScaleNU(Geometry=box_center_slice_py_2.slice_surface, Plane=xy_plane_2, ScaleX=Slider(0.5, range=0.1..1), ScaleY=1, ScaleZ=1)  # -> Geometry, Transform
splint_brep_2 = Brep(splint_brep)
chamfer_side_limit_angle_2 = Number(chamfer_side_limit_angle)
mid_radius = Number(multiplication_5)
yz_plane = YZPlane(Origin=Point(0, 0, 0))
move_6 = Move(Geometry=scale_nu.Geometry, Motion=unit_z_5)  # -> Geometry, Transform
unit_y_4 = UnitY(Factor=1)
joint_center_point = Point(joint_centroid_3)
negative_3 = Negative(Value=chamfer_side_limit_angle_2)
xy_plane_3 = XYPlane(Origin=Point(0, 0, 0))
rotate = Rotate(Geometry=unit_y_4, Angle=degrees(chamfer_side_limit_angle_2), Plane=yz_plane)  # -> Geometry, Transform
transform_3 = Transform(Geometry=xy_plane_3, Transform=rotate.Transform)
rotate_2 = Rotate(Geometry=unit_y_4, Angle=degrees(negative_3), Plane=yz_plane)  # -> Geometry, Transform
transform_4 = Transform(Geometry=xy_plane_3, Transform=rotate_2.Transform)
box_center_slice_py_3 = Python3Script(target_brep=splint_brep, bbox_plane=transform_3, view_vector=rotate.Geometry)  # -> out, slice_surface; inputs target_brep: Brep, bbox_plane: Plane, view_vector: Vector3d
# ---------- box_center_slice_py_3: Python ----------
# This file represents a stub for a GhPython component in Grasshopper.
# It sets up the environment to import and use the splintcommon or other external modules.

from pathlib import Path
import sys
from importlib import reload #FOR DEV
import time

# In normal GH doc
ghFileDir = None
try:
    ghFileDir = str(Path.joinpath(Path(ghenv.Component.OnPingDocument().FilePath).resolve().parents[0], "src"))
except:
    # In GH Cluster
    ghFileDir = str(Path.joinpath(Path(ghenv.Component.OnPingDocument().Owner.OnPingDocument().FilePath).resolve().parents[0], "src"))

print(f"{ghFileDir=}")

if ghFileDir not in sys.path:
    print("ghFileDir needed to be included")
    sys.path.append(ghFileDir)

import splintcommon
reload(splintcommon) #FOR DEV

#splintcommon module is now available for use in this GhPython component
splintcommon.log(f'GhPython Node initialized at {time.ctime()}')

import FeatureIdentification
reload(FeatureIdentification) #FOR DEV
from FeatureIdentification import box_center_slice

import Rhino.Geometry as rg

# Get a slice plane at the center, facing +Y direction
slice_surface = box_center_slice(
    target_brep=target_brep,
    bbox_plane=bbox_plane,
    choose_side_vector=view_vector
)
# ---------- end box_center_slice_py_3 ----------
deconstruct_plane = DeconstructPlane(Plane=transform_3)  # -> Origin, XAxis, YAxis, ZAxis
deconstruct_plane_2 = DeconstructPlane(Plane=transform_4)  # -> Origin, XAxis, YAxis, ZAxis
box_center_slice_py_4 = Python3Script(target_brep=splint_brep_2, bbox_plane=transform_4, view_vector=rotate_2.Geometry)  # -> out, slice_surface; inputs target_brep: Brep, bbox_plane: Plane, view_vector: Vector3d; same code as box_center_slice_py_3
multiplication_6 = Multiplication(A=deconstruct_plane.ZAxis, B=mid_radius)
multiplication_7 = Multiplication(A=deconstruct_plane_2.ZAxis, B=mid_radius)
move_7 = Move(Geometry=box_center_slice_py_3.slice_surface, Motion=multiplication_6)  # -> Geometry, Transform
move_8 = Move(Geometry=box_center_slice_py_4.slice_surface, Motion=multiplication_7)  # -> Geometry, Transform
y_min_slice_surface = Surface(move_7.Geometry)
y_max_slice_surface = Surface(move_8.Geometry)
bottom_slicer_srf = Surface(move_6.Geometry)
joint_center_point_2 = Point(joint_center_point)
brep_curve = BrepCurve(Brep=y_max_slice_surface, Curve=tail_inner_curve_2)  # -> Curves, Points
brep_curve_2 = BrepCurve(Brep=y_max_slice_surface, Curve=tip_inner_curve_2)  # -> Curves, Points
brep_curve_3 = BrepCurve(Brep=bottom_slicer_srf, Curve=tip_outer_curve_2)  # -> Curves, Points
brep_curve_4 = BrepCurve(Brep=y_min_slice_surface, Curve=tail_inner_curve_2)  # -> Curves, Points
brep_curve_5 = BrepCurve(Brep=bottom_slicer_srf, Curve=tail_outer_curve_2)  # -> Curves, Points
brep_curve_6 = BrepCurve(Brep=y_min_slice_surface, Curve=tip_inner_curve_2)  # -> Curves, Points
tip_y_max_pt = Point(brep_curve_2.Points)
tip_bottom_mid_lip = Point(brep_curve_3.Points)
tail_y_max_pt = Point(brep_curve.Points)
tail_bottom_mid_lip = Point(brep_curve_5.Points)
tip_y_min_pt = Point(brep_curve_6.Points)
tail_y_min_pt = Point(brep_curve_4.Points)
cone_creator_cl = ConeCreatorCL(splint_center_point=joint_center_point_2, point_a=tip_y_min_pt, point_b=tip_bottom_mid_lip, point_c=tip_y_max_pt)
cone_creator_cl_2 = ConeCreatorCL(splint_center_point=joint_center_point_2, point_a=tail_y_max_pt, point_b=tail_bottom_mid_lip, point_c=tail_y_min_pt)
splint = Brep(splint_brep)
solid_difference = SolidDifference(BrepsA=splint, BrepsB=cone_creator_cl)
solid_difference_2 = SolidDifference(BrepsA=solid_difference, BrepsB=cone_creator_cl_2)

comfort_trimmed_splint_brep = Brep(solid_difference_2)
splint_brep_3 = Brep(splint_brep)

comfort_trimmed_splint_brep_2 = Brep(splint_brep_3)

comfort_trimmed_splint_brep_3 = Brep(comfort_trimmed_splint_brep_2)
merge_3 = Merge(Data1=comfort_trimmed_splint_brep_3)  # -> flatten(Result)
move_9 = Move(Geometry=merge_3, Motion="300, 0, 0")  # -> Geometry, Transform

# ----
# ID Embossing Gun
finishedsplintbrep_2 = Brep(comfort_trimmed_splint_brep_2)
wall_thickness_mm = Number(wall_thickness)
objectid_text = Text(reverse(objectid_2))
mid_r_3 = Number(mid_r)
lower_angle_from_lip = Slider(-15, range=-90..90)
yz_plane_2 = YZPlane(Origin=Point(0, 0, 0))
projection_centroid = Point(joint_centroid)
unit_x_5 = UnitX(Factor=1)
unit_y_5 = UnitY(Factor=1)
text_size = Slider(2.7, range=2.5..6)
multiplication_8 = Multiplication(A=mid_r_3, B=Slider(0.3, range=-1..1))
box_center_slice_py_5 = Python3Script(target_brep=finishedsplintbrep_2, view_vector=unit_x_5)  # -> out, slice_surface; inputs target_brep: Brep, view_vector: Vector3d; same code as box_center_slice_py
unit_z_6 = UnitZ(Factor=1)
unit_z_7 = UnitZ(Factor=multiplication_8)
north_star_nudge_2 = Panel("100")
move_10 = Move(Geometry=projection_centroid, Motion=unit_z_7)  # -> Geometry, Transform
text_size_2 = Number(text_size)
area_3 = Area(Geometry=box_center_slice_py_5.slice_surface)  # -> Area, Centroid
deconstruct_4 = Deconstruct(Point=area_3.Centroid)  # -> XComponent, YComponent, ZComponent
projection_centroid_2 = Point(move_10.Geometry)
deconstruct_5 = Deconstruct(Point=projection_centroid_2)  # -> XComponent, YComponent, ZComponent
construct_point_2 = ConstructPoint(XCoordinate=deconstruct_5.XComponent, YCoordinate=north_star_nudge_2, ZCoordinate=north_star_nudge_2)
construct_point_3 = ConstructPoint(XCoordinate=deconstruct_5.XComponent, YCoordinate=deconstruct_4.YComponent, ZCoordinate=deconstruct_4.ZComponent)
move_to_point_3 = MoveToPoint(Geometry=box_center_slice_py_5.slice_surface, PointA=area_3.Centroid, PointB=construct_point_3)  # -> Moved, Vector, Transform
brep_brep_5 = BrepBrep(BrepA=finishedsplintbrep_2, BrepB=move_to_point_3.Moved)  # -> Curves, Points
curve_closest_point_2 = CurveClosestPoint(Point=construct_point_2, Curve=brep_brep_5.Curves)  # -> Point, Parameter, Distance
line_11 = Line(StartPoint=projection_centroid_2, EndPoint=curve_closest_point_2.Point)
angle_2 = Angle(VectorA=unit_y_5, VectorB=line_11)  # -> Angle, Reflex
degrees = Degrees(Radians=angle_2.Angle)
negative_4 = Negative(Value=degrees)
addition = Addition(A=lower_angle_from_lip, B=negative_4)
rotate_3 = Rotate(Geometry=unit_y_5, Angle=degrees(addition), Plane=yz_plane_2)  # -> Geometry, Transform
transform_5 = Transform(Geometry=unit_z_6, Transform=rotate_3.Transform)
textgun_py = Python3Script(
    splint_brep=finishedsplintbrep_2,
    object_id=objectid_text,
    text_up_vector=transform_5,
    wall_thickness_mm=wall_thickness_mm,
    text_size=text_size_2,
    text_projection_vector=rotate_3.Geometry,
    extrusion_depth_factor="0.5",
    projection_origin=projection_centroid_2,
    x=Toggle(False))  # -> out, embossedBrep, originalTextBreps, final_text_plane, projected_letters; inputs splint_brep: Brep, object_id: String, text_up_vector: Vector3d, text_size: Double, text_projection_vector: Vector3d, extrusion_depth_factor: Double, projection_origin: Point3d
# ---------- textgun_py: Python ----------
# This file represents a stub for a GhPython component in Grasshopper.
# It sets up the environment to import and use the splintcommon or other external modules.

from pathlib import Path
import sys
from importlib import reload #FOR DEV ONLY
import time

# In normal GH doc
ghFileDir = None
try:
    ghFileDir = str(Path.joinpath(Path(ghenv.Component.OnPingDocument().FilePath).resolve().parents[0], "src"))
except:
    # In GH Cluster
    ghFileDir = str(Path.joinpath(Path(ghenv.Component.OnPingDocument().Owner.OnPingDocument().FilePath).resolve().parents[0], "src"))

print(f"{ghFileDir=}")

if ghFileDir not in sys.path:
    print("ghFileDir needed to be included")
    sys.path.append(ghFileDir)

import splintcommon
reload(splintcommon) #FOR DEV

#splintcommon module is now available for use in this GhPython component
splintcommon.log(f'GhPython Node initialized at {time.ctime()}')

import TextGun
reload(TextGun) #FOR DEV
from TextGun import emboss_text

embossedBrep, originalTextBreps, projected_letters, final_text_plane = emboss_text(
    target_brep=splint_brep,
    text_content=object_id,
    wall_thickness_mm=wall_thickness_mm,
    text_size=text_size,
    text_up_vector=text_up_vector,
    text_projection_vector=text_projection_vector,
    extrusion_depth_factor=extrusion_depth_factor,
    projection_origin=projection_origin,
    emboss_inside=True,
    align_to_surface_normal=True
)
# ---------- end textgun_py ----------
vizvector = VizVector(start=projection_centroid_2, direction=rotate_3.Geometry, arrowlen="5")  # -> cone_2, line, annotation_dot_2; disabled
vizvector_2 = VizVector(start=projection_centroid_2, direction=transform_5, arrowlen="5")  # -> cone_2, line, annotation_dot_2; disabled
vizplane = VizPlane(plane=rotate_3.Geometry)  # -> tip_2, line_2, annotation_dot_2; disabled
brep_2 = Brep(textgun_py.projected_letters)

finishedsplintbrep_3 = Brep(finishedsplintbrep_2)
splint_with_embossed_id = Brep(textgun_py.embossedBrep)

splint_with_embossed_id_2 = Brep(finishedsplintbrep_3)

# ----
# Slit
splint_brep_4 = Brep(splint_with_embossed_id_2)
slit_thickness = Panel("0.3")
include_slit_3 = Boolean(include_slit_2)
shortcircuit_slit_py = Python3Script(is_slit_active=include_slit_3, splint_brep=splint_brep_4)  # -> out, brep_to_slit, brep_to_shortcircuit; inputs is_slit_active: Boolean, splint_brep: Brep
# ---------- shortcircuit_slit_py: Python ----------
if is_slit_active:
    brep_to_slit = splint_brep
    brep_to_shortcircuit = None
else:
    brep_to_slit = None
    brep_to_shortcircuit = splint_brep
# ---------- end shortcircuit_slit_py ----------
unit_y_6 = UnitY(Factor=1)
box_center_slice_py_6 = Python3Script(target_brep=splint_brep_4, view_vector=unit_y_6)  # -> out, slice_surface, z_size; inputs target_brep: Brep, view_vector: Vector3d
# ---------- box_center_slice_py_6: Python ----------
# This file represents a stub for a GhPython component in Grasshopper.
# It sets up the environment to import and use the splintcommon or other external modules.

from pathlib import Path
import sys
from importlib import reload #FOR DEV
import time

# In normal GH doc
ghFileDir = None
try:
    ghFileDir = str(Path.joinpath(Path(ghenv.Component.OnPingDocument().FilePath).resolve().parents[0], "src"))
except:
    # In GH Cluster
    ghFileDir = str(Path.joinpath(Path(ghenv.Component.OnPingDocument().Owner.OnPingDocument().FilePath).resolve().parents[0], "src"))

print(f"{ghFileDir=}")

if ghFileDir not in sys.path:
    print("ghFileDir needed to be included")
    sys.path.append(ghFileDir)

import splintcommon
reload(splintcommon) #FOR DEV

#splintcommon module is now available for use in this GhPython component
splintcommon.log(f'GhPython Node initialized at {time.ctime()}')

import FeatureIdentification
reload(FeatureIdentification) #FOR DEV
from FeatureIdentification import box_center_slice

import Rhino.Geometry as rg

# Get a slice plane at the center, facing +Y direction
slice_surface = box_center_slice(
    target_brep=target_brep,
    bbox_plane=rg.Plane.WorldXY,
    choose_side_vector=view_vector
)

slice_surface, (x_size, y_size, z_size) = box_center_slice(
    target_brep=target_brep,
    bbox_plane=rg.Plane.WorldXY,
    choose_side_vector=view_vector,
    return_size=True
)

print(f"{z_size=}")
# ---------- end box_center_slice_py_6 ----------
multiplication_9 = Multiplication(A=box_center_slice_py_6.z_size, B="-0.7")
unit_z_8 = UnitZ(Factor=multiplication_9)
move_11 = Move(Geometry=box_center_slice_py_6.slice_surface, Motion=unit_z_8)  # -> Geometry, Transform
slitbot_py = Python3Script(splint_brep=shortcircuit_slit_py.brep_to_slit, slit_panel=move_11.Geometry, slit_thickness=slit_thickness)  # -> out, brep_out, flatten(side_a_edges), flatten(side_b_edges), side_a_cutter, side_b_cutter; inputs splint_brep: Brep, slit_panel: Brep, slit_thickness: Double
# ---------- slitbot_py: Python ----------
# This file represents a stub for a GhPython component in Grasshopper.
# It sets up the environment to import and use the splintcommon or other external modules.

from pathlib import Path
import sys
from importlib import reload #FOR DEV
import time

# Walk up through nested clusters to find the root GH document (necessary for use in nested clusters)
doc = ghenv.Component.OnPingDocument()
while not doc.FilePath and doc.Owner:
    doc = doc.Owner.OnPingDocument()
ghFileDir = str(Path(doc.FilePath).resolve().parent / "src")

print(f"{ghFileDir=}")

if ghFileDir not in sys.path:
    print("ghFileDir needed to be included")
    sys.path.append(ghFileDir)

import splintcommon
reload(splintcommon) #FOR DEV
from splintcommon import mark_generation_start
mark_generation_start()

#splintcommon module is now available for use in this GhPython component
splintcommon.log(f'GhPython Node initialized at {time.ctime()}')

#Component code here

import BrepSlit
reload(BrepSlit)
from BrepSlit import cut_slit

fillet_radius = 0.3

brep_out, side_a_edges, side_b_edges, side_a_cutter, side_b_cutter = cut_slit(splint_brep, slit_panel, slit_thickness, fillet_radius)

print(f"{side_a_edges=}")
print(f"{side_b_edges=}")
# ---------- end slitbot_py ----------
merge_4 = Merge(Data1=slitbot_py.side_a_edges, Data2=slitbot_py.side_b_edges)  # -> flatten(Result)
edge_curves = EdgeCurves(sharp_edge_indexes=merge_4, brep=slitbot_py.brep_out)
brep_3 = Brep(slitbot_py.side_a_cutter)
brep_4 = Brep(slitbot_py.side_b_cutter)
shortcircuit_slit_py_2 = Python3Script(is_slit_active=include_slit_3, slit_brep=slitbot_py.brep_out, splint_brep=shortcircuit_slit_py.brep_to_shortcircuit)  # -> out, out_brep; inputs is_slit_active: Boolean, slit_brep: Brep, splint_brep: Brep
# ---------- shortcircuit_slit_py_2: Python ----------
print(f"{is_slit_active=}")
if is_slit_active:
    print("Returning the slit brep")
    out_brep = slit_brep
else:
    print("Returning the boring splint")
    out_brep = splint_brep
# ---------- end shortcircuit_slit_py_2 ----------
splint_brep_w_slit = Brep(shortcircuit_slit_py_2.out_brep)
slit_sharp_edges = Curve(edge_curves)

panel_8 = Panel(textgun_py.out)
panel_9 = Panel(slitbot_py.out)
splint_brep_5 = Brep(splint_brep_4)
bounding_box_2 = BoundingBox(Content=splint_brep_5, Plane=PlaneXY(0, 0, 0))  # -> Box, Box_2
volume_3 = Volume(Geometry=bounding_box_2.Box)  # -> Volume, Centroid
yz_plane_3 = YZPlane(Origin=volume_3.Centroid)
rotate_4 = Rotate(Geometry=splint_brep_5, Angle=degrees("-90"), Plane=yz_plane_3)  # -> Geometry, Transform
addition_2 = Addition(A=volume_3.Centroid, B=point_3)

# ----
# Orienting To Build Plate
# Tip Slant Line, describes the angle necessary to bring the front cut line of the splint down to the build platform.
tip_slant_line_4 = Line(tip_slant_line_2)
finishedsplint = Brep(splint_brep_w_slit)
X = UnitX(Factor=1)
flip = FlipCurve(Curve=tip_slant_line_4)  # -> Curve, Flag
xz = XZPlane(Origin=Point(0, 0, 0))
end = EndPoints(Curve=flip.Curve)  # -> Start, End
angle_3 = Angle(VectorA=flip.Curve, VectorB=X, Plane=xz)  # -> Angle, Reflex
neg = Negative(Value=angle_3.Angle)
pt = Point(end.Start)
pt_2 = Point(end.End)
pl_origin = PlaneOrigin(Base=xz, Origin=pt)
rotate_5 = Rotate(Geometry=finishedsplint, Angle=angle_3.Angle, Plane=pl_origin)  # -> Geometry, Transform
orientedsplint = Brep(rotate_5.Geometry)

deconstruct_6 = Deconstruct(Point=addition_2)  # -> XComponent, YComponent, ZComponent
construct_point_4 = ConstructPoint(XCoordinate=deconstruct_2.XComponent, YCoordinate=deconstruct_6.YComponent, ZCoordinate=deconstruct_6.ZComponent)
move_to_point_4 = MoveToPoint(Geometry=rotate_4.Geometry, PointA=volume_3.Centroid, PointB=construct_point_4)  # -> Moved, Vector, Transform
brep_5 = Brep(move_to_point_4.Moved)
merge_5 = Merge(Data1=brep_5, Data2=brep)  # -> flatten(Result)

# ----
# Final Joining
# And Smoothing
# Bake Me
number_slider = Slider(0.12, range=0.05..0.2)
orientedsplint_2 = Brep(orientedsplint)
shrinkwrap = ShrinkWrap(
    Geometry=orientedsplint_2,
    EdgeLength=number_slider,
    Offset=0,
    Smoothing=Slider(8, range=0..10),
    Optimization=10,
    FillHoles=True)
final_smooth_splint = Mesh(shrinkwrap)

solid_union_2 = SolidUnion(Breps=merge_5)
move_12 = Move(Geometry=solid_union_2, Motion="0, 100, 0")  # -> Geometry, Transform
splint_with_embossed_id_3 = Brep(splint_with_embossed_id_2)
splint_body_smooth = Mesh(splint_brep_w_slit)
savemeshpy_2 = Python3Script(
    geo_input=final_smooth_splint,
    output_dir=output_dir_out_2,
    root_filename=root_filename_out_2,
    bool_activate=dev_activate_toggle)  # -> out; inputs geo_input: Mesh
# ---------- savemeshpy_2: Python ----------
# This file represents a stub for a GhPython component in Grasshopper.
# It sets up the environment to import and use the splintcommon or other external modules.

from pathlib import Path
import sys
from importlib import reload #FOR DEV
import time

# Walk up through nested clusters to find the root GH document (necessary for use in nested clusters)
doc = ghenv.Component.OnPingDocument()
while not doc.FilePath and doc.Owner:
    doc = doc.Owner.OnPingDocument()
ghFileDir = str(Path(doc.FilePath).resolve().parent / "src")

print(f"{ghFileDir=}")

if ghFileDir not in sys.path:
    print("ghFileDir needed to be included")
    sys.path.append(ghFileDir)

import splintcommon
reload(splintcommon) #FOR DEV
from splintcommon import log

#splintcommon module is now available for use in this GhPython component
splintcommon.log(f'GhPython Node initialized at {time.ctime()}')

#Your code here

import splintmeshes
reload(splintmeshes)

# With error handling
try:
    log(f"Logging to {output_dir=} {root_filename=}")
    splintmeshes.save_mesh(geo_input, output_dir, root_filename, format_type="stl")
    log("Export succeeded")
except splintmeshes.MeshExportError as e:
    log("Export failed: {}".format(e))
except ValueError as e:
    log("Bad input: {}".format(e))
# ---------- end savemeshpy_2 ----------
merge_6 = Merge(Data1=splint_with_embossed_id_3)  # -> flatten(Result)
merge_7 = Merge(Data1=splint_body_smooth)  # -> flatten(Result)
panel_10 = Panel(savemeshpy_2)
move_13 = Move(Geometry=merge_6, Motion="350, 0, 0")  # -> Geometry, Transform
move_14 = Move(Geometry=merge_7, Motion="400, 0, 0")  # -> Geometry, Transform

# ----
# Preview Steps
splint_body_direction_indicator = Brep(finishedsplintbrep)
side_cutter_volume_2 = Brep(side_cutter_volume)
preform_barrel = Brep(material_shell_brep_3)
side_cutter_surface_2 = Surface(side_cutter_surface)
inner_finger_form = Brep(inner_shell_brep_3)
splint_body_smooth_2 = Mesh(final_smooth_splint)
merge_8 = Merge(Data1=preform_barrel, Data2=side_cutter_surface_2)  # -> flatten(Result)
merge_9 = Merge(Data1=preform_barrel, Data2=side_cutter_volume_2)  # -> flatten(Result)
merge_10 = Merge(Data1=splint_body_direction_indicator)  # -> flatten(Result)
merge_11 = Merge(Data1=splint_body_smooth_2)  # -> flatten(Result)
move_15 = Move(Geometry=merge_8, Motion="120, 0, 0")  # -> Geometry, Transform
move_16 = Move(Geometry=inner_finger_form, Motion="60, 0, 0")  # -> Geometry, Transform
move_17 = Move(Geometry=merge_9, Motion="180, 0, 0")  # -> Geometry, Transform
move_18 = Move(Geometry=merge_10, Motion="240, 0, 0")  # -> Geometry, Transform
move_19 = Move(Geometry=merge_11, Motion="450, 0, 0")  # -> Geometry, Transform
merge_12 = Merge(
    Data1=move_16.Geometry,
    Data2=move_15.Geometry,
    Data3=move_17.Geometry,
    Data4=move_18.Geometry,
    Data5=move_9.Geometry,
    Data6=move_13.Geometry,
    Data7=move_14.Geometry,
    Data8=move_19.Geometry)  # -> flatten(Result)
random_color = RandomColor(Data=merge_12, Seed=2, FastMode=False)
custom_preview = CustomPreview(Geometry=merge_12, Material=random_color)

# ==== cluster ReliableUnionCL
# Trim Solid is not always working
seam_alignment_line = ClusterInput()  # disabled
join_axis_vector = ClusterInput()  # disabled
brep1 = ClusterInput()
brep2 = ClusterInput()
brep1_2 = Brep(brep1)
brep2_2 = Brep(brep2)
seam_alignment_line_2 = Line(seam_alignment_line)  # disabled
join_axis_vector_2 = Vector(join_axis_vector)  # disabled
number_slider = Slider(0, range=0..1)  # disabled
reverse = Reverse(Vector=join_axis_vector_2)  # disabled
brepunion = Python3Script(BrepA=brep1_2, BrepB=brep2_2)  # -> UnionReport, UnionResult; inputs BrepA: Brep, BrepB: Brep
# ---------- brepunion: Python ----------
# This file represents a stub for a GhPython component in Grasshopper.
# It sets up the environment to import and use the splintcommon or other external modules.

from pathlib import Path
import sys
from importlib import reload #FOR DEV ONLY
import time

# In normal GH doc
ghFileDir = None
try:
    ghFileDir = str(Path.joinpath(Path(ghenv.Component.OnPingDocument().FilePath).resolve().parents[0], "src"))
except:
    # In GH Cluster
    ghFileDir = str(Path.joinpath(Path(ghenv.Component.OnPingDocument().Owner.OnPingDocument().FilePath).resolve().parents[0], "src"))

print(f"{ghFileDir=}")

if ghFileDir not in sys.path:
    print("ghFileDir needed to be included")
    sys.path.append(ghFileDir)

import splintcommon
reload(splintcommon) #FOR DEV ONLY

#splintcommon module is now available for use in this GhPython component
splintcommon.log(f'GhPython Node initialized at {time.ctime()}')

import BrepUnion
reload(BrepUnion)

UnionResult, success, method_used = BrepUnion.robust_brep_union(BrepA, BrepB)

if not success:
    raise Exception(f"Union failed! {method_used}")
# ---------- end brepunion ----------
panel = Panel(brepunion.UnionReport)
merge = Merge(Data1=brep1_2, Data2=brep2_2)  # -> flatten(Result); disabled
unionresult = ClusterOutput(brepunion.UnionResult)  # disabled
unionreport = ClusterOutput(brepunion.UnionReport)
solid_union = SolidUnion(Breps=merge)  # -> flatten(Result); disabled
panel_2 = Panel(solid_union)  # disabled
brepinspect = Python3Script(brepToTest=solid_union)  # -> out, isUsable; inputs brepToTest: Brep; disabled
# ---------- brepinspect: Python ----------
# This file represents a stub for a GhPython component in Grasshopper.
# It sets up the environment to import and use the splintcommon or other external modules.

from pathlib import Path
import sys
from importlib import reload #FOR DEV ONLY
import time

# In normal GH doc
#ghFileDir = str(Path.joinpath(Path(ghenv.Component.OnPingDocument().FilePath).resolve().parents[0], "src"))
# In GH Cluster
ghFileDir = str(Path.joinpath(Path(ghenv.Component.OnPingDocument().Owner.OnPingDocument().FilePath).resolve().parents[0], "src"))

print(f"{ghFileDir=}")

if ghFileDir not in sys.path:
    print("ghFileDir needed to be included")
    sys.path.append(ghFileDir)

import splintcommon
reload(splintcommon) #FOR DEV ONLY

#splintcommon module is now available for use in this GhPython component
splintcommon.log(f'GhPython Node initialized at {time.ctime()}')

import BrepInspect
reload(BrepInspect)

isUsable = BrepInspect.inspect_solid_brep(brepToTest)
# ---------- end brepinspect ----------
check_1_exists = Python3Script(geo=solid_union)  # -> out, doesExist, doesntExist; inputs geo: list of GeometryBase; disabled
# ---------- check_1_exists: Python ----------
from Rhino.Geometry import Brep

print(f"{geo=} type={type(geo)} v1.00")

isExisting = False

if geo is None:
    print("geo is None (root)")
    isExisting = False
elif type(geo) is Brep:
    print("geo is Brep. Yay.")
    isExisting = True
elif hasattr(geo, '__getitem__'):
    print(f"geo len={len(geo)}")
    if len(geo) > 0 and geo[0] is None:
        print(f"geo[0] is None len={len(geo)}")
        isExisting = False
    else:
        isExisting = len(geo) == 1
        print(f"geo is list of {len(geo)} len. {isExisting=}")
else:
    print("fall through no recognized type")

doesExist = isExisting
doesntExist = not isExisting
print(f"{doesExist=} {doesntExist=}")
# ---------- end check_1_exists ----------
pass_items_py = Python3Script(passItems=check_1_exists.doesntExist, brep1=brep1_2, brep2=brep2_2)  # -> out, out_brep1, out_brep2; inputs brep1: Brep, brep2: Brep; disabled
# ---------- pass_items_py: Python ----------
if passItems:
    out_brep1 = brep1
    out_brep2 = brep2
    print("Items passed")
else:
    out_brep1 = None
    out_brep2 = None
    print("Items not passed")
# ---------- end pass_items_py ----------
panel_3 = Panel(pass_items_py.out)  # disabled
brepunion_2 = Python3Script(BrepA=pass_items_py.out_brep1, BrepB=pass_items_py.out_brep2)  # -> out, UnionResult; inputs BrepA: Brep, BrepB: Brep; disabled
# ---------- brepunion_2: Python ----------
# This file represents a stub for a GhPython component in Grasshopper.
# It sets up the environment to import and use the splintcommon or other external modules.

from pathlib import Path
import sys
from importlib import reload #FOR DEV ONLY
import time

# In normal GH doc
ghFileDir = None
try:
    ghFileDir = str(Path.joinpath(Path(ghenv.Component.OnPingDocument().FilePath).resolve().parents[0], "src"))
except:
    # In GH Cluster
    ghFileDir = str(Path.joinpath(Path(ghenv.Component.OnPingDocument().Owner.OnPingDocument().FilePath).resolve().parents[0], "src"))

print(f"{ghFileDir=}")

if ghFileDir not in sys.path:
    print("ghFileDir needed to be included")
    sys.path.append(ghFileDir)

import splintcommon
reload(splintcommon) #FOR DEV ONLY

#splintcommon module is now available for use in this GhPython component
splintcommon.log(f'GhPython Node initialized at {time.ctime()}')

import BrepUnion
reload(BrepUnion)

UnionResult = BrepUnion.robust_brep_union(BrepA, BrepB)
# ---------- end brepunion_2 ----------
panel_4 = Panel(brepunion_2.out)  # disabled
check_1_exists_2 = Python3Script(geo=brepunion_2.UnionResult)  # -> out, doesExist, doesntExist; inputs geo: list of GeometryBase; disabled; same code as check_1_exists
pass_items_py_2 = Python3Script(passItems=check_1_exists_2.doesntExist, brep1=brep1_2, brep2=brep2_2)  # -> out, out_brep1, out_brep2; inputs brep1: Brep, brep2: Brep; disabled; same code as pass_items_py
python_3_script = Python3Script(BrepA=pass_items_py_2.out_brep1, BrepB=pass_items_py_2.out_brep2)  # -> out, FixedBrepA, FixedBrepB, UnionResult; inputs BrepA: Brep, BrepB: Brep; disabled
# ---------- python_3_script: Python ----------
# This file represents a stub for a GhPython component in Grasshopper.
# It sets up the environment to import and use the splintcommon or other external modules.

from pathlib import Path
import sys
from importlib import reload #FOR DEV ONLY
import time

# print("DEBUG")
# print(ghenv.Component.OnPingDocument().Owner.OnPingDocument())
# print("DEBUG END")

ghFileDir = str(Path.joinpath(Path(ghenv.Component.OnPingDocument().Owner.OnPingDocument().FilePath).resolve().parents[0], "src"))
print(f"{ghFileDir=}")

if ghFileDir not in sys.path:
    print("ghFileDir needed to be included")
    sys.path.append(ghFileDir)

import splintcommon
reload(splintcommon) #FOR DEV ONLY

#splintcommon module is now available for use in this GhPython component
splintcommon.log(f'GhPython Node initialized at {time.ctime()}')

import BooleanUnionDiagnostic
reload(BooleanUnionDiagnostic)

FixedBrepA, FixedBrepB, UnionResult = BooleanUnionDiagnostic.do_diagnostic_solid_union(BrepA, BrepB, None, True)
# ---------- end python_3_script ----------
panel_5 = Panel(pass_items_py_2.out)  # disabled
panel_6 = Panel(python_3_script.out)  # disabled
deconstruct_brep = DeconstructBrep(Brep=python_3_script.FixedBrepA)  # -> Faces, Edges, Vertices; disabled
deconstruct_brep_2 = DeconstructBrep(Brep=python_3_script.FixedBrepB)  # -> Faces, Edges, Vertices; disabled
brep_join = BrepJoin(Breps=deconstruct_brep_2.Faces)  # -> Breps, Closed; disabled
brep_join_2 = BrepJoin(Breps=deconstruct_brep.Faces)  # -> Breps, Closed; disabled
merge_2 = Merge(Data1=brep_join_2.Breps, Data2=brep_join.Breps)  # -> flatten(Result); disabled
solid_union_2 = SolidUnion(Breps=merge_2)  # -> flatten(Result); disabled
panel_7 = Panel(brepinspect.isUsable)  # disabled
loft_options = LoftOptions(Closed=False, Adjust=False, Rebuild=0, Refit=0, Type=0)  # disabled
panel_8 = Panel(check_1_exists.out)  # disabled
panel_9 = Panel(check_1_exists.doesntExist)  # disabled
panel_10 = Panel(solid_union_2)  # disabled
panel_11 = Panel(brepinspect.out)  # disabled
check_1_exists_3 = Python3Script(geo=solid_union_2)  # -> out, doesExist, doesntExist; inputs geo: list of GeometryBase; disabled; same code as check_1_exists
pass_items_py_3 = Python3Script(passItems=check_1_exists_3.doesntExist, brep1=brep1_2, brep2=brep2_2)  # -> out, out_brep1, out_brep2; inputs brep1: Brep, brep2: Brep; disabled; same code as pass_items_py
trim_solid = TrimSolid(Shape=pass_items_py_3.out_brep2, Cutters=pass_items_py_3.out_brep1)  # disabled
trim_solid_2 = TrimSolid(Shape=pass_items_py_3.out_brep1, Cutters=pass_items_py_3.out_brep2)  # disabled
list_item = ListItem(List=trim_solid, Index=number_slider, Wrap=True)  # disabled
directional_trim = DirectionalTrim(single_opening_brep=trim_solid_2, trim_shift_vector=join_axis_vector_2)  # -> trimmed_brep_2, naked_curve; disabled
directional_trim_2 = DirectionalTrim(single_opening_brep=list_item, trim_shift_vector=reverse)  # -> flatten(trimmed_brep_2), naked_curve; disabled
curve = Curve(directional_trim_2.naked_curve)  # disabled
curve_2 = Curve(directional_trim.naked_curve)  # disabled
flip_curve = FlipCurve(Curve=curve, Guide=curve_2)  # -> Curve, Flag; disabled
merge_3 = Merge(Data1=curve_2, Data2=flip_curve.Curve)  # -> flatten(Result); disabled
trimmed_brep = Brep(directional_trim_2.trimmed_brep_2)  # disabled
trimmed_brep_2 = Brep(directional_trim.trimmed_brep_2)  # disabled
curve_align_curve_seams = CurveAlignCurveSeams(Curves=merge_3, Guide=seam_alignment_line_2, Snap=False)  # -> Aligned, Points, ResultBoolean; disabled
loft = Loft(Curves=curve_align_curve_seams.Aligned, Options=loft_options)  # disabled
merge_4 = Merge(Data1=trimmed_brep_2, Data2=loft, Data3=trimmed_brep)  # -> flatten(Result); disabled
brep_join_3 = BrepJoin(Breps=merge_4)  # -> Breps, Closed; disabled
panel_12 = Panel(check_1_exists_2.out)  # disabled
panel_13 = Panel(check_1_exists_2.doesntExist)  # disabled
list_item_2 = ListItem(List=brep_join_3.Breps, Index=0, Wrap=True)  # disabled
check_1_exists_4 = Python3Script(geo=list_item_2)  # -> out, doesExist, doesntExist; inputs geo: list of GeometryBase; disabled; same code as check_1_exists
python_3_script_2 = Python3Script(
    method0Exists=check_1_exists.doesExist,
    method0Geo=solid_union,
    method1Exists=check_1_exists_2.doesExist,
    method1Geo=brepunion_2.UnionResult,
    method2Exists=check_1_exists_3.doesExist,
    method2Geo=solid_union_2,
    method3Exists=check_1_exists_4.doesExist,
    method3Geo=list_item_2)  # -> out, result; inputs method0Exists: Boolean, method0Geo: GeometryBase, method1Exists: Boolean, method1Geo: GeometryBase, method2Exists: Boolean, method2Geo: GeometryBase, method3Geo: GeometryBase; disabled
# ---------- python_3_script_2: Python ----------
if method0Exists:
    result = method0Geo
    print("Method 0 Wins")
elif method1Exists:
    result = method1Geo
    print("Method 1 Wins")
elif method2Exists:
    result = method2Geo
    print("Method 2 Wins")
elif method3Exists:
    result = method3Geo
    print("Method 3 Wins")
else:
    print("NOTHING WORKED!!!")
# ---------- end python_3_script_2 ----------

# ==== cluster ConeCreatorCL
splint_center_point = ClusterInput()
point_a = ClusterInput()
point_b = ClusterInput()
point_c = ClusterInput()
splint_center_point_2 = Point(splint_center_point)
point_a_2 = Point(point_a)
point_b_2 = Point(point_b)
point_c_2 = Point(point_c)
ext_ln_pts = ExtLnPts(startpoint=splint_center_point_2, midpoint=point_a_2, extensiondist="10")  # -> end_point_2, extend_line_2
ext_ln_pts_2 = ExtLnPts(startpoint=splint_center_point_2, midpoint=point_b_2, extensiondist="10")  # -> end_point_2, extend_line_2
ext_ln_pts_3 = ExtLnPts(startpoint=splint_center_point_2, midpoint=point_c_2, extensiondist="10")  # -> end_point_2, extend_line_2
reparameterize_curve = ReparameterizeCurve(Curve=ext_ln_pts.extend_line_2)  # -> Reparameterized, Original
reparameterize_curve_2 = ReparameterizeCurve(Curve=ext_ln_pts_2.extend_line_2)  # -> Reparameterized, Original
reparameterize_curve_3 = ReparameterizeCurve(Curve=ext_ln_pts_3.extend_line_2)  # -> Reparameterized, Original
evaluate_curve = EvaluateCurve(Curve=reparameterize_curve_3.Reparameterized, Parameter="0.1")  # -> Point, Tangent, Angle
evaluate_curve_2 = EvaluateCurve(Curve=reparameterize_curve_2.Reparameterized, Parameter="0.1")  # -> Point, Tangent, Angle
evaluate_curve_3 = EvaluateCurve(Curve=reparameterize_curve.Reparameterized, Parameter="0.1")  # -> Point, Tangent, Angle
point_ax = Point(ext_ln_pts.end_point_2)
point_cx = Point(ext_ln_pts_3.end_point_2)
point_ax_2 = Point(evaluate_curve_3.Point)
point_bx = Point(evaluate_curve_2.Point)
point_cx_2 = Point(evaluate_curve.Point)
point_bx_2 = Point(ext_ln_pts_2.end_point_2)
circle_3pt = Circle3Pt(PointA=point_cx_2, PointB=point_bx, PointC=point_ax_2)  # -> Circle, Plane, Radius
circle_3pt_2 = Circle3Pt(PointA=point_cx, PointB=point_bx_2, PointC=point_ax)  # -> Circle, Plane, Radius
merge = Merge(Data1=circle_3pt.Circle, Data2=circle_3pt_2.Circle)
loft = Loft(Curves=merge, Options={Adjust=False, Closed=False, LoftEnds=0, LoftSimp=0, LoftType=0, Rebuild=10, Refit=0.01})
cap_holes = CapHoles(Brep=loft)
brep = ClusterOutput(cap_holes)

# ==== cluster VizVector
arrowlen = ClusterInput()
text = ClusterInput()
arrowlen_2 = Number(arrowlen)
text_2 = Text(text)
start = ClusterInput()
direction = ClusterInput()
division = Division(A=arrowlen_2, B="4")
line_sdl = LineSDL(Start=start, Direction=direction, Length=arrowlen_2)
end_points = EndPoints(Curve=line_sdl)  # -> Start, End
line = ClusterOutput(line_sdl)
plane_normal = PlaneNormal(Origin=end_points.End, ZAxis=line_sdl)
annotation_dot = AnnotationDot(Location=end_points.End, PrimaryText=text_2)  # -> AnnotationDot, Location, PrimaryText, TextHeight
cone = Cone(Base=plane_normal, Radius=division, Length=division)  # -> Cone, Tip
cone_2 = ClusterOutput(cone.Cone)
annotation_dot_2 = ClusterOutput(annotation_dot.AnnotationDot)

# ==== cluster VizPlane
plane = ClusterInput()
deconstruct_plane = DeconstructPlane(Plane=plane)  # -> Origin, XAxis, YAxis, ZAxis
arrow = VizVector(start=deconstruct_plane.Origin, direction=deconstruct_plane.XAxis, arrowlen="3", text="X")  # -> cone_2, line, annotation_dot_2
arrow_2 = VizVector(start=deconstruct_plane.Origin, direction=deconstruct_plane.YAxis, arrowlen="3", text="Y")  # -> cone_2, line, annotation_dot_2
arrow_3 = VizVector(start=deconstruct_plane.Origin, direction=deconstruct_plane.ZAxis, arrowlen="3", text="Z")  # -> cone_2, line, annotation_dot_2
tip = Brep([arrow.cone_2, arrow_2.cone_2, arrow_3.cone_2])
line = Line([arrow.line, arrow_2.line, arrow_3.line])
annotation_dot = AnnotationDot([arrow.annotation_dot_2, arrow_2.annotation_dot_2, arrow_3.annotation_dot_2])
tip_2 = ClusterOutput(tip)
line_2 = ClusterOutput(line)
annotation_dot_2 = ClusterOutput(annotation_dot)

# ==== cluster BrepRefPointCL
nudge_amount = ClusterInput()
north_star_pt = ClusterInput()
brep = ClusterInput()
north_star_pt_2 = Point(north_star_pt)
brep_2 = Brep(brep)
nudge_amount_2 = Point(nudge_amount)
brep_closest_point = BrepClosestPoint(Point=north_star_pt_2, Brep=brep_2)  # -> Point, Normal, Distance
origin = Panel("0, 0, 0")
point = Point(origin)
distance = ClusterOutput(brep_closest_point.Distance)
move_to_point = MoveToPoint(Geometry=brep_closest_point.Point, PointA=point, PointB=nudge_amount_2)  # -> Moved, Vector, Transform
result_point = Point(move_to_point.Moved)
result_point_2 = ClusterOutput(result_point)

# ==== cluster LineToBrepGravitationCL
output_nudge_motion = ClusterInput()
input_line = ClusterInput()
input_brep = ClusterInput()
output_nudge_motion_2 = Point(output_nudge_motion)
input_line_2 = Curve(input_line)
input_brep_2 = Brep(input_brep)
# USAGE NOTE: The Radar line must be outside of the brep in consideration for this to work
construct_domain = ConstructDomain(DomainStart=0, DomainEnd=1)
radar_node_count = Panel("5")
reparameterize_curve = ReparameterizeCurve(Curve=input_line_2)  # -> Reparameterized, Original
range = Range(Domain=construct_domain, Steps=radar_node_count)
params = Number(range)
perp_frame = PerpFrame(Curve=reparameterize_curve.Reparameterized, Parameter=params)
evaluate_curve = EvaluateCurve(Curve=reparameterize_curve.Reparameterized, Parameter=params)  # -> Point, Tangent, Angle
brep_plane = BrepPlane(Brep=input_brep_2, Plane=perp_frame)  # -> flatten(Curves), Points
curve_closest_point = CurveClosestPoint(Point=evaluate_curve.Point, Curve=brep_plane.Curves)  # -> flatten(Point), Parameter, flatten(Distance)
input_brep_3 = Brep(input_brep_2)  # disabled
number = Number(curve_closest_point.Distance)  # disabled
point = Point(curve_closest_point.Point)  # disabled
panel = Panel("0")  # disabled
number_2 = Number(curve_closest_point.Distance)
point_2 = Point(curve_closest_point.Point)
sort_list = SortList(Keys=number, ValuesValuesA=point)  # -> Keys, ValuesValuesA; disabled
panel_2 = Panel("0")  # disabled
evaluate_curve_2 = EvaluateCurve(Curve=reparameterize_curve.Reparameterized, Parameter=panel)  # -> Point, Tangent, Angle; disabled
sort_list_2 = SortList(Keys=number_2, ValuesValuesA=point_2)  # -> Keys, ValuesValuesA
list_item = ListItem(List=sort_list.ValuesValuesA, Index=panel_2, Wrap=True)  # disabled
evaluate_curve_3 = EvaluateCurve(Curve=reparameterize_curve.Reparameterized, Parameter="0")  # -> Point, Tangent, Angle
list_item_2 = ListItem(List=sort_list_2.ValuesValuesA, Index="0", Wrap=True)
line_start_point = Point(evaluate_curve_2.Point)  # disabled
deconstruct = Deconstruct(Point=point)  # -> XComponent, YComponent, ZComponent; disabled
line_start_point_2 = Point(evaluate_curve_3.Point)
deconstruct_2 = Deconstruct(Point=list_item_2)  # -> XComponent, YComponent, ZComponent
deconstruct_3 = Deconstruct(Point=line_start_point)  # -> XComponent, YComponent, ZComponent; disabled
panel_3 = Panel("0, 0, 0")  # disabled
deconstruct_4 = Deconstruct(Point=line_start_point_2)  # -> XComponent, YComponent, ZComponent
output_nudge_motion_3 = Point(output_nudge_motion_2)  # disabled
construct_point = ConstructPoint(XCoordinate=deconstruct_3.XComponent, YCoordinate=deconstruct_3.YComponent, ZCoordinate=deconstruct.ZComponent)  # disabled
origin_point = Point(panel_3)  # disabled
output_nudge_motion_4 = Point(output_nudge_motion_2)
construct_point_2 = ConstructPoint(XCoordinate=deconstruct_4.XComponent, YCoordinate=deconstruct_4.YComponent, ZCoordinate=deconstruct_2.ZComponent)
origin_point_2 = Point("0, 0, 0")
move_to_point = MoveToPoint(Geometry=construct_point, PointA=origin_point, PointB=output_nudge_motion_3)  # -> Moved, Vector, Transform; disabled
move_to_point_2 = MoveToPoint(Geometry=construct_point_2, PointA=origin_point_2, PointB=output_nudge_motion_4)  # -> Moved, Vector, Transform
destination_point = Point(move_to_point.Moved)  # disabled
destination_point_2 = Point(move_to_point_2.Moved)
move_to_point_3 = MoveToPoint(Geometry=reparameterize_curve.Reparameterized, PointA=line_start_point, PointB=destination_point)  # -> Moved, Vector, Transform; disabled
move_to_point_4 = MoveToPoint(Geometry=reparameterize_curve.Reparameterized, PointA=line_start_point_2, PointB=destination_point_2)  # -> Moved, Vector, Transform
brep_curve = BrepCurve(Brep=input_brep_3, Curve=move_to_point_3.Moved)  # -> Curves, Points; disabled
list_length = ListLength(List=brep_curve.Points)  # disabled
panel_4 = Panel("0")  # disabled
bottom_band = Curve(move_to_point_4.Moved)
equality = Equality(FirstNumber=flatten(list_length), SecondNumber=panel_4)  # -> Equality, Inequality; disabled
bottom_band_2 = ClusterOutput(bottom_band)
larger_than = LargerThan(FirstNumber=list_length, SecondNumber=panel_4)  # -> LargerThan, OrEqualTo; disabled
panel_5 = Panel(larger_than.LargerThan)  # disabled
cull_pattern = CullPattern(List=move_to_point_3.Moved, CullPattern=flatten(equality.Equality))  # disabled

# ==== cluster EdgeCurves
brep = ClusterInput()
deconstruct_brep = DeconstructBrep(Brep=brep)  # -> Faces, Edges, Vertices
sharp_edge_indexes = ClusterInput()
list_item = ListItem(List=deconstruct_brep.Edges, Sharp_edge_indexes=sharp_edge_indexes, Wrap=True)
sharp_edge_curves = Curve(list_item)
sharp_edge_curves_2 = ClusterOutput(sharp_edge_curves)

# ==== cluster DirectionalTrim
trim_shift_vector = ClusterInput()
single_opening_brep = ClusterInput()
single_opening_brep_2 = Brep(single_opening_brep)
trim_shift_vector_2 = Vector(trim_shift_vector)
brep_edges = BrepEdges(Brep=single_opening_brep_2)  # -> Naked, Interior, NonManifold
unit_vector = UnitVector(Vector=trim_shift_vector_2)
reverse = Reverse(Vector=unit_vector)
curve = Curve(flatten(brep_edges.Naked))
join_curves = JoinCurves(Curves=curve, Preserve=False)
point = Point("0, 0, 0")
multiplication = Multiplication(A=reverse, B="1000")
multiplication_2 = Multiplication(A=unit_vector, B="1000")
move = Move(Geometry=point, Motion=multiplication)  # -> Geometry, Transform
reparameterize_curve = ReparameterizeCurve(Curve=join_curves)  # -> Reparameterized, Original
line = Line(StartPoint=multiplication, EndPoint=multiplication_2)
divide_curve = DivideCurve(Curve=reparameterize_curve.Reparameterized, Count="10", Kinks=False)  # -> flatten(Points), Tangents, Parameters
plane_fit = PlaneFit(Points=divide_curve.Points)  # -> Plane, Deviation
move_2 = Move(Geometry=plane_fit.Plane, Motion=trim_shift_vector_2)  # -> Geometry, Transform
brep_plane = BrepPlane(Brep=single_opening_brep_2, Plane=move_2.Geometry)  # -> Curves, Points
split_brep = SplitBrep(Brep=single_opening_brep_2, Cutter=brep_plane.Curves)
bounding_box = BoundingBox(Content=split_brep, Plane=PlaneXY(0, 0, 0))  # -> Box, Box_2
volume = Volume(Geometry=bounding_box.Box)  # -> Volume, Centroid
sort_along_curve = SortAlongCurve(Points=volume.Centroid, Curve=line)  # -> Points, Indices
list_item = ListItem(List=sort_along_curve.Indices, Index="-1", Wrap=Toggle(True))
list_item_2 = ListItem(List=split_brep, Index=list_item, Wrap=True)
trimmed_brep = Brep(list_item_2)
brep_edges_2 = BrepEdges(Brep=trimmed_brep)  # -> Naked, Interior, NonManifold
join_curves_2 = JoinCurves(Curves=brep_edges_2.Naked, Preserve=False)
naked_curve = ClusterOutput(join_curves_2)
trimmed_brep_2 = ClusterOutput(trimmed_brep)

# ==== cluster ExtLnPts
extensiondist = ClusterInput()
startpoint = ClusterInput()
midpoint = ClusterInput()
midpoint_2 = Point(midpoint)
startpoint_2 = Point(startpoint)
extensiondist_2 = Number(extensiondist)
line = Line(StartPoint=startpoint_2, EndPoint=midpoint_2)
extend_curve = ExtendCurve(Curve=line, Type=0, Start="0", End=extensiondist_2)
end_points = EndPoints(Curve=extend_curve)  # -> Start, End
extend_line = Line(extend_curve)
end_point = Point(end_points.End)
end_point_2 = ClusterOutput(end_point)
extend_line_2 = ClusterOutput(extend_line)
