# Grasshopper definition SizingRings.gh (Grasshopper 1.0.8)
# plug-ins: Pufferfish, PTComponentLibrary, Wombat

geo_algorithm_name = Panel("BuddyRingsDuo")  # disabled
is_production_mode = BooleanToggle(True)  # disabled
toggle_job_make_it_go = BooleanToggle(True)  # disabled
axial_band_thickness_mm = Panel("1.65")  # disabled
geo_algorithm_name_2 = Panel("SizingRings")
is_production_mode_2 = BooleanToggle(True)
toggle_job_make_it_go_2 = BooleanToggle(True)
band_width_mm = Panel("7.5")
axial_band_thickness_mm_2 = Panel("1.5")
factoryautomatorpy = Python3Script(is_production_mode=is_production_mode, geo_algorithm_name=geo_algorithm_name, toggleJob=toggle_job_make_it_go)  # -> out, root_filename, output_dir, objectID, raw_data; inputs is_production_mode: Boolean, toggleJob: Boolean; disabled
# ---------- factoryautomatorpy: Python ----------
from pathlib import Path
import sys
from importlib import reload #FOR DEV
import time

ghFileDir = str(Path.joinpath(Path(ghenv.Component.OnPingDocument().FilePath).resolve().parents[0], "src"))
print(f"{ghFileDir=}")

if ghFileDir not in sys.path:
    print("ghFileDir needed to be included")
    sys.path.append(ghFileDir)

import splintcommon
reload(splintcommon) #FOR DEV
from splintcommon import mark_generation_start
mark_generation_start()
splintcommon.log(f'FactoryAutomatorPY Running at: ({time.strftime("%H:%M:%S", time.localtime())})')
# ==================== Component Code ===========================

def float_range(start, stop, count):
    current = start
    step = (stop - start) / (count - 1)
    result_range = []
    for c in range(count):
        result_range.append(start + (step * c))
    return result_range

job_data, objectID, root_filename, output_dir, raw_data = splintcommon.load_job_data(is_production_mode, geo_algorithm_name)

# This mapping must match the schema of the data in the DB for this geometry type
# c_left_mm = job_data["c_left_mm"]
# c_right_mm = job_data["c_right_mm"]
# full_perimeter_mm = job_data["full_perimeter_mm"]
# right_forward_offset_mm = job_data["right_forward_offset_mm"]
# b_left_slit = job_data.get("b_left_slit", False)
# b_right_slit = job_data.get("b_right_slit", False)
# band_width_mm = job_data.get("band_width_mm", 7.5)
# splintcommon.log(f"Result data {c_left_mm=} {c_right_mm=} {full_perimeter_mm=} {right_forward_offset_mm=} {b_left_slit=} {b_right_slit=}")
# ---------- end factoryautomatorpy ----------
factoryautomatorpy_2 = Python3Script(is_production_mode=is_production_mode_2, geo_algorithm_name=geo_algorithm_name_2, toggleJob=toggle_job_make_it_go_2)  # -> out, root_filename, output_dir, objectID, raw_data; inputs is_production_mode: Boolean, toggleJob: Boolean; same code as factoryautomatorpy
panel = Panel(factoryautomatorpy.out)
# Sizing Rings
panel_2 = Panel(factoryautomatorpy_2.out)
objectid = Panel(factoryautomatorpy_2.objectID)
b_right_slit = Boolean()  # disabled
output_dir_out = Text(factoryautomatorpy.output_dir)  # disabled
root_filename_out = Text(factoryautomatorpy.root_filename)  # disabled
axial_band_thickness_mm_3 = Number(axial_band_thickness_mm)  # disabled
b_left_slit = Boolean()  # disabled
c_left_mm = Panel("57.0")  # disabled
full_perimeter_mm = Panel("101.0")  # disabled
c_right_mm = Panel("59.0")  # disabled
right_forward_offset_mm = Panel("-10.0")  # disabled
objectid_2 = Panel(factoryautomatorpy.objectID)  # disabled
panel_3 = Panel(b_left_slit)  # disabled
panel_4 = Panel(b_right_slit)  # disabled

# ----
# Circumference Sizing Circles
panel_5 = Panel("5.0")
grid_count = Panel("5")
grid_gap = Panel("17")
min_circumference = Panel("20.0")
count = Panel("25")
axial_band_thickness_mm_4 = Number(axial_band_thickness_mm_2)
series = Series(Start=min_circumference, Step=panel_5, Count=count)
c2r_py = Python3Script(Circumference=series)  # -> Radius
# ---------- c2r_py: Python ----------
import math


Radius = Circumference / (2 * math.pi)
# ---------- end c2r_py ----------
outer_r = Addition(A=c2r_py, B=axial_band_thickness_mm_4)
last_item = ListItem(List=c2r_py, Index=-1, Wrap=True)
addition = Addition(A=last_item, B=grid_gap)
planar_grid = PlanarGrid(
    BasePoint=Point(0, 0, 0),
    IDir=Vector(1, 0, 0),
    JDir=Vector(0, 1, 0),
    IDistance=addition,
    JDistance=addition,
    INumber=grid_count,
    JNumber=grid_count)
grid_rearrangement_py = Python3Script(grid_in=planar_grid)  # -> out, grid_out; inputs grid_in: tree
# ---------- grid_rearrangement_py: Python ----------
# This file represents a stub for a GhPython component in Grasshopper.
# It sets up the environment to import and use the splintcommon or other external modules.

from pathlib import Path
import sys
from importlib import reload #FOR DEV
import time

# Walk up through nested clusters to find the root GH document (necessary for use in nested clusters)
doc = ghenv.Component.OnPingDocument()
while not doc.FilePath and doc.Owner:
    doc = doc.Owner.OnPingDocument()
ghFileDir = str(Path(doc.FilePath).resolve().parent / "src")

print(f"{ghFileDir=}")

if ghFileDir not in sys.path:
    print("ghFileDir needed to be included")
    sys.path.append(ghFileDir)

import splintcommon
reload(splintcommon) #FOR DEV
from splintcommon import mark_generation_start
mark_generation_start()

#splintcommon module is now available for use in this GhPython component
splintcommon.log(f'1. GhPython Node initialized at {time.ctime()}')

#Component code here

import DataTreeUtils
reload(DataTreeUtils)
print("DataTreeUtils from:", DataTreeUtils.__file__)
from DataTreeUtils import tree_to_grid, grid_to_tree, reverse_columns, reorder_column_rows

grid = tree_to_grid(grid_in)               # x is the tree input

print("testing 12:30")
#Then scramble the columns so small and large items checkerboard next to each other
grid = reorder_column_rows(grid, [0, 4, 2, 3, 1], [1, 3])

grid = reorder_column_rows(grid, [3, 1, 2, 0, 4], [0, 2, 4])



grid_out = grid_to_tree(grid)
print("done")
# ---------- end grid_rearrangement_py ----------
data = Data(flatten(grid_rearrangement_py.grid_out))
list_indices = ListIndices(List=data)
smaller_than = SmallerThan(FirstNumber=list_indices, SecondNumber=count)  # -> SmallerThan, OrEqualTo
location_data = Data(flatten(grid_rearrangement_py.grid_out))
last_item_2 = ListItem(List=series, Index=-1, Wrap=True)
debug_grid_gen_py = Python3Script()  # -> out, grid_out
# ---------- debug_grid_gen_py: Python ----------
# This file represents a stub for a GhPython component in Grasshopper.
# It sets up the environment to import and use the splintcommon or other external modules.

from pathlib import Path
import sys
from importlib import reload #FOR DEV
import time

# Walk up through nested clusters to find the root GH document (necessary for use in nested clusters)
doc = ghenv.Component.OnPingDocument()
while not doc.FilePath and doc.Owner:
    doc = doc.Owner.OnPingDocument()
ghFileDir = str(Path(doc.FilePath).resolve().parent / "src")

print(f"{ghFileDir=}")

if ghFileDir not in sys.path:
    print("ghFileDir needed to be included")
    sys.path.append(ghFileDir)

import splintcommon
reload(splintcommon) #FOR DEV
from splintcommon import mark_generation_start
mark_generation_start()

#splintcommon module is now available for use in this GhPython component
splintcommon.log(f'1. GhPython Node initialized at {time.ctime()}')

#Component code here

import DataTreeUtils
reload(DataTreeUtils)
print("DataTreeUtils from:", DataTreeUtils.__file__)
from DataTreeUtils import tree_to_grid, grid_to_tree, reverse_columns, reorder_column_rows

col_vals = ["a", "b", "c", "d", "e"]
row_vals = ["0", "1", "2", "3", "4"]
grid = []

for row_val in row_vals:
    out_row = []
    for col_val in col_vals:
        out_row.append(col_val + row_val)
    print(out_row)
    grid.append(out_row)

print(f"[0][0] == {grid[0][0]}")
print(f"[4][4] == {grid[4][4]}")


grid_out = grid_to_tree(grid)
# ---------- end debug_grid_gen_py ----------
letter_grid = Data(flatten(debug_grid_gen_py.grid_out))
cull_pattern = CullPattern(List=data, CullPattern=smaller_than.SmallerThan)
max_circumference = Panel(last_item_2)
max_radius = Panel(last_item)
center_points = Point(cull_pattern)
annotation_dot = AnnotationDot(Location=location_data, PrimaryText=letter_grid)  # -> AnnotationDot, Location, PrimaryText, TextHeight
annotation_dot_2 = AnnotationDot(Location=center_points, PrimaryText=c2r_py)  # -> AnnotationDot, Location, PrimaryText, TextHeight
circumference_values = Number(series)
inner_radius_values = Number(c2r_py)
outer_radius_values = Number(outer_r)
circle_inner = Circle(Plane=center_points, Radius=c2r_py)
circle_outer = Circle(Plane=center_points, Radius=outer_r)
center_points_2 = Point(center_points)

panel_6 = Panel("-50, 0, -1")  # disabled
panel_7 = Panel("25.0")  # disabled
panel_8 = Panel("-50, 0, 0")  # disabled
panel_9 = Panel("10")  # disabled
panel_10 = Panel("12")  # disabled
cylinder = Cylinder(Base=panel_8, Radius=panel_7, Length=panel_9)  # disabled
cylinder_2 = Cylinder(Base=panel_6, Radius="23.0", Length=panel_10)  # disabled

# ----
# Finger Circles
min_center_gap = Panel("1.0")  # disabled
c_left = Number(c_left_mm)  # disabled
full_perimeter = Number(full_perimeter_mm)  # disabled
c_right = Number(c_right_mm)  # disabled
axial_band_thickness_mm_5 = Number(axial_band_thickness_mm)  # disabled
two_sphere_dist_solver_py = Python3Script(c1=c_left, c2=c_right, full_perimeter=full_perimeter, min_center_gap=min_center_gap)  # -> out, r1, r2, gap, center_to_center; inputs c1: Double, c2: Double, full_perimeter: Double, min_center_gap: Double; disabled
# ---------- two_sphere_dist_solver_py: Python ----------
import math

# Inputs (from GH component)
circumference_1 = c1  # larger circle circumference
circumference_2 = c2  # smaller circle circumference
belt_perimeter = full_perimeter    # convex hull perimeter measurement
is_radius_reversed = False

# Derive radii
r1 = circumference_1 / (2 * math.pi)
r2 = circumference_2 / (2 * math.pi)

# Ensure r1 >= r2
if r2 > r1:
    is_radius_reversed = True
    r1, r2 = r2, r1

def hull_perimeter(d, r1, r2):
    """Convex hull perimeter of two disks with center distance d."""
    tangent_len = 2 * math.sqrt(d**2 - (r1 - r2)**2)
    arc_base = math.pi * (r1 + r2)
    arc_correction = 2 * (r1 - r2) * math.asin((r1 - r2) / d)
    return tangent_len + arc_base + arc_correction

# Bisection solve for center-to-center distance
d_lo = r1 + r2 + 1e-9  # circles just touching
d_hi = belt_perimeter / 2.0
tolerance = 1e-9

for _ in range(200):
    d_mid = (d_lo + d_hi) / 2.0
    if hull_perimeter(d_mid, r1, r2) < belt_perimeter:
        d_lo = d_mid
    else:
        d_hi = d_mid
    if (d_hi - d_lo) < tolerance:
        break

center_distance = (d_lo + d_hi) / 2.0
gap = center_distance - r1 - r2

if (gap < min_center_gap):
    gap = min_center_gap

#Now unreverse the radius if necessary
if is_radius_reversed:
    r1, r2 = r2, r1

center_to_center = r1 + r2 + gap
# ---------- end two_sphere_dist_solver_py ----------
addition_2 = Addition(A=two_sphere_dist_solver_py.r1, B=axial_band_thickness_mm_5)  # disabled
addition_3 = Addition(A=two_sphere_dist_solver_py.r2, B=axial_band_thickness_mm_5)  # disabled
yz_plane = YZPlane(Origin=Point(0, 0, 0))  # disabled
unit_y = UnitY(Factor=expr("-x", two_sphere_dist_solver_py.center_to_center))  # disabled
circle_left = Circle(Plane=yz_plane, Radius=addition_2)  # disabled
circle_left_2 = Circle(Plane=yz_plane, Radius=two_sphere_dist_solver_py.r1)  # disabled
circle_right = Circle(Plane=yz_plane, Radius=two_sphere_dist_solver_py.r2)  # disabled
circle_right_2 = Circle(Plane=yz_plane, Radius=addition_3)  # disabled
move = Move(Geometry=circle_right, Motion=unit_y)  # -> Geometry, Transform; disabled
transform = Transform(Geometry=circle_right_2, Transform=move.Transform)  # disabled
outer_circle_left = Circle(circle_left)  # disabled
outer_circle_right = Circle(transform)  # disabled
circle_right_3 = Circle(move.Geometry)  # disabled
circle_left_3 = Circle(circle_left_2)  # disabled
center_to_center_dist = Number(two_sphere_dist_solver_py.center_to_center)  # disabled
r_right_outer = Number(addition_3)  # disabled
r_left_outer = Number(addition_2)  # disabled
r_right = Number(two_sphere_dist_solver_py.r2)  # disabled
r_left = Number(two_sphere_dist_solver_py.r1)  # disabled

cap_holes = CapHoles(Brep=cylinder_2)  # disabled
cap_holes_2 = CapHoles(Brep=cylinder)  # disabled
solid_difference = SolidDifference(BrepsA=cap_holes_2, BrepsB=cap_holes)  # disabled
volume = Volume(Geometry=solid_difference)  # -> Volume, Centroid; disabled
number_slider = Slider(0, range=0..180)  # disabled
panel_11 = Panel("-1")  # disabled
panel_12 = Panel("1, 1, 0")  # disabled
panel_13 = Panel("-1")  # disabled
unit_x = UnitX(Factor=panel_11)  # disabled
xy_plane = XYPlane(Origin=Point(0, 0, 0))  # disabled
unit_y_2 = UnitY(Factor=1)  # disabled
unit_z = UnitZ(Factor=1)  # disabled
panel_14 = Panel("F4")  # disabled
panel_15 = Panel("0, 1, 1")  # disabled
rotate = Rotate(Geometry=unit_x, Angle=degrees(number_slider), Plane=xy_plane)  # -> Geometry, Transform; disabled
panel_16 = Panel("2.0")  # disabled
vector = Vector(rotate.Geometry)  # disabled
panel_17 = Panel("6.0")  # disabled
panel_18 = Panel("0.4")  # disabled
boolean_toggle = BooleanToggle(True)  # disabled
textgun_py = Python3Script(
    splint_brep=solid_difference,
    object_id=panel_14,
    text_up_vector=unit_z,
    wall_thickness_mm=panel_16,
    text_size=panel_17,
    text_projection_vector=vector,
    extrusion_depth_factor=panel_18,
    projection_origin=volume.Centroid,
    x=boolean_toggle)  # -> out, embossedBrep, originalTextBreps, final_text_plane, projected_letters; inputs splint_brep: Brep, object_id: String, text_up_vector: Vector3d, wall_thickness_mm: Double, text_size: Double, text_projection_vector: Vector3d, extrusion_depth_factor: Double, projection_origin: Point3d; disabled
# ---------- textgun_py: Python ----------
# This file represents a stub for a GhPython component in Grasshopper.
# It sets up the environment to import and use the splintcommon or other external modules.

from pathlib import Path
import sys
from importlib import reload #FOR DEV ONLY
import time

# In normal GH doc
ghFileDir = None
try:
    ghFileDir = str(Path.joinpath(Path(ghenv.Component.OnPingDocument().FilePath).resolve().parents[0], "src"))
except:
    # In GH Cluster
    ghFileDir = str(Path.joinpath(Path(ghenv.Component.OnPingDocument().Owner.OnPingDocument().FilePath).resolve().parents[0], "src"))

print(f"{ghFileDir=}")

if ghFileDir not in sys.path:
    print("ghFileDir needed to be included")
    sys.path.append(ghFileDir)

import splintcommon
reload(splintcommon) #FOR DEV

#splintcommon module is now available for use in this GhPython component
splintcommon.log(f'GhPython Node initialized at {time.ctime()}')

import TextGun
reload(TextGun) #FOR DEV
from TextGun import emboss_text

embossedBrep, originalTextBreps, projected_letters, final_text_plane = emboss_text(
    target_brep=splint_brep,
    text_content=object_id,
    wall_thickness_mm=wall_thickness_mm,
    text_size=text_size,
    text_up_vector=text_up_vector,
    text_projection_vector=text_projection_vector,
    extrusion_depth_factor=extrusion_depth_factor,
    projection_origin=projection_origin,
    emboss_inside=False,
    align_to_surface_normal=True
)
# ---------- end textgun_py ----------
chain_ring_angle = Panel("45")

axial_band_thickness_mm_6 = Number(axial_band_thickness_mm_2)
outer_radius_values_2 = Number(outer_radius_values)
chain_hole_radius = Panel("3.0")
center_points_3 = Point(center_points_2)
inner_radius_values_2 = Number(inner_radius_values)
band_width_mm_2 = Number(band_width_mm)
nudge = Panel("0.1")
addition_4 = Addition(A=chain_hole_radius, B=axial_band_thickness_mm_6)
addition_5 = Addition(A=outer_radius_values_2, B=chain_hole_radius, C=nudge)
deconstruct = Deconstruct(Point=center_points_3)  # -> XComponent, YComponent, ZComponent
X = Multiplication(A="0.4", B=band_width_mm_2)
chain_hole_center_dist = Number(addition_5)
chain_hole_outer_radius = Number(addition_4)
unit_z_2 = UnitZ(Factor=X)
sin = Sine(Value=degrees(chain_ring_angle))
cos = Cosine(Value=degrees(chain_ring_angle))
X_2 = Multiplication(A=sin, B=chain_hole_center_dist)
X_3 = Multiplication(A=cos, B=chain_hole_center_dist)
addition_6 = Addition(A=deconstruct.YComponent, B=X_3)
addition_7 = Addition(A=deconstruct.XComponent, B=X_2)
construct_point = ConstructPoint(XCoordinate=addition_7, YCoordinate=addition_6, ZCoordinate=deconstruct.ZComponent)
chain_hole_centers = Point(construct_point)
circle = Circle(Plane=chain_hole_centers, Radius=chain_hole_radius)
circle_2 = Circle(Plane=chain_hole_centers, Radius=chain_hole_outer_radius)
boundary_surfaces = BoundarySurfaces(Edges=[circle, circle_2])
extrude = Extrude(Base=boundary_surfaces, Direction=unit_z_2)
chain_rings = Brep(extrude)

band_width_mm_3 = Number(band_width_mm)
inner_circle = Circle(circle_inner)
inner_circle_2 = Circle(circle_outer)
center_points_4 = Point(center_points_2)
boundary_surfaces_2 = BoundarySurfaces(Edges=[inner_circle, inner_circle_2])
unit_z_3 = UnitZ(Factor=band_width_mm_3)
division = Division(A=band_width_mm_3, B="2")
unit_z_4 = UnitZ(Factor=division)
extrude_2 = Extrude(Base=boundary_surfaces_2, Direction=unit_z_3)
move_2 = Move(Geometry=center_points_4, Motion=unit_z_4)  # -> Geometry, Transform
center_points_raised = Point(move_2.Geometry)
solid_rings = Brep(extrude_2)

plane = Plane(textgun_py.final_text_plane)  # disabled

# ----
# Create Outer Shell Wall
# Connecting radius coefficient: 0.9 seems to work very well.
# 
# I experimented with both circle closest point distances and circle center distances. Closest point yielded the most predictable results.
outer_circle_right_2 = Circle(outer_circle_right)  # disabled
outer_circle_left_2 = Circle(outer_circle_left)  # disabled
r_right_outer_2 = Number(r_right_outer)  # disabled
r_left_outer_2 = Number(r_left_outer)  # disabled
curve_curve_closest_point = CurveCurveClosestPoint(CurveA=outer_circle_left_2, CurveB=outer_circle_right_2)  # -> PointOnA, ParamOnA, PointOnB, ParamOnB; disabled
connecting_radius_coefficient = Slider(0.9, range=0.2..3)  # disabled
distance = Distance(PointA=curve_curve_closest_point.PointOnA, PointB=curve_curve_closest_point.PointOnB)  # disabled
multiplication = Multiplication(A=distance, B=connecting_radius_coefficient)  # disabled
python_3_script = Python3Script(circle1=outer_circle_left_2, circle2=outer_circle_right_2, hourglass_r=multiplication)  # -> out, a; inputs circle1: Circle, circle2: Circle, hourglass_r: Double; disabled
# ---------- python_3_script: Python ----------
import Rhino.Geometry as rg
import math


def create_hourglass(circle1, circle2, hourglass_r, tolerance=0.01):
    """Create an hourglass-shaped closed curve joining two non-overlapping circles."""
    c1 = circle1.Center
    c2 = circle2.Center
    r1 = circle1.Radius
    r2 = circle2.Radius

    # Direction from c1 to c2
    axis = c2 - c1
    dist = axis.Length
    axis.Unitize()

    # Perpendicular direction in the circle plane
    normal = circle1.Plane.ZAxis
    perp = rg.Vector3d.CrossProduct(normal, axis)
    perp.Unitize()

    print("C1: r={:.3f}, C2: r={:.3f}, dist={:.3f}, hourglass_r={:.3f}".format(
        r1, r2, dist, hourglass_r))

    # Construction radii (externally tangent)
    R1 = r1 + hourglass_r
    R2 = r2 + hourglass_r

    # Circle-circle intersection: find tangent circle centers
    # x = offset along axis from c1, y = perpendicular offset
    x = (dist * dist + R1 * R1 - R2 * R2) / (2.0 * dist)
    y_sq = R1 * R1 - x * x

    if y_sq < 0:
        print("ERROR: no tangent circles exist (y^2={:.3f}). Adjust hourglass_r.".format(y_sq))
        return None

    y = math.sqrt(y_sq)
    base = c1 + axis * x
    t1_center = base + perp * y
    t2_center = base - perp * y

    print("T1 center: {}, T2 center: {}".format(t1_center, t2_center))

    # 4 tangent points (on original circles, toward tangent circle centers)
    def tangent_pt(circ_center, circ_r, tang_center):
        v = tang_center - circ_center
        v.Unitize()
        return circ_center + v * circ_r

    p_c1_t1 = tangent_pt(c1, r1, t1_center)
    p_c1_t2 = tangent_pt(c1, r1, t2_center)
    p_c2_t1 = tangent_pt(c2, r2, t1_center)
    p_c2_t2 = tangent_pt(c2, r2, t2_center)

    # Interior points for 3-point arc construction
    c1_far = c1 - axis * r1                    # C1 farthest from C2
    c2_far = c2 + axis * r2                    # C2 farthest from C1
    t1_inner = t1_center - perp * hourglass_r  # T1 closest to centerline
    t2_inner = t2_center + perp * hourglass_r  # T2 closest to centerline

    # 4 arcs in continuous path order
    arc_c1 = rg.Arc(p_c1_t2, c1_far, p_c1_t1)   # C1 outer (away from C2)
    arc_t1 = rg.Arc(p_c1_t1, t1_inner, p_c2_t1)  # T1 waist (concave inward)
    arc_c2 = rg.Arc(p_c2_t1, c2_far, p_c2_t2)    # C2 outer (away from C1)
    arc_t2 = rg.Arc(p_c2_t2, t2_inner, p_c1_t2)  # T2 waist (concave inward)

    curves = [
        rg.ArcCurve(arc_c1),
        rg.ArcCurve(arc_t1),
        rg.ArcCurve(arc_c2),
        rg.ArcCurve(arc_t2),
    ]

    print("Arc lengths: C1={:.3f}, T1={:.3f}, C2={:.3f}, T2={:.3f}".format(
        curves[0].GetLength(), curves[1].GetLength(),
        curves[2].GetLength(), curves[3].GetLength()))

    joined = rg.Curve.JoinCurves(curves, tolerance)
    if joined and len(joined) > 0:
        result = joined[0]
        print("Joined: closed={}, length={:.3f}".format(result.IsClosed, result.GetLength()))
        return result
    else:
        print("WARNING: JoinCurves failed, returning individual arcs")
        return curves


# GH component inputs: circle1, circle2, hourglass_r, tolerance
a = create_hourglass(circle1, circle2, hourglass_r, 0.1)
# ---------- end python_3_script ----------
outer_perimeter_curve = Curve(python_3_script.a)  # disabled

vizplane = VizPlane(plane=plane)  # -> tip_2, line_2, annotation_dot_2; disabled
brep = Brep(textgun_py.projected_letters)  # disabled
brep_2 = Brep(textgun_py.originalTextBreps)  # disabled
plane_2 = Plane(textgun_py.final_text_plane)  # disabled
brep_3 = Brep(textgun_py.embossedBrep)  # disabled
tip = Brep(vizplane.tip_2)  # disabled
line = Line(vizplane.line_2)  # disabled
annotation_dot_3 = AnnotationDot(vizplane.annotation_dot_2)  # disabled
panel_19 = Panel(textgun_py.out)  # disabled

solid_rings_2 = Brep(solid_rings)
chain_rings_2 = Brep(chain_rings)
merge = Merge(Data1=solid_rings_2, Data2=chain_rings_2)
solid_union = SolidUnion(Breps=merge)

# ----
# Solid Blank
initial_circle_left = Circle(circle_left_3)  # disabled
initial_circle_right = Circle(circle_right_3)  # disabled
outer_perimeter_curve_2 = Curve(outer_perimeter_curve)  # disabled
merge_2 = Merge(Data1=outer_perimeter_curve_2, Data2=initial_circle_left, Data3=initial_circle_right)  # -> flatten(Result); disabled
panel_20 = Panel("150")  # disabled
boundary_surfaces_3 = BoundarySurfaces(Edges=merge_2)  # disabled
unit_x_2 = UnitX(Factor=panel_20)  # disabled
extrude_3 = Extrude(Base=boundary_surfaces_3, Direction=unit_x_2)  # disabled
panel_21 = Panel("-0.50")  # disabled
multiplication_2 = Multiplication(A=unit_x_2, B=panel_21)  # disabled
move_3 = Move(Geometry=extrude_3, Motion=multiplication_2)  # -> Geometry, Transform; disabled
blank_positioned = Brep(move_3.Geometry)  # disabled

# ----
# Front Edge Geometry
outer_perimeter_curve_3 = Curve(outer_perimeter_curve)  # disabled
initial_circle_left_2 = Circle(circle_left_3)  # disabled
initial_circle_right_2 = Circle(circle_right_3)  # disabled
right_forward_offset_mm_2 = Number(right_forward_offset_mm)  # disabled
merge_3 = Merge(Data1=outer_perimeter_curve_3, Data2=initial_circle_left_2, Data3=initial_circle_right_2)  # -> flatten(Result); disabled
panel_22 = Panel("50")  # disabled
boundary_surfaces_4 = BoundarySurfaces(Edges=merge_3)  # disabled
unit_x_3 = UnitX(Factor=panel_22)  # disabled
unit_x_4 = UnitX(Factor=right_forward_offset_mm_2)  # disabled
panel_23 = Panel("-0.50")  # disabled
move_4 = Move(Geometry=initial_circle_right_2, Motion=unit_x_4)  # -> Geometry, Transform; disabled
transform_2 = Transform(Geometry=outer_perimeter_curve_3, Transform=move_4.Transform)  # disabled
multiplication_3 = Multiplication(A=unit_x_3, B=panel_23)  # disabled
front_outer_perimeter_positioned_right = Curve(transform_2)  # disabled
front_outer_perimeter_positioned_left = Curve(outer_perimeter_curve_3)  # disabled
front_circle_left_positioned = Circle(initial_circle_left_2)  # disabled
front_circle_right_positioned = Circle(move_4.Geometry)  # disabled

# ----
# Size Embossing Gun
axial_band_thickness_mm_7 = Number(axial_band_thickness_mm_2)
center_points_5 = Point(center_points_raised)
object_brep = Brep(solid_union)
circumference_values_2 = Number(circumference_values)
unit_x_5 = UnitX(Factor="-1")
xy_plane_2 = XYPlane(Origin=Point(0, 0, 0))
unit_z_5 = UnitZ(Factor=1)
text = Text(circumference_values_2)
rotate_2 = Rotate(Geometry=unit_x_5, Angle=degrees("135"), Plane=xy_plane_2)  # -> Geometry, Transform
unit_y_3 = UnitY(Factor="-1")
boolean_toggle_2 = BooleanToggle(True)
textgun_py_2 = Python3Script(
    splint_brep=object_brep,
    object_id=text,
    text_up_vector=unit_z_5,
    wall_thickness_mm=axial_band_thickness_mm_7,
    text_size="5.5",
    text_projection_vector=rotate_2.Geometry,
    extrusion_depth_factor="0.4",
    projection_origin=center_points_5,
    x=boolean_toggle_2)  # -> out, embossedBrep, originalTextBreps, final_text_plane, projected_letters; inputs splint_brep: Brep, object_id: String, text_up_vector: Vector3d, text_size: Double, text_projection_vector: Vector3d, extrusion_depth_factor: Double, projection_origin: Point3d; same code as textgun_py
reverse = Reverse(Vector=rotate_2.Geometry)
textgun_py_3 = Python3Script(
    splint_brep=textgun_py_2.embossedBrep,
    object_id=text,
    text_up_vector=unit_z_5,
    wall_thickness_mm=axial_band_thickness_mm_7,
    text_size="5.5",
    text_projection_vector=reverse,
    extrusion_depth_factor="0.4",
    projection_origin=center_points_5,
    x=boolean_toggle_2)  # -> out, embossedBrep, originalTextBreps, final_text_plane, projected_letters; inputs splint_brep: Brep, object_id: String, text_up_vector: Vector3d, text_size: Double, text_projection_vector: Vector3d, extrusion_depth_factor: Double, projection_origin: Point3d; same code as textgun_py
brep_4 = Brep(textgun_py_2.originalTextBreps)
panel_24 = Panel(textgun_py_2.out)
ring_with_embossed_size = Brep(textgun_py_3.embossedBrep)

# ----
# Back Edge Geometry
minimum_band_width_mm = Number()  # disabled
outer_perimeter_positioned_left = Curve(front_outer_perimeter_positioned_left)  # disabled
circle_right_positioned = Circle(front_circle_right_positioned)  # disabled
circle_left_positioned = Circle(front_circle_left_positioned)  # disabled
outer_perimeter_positioned_right = Curve(front_outer_perimeter_positioned_right)  # disabled
unit_x_6 = UnitX(Factor=minimum_band_width_mm)  # disabled
move_5 = Move(Geometry=circle_left_positioned, Motion=unit_x_6)  # -> Geometry, Transform; disabled
transform_3 = Transform(Geometry=circle_right_positioned, Transform=move_5.Transform)  # disabled
transform_4 = Transform(Geometry=outer_perimeter_positioned_right, Transform=move_5.Transform)  # disabled
transform_5 = Transform(Geometry=outer_perimeter_positioned_left, Transform=move_5.Transform)  # disabled
back_outer_perimeter_positioned_right = Curve(transform_4)  # disabled
back_outer_perimeter_positioned_left = Curve(transform_5)  # disabled
back_circle_right_positioned = Circle(transform_3)  # disabled
back_circle_left_positioned = Circle(move_5.Geometry)  # disabled

brep_5 = Brep(textgun_py_2.projected_letters)

# ----
# Report Results
# NOTE: Let's make sure everything stays in Breps until this phase
root_filename_out_2 = Text(factoryautomatorpy_2.root_filename)
output_dir_out_2 = Text(factoryautomatorpy_2.output_dir)
axial_band_thickness_mm_8 = Number(axial_band_thickness_mm_2)
sizing_ring_breps = Brep(ring_with_embossed_size)
tunable_mesh_conversion_py = Python3Script(breps_in=sizing_ring_breps)  # -> out, meshes_out; inputs breps_in: list of Brep
# ---------- tunable_mesh_conversion_py: Python ----------
# This file represents a stub for a GhPython component in Grasshopper.
# It sets up the environment to import and use the splintcommon or other external modules.

from pathlib import Path
import sys
from importlib import reload #FOR DEV
import time

# Walk up through nested clusters to find the root GH document (necessary for use in nested clusters)
doc = ghenv.Component.OnPingDocument()
while not doc.FilePath and doc.Owner:
    doc = doc.Owner.OnPingDocument()
ghFileDir = str(Path(doc.FilePath).resolve().parent / "src")

print(f"{ghFileDir=}")

if ghFileDir not in sys.path:
    print("ghFileDir needed to be included")
    sys.path.append(ghFileDir)

import splintcommon
reload(splintcommon) #FOR DEV
from splintcommon import mark_generation_start
mark_generation_start()

#splintcommon module is now available for use in this GhPython component
splintcommon.log(f'GhPython Node initialized at {time.ctime()}')

#Component code here

import splintmeshes
reload(splintmeshes)
from splintmeshes import convert_to_export_meshes


meshes_out = convert_to_export_meshes(
    breps_in,
    quality="high",
    target_edge_length=1.1,
    max_edge_length=1.1,
    min_edge_length=0.03,
    jagged_seams=False,
    simple_planes=True,
    refine_grid=False,
    weld_angle_degrees=45,
    smoothing_iterations=0,
    repair_if_needed=True,
    require_closed=True,
    require_manifold=True,
    shrinkwrap_fallback=True
)

# 7.39 mb and good detail all around!
# meshes_out = convert_to_export_meshes(
#     breps_in,
#     quality="high",
#     target_edge_length=1.1,
#     max_edge_length=1.1,
#     min_edge_length=0.03,
#     jagged_seams=False,
#     simple_planes=True,
#     refine_grid=False,
#     weld_angle_degrees=45,
#     smoothing_iterations=0,
#     repair_if_needed=True,
#     require_closed=True,
#     require_manifold=True,
#     shrinkwrap_fallback=False
# )

# # 10mb, text good, bottoms rounded
# meshes_out = convert_to_export_meshes(
#     breps_in,
#     quality="high",
#     target_edge_length=0.9,
#     max_edge_length=0.9,
#     min_edge_length=0.02,
#     jagged_seams=False,
#     simple_planes=True,
#     refine_grid=False,
#     weld_angle_degrees=45,
#     smoothing_iterations=0,
#     repair_if_needed=True,
#     require_closed=True,
#     require_manifold=True,
#     shrinkwrap_fallback=False
# )

# 8Mb, good text, rounding on tops and bottoms
# meshes_out = convert_to_export_meshes(
#     breps_in,
#     quality="fast",
#     target_edge_length=1.5,
#     max_edge_length=2.0,
#     min_edge_length=0.10,
#     smoothing_iterations=0,
#     repair_if_needed=True,
#     require_closed=True,
#     require_manifold=True,
#     shrinkwrap_fallback=False
# )
# ---------- end tunable_mesh_conversion_py ----------
output_shapes = Geometry(tunable_mesh_conversion_py.meshes_out)
qa_py = Python3Script(output_breps=output_shapes)  # -> out, py_wall_probe_data; inputs output_breps: list of Brep
# ---------- qa_py: Python ----------
# This file represents a stub for a GhPython component in Grasshopper.
# It sets up the environment to import and use the splintcommon or other external modules.

from pathlib import Path
import sys
from importlib import reload #FOR DEV
import time

# Walk up through nested clusters to find the root GH document (necessary for use in nested clusters)
doc = ghenv.Component.OnPingDocument()
while not doc.FilePath and doc.Owner:
    doc = doc.Owner.OnPingDocument()
ghFileDir = str(Path(doc.FilePath).resolve().parent / "src")

print(f"{ghFileDir=}")

if ghFileDir not in sys.path:
    print("ghFileDir needed to be included")
    sys.path.append(ghFileDir)

import splintcommon
reload(splintcommon) #FOR DEV
from splintcommon import mark_generation_start, log
mark_generation_start()

#splintcommon module is now available for use in this GhPython component
splintcommon.log(f'GhPython Node initialized at {time.ctime()}')

#Component code here


import BrepInspect
reload(BrepInspect)
from BrepInspect import inspect_solid_breps

all_ok = inspect_solid_breps(output_breps, verbose=True)

py_wall_probe_data = [{"all_breps_ok": all_ok}]

if not all_ok:
    log("Breps failed structural inspection")
# ---------- end qa_py ----------
panel_25 = Panel(qa_py.out)
py_wall_probe_data = Data(qa_py.py_wall_probe_data)
dev_activate_toggle = BooleanToggle(False)
savemeshpy = Python3Script(
    final_mesh=output_shapes,
    output_dir=output_dir_out_2,
    root_filename=root_filename_out_2,
    bool_activate=dev_activate_toggle,
    axial_band_thickness_mm=axial_band_thickness_mm_8,
    py_wall_probe_data=py_wall_probe_data)  # -> out; inputs final_mesh: list of Mesh, axial_band_thickness_mm: Double
# ---------- savemeshpy: Python ----------
# This file represents a stub for a GhPython component in Grasshopper.
# It sets up the environment to import and use the splintcommon or other external modules.

from pathlib import Path
import sys
from importlib import reload #FOR DEV
import time

# Walk up through nested clusters to find the root GH document (necessary for use in nested clusters)
doc = ghenv.Component.OnPingDocument()
while not doc.FilePath and doc.Owner:
    doc = doc.Owner.OnPingDocument()
ghFileDir = str(Path(doc.FilePath).resolve().parent / "src")

print(f"{ghFileDir=}")

if ghFileDir not in sys.path:
    print("ghFileDir needed to be included")
    sys.path.append(ghFileDir)

import splintcommon
reload(splintcommon) #FOR DEV
from splintcommon import log, gh_decode

#splintcommon module is now available for use in this GhPython component
splintcommon.log(f'GhPython Node initialized at {time.ctime()}')

#Component code here

import splintmeshes
reload(splintmeshes)
from splintmeshes import save_job_output

wall_probe_data = gh_decode(py_wall_probe_data)

# With error handling
try:
    log(f"Logging to {output_dir=} {root_filename=}")
    #splintmeshes.save_mesh(final_splint_mesh, output_dir, root_filename, format_type="stl")

    save_job_output(final_mesh, output_dir, root_filename, format_type="3mf", custom_metadata={
        "wall_probe_data": wall_probe_data,
        "axial_band_thickness_mm": axial_band_thickness_mm,
    })
    log(f"Export succeeded: {output_dir=} {root_filename=}")
except splintmeshes.MeshExportError as e:
    log("Export failed: {}".format(e))
except ValueError as e:
    log("Bad input: {}".format(e))
# ---------- end savemeshpy ----------
panel_26 = Panel(savemeshpy)

b_left_slit_2 = Boolean(b_left_slit)  # disabled
boolean_toggle_3 = BooleanToggle(True)  # disabled
r_left_2 = Number(r_left)  # disabled
unit_y_4 = UnitY(Factor=1)  # disabled
panel_27 = Panel("-1")  # disabled
unit_z_6 = UnitZ(Factor=panel_27)  # disabled
panel_28 = Panel("1.6")  # disabled
annotation_location = Panel("0, -10, -30")  # disabled

# ----
# Initial Geometry
outer_circle_right_3 = Circle(outer_circle_right)  # disabled
outer_circle_left_3 = Circle(outer_circle_left)  # disabled
circle_right_4 = Circle(circle_right_3)  # disabled
circle_left_4 = Circle(circle_left_3)  # disabled
r_right_outer_3 = Number(r_right_outer)  # disabled
r_left_3 = Number(r_left)  # disabled
r_left_outer_3 = Number(r_left_outer)  # disabled
r_right_2 = Number(r_right)  # disabled
merge_4 = Merge(Data1=r_left_3, Data2=r_left_outer_3, Data3=r_right_2, Data4=r_right_outer_3)  # -> flatten(Result); disabled
merge_5 = Merge(Data1=circle_left_4, Data2=outer_circle_left_3, Data3=circle_right_4, Data4=outer_circle_right_3)  # -> flatten(Result); disabled
area = Area(Geometry=merge_5)  # -> Area, Centroid; disabled
deconstruct_2 = Deconstruct(Point=area.Centroid)  # -> XComponent, YComponent, ZComponent; disabled
addition_8 = Addition(A=deconstruct_2.ZComponent, B=merge_4)  # disabled
construct_point_2 = ConstructPoint(XCoordinate=deconstruct_2.XComponent, YCoordinate=deconstruct_2.YComponent, ZCoordinate=addition_8)  # disabled
annotation_dot_4 = AnnotationDot(Location=construct_point_2, PrimaryText=merge_4)  # -> AnnotationDot, Location, PrimaryText, TextHeight; disabled
annotation_dot_5 = AnnotationDot(annotation_dot_4.AnnotationDot)  # disabled
circle_3 = Circle(merge_5)  # disabled

panel_29 = Panel("Left Slit")  # disabled
panel_30 = Panel("Intersected Solid")  # disabled
panel_31 = Panel("Right Slit")  # disabled
panel_32 = Panel("Object ID")  # disabled
panel_33 = Panel("Direction Indicator")  # disabled
panel_34 = Panel("Mesh Smoothing")  # disabled
panel_35 = Panel("Print Bed Orientation")  # disabled
blank_positioned_2 = Brep(blank_positioned)  # disabled
annotation_dot_6 = AnnotationDot(Location=annotation_location, PrimaryText=panel_29)  # -> AnnotationDot, Location, PrimaryText, TextHeight; disabled
annotation_dot_7 = AnnotationDot(Location=annotation_location, PrimaryText=panel_30)  # -> AnnotationDot, Location, PrimaryText, TextHeight; disabled
annotation_dot_8 = AnnotationDot(Location=annotation_location, PrimaryText=panel_31)  # -> AnnotationDot, Location, PrimaryText, TextHeight; disabled
annotation_dot_9 = AnnotationDot(Location=annotation_location, PrimaryText=panel_32)  # -> AnnotationDot, Location, PrimaryText, TextHeight; disabled
annotation_dot_10 = AnnotationDot(Location=annotation_location, PrimaryText=panel_33)  # -> AnnotationDot, Location, PrimaryText, TextHeight; disabled
annotation_dot_11 = AnnotationDot(Location=annotation_location, PrimaryText=panel_34)  # -> AnnotationDot, Location, PrimaryText, TextHeight; disabled
annotation_dot_12 = AnnotationDot(Location=annotation_location, PrimaryText=panel_35)  # -> AnnotationDot, Location, PrimaryText, TextHeight; disabled

# ----
# Solid Intersection Template
blank_positioned_3 = Brep(blank_positioned)  # disabled
front_outer_perimeter_positioned_left_2 = Curve(front_outer_perimeter_positioned_left)  # disabled
front_perimeter_positioned_right = Curve(front_outer_perimeter_positioned_right)  # disabled
back_outer_perimeter_positioned_right_2 = Curve(back_outer_perimeter_positioned_right)  # disabled
back_outer_perimeter_positioned_left_2 = Curve(back_outer_perimeter_positioned_left)  # disabled
far_left_back = Panel("-1000, 1000, 0")  # disabled
far_left_forward = Panel("1000, 1000, 0")  # disabled
far_right_forward = Panel("1000, -1000, 0")  # disabled
far_right_backward = Panel("-1000, -1000, 0")  # disabled
point = Point(far_left_forward)  # disabled
point_2 = Point(far_left_back)  # disabled
point_3 = Point(far_right_forward)  # disabled
point_4 = Point(far_right_backward)  # disabled
curve_closest_point = CurveClosestPoint(Point=point_2, Curve=front_outer_perimeter_positioned_left_2)  # -> Point, Parameter, Distance; disabled
curve_closest_point_2 = CurveClosestPoint(Point=point_3, Curve=back_outer_perimeter_positioned_right_2)  # -> Point, Parameter, Distance; disabled
curve_closest_point_3 = CurveClosestPoint(Point=point_4, Curve=front_perimeter_positioned_right)  # -> Point, Parameter, Distance; disabled
curve_closest_point_4 = CurveClosestPoint(Point=point, Curve=back_outer_perimeter_positioned_left_2)  # -> Point, Parameter, Distance; disabled
merge_6 = Merge(
    Data1=curve_closest_point_4.Point,
    Data2=curve_closest_point_2.Point,
    Data3=curve_closest_point_3.Point,
    Data4=curve_closest_point.Point)  # -> flatten(Result); disabled
panel_36 = Panel("-100")  # disabled
polyline = PolyLine(Vertices=merge_6, Closed=True)  # disabled
unit_z_7 = UnitZ(Factor=panel_36)  # disabled
boundary_surfaces_5 = BoundarySurfaces(Edges=polyline)  # disabled
reverse_2 = Reverse(Vector=unit_z_7)  # disabled
move_6 = Move(Geometry=boundary_surfaces_5, Motion=unit_z_7)  # -> Geometry, Transform; disabled
panel_37 = Panel("2")  # disabled
multiplication_4 = Multiplication(A=reverse_2, B=panel_37)  # disabled
extrude_4 = Extrude(Base=move_6.Geometry, Direction=multiplication_4)  # disabled
blank_positioned_4 = Brep(blank_positioned_3)  # disabled
solid_intersection = SolidIntersection(BrepsA=extrude_4, BrepsB=blank_positioned_4)  # disabled
panel_38 = Panel("0.4")  # disabled
python_3_script_2 = Python3Script(fillet_brep=solid_intersection, fillet_r=panel_38, x=boolean_toggle_3)  # -> out, output_brep, flatten(sharp_edges); inputs fillet_brep: Brep, fillet_r: Double; disabled
# ---------- python_3_script_2: Python ----------
# This file represents a stub for a GhPython component in Grasshopper.
# It sets up the environment to import and use the splintcommon or other external modules.

from pathlib import Path
import sys
from importlib import reload #FOR DEV
import time

# Walk up through nested clusters to find the root GH document (necessary for use in nested clusters)
doc = ghenv.Component.OnPingDocument()
while not doc.FilePath and doc.Owner:
    doc = doc.Owner.OnPingDocument()
ghFileDir = str(Path(doc.FilePath).resolve().parent / "src")

print(f"{ghFileDir=}")

if ghFileDir not in sys.path:
    print("ghFileDir needed to be included")
    sys.path.append(ghFileDir)

import splintcommon
reload(splintcommon) #FOR DEV
from splintcommon import mark_generation_start
mark_generation_start()

#splintcommon module is now available for use in this GhPython component
splintcommon.log(f'Gh FilletSharpEdges Node initialized at {time.ctime()}')

#Component code here

import BrepFillet
reload(BrepFillet)
from BrepFillet import fillet_sharp_edges, find_sharp_edges

# fillet_r = 0.1
output_brep = fillet_sharp_edges(fillet_brep, fillet_r, 60.0, 0.1)

# sharp_edges, sharp_angles = find_sharp_edges(fillet_brep, 60.0)

# print(f"{type(sharp_edges)}")
# print(f"{sharp_edges=}")
# ---------- end python_3_script_2 ----------
panel_39 = Panel(python_3_script_2.out)  # disabled
horizontal_outline_surface = Geometry(boundary_surfaces_5)  # disabled
horizontal_outline = Geometry(polyline)  # disabled
horizontal_cutter = Brep(extrude_4)  # disabled
splint_brep = Brep(python_3_script_2.output_brep)  # disabled

print_bed_laydown_line = Line(StartPoint=curve_closest_point.Point, EndPoint=curve_closest_point_3.Point)  # disabled
horizontal_cutter_2 = Brep(extrude_4)  # disabled

print_bed_laydown_line_2 = Line(print_bed_laydown_line)  # disabled

print_bed_laydown_line_3 = Line(print_bed_laydown_line_2)  # disabled
unit_vector = UnitVector(Vector=print_bed_laydown_line_3)  # disabled
end_points = EndPoints(Curve=print_bed_laydown_line_3)  # -> Start, End; disabled
point_5 = Point(end_points.Start)  # disabled
point_6 = Point(end_points.End)  # disabled

# ----
# Solid Construction Geometry
front_circle_left_positioned_2 = Circle(front_circle_left_positioned)  # disabled
front_outer_perimeter_positioned_left_3 = Curve(front_outer_perimeter_positioned_left)  # disabled
front_circle_right_positioned_2 = Circle(front_circle_right_positioned)  # disabled
front_outer_perimeter_positioned_right_2 = Curve(front_outer_perimeter_positioned_right)  # disabled
back_circle_left_positioned_2 = Circle(back_circle_left_positioned)  # disabled
back_outer_perimeter_positioned_left_3 = Curve(back_outer_perimeter_positioned_left)  # disabled
back_circle_right_positioned_2 = Circle(back_circle_right_positioned)  # disabled
back_outer_perimeter_positioned_right_3 = Curve(back_outer_perimeter_positioned_right)  # disabled
horizontal_outline_surface_2 = Geometry(horizontal_outline_surface)  # disabled
horizontal_outline_2 = Geometry(horizontal_outline)  # disabled
merge_7 = Merge(
    Data1=front_circle_left_positioned_2,
    Data2=front_outer_perimeter_positioned_left_3,
    Data3=front_circle_right_positioned_2,
    Data4=front_outer_perimeter_positioned_right_2)  # -> flatten(Result); disabled
merge_8 = Merge(
    Data1=back_circle_left_positioned_2,
    Data2=back_outer_perimeter_positioned_left_3,
    Data3=back_circle_right_positioned_2,
    Data4=back_outer_perimeter_positioned_right_3)  # -> flatten(Result); disabled
merge_9 = Merge(Data1=horizontal_outline_2, Data2=horizontal_outline_surface_2)  # -> flatten(Result); disabled
horizontal_geometry = Geometry(merge_9)  # disabled
back_geometry = Geometry(merge_8)  # disabled
front_geometry = Geometry(merge_7)  # disabled

horizontal_cutter_3 = Brep(horizontal_cutter)  # disabled
splint_brep_2 = Brep(splint_brep)  # disabled
print_bed_laydown_line_4 = Line(print_bed_laydown_line_2)  # disabled

# ----
# Laydown Line Perp Calcs
print_bed_laydown_line_5 = Line(print_bed_laydown_line_2)  # disabled
panel_40 = Panel("0.3")  # disabled
perp_frame = PerpFrame(Curve=print_bed_laydown_line_5, Parameter=panel_40)  # disabled
panel_41 = Panel("0, -100, 0")  # disabled
panel_42 = Panel("50")  # disabled
line_sdl = LineSDL(Start=perp_frame, Direction=panel_41, Length=panel_42)  # disabled
xy_plane_3 = XYPlane(Origin=Point(0, 0, 0))  # disabled
deconstruct_plane = DeconstructPlane(Plane=perp_frame)  # -> Origin, XAxis, YAxis, ZAxis; disabled
panel_43 = Panel("Xw")  # disabled
orient = Orient(Geometry=line_sdl, Source=xy_plane_3, Target=perp_frame)  # -> Geometry, Transform; disabled
unit_vector_2 = UnitVector(Vector=print_bed_laydown_line_5)  # disabled
reverse_3 = Reverse(Vector=unit_vector_2)  # disabled
unit_vector_3 = UnitVector(Vector=orient.Geometry)  # disabled
construct_plane = ConstructPlane(Origin=deconstruct_plane.Origin, XAxis=unit_vector_3, YAxis=reverse_3)  # disabled
vizplane_2 = VizPlane(plane=construct_plane)  # -> tip_2, line_2, annotation_dot_2; disabled
tip_2 = Brep(vizplane_2.tip_2)  # disabled
line_2 = Line(vizplane_2.line_2)  # disabled
annotation_dot_13 = AnnotationDot(vizplane_2.annotation_dot_2)  # disabled
laydown_line_perp_dir = Vector(unit_vector_3)  # disabled
laydown_plane = Plane(construct_plane)  # disabled

# ----
# Left Slit
laydown_line_perp_dir_2 = Vector(laydown_line_perp_dir)  # disabled
splint_brep_3 = Brep(splint_brep)  # disabled
b_left_slit_3 = Boolean(b_left_slit_2)  # disabled
laydown_plane_2 = Plane(laydown_plane)  # disabled
panel_44 = Panel("0.3")  # disabled
shortcircuit_slit_py = Python3Script(is_slit_active=b_left_slit_3, splint_brep=splint_brep_3)  # -> out, brep_to_slit, brep_to_shortcircuit; inputs is_slit_active: Boolean, splint_brep: Brep; disabled
# ---------- shortcircuit_slit_py: Python ----------
if is_slit_active:
    brep_to_slit = splint_brep
    brep_to_shortcircuit = None
else:
    brep_to_slit = None
    brep_to_shortcircuit = splint_brep
# ---------- end shortcircuit_slit_py ----------
unit_z_8 = UnitZ(Factor=1)  # disabled
box_center_slice_py = Python3Script(target_brep=shortcircuit_slit_py.brep_to_slit, view_vector=laydown_line_perp_dir_2, bbox_plane=laydown_plane_2)  # -> out, slice_surface, y_shift; inputs target_brep: Brep, view_vector: Vector3d, bbox_plane: Plane; disabled
# ---------- box_center_slice_py: Python ----------
# This file represents a stub for a GhPython component in Grasshopper.
# It sets up the environment to import and use the splintcommon or other external modules.

from pathlib import Path
import sys
from importlib import reload #FOR DEV
import time

# In normal GH doc
ghFileDir = None
try:
    ghFileDir = str(Path.joinpath(Path(ghenv.Component.OnPingDocument().FilePath).resolve().parents[0], "src"))
except:
    # In GH Cluster
    ghFileDir = str(Path.joinpath(Path(ghenv.Component.OnPingDocument().Owner.OnPingDocument().FilePath).resolve().parents[0], "src"))

print(f"{ghFileDir=}")

if ghFileDir not in sys.path:
    print("ghFileDir needed to be included")
    sys.path.append(ghFileDir)

import splintcommon
reload(splintcommon) #FOR DEV

#splintcommon module is now available for use in this GhPython component
splintcommon.log(f'GhPython Node initialized at {time.ctime()}')

import FeatureIdentification
reload(FeatureIdentification) #FOR DEV
from FeatureIdentification import box_center_slice

import Rhino.Geometry as rg

# Get a slice plane at the center, facing +Y direction
slice_surface, sizes = box_center_slice(
    target_brep=target_brep,
    bbox_plane=bbox_plane, #rg.Plane.WorldXY,
    choose_side_vector=view_vector,
    return_size=True,
)

print(f"{sizes=}")

y_shift = sizes[1] * .6

print(f"{y_shift=}")
# ---------- end box_center_slice_py ----------
box_center_slice_py_2 = Python3Script(target_brep=shortcircuit_slit_py.brep_to_slit, view_vector=unit_z_8)  # -> out, slice_surface, y_shift; inputs target_brep: Brep, view_vector: Vector3d; disabled
# ---------- box_center_slice_py_2: Python ----------
# This file represents a stub for a GhPython component in Grasshopper.
# It sets up the environment to import and use the splintcommon or other external modules.

from pathlib import Path
import sys
from importlib import reload #FOR DEV
import time

# In normal GH doc
ghFileDir = None
try:
    ghFileDir = str(Path.joinpath(Path(ghenv.Component.OnPingDocument().FilePath).resolve().parents[0], "src"))
except:
    # In GH Cluster
    ghFileDir = str(Path.joinpath(Path(ghenv.Component.OnPingDocument().Owner.OnPingDocument().FilePath).resolve().parents[0], "src"))

print(f"{ghFileDir=}")

if ghFileDir not in sys.path:
    print("ghFileDir needed to be included")
    sys.path.append(ghFileDir)

import splintcommon
reload(splintcommon) #FOR DEV

#splintcommon module is now available for use in this GhPython component
splintcommon.log(f'GhPython Node initialized at {time.ctime()}')

import FeatureIdentification
reload(FeatureIdentification) #FOR DEV
from FeatureIdentification import box_center_slice

import Rhino.Geometry as rg

# Get a slice plane at the center, facing +Y direction
slice_surface, sizes = box_center_slice(
    target_brep=target_brep,
    bbox_plane=rg.Plane.WorldXY,
    choose_side_vector=view_vector,
    return_size=True,
)

print(f"{sizes=}")

y_shift = sizes[1] * .6

print(f"{y_shift=}")
# ---------- end box_center_slice_py_2 ----------
unit_y_5 = UnitY(Factor=box_center_slice_py.y_shift)  # disabled
move_7 = Move(Geometry=box_center_slice_py_2.slice_surface, Motion=unit_y_5)  # -> Geometry, Transform; disabled
slitbot_py = Python3Script(splint_brep=shortcircuit_slit_py.brep_to_slit, slit_panel=move_7.Geometry, slit_thickness=panel_44)  # -> out, brep_out, flatten(side_a_edges), flatten(side_b_edges), side_a_cutter, side_b_cutter; inputs splint_brep: Brep, slit_panel: Brep, slit_thickness: Double; disabled
# ---------- slitbot_py: Python ----------
# This file represents a stub for a GhPython component in Grasshopper.
# It sets up the environment to import and use the splintcommon or other external modules.

from pathlib import Path
import sys
from importlib import reload #FOR DEV
import time

# Walk up through nested clusters to find the root GH document (necessary for use in nested clusters)
doc = ghenv.Component.OnPingDocument()
while not doc.FilePath and doc.Owner:
    doc = doc.Owner.OnPingDocument()
ghFileDir = str(Path(doc.FilePath).resolve().parent / "src")

print(f"{ghFileDir=}")

if ghFileDir not in sys.path:
    print("ghFileDir needed to be included")
    sys.path.append(ghFileDir)

import splintcommon
reload(splintcommon) #FOR DEV
from splintcommon import mark_generation_start
mark_generation_start()

#splintcommon module is now available for use in this GhPython component
splintcommon.log(f'GhPython Node initialized at {time.ctime()}')

#Component code here

import BrepSlit
reload(BrepSlit)
from BrepSlit import cut_slit

fillet_radius = 0.3

brep_out, side_a_edges, side_b_edges, side_a_cutter, side_b_cutter = cut_slit(splint_brep, slit_panel, slit_thickness, fillet_radius)

print(f"{side_a_edges=}")
print(f"{side_b_edges=}")
# ---------- end slitbot_py ----------
shortcircuit_slit_py_2 = Python3Script(is_slit_active=b_left_slit_3, slit_brep=slitbot_py.brep_out, splint_brep=shortcircuit_slit_py.brep_to_shortcircuit)  # -> out, out_brep; inputs is_slit_active: Boolean, slit_brep: Brep, splint_brep: Brep; disabled
# ---------- shortcircuit_slit_py_2: Python ----------
print(f"{is_slit_active=}")
if is_slit_active:
    print("Returning the slit brep")
    out_brep = slit_brep
else:
    print("Returning the boring splint")
    out_brep = splint_brep
# ---------- end shortcircuit_slit_py_2 ----------
splint_brep_left_slit = Brep(shortcircuit_slit_py_2.out_brep)  # disabled

# ----
# Right Slit
laydown_line_perp_dir_3 = Vector(laydown_line_perp_dir)  # disabled
splint_brep_4 = Brep(splint_brep_left_slit)  # disabled
laydown_plane_3 = Plane(laydown_plane)  # disabled
b_right_slit_2 = Boolean(b_right_slit)  # disabled
shortcircuit_slit_py_3 = Python3Script(is_slit_active=b_right_slit_2, splint_brep=splint_brep_4)  # -> out, brep_to_slit, brep_to_shortcircuit; inputs is_slit_active: Boolean, splint_brep: Brep; disabled; same code as shortcircuit_slit_py
unit_z_9 = UnitZ(Factor=1)  # disabled
box_center_slice_py_3 = Python3Script(target_brep=shortcircuit_slit_py_3.brep_to_slit, view_vector=laydown_line_perp_dir_3, bbox_plane=laydown_plane_3)  # -> out, slice_surface, y_shift; inputs target_brep: Brep, view_vector: Vector3d, bbox_plane: Plane; disabled; same code as box_center_slice_py
box_center_slice_py_4 = Python3Script(target_brep=shortcircuit_slit_py_3.brep_to_slit, view_vector=unit_z_9)  # -> out, slice_surface, y_shift; inputs target_brep: Brep, view_vector: Vector3d; disabled; same code as box_center_slice_py_2
unit_y_6 = UnitY(Factor=box_center_slice_py_3.y_shift)  # disabled
reverse_4 = Reverse(Vector=unit_y_6)  # disabled
move_8 = Move(Geometry=box_center_slice_py_4.slice_surface, Motion=reverse_4)  # -> Geometry, Transform; disabled
slitbot_py_2 = Python3Script(splint_brep=shortcircuit_slit_py_3.brep_to_slit, slit_panel=move_8.Geometry, slit_thickness=panel_44)  # -> out, brep_out, flatten(side_a_edges), flatten(side_b_edges), side_a_cutter, side_b_cutter; inputs splint_brep: Brep, slit_panel: Brep, slit_thickness: Double; disabled; same code as slitbot_py
shortcircuit_slit_py_4 = Python3Script(is_slit_active=b_right_slit_2, slit_brep=slitbot_py_2.brep_out, splint_brep=shortcircuit_slit_py_3.brep_to_shortcircuit)  # -> out, out_brep; inputs is_slit_active: Boolean, slit_brep: Brep, splint_brep: Brep; disabled; same code as shortcircuit_slit_py_2
splint_brep_right_slit = Brep(shortcircuit_slit_py_4.out_brep)  # disabled

panel_45 = Panel(slitbot_py_2.out)  # disabled
panel_46 = Panel(slitbot_py.out)  # disabled
laydown_line_perp_dir_4 = Vector(laydown_line_perp_dir)  # disabled
splint_brep_right_slit_2 = Brep(splint_brep_right_slit)  # disabled
splint_brep_left_slit_2 = Brep(splint_brep_left_slit)  # disabled
merge_10 = Merge(Data1=splint_brep_left_slit_2, Data2=annotation_dot_6.AnnotationDot)  # -> flatten(Result); disabled
merge_11 = Merge(Data1=splint_brep_right_slit_2, Data2=annotation_dot_8.AnnotationDot)  # -> flatten(Result); disabled

# ----
# ID Embossing Gun
text_size = Slider(3.3, range=2.5..6)  # disabled
axial_band_thickness_mm_9 = Number(axial_band_thickness_mm_3)  # disabled
objectid_3 = Text(objectid_2)  # disabled
finishedsplintbrep = Brep(splint_brep_right_slit)  # disabled
panel_47 = Panel(objectid_3)  # disabled
panel_48 = Panel("0.29")  # disabled
panel_49 = Panel("4")  # disabled
panel_50 = Panel("proj")  # disabled
boolean_toggle_4 = BooleanToggle(False)  # disabled
panel_51 = Panel("up")  # disabled
vizvector = Arrow(direction=Vector(0, 0, 1), arrowlen=panel_49, text=panel_51)  # -> cone_2, line, annotation_dot_2; disabled
vizvector_2 = Arrow(direction=Vector(0, 0, 1), arrowlen=panel_49, text=panel_50)  # -> cone_2, line, annotation_dot_2; disabled
tip_3 = Brep(vizvector.cone_2)  # disabled
line_3 = Line(vizvector.line)  # disabled
annotation_dot_14 = AnnotationDot(vizvector.annotation_dot_2)  # disabled

vizvector_3 = Arrow(start=deconstruct_plane.Origin, direction=unit_vector_3, arrowlen=panel_49, text=panel_43)  # -> cone_2, line, annotation_dot_2; disabled

very_specific_text_origin_finder_cl = VerySpecificTextOriginFinderCL(target_brep_2=finishedsplintbrep, target_brep=finishedsplintbrep)  # disabled
text_origin_pt = Point(very_specific_text_origin_finder_cl)  # disabled

textgun_py_4 = Python3Script(
    splint_brep=finishedsplintbrep,
    object_id=objectid_3,
    text_up_vector=laydown_line_perp_dir_4,
    wall_thickness_mm=axial_band_thickness_mm_9,
    text_size=text_size,
    text_projection_vector=unit_z_6,
    extrusion_depth_factor=panel_48,
    projection_origin=text_origin_pt,
    x=boolean_toggle_4)  # -> out, embossedBrep, originalTextBreps, final_text_plane, projected_letters; inputs splint_brep: Brep, object_id: String, text_up_vector: Vector3d, text_size: Double, text_projection_vector: Vector3d, extrusion_depth_factor: Double, projection_origin: Point3d; disabled
# ---------- textgun_py_4: Python ----------
# This file represents a stub for a GhPython component in Grasshopper.
# It sets up the environment to import and use the splintcommon or other external modules.

from pathlib import Path
import sys
from importlib import reload #FOR DEV ONLY
import time

# In normal GH doc
ghFileDir = None
try:
    ghFileDir = str(Path.joinpath(Path(ghenv.Component.OnPingDocument().FilePath).resolve().parents[0], "src"))
except:
    # In GH Cluster
    ghFileDir = str(Path.joinpath(Path(ghenv.Component.OnPingDocument().Owner.OnPingDocument().FilePath).resolve().parents[0], "src"))

print(f"{ghFileDir=}")

if ghFileDir not in sys.path:
    print("ghFileDir needed to be included")
    sys.path.append(ghFileDir)

import splintcommon
reload(splintcommon) #FOR DEV

#splintcommon module is now available for use in this GhPython component
splintcommon.log(f'GhPython Node initialized at {time.ctime()}')

import TextGun
reload(TextGun) #FOR DEV
from TextGun import emboss_text

embossedBrep, originalTextBreps, projected_letters, final_text_plane = emboss_text(
    target_brep=splint_brep,
    text_content=object_id,
    wall_thickness_mm=wall_thickness_mm,
    text_size=text_size,
    text_up_vector=text_up_vector,
    text_projection_vector=text_projection_vector,
    extrusion_depth_factor=extrusion_depth_factor,
    projection_origin=projection_origin,
    emboss_inside=True,
    align_to_surface_normal=True
)
# ---------- end textgun_py_4 ----------
plane_3 = Plane(textgun_py_4.final_text_plane)  # disabled
vizplane_3 = VizPlane(plane=plane_3)  # -> tip_2, line_2, annotation_dot_2; disabled
brep_6 = Brep(textgun_py_4.originalTextBreps)  # disabled
panel_52 = Panel(textgun_py_4.out)  # disabled
tip_4 = Brep(vizplane_3.tip_2)  # disabled
line_4 = Line(vizplane_3.line_2)  # disabled
annotation_dot_15 = AnnotationDot(vizplane_3.annotation_dot_2)  # disabled
plane_4 = Plane(textgun_py_4.final_text_plane)  # disabled
projected_letters_brep = Brep(graft(textgun_py_4.projected_letters))  # disabled
splint_with_embossed_id = Brep(textgun_py_4.embossedBrep)  # disabled
panel_53 = Panel(projected_letters_brep)  # disabled

# ----
# Direction Indicator
ball_r_to_wall_ratio = Slider(0.68, range=0.6..1)  # disabled
splint_body = Brep(splint_with_embossed_id)  # disabled
axial_band_thickness_mm_10 = Number(axial_band_thickness_mm_3)  # disabled
unit_y_7 = UnitY(Factor=1)  # disabled
unit_y_8 = UnitY(Factor=1)  # disabled
unit_z_10 = UnitZ(Factor=1)  # disabled
multiplication_5 = Multiplication(A=axial_band_thickness_mm_10, B=ball_r_to_wall_ratio)  # disabled
xy_plane_4 = XYPlane(Origin=Point(0, 0, 0))  # disabled
nub_radius = Panel(multiplication_5)  # disabled
box_center_slice_py_5 = Python3Script(target_brep=splint_body, view_vector=unit_y_8)  # -> out, slice_surface, y_shift; inputs target_brep: Brep, view_vector: Vector3d; disabled; same code as box_center_slice_py_2
box_center_slice_py_6 = Python3Script(target_brep=splint_body, view_vector=unit_z_10, bbox_plane=xy_plane_4)  # -> out, slice_surface, y_shift; inputs target_brep: Brep, view_vector: Vector3d, bbox_plane: Plane; disabled; same code as box_center_slice_py
area_2 = Area(Geometry=box_center_slice_py_5.slice_surface)  # -> Area, Centroid; disabled
deconstruct_3 = Deconstruct(Point=area_2.Centroid)  # -> XComponent, YComponent, ZComponent; disabled
area_3 = Area(Geometry=box_center_slice_py_6.slice_surface)  # -> Area, Centroid; disabled
panel_54 = Panel("0.6")  # disabled
scale = Scale(Geometry=box_center_slice_py_6.slice_surface, Center=area_3.Centroid, Factor=panel_54)  # -> Geometry, Transform; disabled
brep_brep = BrepBrep(BrepA=splint_body, BrepB=scale.Geometry)  # -> Curves, Points; disabled
panel_55 = Panel("0")  # disabled
list_item = ListItem(List=brep_brep.Curves, Index=panel_55, Wrap=True)  # disabled
panel_56 = Panel("0")  # disabled
area_4 = Area(Geometry=list_item)  # -> Area, Centroid; disabled
panel_57 = Panel("-100")  # disabled
central_post_centroid = Point(area_4.Centroid)  # disabled
central_post_centroid_2 = Point(central_post_centroid)  # disabled
deconstruct_4 = Deconstruct(Point=central_post_centroid_2)  # -> XComponent, YComponent, ZComponent; disabled
construct_point_3 = ConstructPoint(XCoordinate=deconstruct_3.XComponent, YCoordinate=deconstruct_4.YComponent, ZCoordinate=deconstruct_3.ZComponent)  # disabled
move_to_point = MoveToPoint(Geometry=box_center_slice_py_5.slice_surface, PointA=area_2.Centroid, PointB=construct_point_3)  # -> Moved, Vector, Transform; disabled
brep_brep_2 = BrepBrep(BrepA=splint_body, BrepB=move_to_point.Moved)  # -> Curves, Points; disabled
list_item_2 = ListItem(List=brep_brep_2.Curves, Index=panel_56, Wrap=True)  # disabled
central_post_cross_section = Curve(list_item_2)  # disabled
unit_z_11 = UnitZ(Factor=panel_57)  # disabled
move_9 = Move(Geometry=central_post_centroid, Motion=unit_z_11)  # -> Geometry, Transform; disabled
curve_closest_point_5 = CurveClosestPoint(Point=move_9.Geometry, Curve=central_post_cross_section)  # -> Point, Parameter, Distance; disabled
deconstruct_5 = Deconstruct(Point=curve_closest_point_5.Point)  # -> XComponent, YComponent, ZComponent; disabled
panel_58 = Panel("100")  # disabled
negative = Negative(Value=panel_58)  # disabled
construct_point_4 = ConstructPoint(XCoordinate=panel_58, YCoordinate=deconstruct_5.YComponent, ZCoordinate=negative)  # disabled
curve_closest_point_6 = CurveClosestPoint(Point=construct_point_4, Curve=central_post_cross_section)  # -> Point, Parameter, Distance; disabled
line_5 = Line(StartPoint=curve_closest_point_5.Point, EndPoint=curve_closest_point_6.Point)  # disabled
point_on_curve = PointOnCurve(line_5, parameter=0.564)  # disabled
point_7 = Point(point_on_curve)  # disabled
xy_plane_5 = XYPlane(Origin=point_7)  # disabled
sphere = Sphere(Base=xy_plane_5, Radius=nub_radius)  # disabled
splint_body_2 = Brep(splint_body)  # disabled
solid_difference_2 = SolidDifference(BrepsA=splint_body_2, BrepsB=sphere)  # disabled
splints_w_direction_indicator = Brep(solid_difference_2)  # disabled

direction_sphere = Geometry(sphere)  # disabled

# ----
# Final Meshing
# And Smoothing
number_slider_2 = Slider(0.12, range=0.05..0.2)  # disabled
splint_brep_5 = Brep(splints_w_direction_indicator)  # disabled
number_slider_3 = Slider(8, range=0..10)  # disabled
shrinkwrap = ShrinkWrap(Geometry=splint_brep_5, EdgeLength=number_slider_2, Offset=0, Smoothing=number_slider_3, Optimization=10, FillHoles=True)  # disabled
splint_smooth_mesh = Mesh(shrinkwrap)  # disabled

splint_with_embossed_id_2 = Brep(splint_with_embossed_id)  # disabled
projected_letters_brep_2 = Brep(graft(projected_letters_brep))  # disabled
splints_w_direction_indicator_2 = Brep(splints_w_direction_indicator)  # disabled
direction_sphere_2 = Geometry(direction_sphere)  # disabled
splint_smooth_mesh_2 = Mesh(splint_smooth_mesh)  # disabled

# ----
# Print Bed Orientation
print_bed_laydown_line_6 = Line(print_bed_laydown_line_2)  # disabled
splint = Geometry(splint_smooth_mesh)  # disabled
panel_59 = Panel("90")  # disabled
rotate_axis = RotateAxis(Geometry=splint, Angle=degrees(panel_59), Axis=print_bed_laydown_line_6)  # -> Geometry, Transform; disabled
oriented_splint = Geometry(rotate_axis.Geometry)  # disabled

oriented_splint_2 = Geometry(oriented_splint)  # disabled

# ----
# Probe Construction
splint_brep_6 = Brep(splints_w_direction_indicator)  # disabled
front_circle_left_positioned_3 = Circle(front_circle_left_positioned)  # disabled
back_circle_left_positioned_3 = Circle(back_circle_left_positioned)  # disabled
back_circle_right_positioned_3 = Circle(back_circle_right_positioned)  # disabled
front_circle_right_positioned_3 = Circle(front_circle_right_positioned)  # disabled
unit_y_9 = UnitY(Factor=1)  # disabled
yz_plane_2 = YZPlane(Origin=Point(0, 0, 0))  # disabled
bounding_box = BoundingBox(Content=[front_circle_left_positioned_3, back_circle_left_positioned_3], Plane=PlaneXY(0, 0, 0), UnionBox=True)  # -> Box, Box_2; disabled
bounding_box_2 = BoundingBox(Content=[front_circle_right_positioned_3, back_circle_right_positioned_3], Plane=PlaneXY(0, 0, 0), UnionBox=True)  # -> Box, Box_2; disabled
box_center_slice_py_7 = Python3Script(target_brep=splint_brep_6, view_vector=unit_y_9, bbox_plane=yz_plane_2)  # -> out, slice_surface, y_shift; inputs target_brep: Brep, view_vector: Vector3d, bbox_plane: Plane; disabled; same code as box_center_slice_py
volume_2 = Volume(Geometry=bounding_box.Box)  # -> Volume, Centroid; disabled
volume_3 = Volume(Geometry=bounding_box_2.Box)  # -> Volume, Centroid; disabled
area_5 = Area(Geometry=box_center_slice_py_7.slice_surface)  # -> Area, Centroid; disabled
deconstruct_6 = Deconstruct(Point=volume_3.Centroid)  # -> XComponent, YComponent, ZComponent; disabled
deconstruct_7 = Deconstruct(Point=volume_2.Centroid)  # -> XComponent, YComponent, ZComponent; disabled
deconstruct_8 = Deconstruct(Point=area_5.Centroid)  # -> XComponent, YComponent, ZComponent; disabled
construct_point_5 = ConstructPoint(XCoordinate=deconstruct_8.XComponent, YCoordinate=deconstruct_6.YComponent, ZCoordinate=deconstruct_8.ZComponent)  # disabled
construct_point_6 = ConstructPoint(XCoordinate=deconstruct_8.XComponent, YCoordinate=deconstruct_7.YComponent, ZCoordinate=deconstruct_8.ZComponent)  # disabled
unit_z_12 = UnitZ(Factor=1)  # disabled
panel_60 = Panel("30")  # disabled

scale_2 = Scale(Geometry=box_center_slice_py_7.slice_surface, Center=area_5.Centroid, Factor=panel_28)  # -> Geometry, Transform; disabled

move_to_point_2 = MoveToPoint(Geometry=scale_2.Geometry, PointA=area_5.Centroid, PointB=construct_point_5)  # -> Moved, Vector, Transform; disabled
move_to_point_3 = MoveToPoint(Geometry=scale_2.Geometry, PointA=area_5.Centroid, PointB=construct_point_6)  # -> Moved, Vector, Transform; disabled
brep_brep_3 = BrepBrep(BrepA=splint_brep_6, BrepB=move_to_point_2.Moved)  # -> Curves, Points; disabled
brep_brep_4 = BrepBrep(BrepA=splint_brep_6, BrepB=move_to_point_3.Moved)  # -> Curves, Points; disabled
area_6 = Area(Geometry=brep_brep_3.Curves)  # -> Area, Centroid; disabled
area_7 = Area(Geometry=brep_brep_4.Curves)  # -> Area, Centroid; disabled
average = Average(Input=area_6.Centroid)  # disabled
deconstruct_9 = Deconstruct(Point=average)  # -> XComponent, YComponent, ZComponent; disabled
average_2 = Average(Input=area_7.Centroid)  # disabled
average_3 = Average(Input=[average_2, average])  # disabled
deconstruct_10 = Deconstruct(Point=average_3)  # -> XComponent, YComponent, ZComponent; disabled
deconstruct_11 = Deconstruct(Point=average_2)  # -> XComponent, YComponent, ZComponent; disabled
construct_point_7 = ConstructPoint(XCoordinate=deconstruct_10.XComponent, YCoordinate=deconstruct_9.YComponent, ZCoordinate=deconstruct_9.ZComponent)  # disabled
construct_point_8 = ConstructPoint(XCoordinate=deconstruct_10.XComponent, YCoordinate=deconstruct_11.YComponent, ZCoordinate=deconstruct_11.ZComponent)  # disabled
line_6 = Line(StartPoint=construct_point_8, EndPoint=construct_point_7)  # disabled
line_sdl_2 = LineSDL(Start=average, Direction=unit_z_12, Length=panel_60)  # disabled
line_sdl_3 = LineSDL(Start=average_2, Direction=unit_z_12, Length=panel_60)  # disabled
middle_wall_probe_line = Line(line_6)  # disabled
right_probe_line = Line(line_sdl_2)  # disabled
left_probe_line = Line(line_sdl_3)  # disabled

# ----
# Wall Probe Data
middle_wall_probe_line_2 = Line(middle_wall_probe_line)  # disabled
right_probe_line_2 = Line(right_probe_line)  # disabled
left_probe_line_2 = Line(left_probe_line)  # disabled
splint_smooth_mesh_3 = Mesh(splint_smooth_mesh)  # disabled
wall_probe_data = Python3Script(
    splint_mesh=splint_smooth_mesh_3,
    left_probe_line=left_probe_line_2,
    right_probe_line=right_probe_line_2,
    middle_wall_probe_line=middle_wall_probe_line_2)  # -> out, preview_geos, py_wall_probe_data; inputs splint_mesh: Mesh, left_probe_line: Line, right_probe_line: Line, middle_wall_probe_line: Line; disabled
# ---------- wall_probe_data: Python ----------
# This file represents a stub for a GhPython component in Grasshopper.
# It sets up the environment to import and use the splintcommon or other external modules.

from pathlib import Path
import sys
from importlib import reload #FOR DEV
import time

# Walk up through nested clusters to find the root GH document (necessary for use in nested clusters)
doc = ghenv.Component.OnPingDocument()
while not doc.FilePath and doc.Owner:
    doc = doc.Owner.OnPingDocument()
ghFileDir = str(Path(doc.FilePath).resolve().parent / "src")

print(f"{ghFileDir=}")

if ghFileDir not in sys.path:
    print("ghFileDir needed to be included")
    sys.path.append(ghFileDir)

import splintcommon
reload(splintcommon) #FOR DEV
from splintcommon import mark_generation_start
mark_generation_start()

#splintcommon module is now available for use in this GhPython component
splintcommon.log(f'GhPython Node initialized at {time.ctime()}')

#Component code here

import splintmeasurement
reload(splintmeasurement) 
from splintmeasurement import measure_mesh_wall_thickness
preview_geos = []
py_wall_probe_data = {}

# LEFT upwards probe line
probe_data = measure_mesh_wall_thickness(splint_mesh, left_probe_line)
print(f"{probe_data=}")
py_wall_probe_data["left_ring_wall_thickness_mm"] = probe_data.get("thickness_mm", "None")
preview_geos.append(left_probe_line)
preview_geos.append(probe_data.get("inner_point", "None")) #"thickness_mm": None, "inner_point": inner_point, "outer_point": None
preview_geos.append(probe_data.get("outer_point", "None"))

# RIGHT upwards probe line
right_probe_data = measure_mesh_wall_thickness(splint_mesh, right_probe_line)
print(f"{right_probe_data=}")
py_wall_probe_data["right_ring_wall_thickness_mm"] = right_probe_data.get("thickness_mm", "None")
preview_geos.append(right_probe_line)
preview_geos.append(right_probe_data.get("inner_point", "None")) #"thickness_mm": None, "inner_point": inner_point, "outer_point": None
preview_geos.append(right_probe_data.get("outer_point", "None"))

# MIDDLE - left to right side probe line
middle_probe_data = measure_mesh_wall_thickness(splint_mesh, right_probe_line)
print(f"{middle_probe_data=}")
py_wall_probe_data["middle_wall_thickness_mm"] = middle_probe_data.get("thickness_mm", "None")
preview_geos.append(middle_wall_probe_line)
preview_geos.append(middle_probe_data.get("inner_point", "None")) #"thickness_mm": None, "inner_point": inner_point, "outer_point": None
preview_geos.append(middle_probe_data.get("outer_point", "None"))

# probe_thicknesses, preview_geo = measure_mesh_wall_thickness(splint_mesh, ray_lines, far_distance=200.0):
print(f"{py_wall_probe_data=}")

py_wall_probe_data = [py_wall_probe_data]
# ---------- end wall_probe_data ----------
panel_61 = Panel(wall_probe_data.py_wall_probe_data)  # disabled
probe_preview_geometry = Geometry(wall_probe_data.preview_geos)  # disabled
panel_62 = Panel(wall_probe_data.out)  # disabled
number_slider_4 = Slider(0, range=0..4)  # disabled
py_wall_probe_data_2 = Data(wall_probe_data.py_wall_probe_data)  # disabled
list_item_3 = ListItem(List=probe_preview_geometry, Index=number_slider_4, Wrap=False)  # disabled

probe_preview_geometry_2 = Geometry(probe_preview_geometry)  # disabled

# ----
# Preview Steps
merge_12 = Merge(Data1=splint_brep_2, Data2=annotation_dot_7.AnnotationDot)  # -> flatten(Result); disabled
merge_13 = Merge(Data1=front_geometry, Data2=back_geometry, Data3=horizontal_geometry)  # -> flatten(Result); disabled
merge_14 = Merge(Data1=horizontal_cutter_3, Data2=blank_positioned_2)  # -> flatten(Result); disabled
merge_15 = Merge(Data1=circle_3, Data2=annotation_dot_5)  # -> flatten(Result); disabled
merge_16 = Merge(Data1=splint_with_embossed_id_2, Data2=projected_letters_brep_2, Data3=annotation_dot_9.AnnotationDot)  # -> flatten(Result); disabled
merge_17 = Merge(Data1=splints_w_direction_indicator_2, Data2=direction_sphere_2, Data3=annotation_dot_10.AnnotationDot)  # -> flatten(Result); disabled
merge_18 = Merge(Data1=splint_smooth_mesh_2, Data2=annotation_dot_11.AnnotationDot, Data3=probe_preview_geometry_2)  # -> flatten(Result); disabled
merge_19 = Merge(Data1=print_bed_laydown_line_4, Data2=oriented_splint_2, Data3=annotation_dot_12.AnnotationDot)  # -> flatten(Result); disabled
panel_63 = Panel("250, 0, 0")  # disabled
panel_64 = Panel("120, 0, 0")  # disabled
panel_65 = Panel("60, 0, 0")  # disabled
panel_66 = Panel("350, 0, 0")  # disabled
panel_67 = Panel("450, 0, 0")  # disabled
panel_68 = Panel("400, 0, 0")  # disabled
panel_69 = Panel("500, 0, 0")  # disabled
panel_70 = Panel("550, 0, 0")  # disabled
panel_71 = Panel("600, 0, 0")  # disabled
panel_72 = Panel("650, 0, 0")  # disabled
movecomplex_cl = MoveComplexCL(base_move_vector=panel_65, geo_data=merge_15, is_simple=True)  # disabled
movecomplex_cl_2 = MoveComplexCL(base_move_vector=panel_63, geo_data=merge_14, is_simple=True)  # disabled
movecomplex_cl_3 = MoveComplexCL(base_move_vector=panel_66, geo_data=merge_12, is_simple=True)  # disabled
movecomplex_cl_4 = MoveComplexCL(base_move_vector=panel_68, geo_data=merge_10, is_simple=True)  # disabled
movecomplex_cl_5 = MoveComplexCL(base_move_vector=panel_64, geo_data=merge_13, is_simple=True)  # disabled
movecomplex_cl_6 = MoveComplexCL(base_move_vector=panel_67, geo_data=merge_11, is_simple=True)  # disabled
movecomplex_cl_7 = MoveComplexCL(base_move_vector=panel_69, geo_data=merge_16, is_simple=True)  # disabled
movecomplex_cl_8 = MoveComplexCL(base_move_vector=panel_70, geo_data=merge_17, is_simple=True)  # disabled
movecomplex_cl_9 = MoveComplexCL(base_move_vector=panel_71, geo_data=merge_18, is_simple=True)  # disabled
movecomplex_cl_10 = MoveComplexCL(base_move_vector=panel_72, geo_data=merge_19, is_simple=True)  # disabled
merge_20 = Merge(
    Data1=movecomplex_cl,
    Data2=movecomplex_cl_5,
    Data3=movecomplex_cl_2,
    Data4=movecomplex_cl_3,
    Data5=movecomplex_cl_4,
    Data6=movecomplex_cl_6,
    Data7=movecomplex_cl_7,
    Data8=movecomplex_cl_8,
    Data9=movecomplex_cl_9,
    Data10=movecomplex_cl_10)  # -> flatten(Result); disabled
random_color = RandomColor(Data=merge_20, Seed=2, FastMode=False)  # disabled
custom_preview = CustomPreview(Geometry=merge_20, Material=random_color)  # disabled

# ----
# Report Results
dev_activate_toggle_2 = BooleanToggle(True)  # disabled
axial_band_thickness_mm_11 = Number(axial_band_thickness_mm_3)  # disabled
py_wall_probe_data_3 = Data(py_wall_probe_data_2)  # disabled
root_filename_out_3 = Text(root_filename_out)  # disabled
output_dir_out_3 = Text(output_dir_out)  # disabled
splint_mesh = Mesh(splint_smooth_mesh)  # disabled
panel_73 = Panel(py_wall_probe_data_3)  # disabled
savemeshpy_2 = Python3Script(
    final_splint_mesh=splint_mesh,
    output_dir=output_dir_out_3,
    root_filename=root_filename_out_3,
    bool_activate=dev_activate_toggle_2,
    axial_band_thickness_mm=axial_band_thickness_mm_11,
    py_wall_probe_data=py_wall_probe_data_3)  # -> out; inputs final_splint_mesh: Mesh, axial_band_thickness_mm: Double; disabled
# ---------- savemeshpy_2: Python ----------
# This file represents a stub for a GhPython component in Grasshopper.
# It sets up the environment to import and use the splintcommon or other external modules.

from pathlib import Path
import sys
from importlib import reload #FOR DEV
import time

# Walk up through nested clusters to find the root GH document (necessary for use in nested clusters)
doc = ghenv.Component.OnPingDocument()
while not doc.FilePath and doc.Owner:
    doc = doc.Owner.OnPingDocument()
ghFileDir = str(Path(doc.FilePath).resolve().parent / "src")

print(f"{ghFileDir=}")

if ghFileDir not in sys.path:
    print("ghFileDir needed to be included")
    sys.path.append(ghFileDir)

import splintcommon
reload(splintcommon) #FOR DEV
from splintcommon import log, gh_decode

#splintcommon module is now available for use in this GhPython component
splintcommon.log(f'GhPython Node initialized at {time.ctime()}')

#Component code here

import splintmeshes
reload(splintmeshes)
from splintmeshes import save_job_output

wall_probe_data = gh_decode(py_wall_probe_data)

# With error handling
try:
    log(f"Logging to {output_dir=} {root_filename=}")
    #splintmeshes.save_mesh(final_splint_mesh, output_dir, root_filename, format_type="stl")

    save_job_output(final_splint_mesh, output_dir, root_filename, "stl", custom_metadata={
        "wall_probe_data": wall_probe_data,
        "axial_band_thickness_mm": axial_band_thickness_mm,
    })
    log(f"Export succeeded: {output_dir=} {root_filename=}")
except splintmeshes.MeshExportError as e:
    log("Export failed: {}".format(e))
except ValueError as e:
    log("Bad input: {}".format(e))
# ---------- end savemeshpy_2 ----------
# Bake Me
panel_74 = Panel(savemeshpy_2)  # disabled

# ==== cluster VizPlane
plane = ClusterInput()
deconstruct_plane = DeconstructPlane(Plane=plane)  # -> Origin, XAxis, YAxis, ZAxis
arrow = Arrow(start=deconstruct_plane.Origin, direction=deconstruct_plane.XAxis, arrowlen="3", text="X")  # -> cone_2, line, annotation_dot_2
arrow_2 = Arrow(start=deconstruct_plane.Origin, direction=deconstruct_plane.YAxis, arrowlen="3", text="Y")  # -> cone_2, line, annotation_dot_2
arrow_3 = Arrow(start=deconstruct_plane.Origin, direction=deconstruct_plane.ZAxis, arrowlen="3", text="Z")  # -> cone_2, line, annotation_dot_2
tip = Brep([arrow.cone_2, arrow_2.cone_2, arrow_3.cone_2])
line = Line([arrow.line, arrow_2.line, arrow_3.line])
annotation_dot = AnnotationDot([arrow.annotation_dot_2, arrow_2.annotation_dot_2, arrow_3.annotation_dot_2])
tip_2 = ClusterOutput(tip)
line_2 = ClusterOutput(line)
annotation_dot_2 = ClusterOutput(annotation_dot)

# ==== cluster VerySpecificTextOriginFinderCL
target_brep = ClusterInput()
target_brep_2 = ClusterInput()
unit_z = UnitZ(Factor=1)
box_center_slice_py = Python3Script(target_brep=target_brep, view_vector=unit_z)  # -> out, slice_surface, y_size; inputs target_brep: Brep, view_vector: Vector3d
# ---------- box_center_slice_py: Python ----------
# This file represents a stub for a GhPython component in Grasshopper.
# It sets up the environment to import and use the splintcommon or other external modules.

from pathlib import Path
import sys
from importlib import reload #FOR DEV
import time

# In normal GH doc
ghFileDir = None
try:
    ghFileDir = str(Path.joinpath(Path(ghenv.Component.OnPingDocument().FilePath).resolve().parents[0], "src"))
except:
    # In GH Cluster
    ghFileDir = str(Path.joinpath(Path(ghenv.Component.OnPingDocument().Owner.OnPingDocument().FilePath).resolve().parents[0], "src"))

print(f"{ghFileDir=}")

if ghFileDir not in sys.path:
    print("ghFileDir needed to be included")
    sys.path.append(ghFileDir)

import splintcommon
reload(splintcommon) #FOR DEV

#splintcommon module is now available for use in this GhPython component
splintcommon.log(f'GhPython Node initialized at {time.ctime()}')

import FeatureIdentification
reload(FeatureIdentification) #FOR DEV
from FeatureIdentification import box_center_slice

import Rhino.Geometry as rg

# Get a slice plane at the center, facing +Y direction
slice_surface, sizes = box_center_slice(
    target_brep=target_brep,
    bbox_plane=rg.Plane.WorldXY,
    choose_side_vector=view_vector,
    return_size=True,
)

print(f"{sizes=}")

y_size = sizes[1]

print(f"{y_size=}")
# ---------- end box_center_slice_py ----------
target_brep_3 = Brep(target_brep_2)
multiplication = Multiplication(A=box_center_slice_py.y_size, B="0.8")
unit_z_2 = UnitZ(Factor="1.5")
unit_y = UnitY(Factor=multiplication)
move = Move(Geometry=box_center_slice_py.slice_surface, Motion=unit_y)  # -> Geometry, Transform
move_2 = Move(Geometry=move.Geometry, Motion=unit_z_2)  # -> Geometry, Transform
brep_brep = BrepBrep(BrepA=target_brep_3, BrepB=move_2.Geometry)  # -> Curves, Points
area = Area(Geometry=brep_brep.Curves)  # -> Area, Centroid
reverse = Reverse(Vector=unit_z_2)
area_2 = Area(Geometry=box_center_slice_py.slice_surface)  # -> Area, Centroid
move_3 = Move(Geometry=area.Centroid, Motion=reverse)  # -> Geometry, Transform
line = Line(StartPoint=area_2.Centroid, EndPoint=move_3.Geometry)
midpoint = Midpoint(Curve=line)
midpoint_2 = ClusterOutput(midpoint)

# ==== cluster MoveComplexCL
base_move_vector = ClusterInput()
is_simple = ClusterInput()
geo_data = ClusterInput()
is_simple_2 = Boolean(is_simple)
geo_data_2 = Geometry(geo_data)
base_move_vector_2 = Vector(base_move_vector)
pick_n_choose = PickNChoose(Pattern=is_simple_2, Stream0="40", Stream1="0")
transpose_py = Python3Script(data=geo_data_2)  # -> out, result; inputs data: tree of GeometryBase
# ---------- transpose_py: Python ----------
# Input: data (Tree Access)
# Output: result

from Grasshopper import DataTree
from Grasshopper.Kernel.Data import GH_Path

branches = [list(data.Branch(i)) for i in range(data.BranchCount)]

print("Branch count: {}".format(data.BranchCount))
for i, b in enumerate(branches):
    print("  Branch {}: {} items, path {}".format(i, len(b), data.Path(i)))

count = min(len(b) for b in branches)
print("Transposing: {} branches x {} items".format(len(branches), count))

result = DataTree[object]()
for i in range(count):
    path = GH_Path(i)
    for b in branches:
        result.Add(b[i], path)

print("Output: {} branches x {} items each".format(result.BranchCount, result.Branch(0).Count if result.BranchCount > 0 else 0))
# ---------- end transpose_py ----------
panel = Panel(transpose_py.out)
python_3_script = Python3Script(data=transpose_py.result, base_vector=base_move_vector_2, z_separation=pick_n_choose)  # -> out, vectors; inputs data: tree, base_vector: Vector3d, z_separation: Double
# ---------- python_3_script: Python ----------
# This file represents a stub for a GhPython component in Grasshopper.
# It sets up the environment to import and use the splintcommon or other external modules.

from pathlib import Path
import sys
from importlib import reload #FOR DEV
import time

# Walk up through nested clusters to find the root GH document (necessary for use in nested clusters)
doc = ghenv.Component.OnPingDocument()
while not doc.FilePath and doc.Owner:
    doc = doc.Owner.OnPingDocument()
ghFileDir = str(Path(doc.FilePath).resolve().parent / "src")

print(f"{ghFileDir=}")

if ghFileDir not in sys.path:
    print("ghFileDir needed to be included")
    sys.path.append(ghFileDir)

import splintcommon
reload(splintcommon) #FOR DEV

#splintcommon module is now available for use in this GhPython component
splintcommon.log(f'GhPython Node initialized at {time.ctime()}')

#Your code here

# Inputs:
#   data         (Tree Access, type hint: ghdoc Object)
#   base_vector  (Item Access, type hint: Vector3d)
#   z_separation (Item Access, type hint: float)
# Output:
#   vectors

import Rhino.Geometry as rg
from Grasshopper import DataTree
from Grasshopper.Kernel.Data import GH_Path

branch_count = data.BranchCount
print("Branches: {}, z_separation: {}".format(branch_count, z_separation))

vectors = DataTree[rg.Vector3d]()

for i in range(branch_count):
    path = data.Path(i)
    item_count = data.Branch(i).Count
    vec = rg.Vector3d(base_vector.X, base_vector.Y, base_vector.Z + z_separation * i)
    print("  Branch {} ({}): {} items, vec Z={:.2f}".format(i, path, item_count, vec.Z))
    # One vector per item so the tree matches the geometry tree for Move
    for j in range(item_count):
        vectors.Add(vec, path)
# ---------- end python_3_script ----------
move = Move(Geometry=transpose_py.result, Motion=python_3_script.vectors)  # -> Geometry, Transform
panel_2 = Panel(move.Geometry)
geometry = Geometry(move.Geometry)
geometry_2 = ClusterOutput(geometry)

# ==== cluster Arrow
arrowlen = ClusterInput()
text = ClusterInput()
arrowlen_2 = Number(arrowlen)
text_2 = Text(text)
start = ClusterInput()
direction = ClusterInput()
division = Division(A=arrowlen_2, B="4")
line_sdl = LineSDL(Start=start, Direction=direction, Length=arrowlen_2)
end_points = EndPoints(Curve=line_sdl)  # -> Start, End
line = ClusterOutput(line_sdl)
plane_normal = PlaneNormal(Origin=end_points.End, ZAxis=line_sdl)
annotation_dot = AnnotationDot(Location=end_points.End, PrimaryText=text_2)  # -> AnnotationDot, Location, PrimaryText, TextHeight
cone = Cone(Base=plane_normal, Radius=division, Length=division)  # -> Cone, Tip
cone_2 = ClusterOutput(cone.Cone)
annotation_dot_2 = ClusterOutput(annotation_dot.AnnotationDot)
