# Grasshopper definition finger_model.gh (Grasshopper 1.0.8)

lateral = Slider(-10, range=-10..20)
flex = Slider(14, range=-10..40)
phalanx_l = Panel("30")

# ----
# Rotational Alternatives
panel = Panel("0, -100, 0")  # disabled
xy_plane = XYPlane(Origin=panel)  # disabled
deconstruct_plane = DeconstructPlane(Plane=xy_plane)  # -> Origin, XAxis, YAxis, ZAxis; disabled
panel_2 = Panel("10")  # disabled
xz_plane = XZPlane(Origin=Point(0, 0, 0))  # disabled
line_sdl = LineSDL(Start=xy_plane, Direction=deconstruct_plane.XAxis, Length=panel_2)  # disabled
panel_3 = Panel("45")  # disabled
end_points = EndPoints(Curve=line_sdl)  # -> Start, End; disabled
line_sdl_2 = LineSDL(Start=end_points.Start, Direction=deconstruct_plane.YAxis, Length=1)  # disabled
rotate = Rotate(Geometry=line_sdl, Angle=degrees(panel_3), Plane=xz_plane)  # -> Geometry, Transform; disabled
rotate_axis = RotateAxis(Geometry=line_sdl, Angle=degrees(panel_3), Axis=line_sdl_2)  # -> Geometry, Transform; disabled

unit_x = UnitX(Factor=1)
xy_plane_2 = XYPlane(Origin="0, -50, 0")
fingermodel_demo_py = Python3Script(toggle=Toggle(False))  # -> out, cFinger_brep, cCenterline, cComponents, sCenterline, sFinger_brep, sComponents, splintBlank, splintBlankCenterline
# ---------- fingermodel_demo_py: Python ----------
# This file represents a stub for a GhPython component in Grasshopper.
# It sets up the environment to import and use the splintcommon or other external modules.

from pathlib import Path
import sys
from importlib import reload #FOR DEV ONLY
import time

# In normal GH doc
ghFileDir = None
try:
    ghFileDir = str(Path.joinpath(Path(ghenv.Component.OnPingDocument().FilePath).resolve().parents[0], "src"))
except:
    # In GH Cluster
    ghFileDir = str(Path.joinpath(Path(ghenv.Component.OnPingDocument().Owner.OnPingDocument().FilePath).resolve().parents[0], "src"))

print(f"{ghFileDir=}")

if ghFileDir not in sys.path:
    print("ghFileDir needed to be included")
    sys.path.append(ghFileDir)

import splintcommon
reload(splintcommon) #FOR DEV ONLY

#splintcommon module is now available for use in this GhPython component
splintcommon.log(f'GhPython Node initialized at {time.ctime()}')

#Your code here



# Example usage of create_finger_model

from importlib import reload
import FingerModel
reload(FingerModel)

from FingerModel import create_finger_model, FingerParams

# Create params with all measurements
coreParams = FingerParams(
    # Segment range - generate full finger or subset
    start_at="metacarpal",  # or "mcp", "pip", "dip"
    end_at="tip",            # or "mcp", "pip", "dip", "tip"

    # Circumferences (mm)
    mcp_circ=80.0,
    proximal_mid_circ=82.0,
    pip_circ=65.0,
    middle_mid_circ=65.0,
    dip_circ=55.0,
    distal_mid_circ=54.0,
    tip_circ=44.0, #not really a "joint" but conceptually fits here
    
    # Metacarpal stub length
    metacarpal_len=20.0,
    # Phalanx lengths (mm)
    proximal_len=45.0,
    middle_len=28.0,
    distal_len=22.0,
    
    # Joint angles (degrees) - positive = curl toward palm
    mcp_flex=40.0,
    pip_flex=50.0,
    dip_flex=50.0,

    mcp_lateral=4.0,
    pip_lateral=4.0,
    dip_lateral=4.0,
    
)

# Create the finger model
cCenterline, cFinger_brep, cComponents, cJointPositions = create_finger_model(
    coreParams,
    tolerance=None,      # Use document tolerance
    return_parts=True    # Return individual components
)

from dataclasses import replace
# Create the shell params
shellParams = replace(coreParams, shell_thickness=2.0, start_at="proximal", end_at="middle")
shellParams.trim_start=("pip", -1 * shellParams.proximal_len * 0.65)  # 10mm before MCP joint
shellParams.trim_end=("pip", shellParams.middle_len * 0.55)
# Create the shell model

sCenterline, sFinger_brep, sComponents, sJointPositions = create_finger_model(
    shellParams,
    tolerance=None,      # Use document tolerance
    return_parts=True    # Return individual components
)


from BrepDifference import robust_brep_difference

# Subtract inner from shell to create hollow splint
splintBlank, success, method = robust_brep_difference(
    minuend=sFinger_brep,      # subtract FROM this (larger)
    subtrahend=cFinger_brep,   # subtract this (smaller)
    base_tolerance=0.001
)

if success:
    print(f"Hollow splint created via {method}")
    # result_brep is now a hollow shell
else:
    print(f"Difference failed: {method}")
# ---------- end fingermodel_demo_py ----------
metacarpal_stub = LineSDL(Start=xy_plane_2, Direction=unit_x, Length="10")
panel_4 = Panel(fingermodel_demo_py.out)
brep = Brep(fingermodel_demo_py.cFinger_brep)
brep_2 = Brep(fingermodel_demo_py.sFinger_brep)
end_points_2 = EndPoints(Curve=metacarpal_stub)  # -> Start, End
unit_y = UnitY(Factor="53")
unit_y_2 = UnitY(Factor="100")
unit_y_3 = UnitY(Factor="150")
unit_y_4 = UnitY(Factor="50")
unit_y_5 = UnitY(Factor="55")
unit_y_6 = UnitY(Factor="100")
plane_origin = PlaneOrigin(Base=xy_plane_2, Origin=end_points_2.End)
move = Move(Geometry=fingermodel_demo_py.sCenterline, Motion=unit_y)  # -> Geometry, Transform
move_2 = Move(Geometry=fingermodel_demo_py.cComponents, Motion=unit_y_2)  # -> Geometry, Transform
move_3 = Move(Geometry=fingermodel_demo_py.splintBlank, Motion=unit_y_3)  # -> Geometry, Transform
move_4 = Move(Geometry=fingermodel_demo_py.cCenterline, Motion=unit_y_4)  # -> Geometry, Transform
move_5 = Move(Geometry=fingermodel_demo_py.splintBlankCenterline, Motion=unit_y_5)  # -> Geometry, Transform
move_6 = Move(Geometry=fingermodel_demo_py.sComponents, Motion=unit_y_6)  # -> Geometry, Transform
proximal_phalanx = ProximalPhalanx(initialplane=plane_origin, flex_deg=flex, lat_deg=lateral, phalanx_l=phalanx_l)  # -> newplane, newline
middle_phalanx = ProximalPhalanx(initialplane=proximal_phalanx.newplane, flex_deg=flex, lat_deg=lateral, phalanx_l=phalanx_l)  # -> newplane, newline
distal_phalanx = ProximalPhalanx(initialplane=middle_phalanx.newplane, flex_deg=flex, lat_deg=lateral, phalanx_l=phalanx_l)  # -> newplane, newline

# ==== cluster ProximalPhalanx
initialplane = ClusterInput()
phalanx_l = ClusterInput()
lat_deg = ClusterInput()
flex_deg = ClusterInput()
initialplane_2 = Plane(initialplane)
phalanx_l_2 = Number(phalanx_l)
lat_deg_2 = Number(lat_deg)
flex_deg_2 = Number(flex_deg)
deconstruct_plane = DeconstructPlane(Plane=initialplane_2)  # -> Origin, XAxis, YAxis, ZAxis
line_sdl = LineSDL(Start=deconstruct_plane.Origin, Direction=deconstruct_plane.XAxis, Length=phalanx_l_2)
cluster = Cluster(initialplane=initialplane_2, xyrotate=lat_deg_2, xzrotate=flex_deg_2, inputline=line_sdl)  # -> newplane_2, newline_3
newplane = ClusterOutput(cluster.newplane_2)
newline = ClusterOutput(cluster.newline_3)

# ==== cluster Cluster
initialplane = ClusterInput()
inputline = ClusterInput()
xzrotate = ClusterInput()
xyrotate = ClusterInput()
initialplane_2 = Plane(initialplane)
inputline_2 = Line(inputline)
xzrotate_2 = Number(xzrotate)
xyrotate_2 = Number(xyrotate)
deconstruct_plane = DeconstructPlane(Plane=initialplane_2)  # -> Origin, XAxis, YAxis, ZAxis
unit_y_ln = LineSDL(Start=deconstruct_plane.Origin, Direction=deconstruct_plane.YAxis, Length="3")
unit_z_ln = LineSDL(Start=deconstruct_plane.Origin, Direction=deconstruct_plane.ZAxis, Length="3")
initialplane_3 = Plane(initialplane_2)
rotate_axis = RotateAxis(Geometry=initialplane_3, Angle=degrees(xzrotate_2), Axis=unit_y_ln)  # -> Geometry, Transform
rotate_axis_2 = RotateAxis(Geometry=rotate_axis.Geometry, Angle=degrees(xyrotate_2), Axis=unit_z_ln)  # -> Geometry, Transform
plane = Plane(rotate_axis_2.Geometry)
plane_2 = Plane(rotate_axis.Geometry)
merge = Merge(Data1=rotate_axis.Transform, Data2=rotate_axis_2.Transform)
deconstruct_plane_2 = DeconstructPlane(Plane=plane)  # -> Origin, XAxis, YAxis, ZAxis
mass_transform = MassTransform(Transforms=merge)  # -> MassTransform, PartialTransforms
transform = Transform(Geometry=inputline_2, Transform=mass_transform.MassTransform)
newline = Line(transform)
end_points = EndPoints(Curve=newline)  # -> Start, End
construct_plane = ConstructPlane(Origin=end_points.End, XAxis=deconstruct_plane_2.XAxis, YAxis=deconstruct_plane_2.YAxis)
newplane = Plane(construct_plane)
newline_2 = Line(newline)
newline_3 = ClusterOutput(newline_2)
newplane_2 = ClusterOutput(newplane)
