# Grasshopper definition infinity_splint_generator_251004.gh (Grasshopper 1.0.8)
# plug-ins: Pufferfish, Bowerbird2, Wombat

axial_band_thickness_mm = Panel("3.25")
axial_band_thickness_mm_2 = Panel("1.5")
axial_band_thickness_mm_3 = Panel("2.20")
# Infinity Splint
# Here are Vince's measurements:
# 
# "inter-phalange length" (is this mid splint, or inner to inner, or outer to outer?)- 3.3mm
# "root circumference" (circumference of the mid-phalange area nearest the palm)- 5.6mm
# "mid circumference" (circumference of the joint in the middle of the splint)- 5.7mm
# "tip circumference" (circumference of the mid-phalange area closest the finger tip) 5.2mm
is_production_mode = BooleanToggle(True)
root_filename = Panel("infinitysplint_test")
output_dir_test = Panel("/Users/jon/Desktop/gh_output/")
geo_algorithm_name = Panel("infinity_splint_generator_251004")

# ---- group: External Parameters DEV
# Positive flexion curls down around the single band
# 
# Negative curls towards the double band
tipcircumferencemm = Panel("47.0")
interphalangedistancemm = Panel("26.0")
rootcircumferencemm = Panel("49")
midcircumferencemm = Panel("57")
flexiondegrees = Panel("-25.0")

# ----
toggle_job_make_it_go = BooleanToggle(False)

# ---- group: Internal Parameters
bottom_band_strap_width_mm = Panel("7.0")
top_band_strap_width_mm = Panel("5.0")
mid_joint_rise_factor = Panel("1.0")
axial_band_thickness_mm_4 = Panel("1.75")

# ----
factoryautomatorpy = Python3Script(
    is_production_mode=is_production_mode,
    geo_algorithm_name=geo_algorithm_name,
    interPhalangeDistanceMM=interphalangedistancemm,
    rootCircumferenceMM=rootcircumferencemm,
    midCircumferenceMM=midcircumferencemm,
    tipCircumferenceMM=tipcircumferencemm,
    flexionDegrees=flexiondegrees,
    root_filename=root_filename,
    output_dir=output_dir_test,
    x=toggle_job_make_it_go)  # -> out, interPhalangeDistanceMM_out, rootCircumferenceMM_out, midCircumferenceMM_out, tipCircumferenceMM_out, flexionDegrees_out, root_filename_out, output_dir_out, objectID; inputs is_production_mode: Boolean, interPhalangeDistanceMM: Double, rootCircumferenceMM: Double, midCircumferenceMM: Double, tipCircumferenceMM: Double, flexionDegrees: Double, root_filename: String, x: Boolean
# ---------- factoryautomatorpy: Python ----------
from pathlib import Path
import sys
from importlib import reload #FOR DEV ONLY
import time

ghFileDir = str(Path.joinpath(Path(ghenv.Component.OnPingDocument().FilePath).resolve().parents[0], "src"))
print(f"{ghFileDir=}")

if ghFileDir not in sys.path:
    print("ghFileDir needed to be included")
    sys.path.append(ghFileDir)

import splintcommon
reload(splintcommon) #FOR DEV ONLY

splintcommon.log_clear(f'FactoryAutomatorPY Running at: ({time.strftime("%H:%M:%S", time.localtime())})')
jobname = "LocalDev"
objectID = "LOCL"

if not is_production_mode:
    print("Passing along local data only")    
    
    # WORK TO DO! This mapping must match the Named Geometry Definition
    interPhalangeDistanceMM_out = interPhalangeDistanceMM
    rootCircumferenceMM_out = rootCircumferenceMM
    midCircumferenceMM_out = midCircumferenceMM
    tipCircumferenceMM_out = tipCircumferenceMM
    flexionDegrees_out = flexionDegrees

    root_filename_out = root_filename
    output_dir_out = output_dir

else:
    # We start hunting for files to see if work needs to be done.
    splintcommon.log("Looking for available job data...")

    job_data = splintcommon.get_next_geo_job(geo_algorithm_name)
    splintcommon.log(f"{job_data=}")

    if job_data is None:
        splintcommon.log("No Job Data Available")
        objectID = "NONE"
    else:
        # {
        # "inter-phalange-distance-mm": 25.1,
        # "root-circumference-mm": 25.2,
        # "mid-circumference-mm": 25.3,
        # "tip-circumference-mm": 25.4,
        # "flexion-degrees": 1.5
        # }

        # WORK TO DO! This mapping must match the schema of the data in the DB for this geometry type
        interPhalangeDistanceMM_out = job_data["interPhalangeDistanceMM"]
        rootCircumferenceMM_out = job_data["rootCircumferenceMM"]
        midCircumferenceMM_out = job_data["midCircumferenceMM"]
        tipCircumferenceMM_out = job_data["tipCircumferenceMM"]
        flexionDegrees_out = job_data["flexionDegrees"]

        jobname = job_data["jobname"]
        objectID = job_data["objectID"]

        root_filename_out = jobname
        output_dir_out = splintcommon.splint_outbox_dir
splintcommon.log(f"Result data {jobname=} {objectID=} {interPhalangeDistanceMM_out=} {rootCircumferenceMM_out=} {midCircumferenceMM_out=} {tipCircumferenceMM_out=} {flexionDegrees_out=}")
# ---------- end factoryautomatorpy ----------
panel = Panel("""{
  "interPhalangeDistanceMM": 26,
  "rootCircumferenceMM": 49,
  "midCircumferenceMM": 57,
  "tipCircumferenceMM": 47,
  "flexionDegrees": -25
}""")
panel_2 = Panel(factoryautomatorpy.out)

# ----
# Central Finger Line Geometry
# The segment distance and top band strap width are added to each other to account for one half of the strap hanging off of each sidge of the inter phalange distance
addition = Addition(A=factoryautomatorpy.interPhalangeDistanceMM_out, B=top_band_strap_width_mm)
xy_plane = XYPlane(Origin=Point(0, 0, 0))
division = Division(A=addition, B="2")
unit_x = UnitX(Factor=1)
xz_plane = XZPlane(Origin=Point(0, 0, 0))
line_sdl = LineSDL(Start=xy_plane, Direction=unit_x, Length=division)
rotate = Rotate(Geometry=unit_x, Angle=expr("-x", degrees(factoryautomatorpy.flexionDegrees_out)), Plane=xz_plane)  # -> Geometry, Transform
first_segment_end_points = EndPoints(Curve=line_sdl)  # -> Start, End
line_sdl_2 = LineSDL(Start=first_segment_end_points.End, Direction=rotate.Geometry, Length=division)
second_segment_end_points = EndPoints(Curve=line_sdl_2)  # -> Start, End
firstsegmentdirection = Vector(unit_x)
firstsegmentline = Line(line_sdl)
secondsegmentline = Line(line_sdl_2)
firstsegmentstart = Point(first_segment_end_points.Start)
firstsegmentend = Point(first_segment_end_points.End)
secondsegmentend = Point(second_segment_end_points.End)

# ---- group: Prep Circumference Values
circ2radius_py = Python3Script(c=factoryautomatorpy.tipCircumferenceMM_out)  # -> r; inputs c: Double
# ---------- circ2radius_py: Python ----------
import math


r = (c/math.pi)/2
# ---------- end circ2radius_py ----------
circ2radius_py_2 = Python3Script(c=factoryautomatorpy.rootCircumferenceMM_out)  # -> r; inputs c: Double; same code as circ2radius_py
circ2radius_py_3 = Python3Script(c=factoryautomatorpy.midCircumferenceMM_out)  # -> r; inputs c: Double; same code as circ2radius_py
radius_mid = Number(circ2radius_py_3)
radius_tip = Number(circ2radius_py)
radius_root = Number(circ2radius_py_2)

# ----
wall_thickness = Number(axial_band_thickness_mm_4)
objectid = Text(factoryautomatorpy.objectID)
root_filename_out = Text(factoryautomatorpy.root_filename_out)
output_dir_out = Text(factoryautomatorpy.output_dir_out)
nudge_r = Panel("0.15")

# ----
# Alignment Work
firstsegmentstart_2 = Point(firstsegmentstart)
secondsegmentend_2 = Point(secondsegmentend)
radius_root_2 = Number(radius_root)
line = Line(StartPoint=firstsegmentstart_2, EndPoint=secondsegmentend_2)
unit_z = UnitZ(Factor=radius_root_2)
move = Move(Geometry=line, Motion=unit_z)  # -> Geometry, Transform
average_center_line = Line(line)
seam_line = Line(move.Geometry)

firstsegmentdirection_2 = Vector(firstsegmentdirection)
seam_line_2 = Line(seam_line)
dev_activate_toggle = BooleanToggle(True)
root_filename_out_2 = Text(root_filename_out)
output_dir_out_2 = Text(output_dir_out)

# ----
# Finger Preform Solid
# Outer Finger Preform
# Inner Finger Preform
awial_band_thickness_mm = Number(axial_band_thickness_mm_4)
production_mode = Panel(is_production_mode)
outer_root_extend = Panel("6")
inner_root_extend = Panel("10.3")
radius_root_3 = Number(radius_root)
addition_2 = Addition(A=radius_root_3, B=awial_band_thickness_mm)
secondsegmentline_2 = Line(secondsegmentline)
firstsegmentend_2 = Point(firstsegmentend)
firstsegmentline_2 = Line(firstsegmentline)
secondsegmentend_3 = Point(secondsegmentend)
radius_mid_2 = Number(radius_mid)
addition_3 = Addition(A=radius_mid_2, B=awial_band_thickness_mm)
radius_tip_2 = Number(radius_tip)
addition_4 = Addition(A=radius_tip_2, B=awial_band_thickness_mm)
radius_outer_tip = Number(addition_4)
radius_outer_mid = Number(addition_3)
radius_outer_root = Number(addition_2)
cylinder_cl = CylinderCl(begin_r=radius_mid_2, center_line=secondsegmentline_2, end_r=radius_tip_2)  # -> taperedcylinder, out
cylinder_cl_2 = CylinderCl(begin_extend_mm=inner_root_extend, begin_r=radius_root_3, center_line=firstsegmentline_2, end_r=radius_mid_2)  # -> taperedcylinder, out
cylinder_cl_3 = CylinderCl(begin_r=radius_outer_mid, center_line=secondsegmentline_2, end_r=radius_outer_tip)  # -> taperedcylinder, out
cylinder_cl_4 = CylinderCl(begin_extend_mm=outer_root_extend, begin_r=radius_outer_root, center_line=firstsegmentline_2, end_r=radius_outer_mid)  # -> taperedcylinder, out

addition_5 = Addition(A=radius_tip_2, B=nudge_r)
addition_6 = Addition(A=radius_mid_2, B=nudge_r)
addition_7 = Addition(A=radius_outer_mid, B=nudge_r)
addition_8 = Addition(A=radius_outer_tip, B=nudge_r)

sphere = Sphere(Base=secondsegmentend_3, Radius=addition_5)
sphere_2 = Sphere(Base=firstsegmentend_2, Radius=addition_6)
sphere_3 = Sphere(Base=firstsegmentend_2, Radius=addition_7)
sphere_4 = Sphere(Base=secondsegmentend_3, Radius=addition_8)
merge = Merge(Data1=cylinder_cl_2.taperedcylinder, Data2=sphere_2, Data3=cylinder_cl.taperedcylinder, Data4=sphere)  # -> flatten(Result)
merge_2 = Merge(Data1=cylinder_cl_4.taperedcylinder, Data2=sphere_3, Data3=cylinder_cl_3.taperedcylinder, Data4=sphere_4)  # -> flatten(Result)
brepunion_cl = BrepUnionCL(inputbreps=flatten(merge_2))  # -> unionreport_3, unionresult
outer_shell_brep = Brep(brepunion_cl.unionresult)

reliable_union_cl = ReliableUnionCL(
    brep1=cylinder_cl_4.taperedcylinder,
    brep2=sphere_3,
    seam_alignment_line=seam_line_2,
    join_axis_vector=firstsegmentdirection_2)  # -> unionresult, unionreport; disabled
brepinspect_py = Python3Script(brepToTest=sphere_3)  # -> out; inputs brepToTest: Brep
# ---------- brepinspect_py: Python ----------
# This file represents a stub for a GhPython component in Grasshopper.
# It sets up the environment to import and use the splintcommon or other external modules.

from pathlib import Path
import sys
from importlib import reload #FOR DEV ONLY
import time

# In normal GH doc
ghFileDir = None
try:
    ghFileDir = str(Path.joinpath(Path(ghenv.Component.OnPingDocument().FilePath).resolve().parents[0], "src"))
except:
    # In GH Cluster
    ghFileDir = str(Path.joinpath(Path(ghenv.Component.OnPingDocument().Owner.OnPingDocument().FilePath).resolve().parents[0], "src"))

print(f"{ghFileDir=}")

if ghFileDir not in sys.path:
    print("ghFileDir needed to be included")
    sys.path.append(ghFileDir)

import splintcommon
reload(splintcommon) #FOR DEV ONLY

#splintcommon module is now available for use in this GhPython component
splintcommon.log(f'GhPython Node initialized at {time.ctime()}')

import BrepInspect
reload(BrepInspect)

BrepInspect.inspect_solid_brep(brepToTest)
# ---------- end brepinspect_py ----------
brepunion_cl_2 = BrepUnionCL(inputbreps=flatten(merge))  # -> unionreport_3, unionresult
panel_3 = Panel(brepinspect_py)

inner_shell_brep = Brep(brepunion_cl_2.unionresult)
solid_difference = SolidDifference(BrepsA=outer_shell_brep, BrepsB=inner_shell_brep)
material_shell_brep = Brep(solid_difference)

# ----
# Preform
# Orientation
# Adjustment
firstsegmentdirection_3 = Vector(firstsegmentdirection)
secondsegmentline_3 = Line(secondsegmentline)
firstsegmentstart_3 = Point(firstsegmentstart)
firstsegmentend_3 = Point(firstsegmentend)
firstsegmentline_3 = Line(firstsegmentline)
average_center_line_2 = Line(average_center_line)
secondsegmentend_4 = Point(secondsegmentend)
material_shell_brep_2 = Brep(material_shell_brep)
inner_shell_brep_2 = Brep(inner_shell_brep)
outer_shell_brep_2 = Brep(outer_shell_brep)
xz_plane_2 = XZPlane(Origin=Point(0, 0, 0))
angle = Angle(VectorA=average_center_line_2, VectorB=firstsegmentdirection_3, Plane=xz_plane_2)  # -> Angle, Reflex
finger_model_rotate = Rotate(Geometry=material_shell_brep_2, Angle=angle.Angle, Plane=xz_plane_2)  # -> Geometry, Transform
outer_barrel_transform = Transform(Geometry=outer_shell_brep_2, Transform=finger_model_rotate.Transform)
inner_barrel_transform = Transform(Geometry=inner_shell_brep_2, Transform=finger_model_rotate.Transform)
center_line_transform = Transform(Geometry=average_center_line_2, Transform=finger_model_rotate.Transform)
root_line_transform = Transform(Geometry=firstsegmentline_3, Transform=finger_model_rotate.Transform)
tip_line_transform = Transform(Geometry=secondsegmentline_3, Transform=finger_model_rotate.Transform)
first_orientation_shift_transform = Transform(finger_model_rotate.Transform)
firstsegmentline_4 = Line(root_line_transform)
secondsegmentline_4 = Line(tip_line_transform)

inner_shell_brep_3 = Brep(inner_barrel_transform)

# ----
# Bottom Center Band Creation
ref_nudge = Panel("-75")
bottom_band_width_mm = Panel(bottom_band_strap_width_mm)
curve_middle = CurveMiddle(Curve=center_line_transform)
unit_z_2 = UnitZ(Factor=ref_nudge)
unit_y = UnitY(Factor=ref_nudge)
move_2 = Move(Geometry=curve_middle, Motion=unit_z_2)  # -> Geometry, Transform
point = Point(move_2.Geometry)
move_3 = Move(Geometry=point, Motion=unit_y)  # -> Geometry, Transform
point_2 = Point(move_3.Geometry)
merge_3 = Merge(Data1=curve_middle, Data2=point, Data3=point_2)  # -> flatten(Result)
plane_fit = PlaneFit(Points=merge_3)  # -> Plane, Deviation
brep_plane = BrepPlane(Brep=finger_model_rotate.Geometry, Plane=plane_fit.Plane)  # -> Curves, Points
panel_4 = Panel(brep_plane.Curves)
length = Length(Curve=brep_plane.Curves)
sort_list = SortList(Keys=length, ValuesValuesA=brep_plane.Curves)  # -> Keys, ValuesValuesA
unit_x_2 = UnitX(Factor=1)
xy_plane_2 = XYPlane(Origin=Point(0, 0, 0))
list_item = ListItem(List=sort_list.ValuesValuesA, Index="-1", Wrap=True)
line_sdl_3 = LineSDL(Start=xy_plane_2, Direction=unit_x_2, Length=bottom_band_width_mm)
curve_closest_point = CurveClosestPoint(Point=point, Curve=list_item)  # -> Point, Parameter, Distance
curve_middle_2 = CurveMiddle(Curve=line_sdl_3)
line_2 = Line(StartPoint=curve_middle_2, EndPoint=curve_closest_point.Point)
move_4 = Move(Geometry=line_sdl_3, Motion=line_2)  # -> Geometry, Transform
bottom_band_line = Curve(move_4.Geometry)
perp_frame = PerpFrame(Curve=bottom_band_line, Parameter="0")
end_points = EndPoints(Curve=bottom_band_line)  # -> Start, End
brep_plane_2 = BrepPlane(Brep=finger_model_rotate.Geometry, Plane=perp_frame)  # -> Curves, Points
length_2 = Length(Curve=brep_plane_2.Curves)
panel_5 = Panel(brep_plane_2.Curves)
sort_list_2 = SortList(Keys=length_2, ValuesValuesA=brep_plane_2.Curves)  # -> Keys, ValuesValuesA
list_item_2 = ListItem(List=sort_list_2.ValuesValuesA, Index="-1", Wrap=True)
curve_closest_point_2 = CurveClosestPoint(Point=end_points.Start, Curve=list_item_2)  # -> Point, Parameter, Distance
multiplication = Multiplication(A=curve_closest_point_2.Distance, B="-1.5")
unit_z_3 = UnitZ(Factor=multiplication)
move_5 = Move(Geometry=bottom_band_line, Motion=unit_z_3)  # -> Geometry, Transform
bottom_band = Curve(move_5.Geometry)

# ----
# Top Band Creation
# 1. Move the top bands into place
# 2. Connect the ends of the top bands to create a v shaped mask to intersect with the preform
center_line_curve = Curve(center_line_transform)
outer_shell_brep_3 = Brep(outer_barrel_transform)
top_band_width_mm = Panel(top_band_strap_width_mm)
end_points_2 = EndPoints(Curve=center_line_curve)  # -> Start, End
unit_x_3 = UnitX(Factor="-1")
unit_x_4 = UnitX(Factor=1)
nudge = Panel("50")
left_band_guide = LineSDL(Start=end_points_2.Start, Direction=unit_x_4, Length=top_band_width_mm)
right_band_guide = LineSDL(Start=end_points_2.End, Direction=unit_x_3, Length=top_band_width_mm)
unit_z_4 = UnitZ(Factor=nudge)
move_6 = Move(Geometry=left_band_guide, Motion=unit_z_4)  # -> Geometry, Transform
move_7 = Move(Geometry=right_band_guide, Motion=unit_z_4)  # -> Geometry, Transform
xz_plane_3 = XZPlane(Origin=Point(0, 0, 0))
end_points_3 = EndPoints(Curve=move_7.Geometry)  # -> Start, End
brep_plane_3 = BrepPlane(Brep=outer_shell_brep_3, Plane=xz_plane_3)  # -> Curves, Points
perp_frame_2 = PerpFrame(Curve=move_7.Geometry, Parameter="0")
perp_frame_3 = PerpFrame(Curve=move_7.Geometry, Parameter="1.0")
end_points_4 = EndPoints(Curve=move_6.Geometry)  # -> Start, End
perp_frame_4 = PerpFrame(Curve=move_6.Geometry, Parameter="0")
perp_frame_5 = PerpFrame(Curve=move_6.Geometry, Parameter="1.0")
brep_plane_4 = BrepPlane(Brep=outer_shell_brep_3, Plane=perp_frame_3)  # -> Curves, Points
brep_plane_5 = BrepPlane(Brep=outer_shell_brep_3, Plane=perp_frame_2)  # -> Curves, Points
brep_plane_6 = BrepPlane(Brep=outer_shell_brep_3, Plane=perp_frame_4)  # -> Curves, Points
brep_plane_7 = BrepPlane(Brep=outer_shell_brep_3, Plane=perp_frame_5)  # -> Curves, Points
curve_closest_point_3 = CurveClosestPoint(Point=end_points_3.End, Curve=brep_plane_4.Curves)  # -> Point, Parameter, Distance
curve_closest_point_4 = CurveClosestPoint(Point=end_points_4.End, Curve=brep_plane_7.Curves)  # -> Point, Parameter, Distance
curve_closest_point_5 = CurveClosestPoint(Point=end_points_4.Start, Curve=brep_plane_6.Curves)  # -> Point, Parameter, Distance
curve_closest_point_6 = CurveClosestPoint(Point=end_points_3.Start, Curve=brep_plane_5.Curves)  # -> Point, Parameter, Distance
merge_4 = Merge(Data1=curve_closest_point_6.Distance, Data2=curve_closest_point_3.Distance)
merge_5 = Merge(Data1=curve_closest_point_5.Distance, Data2=curve_closest_point_4.Distance)
sort_list_3 = SortList(Keys=merge_4, ValuesValuesA=merge_4)  # -> Keys, ValuesValuesA
sort_list_4 = SortList(Keys=merge_5, ValuesValuesA=merge_5)  # -> Keys, ValuesValuesA
list_item_3 = ListItem(List=sort_list_3.ValuesValuesA, Index="0", Wrap=True)
list_item_4 = ListItem(List=sort_list_4.ValuesValuesA, Index="0", Wrap=True)
unit_z_5 = UnitZ(Factor=expr("-x", list_item_3))
unit_z_6 = UnitZ(Factor=expr("-x", list_item_4))
move_8 = Move(Geometry=move_7.Geometry, Motion=unit_z_5)  # -> Geometry, Transform
move_9 = Move(Geometry=move_6.Geometry, Motion=unit_z_6)  # -> Geometry, Transform
root_top_band = Curve(move_9.Geometry)
tip_top_band = Curve(move_8.Geometry)

point_3 = Point(end_points_4.End)
point_4 = Point(end_points_3.End)

# ----
# Side Cutter Profile
bottom_band_width_mm_2 = Panel(bottom_band_strap_width_mm)
mid_joint_rise_factor_2 = Panel(mid_joint_rise_factor)
root_top_band_2 = Curve(root_top_band)
tip_top_band_2 = Curve(tip_top_band)
bottom_band_2 = Curve(bottom_band)
multiplication_2 = Multiplication(A=bottom_band_width_mm_2, B=mid_joint_rise_factor_2)
midpoint = Midpoint(Curve=bottom_band_2)
unit_z_7 = UnitZ(Factor=multiplication_2)
move_10 = Move(Geometry=midpoint, Motion=unit_z_7)  # -> Geometry, Transform
end_points_5 = EndPoints(Curve=bottom_band_2)  # -> Start, End
end_points_6 = EndPoints(Curve=root_top_band_2)  # -> Start, End
end_points_7 = EndPoints(Curve=tip_top_band_2)  # -> Start, End
top_right_band_right_pt = Point(end_points_7.Start)
top_right_band_left_pt = Point(end_points_7.End)
bottom_right_pt = Point(end_points_5.End)
bottom_left_pt = Point(end_points_5.Start)
top_left_band_left_pt = Point(end_points_6.Start)
top_left_band_right_pt = Point(end_points_6.End)
central_pt = Point(move_10.Geometry)
line_3 = Line(StartPoint=top_left_band_right_pt, EndPoint=central_pt)
line_4 = Line(StartPoint=central_pt, EndPoint=top_right_band_left_pt)
midpoint_2 = Midpoint(Curve=line_3)
midpoint_3 = Midpoint(Curve=line_4)
line_5 = Line(StartPoint=bottom_right_pt, EndPoint=bottom_left_pt)
line_6 = Line(StartPoint=bottom_left_pt, EndPoint=top_left_band_left_pt)
line_7 = Line(StartPoint=top_left_band_left_pt, EndPoint=top_left_band_right_pt)
tip_slant_line = Line(StartPoint=top_right_band_right_pt, EndPoint=bottom_right_pt)
line_8 = Line(StartPoint=top_left_band_right_pt, EndPoint=midpoint_2)
line_9 = Line(StartPoint=top_right_band_left_pt, EndPoint=top_right_band_right_pt)
line_10 = Line(StartPoint=midpoint_3, EndPoint=top_right_band_left_pt)
merge_6 = Merge(Data1=line_5, Data2=line_6, Data3=line_7, Data4=line_8, Data6=line_10, Data7=line_9, Data8=tip_slant_line)  # -> flatten(Result)
join_curves = JoinCurves(Curves=merge_6, Preserve=False)
connect_curves = ConnectCurves(Curves=join_curves, Continuity=2, Close=True, Bulge=Slider(0.6, range=0..2))
close_curve = CloseCurve(Curve=connect_curves, Tolerance=0)
xz_plane_4 = XZPlane(Origin=Point(0, 0, 0))
unit_y_2 = UnitY(Factor="-30")
project = Project(Geometry=close_curve, Plane=xz_plane_4)  # -> Geometry, Transform
planar = Planar(Curve=project.Geometry)  # -> Planar, Plane, Deviation
move_11 = Move(Geometry=project.Geometry, Motion=unit_y_2)  # -> Geometry, Transform
panel_6 = Panel(planar.Planar)
cutter_curve = Curve(move_11.Geometry)

# ----
# Side Cutter Volume
cutter_curve_2 = Curve(cutter_curve)
panel_7 = Panel(cutter_curve_2)
unit_y_3 = UnitY(Factor="60")
boundary_surfaces = BoundarySurfaces(Edges=cutter_curve_2)
extrude = Extrude(Base=boundary_surfaces, Direction=unit_y_3)
side_cutter_surface = Surface(boundary_surfaces)
side_cutter_volume = Brep(extrude)

# ----
# Splint Body
preform_tube_brep = Brep(finger_model_rotate.Geometry)
solid_intersection = SolidIntersection(BrepsA=preform_tube_brep, BrepsB=side_cutter_volume)
splint_body = Brep(solid_intersection)

# ---- group: splint-nub
# Direction
# Indicator
ball_r_to_wall_ratio = Slider(0.65, range=0.6..1)
splint_body_2 = Brep(splint_body)
wall_thickness_2 = Number(wall_thickness)
tip_top_band_3 = Curve(tip_top_band)
midpoint_4 = Midpoint(Curve=tip_top_band_3)
multiplication_3 = Multiplication(A=wall_thickness_2, B=ball_r_to_wall_ratio)
nub_radius = Panel(multiplication_3)
brep_closest_point = BrepClosestPoint(Point=midpoint_4, Brep=splint_body_2)  # -> Point, Normal, Distance
sphere_5 = Sphere(Base=midpoint_4, Radius=nub_radius)
surface_sinking_ratio = Slider(0.4, range=0..1)
line_11 = Line(StartPoint=midpoint_4, EndPoint=brep_closest_point.Point)
multiplication_4 = Multiplication(A=nub_radius, B=surface_sinking_ratio)
extend_curve = ExtendCurve(Curve=line_11, Type=0, Start=0, End=multiplication_4)
end_points_8 = EndPoints(Curve=extend_curve)  # -> Start, End
move_to_point = MoveToPoint(Geometry=sphere_5, PointA=midpoint_4, PointB=end_points_8.End)  # -> Moved, Vector, Transform
splint_nub = Brep(move_to_point.Moved)

# ----
merge_7 = Merge(Data1=splint_nub, Data2=splint_body)  # -> flatten(Result)

# ---- group: splint-nub (continued)
solid_union = SolidUnion(Breps=merge_7)
finishedsplint = Brep(solid_union)

# ----
# ID Gun
finishedsplintbrep = Brep(finishedsplint)
wall_thickness_3 = Number(wall_thickness)
objectid_2 = Text(objectid)
text_size = Slider(3.3, range=2.5..6)
xz_plane_5 = XZPlane(Origin=Point(0, 0, 0))
to = Volume(Geometry=finishedsplintbrep)  # -> Volume, Centroid
bb_text = BBText(Location=xz_plane_5, Text=objectid_2, Size=text_size, Bold=Toggle(True), HorizontalAlignment=0, VerticalAlignment=0)
bounding_box = BoundingBox(Content=bb_text, Plane=PlaneXY(0, 0, 0), UnionBox=True)  # -> Box, Box_2
from = Volume(Geometry=bounding_box.Box)  # -> Volume, Centroid
line_12 = Line(StartPoint=from.Centroid, EndPoint=to.Centroid)
side_projection_angle = Slider(-28, range=-90..90)
boundary_surfaces_2 = BoundarySurfaces(Edges=bb_text)
unit_y_4 = UnitY(Factor=1)
yz_plane = YZPlane(Origin=Point(0, 0, 0))
move_12 = Move(Geometry=boundary_surfaces_2, Motion=line_12)  # -> Geometry, Transform
rotate_2 = Rotate(Geometry=unit_y_4, Angle=degrees(side_projection_angle), Plane=yz_plane)  # -> Geometry, Transform
transform = Transform(Geometry=move_12.Geometry, Transform=rotate_2.Transform)  # -> flatten(Geometry)
finishedsplintbrep_2 = Brep(finishedsplintbrep)
area = Area(Geometry=transform)  # -> Area, Centroid
text_projection_vector = Vector(rotate_2.Geometry)
vector_display = VectorDisplay(Anchor=to.Centroid, Vector=text_projection_vector)
wall_thickness_4 = Number(wall_thickness_3)
project_point = ProjectPoint(Point=area.Centroid, Direction=text_projection_vector, Geometry=finishedsplintbrep_2)  # -> Point, Index
multiplication_5 = Multiplication(A=text_projection_vector, B=wall_thickness_4, C="0.8")

extrude_2 = Extrude(Base=transform, Direction=multiplication_5)  # -> flatten(Extrusion)
volume = Volume(Geometry=extrude_2)  # -> Volume, Centroid
line_13 = Line(StartPoint=volume.Centroid, EndPoint=project_point.Point)

move_to_point_2 = MoveToPoint(Geometry=extrude_2, PointA=volume.Centroid, PointB=project_point.Point)  # -> Moved, Vector, Transform
solid_difference_2 = SolidDifference(BrepsA=finishedsplintbrep_2, BrepsB=move_to_point_2.Moved)
splint_w_id = Brep(solid_difference_2)

# ----
# Orienting To Build Plate
# Tip Slant Line, describes the angle necessary to bring the front cut line of the splint down to the build platform.
tip_slant_line_2 = Line(tip_slant_line)
finishedsplint_2 = Brep(splint_w_id)
X = UnitX(Factor=1)
flip = FlipCurve(Curve=tip_slant_line_2)  # -> Curve, Flag
xz = XZPlane(Origin=Point(0, 0, 0))
end = EndPoints(Curve=flip.Curve)  # -> Start, End
angle_2 = Angle(VectorA=flip.Curve, VectorB=X, Plane=xz)  # -> Angle, Reflex
neg = Negative(Value=angle_2.Angle)
pt = Point(end.Start)
pt_2 = Point(end.End)
pl_origin = PlaneOrigin(Base=xz, Origin=pt)
rotate_3 = Rotate(Geometry=finishedsplint_2, Angle=angle_2.Angle, Plane=pl_origin)  # -> Geometry, Transform
orientedsplint = Brep(rotate_3.Geometry)

# ----
# Final Joining
# And Smoothing
# Bake Me
number_slider = Slider(0.12, range=0.05..0.2)
orientedsplint_2 = Brep(orientedsplint)
shrinkwrap = ShrinkWrap(
    Geometry=orientedsplint_2,
    EdgeLength=number_slider,
    Offset=0,
    Smoothing=Slider(8, range=0..10),
    Optimization=10,
    FillHoles=True)
final_smooth_splint = Mesh(shrinkwrap)

# ----
# Preview Steps
side_cutter_volume_2 = Brep(side_cutter_volume)
inner_finger_form = Brep(inner_barrel_transform)
side_cutter_surface_2 = Surface(side_cutter_surface)
splint_body_sharp = Brep(splint_body)
preform_barrel = Brep(finger_model_rotate.Geometry)
splint_body_smooth = Mesh(final_smooth_splint)
merge_8 = Merge(Data1=preform_barrel, Data2=side_cutter_surface_2)  # -> flatten(Result)
merge_9 = Merge(Data1=preform_barrel, Data2=side_cutter_volume_2)  # -> flatten(Result)
merge_10 = Merge(Data1=splint_body_smooth)  # -> flatten(Result)
merge_11 = Merge(Data1=splint_body_sharp)  # -> flatten(Result)
move_13 = Move(Geometry=inner_finger_form, Motion="60, 0, 0")  # -> Geometry, Transform
move_14 = Move(Geometry=merge_8, Motion="120, 0, 0")  # -> Geometry, Transform
move_15 = Move(Geometry=merge_9, Motion="180, 0, 0")  # -> Geometry, Transform
move_16 = Move(Geometry=merge_10, Motion="300, 0, 0")  # -> Geometry, Transform
move_17 = Move(Geometry=merge_11, Motion="240, 0, 0")  # -> Geometry, Transform
merge_12 = Merge(Data1=move_13.Geometry, Data2=move_14.Geometry, Data3=move_15.Geometry, Data4=move_17.Geometry, Data5=move_16.Geometry)  # -> flatten(Result)
random_color = RandomColor(Data=merge_12, Seed=2, FastMode=False)
custom_preview = CustomPreview(Geometry=merge_12, Material=random_color)

savemeshpy = Python3Script(
    geo_input=final_smooth_splint,
    output_file_dir=output_dir_out_2,
    jobname=root_filename_out_2,
    bool_activate=dev_activate_toggle)  # -> out; inputs geo_input: Mesh
# ---------- savemeshpy: Python ----------
# See: https://discourse.mcneel.com/t/how-to-optimise-ghpython-obj-export/87598/76

# This code is intended to be run inside a Grasshopper Python component
# It exports a given mesh to an OBJ or STL file using Rhino's export functionality
# Node inputs:
#   geo_input: The input mesh to be exported (Rhino.Geometry.Mesh)
#   output_file_dir: The directory where the exported file will be saved (string)
#   jobname: The base name for the exported file (string)

# Start standard gh python imports
from pathlib import Path
import sys
from importlib import reload #FOR DEV ONLY

ghFileDir = str(Path.joinpath(Path(ghenv.Component.OnPingDocument().FilePath).resolve().parents[0], "src"))
if ghFileDir not in sys.path:
    print("ghFileDir needed to be included")
    sys.path.append(ghFileDir)
import splintcommon
reload(splintcommon)
# End standard gh python imports

import time
splintcommon.log(f'Save Mesh Running at: ({time.strftime("%H:%M:%S", time.localtime())})')

import scriptcontext as sc
# import rhinoscriptsyntax as rs
import System
import Rhino
import random
import string
import os
import traceback

def add_layer(layer_name=None, layer_color=None):
    """Adds a new layer to the active Rhino document.
    
    Args:
      layer_name (str): An optional layer name.
      layer_color (System.Drawing.Color): An optional layer color.
    Returns:
      The index of the new layer.
    """
    sc.doc = Rhino.RhinoDoc.ActiveDoc
    if layer_name != None:
        # Check whether the layer name is valid
        if not Rhino.DocObjects.Layer.IsValidName(layer_name):
            raise ValueError("{} is not a valid layer name."\
                .format(layer_name))
        # Check whether a layer with the same name already exists
        layer_index = sc.doc.Layers.Find(layer_name, True)
        if layer_index >= 0:
            raise ValueError("A layer with the name {} already exists."\
                .format(layer_name))
    else:
        layer_name = sc.doc.Layers.GetUnusedLayerName(False)
    
    # Check whether the layer color is valid
    if layer_color != None:
        if not isinstance(layer_color, System.Drawing.Color):
            raise ValueError("{} is not a valid layer color."\
                .format(layer_color))
    else:
        layer_color = System.Drawing.Color.Black # default layer color
    
    # Add a new layer to the active document
    layer_index = sc.doc.Layers.Add(layer_name, layer_color)
    if layer_index < 0:
        raise ValueError("Unable to add layer {} to document."\
            .format(layer_name))
    return layer_index
    

def delete_layer(layer):
    """Deletes an existing layer from the active Rhino document. 
    The layer to be removed cannot be the current layer and 
    it will be deleted even if it contains objects.
    
    Args:
      layer (str\id): A name or id of an existing layer.
    Returns:
      True or False, indicating success or failure.
    """
    sc.doc = Rhino.RhinoDoc.ActiveDoc
    layer_index = sc.doc.Layers.Find(layer, True)
    if layer_index < 0:
        raise ValueError("The layer {} does not exist.".format(layer))
    rc = sc.doc.Layers.Purge(layer_index, True)
    sc.doc.Views.Redraw()
    return rc
    

def bake_mesh(layer, mesh, mesh_name=None):
    """Bakes a mesh object to the active Rhino document.
    
    Args:
      layer (str\id): The name or id of an existing layer.
      mesh (Rhino.Geometry.Mesh): A mesh object to bake.
      mesh_name (str): An optional mesh object name.
    Returns:
      The GUID of the baked mesh.
    """

    splintcommon.log(f"mesh type:{type(mesh)}")
    # mesh = rs.coercemesh(mesh)
    # splintcommon.log(f"mesh type:{type(mesh)}")

    sc.doc = Rhino.RhinoDoc.ActiveDoc
    # Check whether the mesh is a mesh object
    if mesh.ObjectType != Rhino.DocObjects.ObjectType.Mesh:
        raise ValueError("{} is not a mesh.".format(mesh))
    # Create the mesh object attributes
    attr = Rhino.DocObjects.ObjectAttributes()
    # Set the mesh object layer index attribute
    layer_index = sc.doc.Layers.Find(layer, True)
    if layer_index < 0:
        if layer == "Default":
            raise ValueError("The layer {} can't be baked to.".format(layer))
        else:
            raise ValueError("The layer {} does not exist.".format(layer))    
    else:
        attr.LayerIndex = layer_index
    # Set the mesh object name attribute
    if mesh_name != None:
        attr.Name = mesh_name
    # Bake the mesh to the active Rhino documemnt
    mesh_id = sc.doc.Objects.AddMesh(mesh, attr)
    return mesh_id

def get_obj_settings():
    splintcommon.log("Using OBJ mesh settings")
    """Returns the settings for the OBJ export command as a string."""
    # Formatting options
    cfg = "_Geometry=_Mesh "
    cfg += "_EndOfLine=CRLF "
    cfg += "_ExportRhinoObjectNames=_ExportObjectsAsOBJGroups "
    cfg += "_ExportMeshTextureCoordinates=_Yes "
    cfg += "_ExportMeshVertexNormals=_Yes "
    cfg += "_ExportMeshVertexColors=_Yes "
    cfg += "_CreateNGons=_No "
    cfg += "_ExportMaterialDefinitions=_No "
    cfg += "_YUp=_Yes "
    cfg += "_WrapLongLines=_No "
    cfg += "_VertexWelding=_Unmodified "
    cfg += "_WritePrecision=4 "
    cfg += "_Enter "
    # Detailed options
    cfg += "_DetailedOptions "
    cfg += "_JaggedSeams=_No "
    cfg += "_PackTextures=_No "
    cfg += "_Refine=_No "
    cfg += "_SimplePlane=_No "
    # Advanced options
    cfg += "_AdvancedOptions "
    cfg += "_Angle=0 "
    cfg += "_AspectRatio=0 "
    cfg += "_Distance=0.0 "
    cfg += "_Density=0.5 "
    cfg += "_Grid=0 "
    cfg += "_MaxEdgeLength=0 "
    cfg += "_MinEdgeLength=0.0001 "
    cfg += "_Enter _Enter" # remove the last _Enter to check if density is set
    return cfg, "obj"

def get_stl_settings_default():
    #[ANGLE,ASPECT RATIO,MAX DIST TO SRF,GRID,DENSITY,MAX EDGE LEN,MIN EDGE LEN]
    #Change list below as needed
    setting_list=[15,0,0.01,16,0,0,0.001]   
    return get_stl_settings(*setting_list)

def get_stl_settings(ang,ar,dist,grid,den,maxL=0,minL=.0001):
    splintcommon.log("Using STL mesh settings")
    e_str = "_ExportFileAs=_Binary "
    e_str+= "_ExportUnfinishedObjects=_Yes "
    e_str+= "_UseSimpleDialog=_No "
    e_str+= "_Enter _DetailedOptions "
    e_str+= "_JaggedSeams=_No "
    e_str+= "_PackTextures=_No "
    e_str+= "_Refine=_Yes "
    e_str+= "_SimplePlane=_Yes "
    # e_str+= "_AdvancedOptions "
    # e_str+= "_Angle={} ".format(ang)
    # e_str+= "_AspectRatio={} ".format(ar)
    # e_str+= "_Distance={} ".format(dist)
    # e_str+= "_Density={} ".format(den)
    # e_str+= "_Grid={} ".format(grid)
    # e_str+= "_MaxEdgeLength={} ".format(maxL)
    # e_str+= "_MinEdgeLength={} ".format(minL)
    e_str+= "_Enter _Enter"
    return e_str, "stl"

def export_mesh_files(meshes, path, filename, debug=False, asObj=True):
    """Exports a collection of meshes to an OBJ file.
    
    Args:
      meshes (list): A list of Rhino.Geometry.Mesh objects.
      path (str): An absolute path pointing to a directory.
      filename (str): A filename (without extension).
      debug (bool): Optional True to print debug information.
    Returns:
      True or False, indicating success or failure.
    """

    sc.doc = Rhino.RhinoDoc.ActiveDoc
    sc.doc.Views.RedrawEnabled = True # JG - False
    if debug: 
        now = time.process_time()
        elapsed = 0.0
        
    # Create a temporary layer
    splintcommon.log(f"export_mesh_files: Creating temp layer")
    layer = "".join(random.choice(string.ascii_uppercase) for _ in range(9))
    layer_index = add_layer(layer)
    if debug: 
        then, now = now, time.process_time()
        elapsed += now - then
        splintcommon.log("Creating temporary layer: {0:.4f} seconds".format(now-then))
        
    # Bake the temporary mesh(es)
    splintcommon.log(f"export_mesh_files: Baking temp mesh(es)")
    mesh_ids = [bake_mesh(layer, mesh) for mesh in meshes]
    if debug: 
        then, now = now, time.process_time()
        elapsed += now - then
        splintcommon.log("Creating temporary mesh(es): {0:.4f} seconds".format(now-then))
    
    # Unselect all objects in the scene
    sc.doc.Objects.UnselectAll()
    # Select the baked mesh object(s)
    for mid in mesh_ids:
        sc.doc.Objects.Select(mid)
    if debug: 
        then, now = now, time.process_time()
        elapsed += now - then
        splintcommon.log("Unselecting and selecting: {0:.4f} seconds".format(now-then))
    
    # Export the selected mesh object(s) to mesh file
    splintcommon.log(f"export_mesh_files: exporting to file")
    export_config, export_extension = get_obj_settings() if asObj else get_stl_settings_default()
    export_fname = "{}.{}".format(filename, export_extension)
    export_fpath = Path(os.path.join(path, export_fname))
    splintcommon.log(f"export_mesh_files: Export Values: {export_fname=} {export_fpath=}")
    
    if export_fpath.exists():
        splintcommon.log(f"export_mesh_files: REMOVING EXISTING MESH FILE: {export_fpath}")
        export_fpath.unlink()
        time.sleep(1.0)
        splintcommon.log(f"export_mesh_files: testing... MeshStillExists:{export_fpath.exists()}")

    splintcommon.log(f"export_mesh_files: exporting to file")

    cmd = '_-Export _Pause "{}" {} _Enter'.format(export_fpath, export_config) # _Enter
    # see: https://discourse.mcneel.com/t/export-command-line-options/87537/5
    splintcommon.log(f"export_mesh_files: RUNNING cmd: '{cmd}'")
    
    #start = Rhino.DocObjects.RhinoObject.NextRuntimeSerialNumber
    rc = Rhino.RhinoApp.RunScript(cmd, True)

    splintcommon.log(f"export_mesh_files: Completion {rc=}")

    #end = Rhino.DocObjects.RhinoObject.NextRuntimeSerialNumber
    #global __command_serial_numbers
    #__command_serial_numbers = None
    #if start != end:
        #__command_serial_numbers = (start, end)
    
    if debug: 
        then, now = now, time.process_time()
        elapsed += now - then
        splintcommon.log("Exporting Mesh Result: {0:.4f} seconds result={1}".format(now-then, rc))
    
    # Delete the temporary layer and meshes
    splintcommon.log(f"export_mesh_files: cleaning up temp layer")
    delete_layer(layer)
    
    if debug: 
        then, now = now, time.process_time()
        elapsed += now - then
        splintcommon.log("Cleaning up: {0:.4f} seconds\n".format(now-then))
        splintcommon.log("Total elapsed: {0:.4f} seconds".format(elapsed))

    sc.doc.Views.RedrawEnabled = True

    splintcommon.log(f"export_mesh_files: Returning result: {rc=}")

    return rc

def saveMeshToFile(inputMesh, directory, rootFilename):
    try:
        splintcommon.log(f"inputMesh type: {inputMesh}")
        splintcommon.log(f"{directory=}")
        splintcommon.log(f"{rootFilename=}")
        
        if inputMesh is None or directory is None or rootFilename is None:        
            raise ValueError("Missing required inputs for saving file")

        #TODO, Validate the path more completely
        if "." in directory or "." in rootFilename:
            raise ValueError(f"Path must not contain dot character: {directory}")

        result = export_mesh_files([inputMesh], directory, rootFilename, True, False)

        if not result:
            raise ValueError(f"FAIL: mesh export failed. {result=}")
        else:
            splintcommon.log(f'SUCCESS: Saved to {rootFilename} in {directory}')
            splintcommon.confirm_job_is_processed_and_exit(jobname, True, "mesh exported normally")

    except Exception as e:
        errMsg = f"Exception: {traceback.format_exc()}"
        splintcommon.log(errMsg)
        splintcommon.confirm_job_is_processed_and_exit(jobname, False, errMsg)

if geo_input is None:
    message = f"No mesh input To Process {geo_input=}"
    splintcommon.log(message)
    splintcommon.confirm_job_is_processed_and_exit(jobname, False, message)
else:
    saveMeshToFile(geo_input, output_file_dir, jobname)
# ---------- end savemeshpy ----------
panel_8 = Panel(savemeshpy)

# ==== cluster CylinderCl
begin_extend_mm = ClusterInput()
begin_r = ClusterInput()
center_line = ClusterInput()
end_r = ClusterInput()
begin_extend_mm_2 = Number(begin_extend_mm)
begin_r_2 = Number(begin_r)
center_line_2 = Curve(center_line)
original_center_line = Curve(center_line_2)
default_number = Number("0")
combine_data = CombineData(Input0=begin_extend_mm_2, Input1=default_number)  # -> Result, Index
begin_extend_mm_3 = Number(combine_data.Result)
begin_extend_mm_4 = Number(begin_extend_mm_3)
panel = Panel(combine_data.Result)
extend_curve = ExtendCurve(Curve=original_center_line, Type=0, Start=begin_extend_mm_4, End="0")
reparameterize_curve = ReparameterizeCurve(Curve=extend_curve)  # -> Reparameterized, Original
length = Length(Curve=original_center_line)
end_r_2 = Number(end_r)
panel_2 = Panel("r diff towards begin")
subtraction = Subtraction(A=begin_r_2, B=end_r_2)
length_2 = Length(Curve=reparameterize_curve.Reparameterized)
# change for extended l
panel_3 = Panel("change over l")
radius_begin_end_ratio = Division(A=subtraction, B=length)
augmented_center_line = Curve(reparameterize_curve.Reparameterized)  # disabled
multiplication = Multiplication(A=radius_begin_end_ratio, B=length_2)
panel_4 = Panel("1")  # disabled
panel_5 = Panel("0")  # disabled
panel_6 = Panel("new begin r")
addition = Addition(A=multiplication, B=end_r_2)
perp_frame = PerpFrame(Curve=augmented_center_line, Parameter=panel_4)  # disabled
perp_frame_2 = PerpFrame(Curve=augmented_center_line, Parameter=panel_5)  # disabled
augmented_begin_r = Number(addition)
augmented_begin_r_2 = Number(augmented_begin_r)  # disabled
circle = Circle(Plane=perp_frame_2, BeginR=augmented_begin_r_2)  # disabled
circle_2 = Circle(Plane=perp_frame, Radius=end_r_2)  # disabled

# ---- group: Non-Augmented-RealityCheck
perp_frame_3 = PerpFrame(Curve=original_center_line, Parameter=panel_5)  # disabled
circle_3 = Circle(Plane=perp_frame_3, BeginR=begin_r_2)  # disabled

# ----
augmented_begin_r_3 = Number(augmented_begin_r)
augmented_center_line_2 = Curve(reparameterize_curve.Reparameterized)
merge = Merge(Data1=circle, Data2=circle_2)  # -> flatten(Result); disabled
end_r_3 = Number(end_r_2)
loft = Loft(Curves=merge, Options={Adjust=False, Closed=False, LoftEnds=0, LoftSimp=0, LoftType=0, Rebuild=10, Refit=0.01})  # disabled
taperedcylinder_py = Python3Script(centerLine=augmented_center_line_2, startR=augmented_begin_r_3, endR=end_r_3)  # -> out, taperedCylinder; inputs centerLine: Line, startR: Double, endR: Double
# ---------- taperedcylinder_py: Python ----------
# This file represents a stub for a GhPython component in Grasshopper.
# It sets up the environment to import and use the splintcommon or other external modules.

from pathlib import Path
import sys
from importlib import reload #FOR DEV ONLY
import time

# In normal GH doc
ghFileDir = None
try:
    ghFileDir = str(Path.joinpath(Path(ghenv.Component.OnPingDocument().FilePath).resolve().parents[0], "src"))
except:
    # In GH Cluster
    ghFileDir = str(Path.joinpath(Path(ghenv.Component.OnPingDocument().Owner.OnPingDocument().FilePath).resolve().parents[0], "src"))

print(f"{ghFileDir=}")

if ghFileDir not in sys.path:
    print("ghFileDir needed to be included")
    sys.path.append(ghFileDir)

import splintcommon
reload(splintcommon) #FOR DEV ONLY

#splintcommon module is now available for use in this GhPython component
splintcommon.log(f'GhPython Node initialized at {time.ctime()}')

import BrepGeneration
reload(BrepGeneration)

taperedCylinder = BrepGeneration.create_tapered_cylinder(centerLine, startR, endR)
# ---------- end taperedcylinder_py ----------
cap_holes = CapHoles(Brep=loft)  # disabled
brepinspect_py = Python3Script(brepToTest=taperedcylinder_py.taperedCylinder)  # -> out; inputs brepToTest: Brep
# ---------- brepinspect_py: Python ----------
# This file represents a stub for a GhPython component in Grasshopper.
# It sets up the environment to import and use the splintcommon or other external modules.

from pathlib import Path
import sys
from importlib import reload #FOR DEV ONLY
import time

# In normal GH doc
#ghFileDir = str(Path.joinpath(Path(ghenv.Component.OnPingDocument().FilePath).resolve().parents[0], "src"))
# In GH Cluster
ghFileDir = str(Path.joinpath(Path(ghenv.Component.OnPingDocument().Owner.OnPingDocument().FilePath).resolve().parents[0], "src"))

print(f"{ghFileDir=}")

if ghFileDir not in sys.path:
    print("ghFileDir needed to be included")
    sys.path.append(ghFileDir)

import splintcommon
reload(splintcommon) #FOR DEV ONLY

#splintcommon module is now available for use in this GhPython component
splintcommon.log(f'GhPython Node initialized at {time.ctime()}')

import BrepInspect
reload(BrepInspect)

BrepInspect.inspect_solid_brep(brepToTest)
# ---------- end brepinspect_py ----------
panel_7 = Panel(taperedcylinder_py.out)
panel_8 = Panel(brepinspect_py)
out = ClusterOutput(taperedcylinder_py.out)
taperedcylinder = ClusterOutput(taperedcylinder_py.taperedCylinder)

# ==== cluster ReliableUnionCL
# Trim Solid is not always working
seam_alignment_line = ClusterInput()  # disabled
join_axis_vector = ClusterInput()  # disabled
brep1 = ClusterInput()
brep2 = ClusterInput()
brep1_2 = Brep(brep1)
brep2_2 = Brep(brep2)
seam_alignment_line_2 = Line(seam_alignment_line)  # disabled
join_axis_vector_2 = Vector(join_axis_vector)  # disabled
number_slider = Slider(0, range=0..1)  # disabled
reverse = Reverse(Vector=join_axis_vector_2)  # disabled
brepunion = Python3Script(BrepA=brep1_2, BrepB=brep2_2)  # -> UnionReport, UnionResult; inputs BrepA: Brep, BrepB: Brep
# ---------- brepunion: Python ----------
# This file represents a stub for a GhPython component in Grasshopper.
# It sets up the environment to import and use the splintcommon or other external modules.

from pathlib import Path
import sys
from importlib import reload #FOR DEV ONLY
import time

# In normal GH doc
ghFileDir = None
try:
    ghFileDir = str(Path.joinpath(Path(ghenv.Component.OnPingDocument().FilePath).resolve().parents[0], "src"))
except:
    # In GH Cluster
    ghFileDir = str(Path.joinpath(Path(ghenv.Component.OnPingDocument().Owner.OnPingDocument().FilePath).resolve().parents[0], "src"))

print(f"{ghFileDir=}")

if ghFileDir not in sys.path:
    print("ghFileDir needed to be included")
    sys.path.append(ghFileDir)

import splintcommon
reload(splintcommon) #FOR DEV ONLY

#splintcommon module is now available for use in this GhPython component
splintcommon.log(f'GhPython Node initialized at {time.ctime()}')

import BrepUnion
reload(BrepUnion)

UnionResult, success, method_used = BrepUnion.robust_brep_union(BrepA, BrepB)

if not success:
    raise Exception(f"Union failed! {method_used}")
# ---------- end brepunion ----------
panel = Panel(brepunion.UnionReport)
merge = Merge(Data1=brep1_2, Data2=brep2_2)  # -> flatten(Result); disabled
unionresult = ClusterOutput(brepunion.UnionResult)  # disabled
unionreport = ClusterOutput(brepunion.UnionReport)
solid_union = SolidUnion(Breps=merge)  # -> flatten(Result); disabled
panel_2 = Panel(solid_union)  # disabled
brepinspect = Python3Script(brepToTest=solid_union)  # -> out, isUsable; inputs brepToTest: Brep; disabled
# ---------- brepinspect: Python ----------
# This file represents a stub for a GhPython component in Grasshopper.
# It sets up the environment to import and use the splintcommon or other external modules.

from pathlib import Path
import sys
from importlib import reload #FOR DEV ONLY
import time

# In normal GH doc
#ghFileDir = str(Path.joinpath(Path(ghenv.Component.OnPingDocument().FilePath).resolve().parents[0], "src"))
# In GH Cluster
ghFileDir = str(Path.joinpath(Path(ghenv.Component.OnPingDocument().Owner.OnPingDocument().FilePath).resolve().parents[0], "src"))

print(f"{ghFileDir=}")

if ghFileDir not in sys.path:
    print("ghFileDir needed to be included")
    sys.path.append(ghFileDir)

import splintcommon
reload(splintcommon) #FOR DEV ONLY

#splintcommon module is now available for use in this GhPython component
splintcommon.log(f'GhPython Node initialized at {time.ctime()}')

import BrepInspect
reload(BrepInspect)

isUsable = BrepInspect.inspect_solid_brep(brepToTest)
# ---------- end brepinspect ----------
check_1_exists = Python3Script(geo=solid_union)  # -> out, doesExist, doesntExist; inputs geo: list of GeometryBase; disabled
# ---------- check_1_exists: Python ----------
from Rhino.Geometry import Brep

print(f"{geo=} type={type(geo)} v1.00")

isExisting = False

if geo is None:
    print("geo is None (root)")
    isExisting = False
elif type(geo) is Brep:
    print("geo is Brep. Yay.")
    isExisting = True
elif hasattr(geo, '__getitem__'):
    print(f"geo len={len(geo)}")
    if len(geo) > 0 and geo[0] is None:
        print(f"geo[0] is None len={len(geo)}")
        isExisting = False
    else:
        isExisting = len(geo) == 1
        print(f"geo is list of {len(geo)} len. {isExisting=}")
else:
    print("fall through no recognized type")

doesExist = isExisting
doesntExist = not isExisting
print(f"{doesExist=} {doesntExist=}")
# ---------- end check_1_exists ----------
pass_items_py = Python3Script(passItems=check_1_exists.doesntExist, brep1=brep1_2, brep2=brep2_2)  # -> out, out_brep1, out_brep2; inputs brep1: Brep, brep2: Brep; disabled
# ---------- pass_items_py: Python ----------
if passItems:
    out_brep1 = brep1
    out_brep2 = brep2
    print("Items passed")
else:
    out_brep1 = None
    out_brep2 = None
    print("Items not passed")
# ---------- end pass_items_py ----------
panel_3 = Panel(pass_items_py.out)  # disabled
brepunion_2 = Python3Script(BrepA=pass_items_py.out_brep1, BrepB=pass_items_py.out_brep2)  # -> out, UnionResult; inputs BrepA: Brep, BrepB: Brep; disabled
# ---------- brepunion_2: Python ----------
# This file represents a stub for a GhPython component in Grasshopper.
# It sets up the environment to import and use the splintcommon or other external modules.

from pathlib import Path
import sys
from importlib import reload #FOR DEV ONLY
import time

# In normal GH doc
ghFileDir = None
try:
    ghFileDir = str(Path.joinpath(Path(ghenv.Component.OnPingDocument().FilePath).resolve().parents[0], "src"))
except:
    # In GH Cluster
    ghFileDir = str(Path.joinpath(Path(ghenv.Component.OnPingDocument().Owner.OnPingDocument().FilePath).resolve().parents[0], "src"))

print(f"{ghFileDir=}")

if ghFileDir not in sys.path:
    print("ghFileDir needed to be included")
    sys.path.append(ghFileDir)

import splintcommon
reload(splintcommon) #FOR DEV ONLY

#splintcommon module is now available for use in this GhPython component
splintcommon.log(f'GhPython Node initialized at {time.ctime()}')

import BrepUnion
reload(BrepUnion)

UnionResult = BrepUnion.robust_brep_union(BrepA, BrepB)
# ---------- end brepunion_2 ----------
panel_4 = Panel(brepunion_2.out)  # disabled
check_1_exists_2 = Python3Script(geo=brepunion_2.UnionResult)  # -> out, doesExist, doesntExist; inputs geo: list of GeometryBase; disabled; same code as check_1_exists
pass_items_py_2 = Python3Script(passItems=check_1_exists_2.doesntExist, brep1=brep1_2, brep2=brep2_2)  # -> out, out_brep1, out_brep2; inputs brep1: Brep, brep2: Brep; disabled; same code as pass_items_py
python_3_script = Python3Script(BrepA=pass_items_py_2.out_brep1, BrepB=pass_items_py_2.out_brep2)  # -> out, FixedBrepA, FixedBrepB, UnionResult; inputs BrepA: Brep, BrepB: Brep; disabled
# ---------- python_3_script: Python ----------
# This file represents a stub for a GhPython component in Grasshopper.
# It sets up the environment to import and use the splintcommon or other external modules.

from pathlib import Path
import sys
from importlib import reload #FOR DEV ONLY
import time

# print("DEBUG")
# print(ghenv.Component.OnPingDocument().Owner.OnPingDocument())
# print("DEBUG END")

ghFileDir = str(Path.joinpath(Path(ghenv.Component.OnPingDocument().Owner.OnPingDocument().FilePath).resolve().parents[0], "src"))
print(f"{ghFileDir=}")

if ghFileDir not in sys.path:
    print("ghFileDir needed to be included")
    sys.path.append(ghFileDir)

import splintcommon
reload(splintcommon) #FOR DEV ONLY

#splintcommon module is now available for use in this GhPython component
splintcommon.log(f'GhPython Node initialized at {time.ctime()}')

import BooleanUnionDiagnostic
reload(BooleanUnionDiagnostic)

FixedBrepA, FixedBrepB, UnionResult = BooleanUnionDiagnostic.do_diagnostic_solid_union(BrepA, BrepB, None, True)
# ---------- end python_3_script ----------
panel_5 = Panel(pass_items_py_2.out)  # disabled
panel_6 = Panel(python_3_script.out)  # disabled
deconstruct_brep = DeconstructBrep(Brep=python_3_script.FixedBrepA)  # -> Faces, Edges, Vertices; disabled
deconstruct_brep_2 = DeconstructBrep(Brep=python_3_script.FixedBrepB)  # -> Faces, Edges, Vertices; disabled
brep_join = BrepJoin(Breps=deconstruct_brep_2.Faces)  # -> Breps, Closed; disabled
brep_join_2 = BrepJoin(Breps=deconstruct_brep.Faces)  # -> Breps, Closed; disabled
merge_2 = Merge(Data1=brep_join_2.Breps, Data2=brep_join.Breps)  # -> flatten(Result); disabled
solid_union_2 = SolidUnion(Breps=merge_2)  # -> flatten(Result); disabled
panel_7 = Panel(brepinspect.isUsable)  # disabled
loft_options = LoftOptions(Closed=False, Adjust=False, Rebuild=0, Refit=0, Type=0)  # disabled
panel_8 = Panel(check_1_exists.out)  # disabled
panel_9 = Panel(check_1_exists.doesntExist)  # disabled
panel_10 = Panel(solid_union_2)  # disabled
panel_11 = Panel(brepinspect.out)  # disabled
check_1_exists_3 = Python3Script(geo=solid_union_2)  # -> out, doesExist, doesntExist; inputs geo: list of GeometryBase; disabled; same code as check_1_exists
pass_items_py_3 = Python3Script(passItems=check_1_exists_3.doesntExist, brep1=brep1_2, brep2=brep2_2)  # -> out, out_brep1, out_brep2; inputs brep1: Brep, brep2: Brep; disabled; same code as pass_items_py
trim_solid = TrimSolid(Shape=pass_items_py_3.out_brep2, Cutters=pass_items_py_3.out_brep1)  # disabled
trim_solid_2 = TrimSolid(Shape=pass_items_py_3.out_brep1, Cutters=pass_items_py_3.out_brep2)  # disabled
list_item = ListItem(List=trim_solid, Index=number_slider, Wrap=True)  # disabled
directional_trim = DirectionalTrim(single_opening_brep=trim_solid_2, trim_shift_vector=join_axis_vector_2)  # -> trimmed_brep_2, naked_curve; disabled
directional_trim_2 = DirectionalTrim(single_opening_brep=list_item, trim_shift_vector=reverse)  # -> flatten(trimmed_brep_2), naked_curve; disabled
curve = Curve(directional_trim_2.naked_curve)  # disabled
curve_2 = Curve(directional_trim.naked_curve)  # disabled
flip_curve = FlipCurve(Curve=curve, Guide=curve_2)  # -> Curve, Flag; disabled
merge_3 = Merge(Data1=curve_2, Data2=flip_curve.Curve)  # -> flatten(Result); disabled
trimmed_brep = Brep(directional_trim_2.trimmed_brep_2)  # disabled
trimmed_brep_2 = Brep(directional_trim.trimmed_brep_2)  # disabled
curve_align_curve_seams = CurveAlignCurveSeams(Curves=merge_3, Guide=seam_alignment_line_2, Snap=False)  # -> Aligned, Points, ResultBoolean; disabled
loft = Loft(Curves=curve_align_curve_seams.Aligned, Options=loft_options)  # disabled
merge_4 = Merge(Data1=trimmed_brep_2, Data2=loft, Data3=trimmed_brep)  # -> flatten(Result); disabled
brep_join_3 = BrepJoin(Breps=merge_4)  # -> Breps, Closed; disabled
panel_12 = Panel(check_1_exists_2.out)  # disabled
panel_13 = Panel(check_1_exists_2.doesntExist)  # disabled
list_item_2 = ListItem(List=brep_join_3.Breps, Index=0, Wrap=True)  # disabled
check_1_exists_4 = Python3Script(geo=list_item_2)  # -> out, doesExist, doesntExist; inputs geo: list of GeometryBase; disabled; same code as check_1_exists
python_3_script_2 = Python3Script(
    method0Exists=check_1_exists.doesExist,
    method0Geo=solid_union,
    method1Exists=check_1_exists_2.doesExist,
    method1Geo=brepunion_2.UnionResult,
    method2Exists=check_1_exists_3.doesExist,
    method2Geo=solid_union_2,
    method3Exists=check_1_exists_4.doesExist,
    method3Geo=list_item_2)  # -> out, result; inputs method0Exists: Boolean, method0Geo: GeometryBase, method1Exists: Boolean, method1Geo: GeometryBase, method2Exists: Boolean, method2Geo: GeometryBase, method3Geo: GeometryBase; disabled
# ---------- python_3_script_2: Python ----------
if method0Exists:
    result = method0Geo
    print("Method 0 Wins")
elif method1Exists:
    result = method1Geo
    print("Method 1 Wins")
elif method2Exists:
    result = method2Geo
    print("Method 2 Wins")
elif method3Exists:
    result = method3Geo
    print("Method 3 Wins")
else:
    print("NOTHING WORKED!!!")
# ---------- end python_3_script_2 ----------

# ==== cluster BrepUnionCL
inputbreps = ClusterInput()
brepunion_py = Python3Script(InputBreps=inputbreps)  # -> UnionReport, UnionResult; inputs InputBreps: list of Brep
# ---------- brepunion_py: Python ----------
# This file represents a stub for a GhPython component in Grasshopper.
# It sets up the environment to import and use the splintcommon or other external modules.

from pathlib import Path
import sys
from importlib import reload #FOR DEV ONLY
import time

# In normal GH doc
ghFileDir = None
try:
    ghFileDir = str(Path.joinpath(Path(ghenv.Component.OnPingDocument().FilePath).resolve().parents[0], "src"))
except:
    # In GH Cluster
    ghFileDir = str(Path.joinpath(Path(ghenv.Component.OnPingDocument().Owner.OnPingDocument().FilePath).resolve().parents[0], "src"))

print(f"{ghFileDir=}")

if ghFileDir not in sys.path:
    print("ghFileDir needed to be included")
    sys.path.append(ghFileDir)

import splintcommon
reload(splintcommon) #FOR DEV ONLY

#splintcommon module is now available for use in this GhPython component
splintcommon.log(f'GhPython Node initialized at {time.ctime()}')

import BrepUnion
reload(BrepUnion)

UnionResult, success, method_used = BrepUnion.robust_brep_union(InputBreps)

if not success:
    msg = f"Union failed! {method_used}"
    ghenv.Component.AddRuntimeMessage(
        ghenv.Component.GH_RuntimeMessageLevel.Error, msg
    )
    raise Exception(msg)
# ---------- end brepunion_py ----------
unionreport = Text(flatten(brepunion_py.UnionReport))
unionreport_2 = Panel(unionreport)
unionresult = ClusterOutput(brepunion_py.UnionResult)
unionreport_3 = ClusterOutput(unionreport)

# ==== cluster DirectionalTrim
trim_shift_vector = ClusterInput()
single_opening_brep = ClusterInput()
single_opening_brep_2 = Brep(single_opening_brep)
trim_shift_vector_2 = Vector(trim_shift_vector)
brep_edges = BrepEdges(Brep=single_opening_brep_2)  # -> Naked, Interior, NonManifold
unit_vector = UnitVector(Vector=trim_shift_vector_2)
reverse = Reverse(Vector=unit_vector)
curve = Curve(flatten(brep_edges.Naked))
join_curves = JoinCurves(Curves=curve, Preserve=False)
point = Point("0, 0, 0")
multiplication = Multiplication(A=reverse, B="1000")
multiplication_2 = Multiplication(A=unit_vector, B="1000")
move = Move(Geometry=point, Motion=multiplication)  # -> Geometry, Transform
reparameterize_curve = ReparameterizeCurve(Curve=join_curves)  # -> Reparameterized, Original
line = Line(StartPoint=multiplication, EndPoint=multiplication_2)
divide_curve = DivideCurve(Curve=reparameterize_curve.Reparameterized, Count="10", Kinks=False)  # -> flatten(Points), Tangents, Parameters
plane_fit = PlaneFit(Points=divide_curve.Points)  # -> Plane, Deviation
move_2 = Move(Geometry=plane_fit.Plane, Motion=trim_shift_vector_2)  # -> Geometry, Transform
brep_plane = BrepPlane(Brep=single_opening_brep_2, Plane=move_2.Geometry)  # -> Curves, Points
split_brep = SplitBrep(Brep=single_opening_brep_2, Cutter=brep_plane.Curves)
bounding_box = BoundingBox(Content=split_brep, Plane=PlaneXY(0, 0, 0))  # -> Box, Box_2
volume = Volume(Geometry=bounding_box.Box)  # -> Volume, Centroid
sort_along_curve = SortAlongCurve(Points=volume.Centroid, Curve=line)  # -> Points, Indices
list_item = ListItem(List=sort_along_curve.Indices, Index="-1", Wrap=Toggle(True))
list_item_2 = ListItem(List=split_brep, Index=list_item, Wrap=True)
trimmed_brep = Brep(list_item_2)
brep_edges_2 = BrepEdges(Brep=trimmed_brep)  # -> Naked, Interior, NonManifold
join_curves_2 = JoinCurves(Curves=brep_edges_2.Naked, Preserve=False)
naked_curve = ClusterOutput(join_curves_2)
trimmed_brep_2 = ClusterOutput(trimmed_brep)
