# Grasshopper definition infinitysplint.gh (Grasshopper 1.0.8)
# plug-ins: Pufferfish, Wombat

axial_band_thickness_mm = Panel("3.25")
axial_band_thickness_mm_2 = Panel("1.5")
axial_band_thickness_mm_3 = Panel("2.20")

# ---- group: External Parameters
tip_circumference_mm = Panel("52.0")
# Infinity Splint
# Here are Vince's measurements:
# 
# "inter-phalange length" (is this mid splint, or inner to inner, or outer to outer?)- 3.3mm
# "root circumference" (circumference of the mid-phalange area nearest the palm)- 5.6mm
# "mid circumference" (circumference of the joint in the middle of the splint)- 5.7mm
# "tip circumference" (circumference of the mid-phalange area closest the finger tip) 5.2mm
inter_phalange_distance_mm = Panel("33.0")
root_circumference_mm = Panel("56.0")
mid_circumference_mm = Panel("57.0")
flexion_degrees = Panel("10.0")

# ---- group: Internal Parameters
bottom_band_width_mm = Panel("7.0")
top_band_width_mm = Panel("5.0")
mid_joint_rise_factor = Panel("1.0")
axial_band_thickness_mm_4 = Panel("2.25")

# ----
# Central Finger Line Geometry
addition = Addition(A=inter_phalange_distance_mm, B=top_band_width_mm)
xy_plane = XYPlane(Origin=Point(0, 0, 0))
division = Division(A=addition, B="2")
unit_x = UnitX(Factor=1)
xz_plane = XZPlane(Origin=Point(0, 0, 0))
line_sdl = LineSDL(Start=xy_plane, Direction=unit_x, Length=division)
rotate = Rotate(Geometry=unit_x, Angle=expr("-x", degrees(flexion_degrees)), Plane=xz_plane)  # -> Geometry, Transform
first_segment_end_points = EndPoints(Curve=line_sdl)  # -> Start, End
line_sdl_2 = LineSDL(Start=first_segment_end_points.End, Direction=rotate.Geometry, Length=division)
second_segment_end_points = EndPoints(Curve=line_sdl_2)  # -> Start, End
firstsegmentdirection = Vector(unit_x)
secondsegmentline = Line(line_sdl_2)
firstsegmentstart = Point(first_segment_end_points.Start)
firstsegmentline = Line(line_sdl)
firstsegmentend = Point(first_segment_end_points.End)
secondsegmentend = Point(second_segment_end_points.End)

# ---- group: Prep Circumference Values
circ2radius_py = Python3Script(c=tip_circumference_mm)  # -> r; inputs c: Double
# ---------- circ2radius_py: Python ----------
import math


r = (c/math.pi)/2
# ---------- end circ2radius_py ----------
circ2radius_py_2 = Python3Script(c=root_circumference_mm)  # -> r; inputs c: Double; same code as circ2radius_py
circ2radius_py_3 = Python3Script(c=mid_circumference_mm)  # -> r; inputs c: Double; same code as circ2radius_py
radius_mid = Number(circ2radius_py_3)
radius_tip = Number(circ2radius_py)
radius_root = Number(circ2radius_py_2)

# ----
# Finger Preform Solid
# Outer Finger Preform
firstsegmentend_2 = Point(firstsegmentend)
secondsegmentline_2 = Line(secondsegmentline)
firstsegmentline_2 = Line(firstsegmentline)
secondsegmentend_2 = Point(secondsegmentend)
radius_mid_2 = Number(radius_mid)
addition_2 = Addition(A=radius_mid_2, B=axial_band_thickness_mm_4)
# Inner Finger Preform
radius_root_2 = Number(radius_root)
addition_3 = Addition(A=radius_root_2, B=axial_band_thickness_mm_4)
radius_tip_2 = Number(radius_tip)
addition_4 = Addition(A=radius_tip_2, B=axial_band_thickness_mm_4)
radius_outer_tip = Number(addition_4)
radius_outer_mid = Number(addition_2)
radius_outer_root = Number(addition_3)
cylinder_cl = CylinderCl(radius=radius_root_2, center_line=firstsegmentline_2, radius_2=radius_mid_2)  # -> brep, facenormals
cylinder_cl_2 = CylinderCl(radius=radius_mid_2, center_line=secondsegmentline_2, radius_2=radius_tip_2)  # -> brep, facenormals
sphere = Sphere(Base=firstsegmentend_2, Radius=radius_outer_mid)
sphere_2 = Sphere(Base=firstsegmentend_2, Radius=radius_mid_2)
cylinder_cl_3 = CylinderCl(radius=radius_outer_mid, center_line=secondsegmentline_2, radius_2=radius_outer_tip)  # -> brep, facenormals
cylinder_cl_4 = CylinderCl(radius=radius_outer_root, center_line=firstsegmentline_2, radius_2=radius_outer_mid)  # -> brep, facenormals
brep = Brep(sphere)
run_it_toggle = BooleanToggle(True)
allowable_jiggle = Panel("0.1, 0.0, 0.1")
max_jiggle_cycles = Panel("3")
run_it_toggle_2 = BooleanToggle(False)

sphere_3 = Sphere(Base=secondsegmentend_2, Radius=radius_tip_2)
sphere_4 = Sphere(Base=secondsegmentend_2, Radius=radius_outer_tip)

merge = Merge(Data1=cylinder_cl.brep, Data2=sphere_2, Data3=cylinder_cl_2.brep, Data4=sphere_3)  # -> flatten(Result)
merge_2 = Merge(Data1=cylinder_cl_4.brep, Data2=brep, Data3=cylinder_cl_3.brep, Data4=sphere_4)  # -> flatten(Result)
bool_jig_union_py = Python3Script(breps=merge, jiggleToleranceVector=allowable_jiggle, maxAttempts=max_jiggle_cycles, x=run_it_toggle)  # -> out, unionedBrep, jiggleCount, testedPoints; inputs breps: list of Brep, jiggleToleranceVector: Vector3d, maxAttempts: Int32, x: Boolean
# ---------- bool_jig_union_py: Python ----------
from Rhino.Geometry import Brep, Vector3d, BoundingBox, Point3d
import clr #see: https://discourse.mcneel.com/t/activating-additional-out-parameters-rhinocommon-python/149516
import Rhino
import System
import random
from Rhino.Geometry import VolumeMassProperties
from typing import List

#jiggleVector, is a 3D vector with each component describing the amount of plus or minus jiggle allowed in each attempt to get the
# union to work. Union is first attempted without any jiggle and the hope is that works fine

# Is this a kluge? I'll let you decide. We're trying to make a Boolean Union work for all situations across a range.
# Because of the randomness in the jiggle, multiple iterations may need to happen to get a result

tol = 0.1
allowNonManifold = False
toggleJigglePositive = True

#inputs
# breps - breps to union together
# jiggleToleranceVector - 3D vector specifying the amount of allowed motion in a single jiggle in each direction
# maxAttempts - How many times to loop through the whole list of breps nudging them randomly

print(f"jiggle {maxAttempts=} X={jiggleToleranceVector.X}, Y={jiggleToleranceVector.Y}, Z={jiggleToleranceVector.Z}")

def getRandomJiggle(tolerance):
    global toggleJigglePositive
    toggleJigglePositive = not toggleJigglePositive
    dir = 1 if toggleJigglePositive else -1
    return random.uniform(0.0, dir * tolerance)
    # return random.uniform(-tolerance, tolerance)

def randomNudge(geo):
    xJiggle = getRandomJiggle(jiggleToleranceVector.X)
    yJiggle = getRandomJiggle(jiggleToleranceVector.Y)
    zJiggle = getRandomJiggle(jiggleToleranceVector.Z)
    print(f"nudge x={xJiggle} y={yJiggle} z={zJiggle}")
    geo.Transform(Rhino.Geometry.Transform.Translation(xJiggle, yJiggle, zJiggle))

def generatePointsInsideBrep(inputBrep: Brep, pointCount: int):
    bb: BoundingBox = inputBrep.GetBoundingBox.Overloads[bool](False)

    resultPts = []
    attempts = 0
    maxAttempts = 10 * pointCount

    while len(resultPts) < pointCount:
        attempts += 1
        randPt = Point3d(random.uniform(bb.Min.X, bb.Max.X), random.uniform(bb.Min.Y, bb.Max.Y), random.uniform(bb.Min.Z, bb.Max.Z))
        if inputBrep.IsPointInside(randPt, tol, True):
            resultPts.append(randPt)
        if attempts > maxAttempts:
            raise Exception(f"Unable to generate {pointCount} points inside geometry in {attempts} attempts. Generated {len(resultPts)} points successfully")

    print(f"Generated {len(resultPts)} points successfully inside brep in {attempts} attempts. ")
    return resultPts

def isAcceptableResult(unionedBreps, interiorPoints: List[Point3d]):
    if unionedBreps is None:
        print("isAcceptableResult result='No BREP'")
        return False
    elif len(unionedBreps) == 1:
        testBrep: Brep = unionedBreps[0]
        #So far so good, now test the interior points
        for pt in interiorPoints:
            if not testBrep.IsPointInside(pt, tol, False):
                print("isAcceptableResult result='Failed Point Check'")
                return False

        print("isAcceptableResult result='Success'")
        return True
    else:
        print("isAcceptableResult result='Multiple BREPs'")
        return False

def doUnionRun():
    try:
        print(f"received {len(breps)} input(s)")
        testPointCount = 400

        testPts = []
        for bp in breps:
            testPts.extend(generatePointsInsideBrep(bp, testPointCount))

        unionedBrep = Brep.CreateBooleanUnion(breps, tol, allowNonManifold)
        
        unionAttempt = 0
        print(f"{unionAttempt=} type={type(unionedBrep)}")

        if isAcceptableResult(unionedBrep, testPts):
            print(f"Successful Union on first attempt!")
        else:
            isGoodResultFound = False
            for desperationFactor in range(0, maxAttempts):
                for inBrep in breps:
                    unionAttempt += 1
                    randomNudge(inBrep)
                    unionedBrep = Brep.CreateBooleanUnion(breps, tol, allowNonManifold)
                    if isAcceptableResult(unionedBrep, testPts):
                        print(f"SUCCESS: {unionAttempt=} type={type(unionedBrep)} {desperationFactor=}")
                        isGoodResultFound = True
                        break
                    else:
                        print(f"FAIL: {unionAttempt=} type={type(unionedBrep)} {desperationFactor=}")

                if isGoodResultFound:
                    break

        jiggleCount = unionAttempt

        if unionedBrep is None:
            raise Exception("Unable to boolean provided breps")

        resultBrep = unionedBrep[0]
        print(f"Success out={type(resultBrep)}")

        volProps = VolumeMassProperties.Compute.Overloads[Brep](resultBrep)
        print(f"{volProps=}")
        if volProps is None:
            msg = "Invalid brep generated, could not compute volume"
            print(msg)
            raise Exception(msg)


        return resultBrep, jiggleCount, volProps.Volume, testPts
    except Exception as exc:
        print(exc)
        raise exc


# Do two runs to check agreement

unions = []
jigCounts = []
vols = []
testPtsLists = []

for i in range (0, 4):
    try:
        un, jig, vol, testPts = doUnionRun();
        unions.append(un)
        jigCounts.append(jig)
        vols.append(vol)
        testPtsLists.append(testPts)
        print(f"Union generation attempt {i=} succeeded")
        if len(unions) > 1:
            break;
    except:
        print(f"Union generation attempt {i=} failed")
        pass

if len(unions) != 2:
    raise Exception("Boolean Union not possible after repeated attempts")

print(f"Result volumes {vols[0]=} {vols[1]=}")
iResult = 0 if (vols[0] > vols[1]) else 1
unionedBrep = unions[iResult]
jiggleCount = jigCounts[iResult]
testedPoints = testPtsLists[iResult]


#another way to do boolean union, that may help in some situations:
# nakedEdgePoints = clr.StrongBox[System.Array[Rhino.Geometry.Point3d]]()
# badIntersectionPoints = clr.StrongBox[System.Array[Rhino.Geometry.Point3d]]()
# nonManifoldEdgePoints = clr.StrongBox[System.Array[Rhino.Geometry.Point3d]]()

# #see: https://developer.rhino3d.com/api/rhinocommon/rhino.geometry.brep/createbooleanunion#(ienumerable%3Cbrep%3E,double,boolean)
# unionedBrep = Brep.CreateBooleanUnion(breps, tol, allowNonManifold, nakedEdgePoints, badIntersectionPoints, nonManifoldEdgePoints)
# print(f"nep={type(nakedEdgePoints)} bip={type(badIntersectionPoints)} nep={type(nonManifoldEdgePoints)}")
# ---------- end bool_jig_union_py ----------
bool_jig_union_py_2 = Python3Script(breps=merge_2, jiggleToleranceVector=allowable_jiggle, maxAttempts=max_jiggle_cycles, x=run_it_toggle_2)  # -> out, unionedBrep, jiggleCount, testedPoints; inputs breps: list of Brep, jiggleToleranceVector: Vector3d, maxAttempts: Int32; same code as bool_jig_union_py
region_test_points = Point(bool_jig_union_py.testedPoints)
region_test_points_2 = Point(bool_jig_union_py_2.testedPoints)
panel = Panel(bool_jig_union_py.jiggleCount)
panel_2 = Panel(bool_jig_union_py_2.jiggleCount)
panel_3 = Panel(bool_jig_union_py.out)
panel_4 = Panel(bool_jig_union_py_2.out)
scale_nu = ScaleNU(Geometry=bool_jig_union_py.unionedBrep, Plane=PlaneXY(0, 0, 0), ScaleX="1.01", ScaleY=1, ScaleZ=1)  # -> Geometry, Transform
final_vol = Volume(Geometry=scale_nu.Geometry)  # -> Volume, Centroid
init_vol = Volume(Geometry=bool_jig_union_py.unionedBrep)  # -> Volume, Centroid
outer_shell_brep = Brep(bool_jig_union_py_2.unionedBrep)
move_to_point = MoveToPoint(Geometry=scale_nu.Geometry, PointA=final_vol.Centroid, PointB=init_vol.Centroid)  # -> Moved, Vector, Transform
solid_difference = SolidDifference(BrepsA=bool_jig_union_py_2.unionedBrep, BrepsB=move_to_point.Moved)
material_shell_brep = Brep(solid_difference)
inner_shell_brep = Brep(move_to_point.Moved)

# ----
# Preform
# Orientation
# Adjustment
firstsegmentdirection_2 = Vector(firstsegmentdirection)
secondsegmentline_3 = Line(secondsegmentline)
firstsegmentstart_2 = Point(firstsegmentstart)
firstsegmentend_3 = Point(firstsegmentend)
firstsegmentline_3 = Line(firstsegmentline)
secondsegmentend_3 = Point(secondsegmentend)
material_shell_brep_2 = Brep(material_shell_brep)
inner_shell_brep_2 = Brep(inner_shell_brep)
outer_shell_brep_2 = Brep(outer_shell_brep)
line = Line(StartPoint=firstsegmentstart_2, EndPoint=secondsegmentend_3)
xz_plane_2 = XZPlane(Origin=Point(0, 0, 0))
angle = Angle(VectorA=line, VectorB=firstsegmentdirection_2, Plane=xz_plane_2)  # -> Angle, Reflex
finger_model_rotate = Rotate(Geometry=material_shell_brep_2, Angle=angle.Angle, Plane=xz_plane_2)  # -> Geometry, Transform
outer_barrel_transform = Transform(Geometry=outer_shell_brep_2, Transform=finger_model_rotate.Transform)
inner_barrel_transform = Transform(Geometry=inner_shell_brep_2, Transform=finger_model_rotate.Transform)
center_line_transform = Transform(Geometry=line, Transform=finger_model_rotate.Transform)
root_line_transform = Transform(Geometry=firstsegmentline_3, Transform=finger_model_rotate.Transform)
tip_line_transform = Transform(Geometry=secondsegmentline_3, Transform=finger_model_rotate.Transform)
firstsegmentline_4 = Line(root_line_transform)
secondsegmentline_4 = Line(tip_line_transform)

# ----
# Bottom Center Band Creation
curve_middle = CurveMiddle(Curve=center_line_transform)
bottom_band_width_mm_2 = Panel(bottom_band_width_mm)
ref_nudge = Panel("-75")
unit_z = UnitZ(Factor=ref_nudge)
unit_y = UnitY(Factor=ref_nudge)
move = Move(Geometry=curve_middle, Motion=unit_z)  # -> Geometry, Transform
point = Point(move.Geometry)
move_2 = Move(Geometry=point, Motion=unit_y)  # -> Geometry, Transform
point_2 = Point(move_2.Geometry)
merge_3 = Merge(Data1=curve_middle, Data2=point, Data3=point_2)  # -> flatten(Result)
plane_fit = PlaneFit(Points=merge_3)  # -> Plane, Deviation
brep_plane = BrepPlane(Brep=finger_model_rotate.Geometry, Plane=plane_fit.Plane)  # -> Curves, Points
length = Length(Curve=brep_plane.Curves)
panel_5 = Panel(brep_plane.Curves)
sort_list = SortList(Keys=length, ValuesValuesA=brep_plane.Curves)  # -> Keys, ValuesValuesA
unit_x_2 = UnitX(Factor=1)
xy_plane_2 = XYPlane(Origin=Point(0, 0, 0))
list_item = ListItem(List=sort_list.ValuesValuesA, Index="-1", Wrap=True)
line_sdl_3 = LineSDL(Start=xy_plane_2, Direction=unit_x_2, Length=bottom_band_width_mm_2)
curve_closest_point = CurveClosestPoint(Point=point, Curve=list_item)  # -> Point, Parameter, Distance
curve_middle_2 = CurveMiddle(Curve=line_sdl_3)
line_2 = Line(StartPoint=curve_middle_2, EndPoint=curve_closest_point.Point)
move_3 = Move(Geometry=line_sdl_3, Motion=line_2)  # -> Geometry, Transform
bottom_band_line = Curve(move_3.Geometry)
perp_frame = PerpFrame(Curve=bottom_band_line, Parameter="0")
end_points = EndPoints(Curve=bottom_band_line)  # -> Start, End
brep_plane_2 = BrepPlane(Brep=finger_model_rotate.Geometry, Plane=perp_frame)  # -> Curves, Points
length_2 = Length(Curve=brep_plane_2.Curves)
panel_6 = Panel(brep_plane_2.Curves)
sort_list_2 = SortList(Keys=length_2, ValuesValuesA=brep_plane_2.Curves)  # -> Keys, ValuesValuesA
list_item_2 = ListItem(List=sort_list_2.ValuesValuesA, Index="-1", Wrap=True)
curve_closest_point_2 = CurveClosestPoint(Point=end_points.Start, Curve=list_item_2)  # -> Point, Parameter, Distance
multiplication = Multiplication(A=curve_closest_point_2.Distance, B="-1.5")
unit_z_2 = UnitZ(Factor=multiplication)
move_4 = Move(Geometry=bottom_band_line, Motion=unit_z_2)  # -> Geometry, Transform
bottom_band = Curve(move_4.Geometry)

# ----
# Top Band Creation
# 1. Move the top bands into place
# 2. Connect the ends of the top bands to create a v shaped mask to intersect with the preform
outer_shell_brep_3 = Brep(outer_barrel_transform)
center_line_curve = Curve(center_line_transform)
top_band_width_mm_2 = Panel(top_band_width_mm)
end_points_2 = EndPoints(Curve=center_line_curve)  # -> Start, End
unit_x_3 = UnitX(Factor="-1")
unit_x_4 = UnitX(Factor=1)
line_sdl_4 = LineSDL(Start=end_points_2.End, Direction=unit_x_3, Length=top_band_width_mm_2)
line_sdl_5 = LineSDL(Start=end_points_2.Start, Direction=unit_x_4, Length=top_band_width_mm_2)
nudge = Panel("50")
nudge_2 = Panel("50")
unit_z_3 = UnitZ(Factor=nudge)
unit_z_4 = UnitZ(Factor=nudge_2)
move_5 = Move(Geometry=line_sdl_4, Motion=unit_z_3)  # -> Geometry, Transform
move_6 = Move(Geometry=line_sdl_5, Motion=unit_z_4)  # -> Geometry, Transform
xz_plane_3 = XZPlane(Origin=Point(0, 0, 0))
end_points_3 = EndPoints(Curve=move_5.Geometry)  # -> Start, End
end_points_4 = EndPoints(Curve=move_6.Geometry)  # -> Start, End
brep_plane_3 = BrepPlane(Brep=outer_shell_brep_3, Plane=xz_plane_3)  # -> Curves, Points
perp_frame_2 = PerpFrame(Curve=move_5.Geometry, Parameter="0")
perp_frame_3 = PerpFrame(Curve=move_5.Geometry, Parameter="1.0")
perp_frame_4 = PerpFrame(Curve=move_6.Geometry, Parameter="0")
perp_frame_5 = PerpFrame(Curve=move_6.Geometry, Parameter="1.0")
brep_plane_4 = BrepPlane(Brep=outer_shell_brep_3, Plane=perp_frame_2)  # -> Curves, Points
brep_plane_5 = BrepPlane(Brep=outer_shell_brep_3, Plane=perp_frame_3)  # -> Curves, Points
brep_plane_6 = BrepPlane(Brep=outer_shell_brep_3, Plane=perp_frame_4)  # -> Curves, Points
brep_plane_7 = BrepPlane(Brep=outer_shell_brep_3, Plane=perp_frame_5)  # -> Curves, Points
curve_closest_point_3 = CurveClosestPoint(Point=end_points_3.End, Curve=brep_plane_5.Curves)  # -> Point, Parameter, Distance
curve_closest_point_4 = CurveClosestPoint(Point=end_points_4.End, Curve=brep_plane_7.Curves)  # -> Point, Parameter, Distance
curve_closest_point_5 = CurveClosestPoint(Point=end_points_3.Start, Curve=brep_plane_4.Curves)  # -> Point, Parameter, Distance
curve_closest_point_6 = CurveClosestPoint(Point=end_points_4.Start, Curve=brep_plane_6.Curves)  # -> Point, Parameter, Distance
merge_4 = Merge(Data1=curve_closest_point_5.Distance, Data2=curve_closest_point_3.Distance)
merge_5 = Merge(Data1=curve_closest_point_6.Distance, Data2=curve_closest_point_4.Distance)
sort_list_3 = SortList(Keys=merge_4, ValuesValuesA=merge_4)  # -> Keys, ValuesValuesA
sort_list_4 = SortList(Keys=merge_5, ValuesValuesA=merge_5)  # -> Keys, ValuesValuesA
list_item_3 = ListItem(List=sort_list_3.ValuesValuesA, Index="0", Wrap=True)
list_item_4 = ListItem(List=sort_list_4.ValuesValuesA, Index="0", Wrap=True)
unit_z_5 = UnitZ(Factor=expr("-x", list_item_3))
unit_z_6 = UnitZ(Factor=expr("-x", list_item_4))
move_7 = Move(Geometry=move_5.Geometry, Motion=unit_z_5)  # -> Geometry, Transform
move_8 = Move(Geometry=move_6.Geometry, Motion=unit_z_6)  # -> Geometry, Transform
root_top_band = Curve(move_8.Geometry)
tip_top_band = Curve(move_7.Geometry)

# ----
# Side Cutter Profile
bottom_band_2 = Curve(bottom_band)
bottom_band_width_mm_3 = Panel(bottom_band_width_mm)
mid_joint_rise_factor_2 = Panel(mid_joint_rise_factor)
root_top_band_2 = Curve(root_top_band)
tip_top_band_2 = Curve(tip_top_band)
multiplication_2 = Multiplication(A=bottom_band_width_mm_3, B=mid_joint_rise_factor_2)
midpoint = Midpoint(Curve=bottom_band_2)
unit_z_7 = UnitZ(Factor=multiplication_2)
flip_curve = FlipCurve(Curve=bottom_band_2)  # -> Curve, Flag
move_9 = Move(Geometry=midpoint, Motion=unit_z_7)  # -> Geometry, Transform
end_points_5 = EndPoints(Curve=bottom_band_2)  # -> Start, End
end_points_6 = EndPoints(Curve=root_top_band_2)  # -> Start, End
end_points_7 = EndPoints(Curve=tip_top_band_2)  # -> Start, End
point_3 = Point(end_points_6.Start)
point_4 = Point(end_points_6.End)
point_5 = Point(end_points_5.Start)
point_6 = Point(move_9.Geometry)
point_7 = Point(end_points_5.End)
point_8 = Point(end_points_7.End)
point_9 = Point(end_points_5.End)
point_10 = Point(end_points_7.Start)
line_3 = Line(StartPoint=point_4, EndPoint=point_6)
line_4 = Line(StartPoint=point_6, EndPoint=point_8)
line_5 = Line(StartPoint=point_3, EndPoint=point_4)
line_6 = Line(StartPoint=point_7, EndPoint=point_5)
line_7 = Line(StartPoint=point_5, EndPoint=point_3)
midpoint_2 = Midpoint(Curve=line_4)
line_8 = Line(StartPoint=point_8, EndPoint=point_10)
line_9 = Line(StartPoint=point_10, EndPoint=point_9)
line_10 = Line(StartPoint=point_9, EndPoint=point_7)
midpoint_3 = Midpoint(Curve=line_3)
line_11 = Line(StartPoint=midpoint_2, EndPoint=point_8)
line_12 = Line(StartPoint=point_4, EndPoint=midpoint_3)
merge_6 = Merge(Data1=line_6, Data2=line_7, Data3=line_5, Data4=line_12, Data6=line_11, Data7=line_8, Data8=line_9, Data9=line_10)  # -> flatten(Result)
xz_plane_4 = XZPlane(Origin=Point(0, 0, 0))
join_curves = JoinCurves(Curves=merge_6, Preserve=False)
connect_curves = ConnectCurves(Curves=join_curves, Continuity=2, Close=True, Bulge=Slider(0.6, range=0..2))
close_curve = CloseCurve(Curve=connect_curves, Tolerance=0)
unit_y_2 = UnitY(Factor="-30")
project = Project(Geometry=close_curve, Plane=xz_plane_4)  # -> Geometry, Transform
planar = Planar(Curve=project.Geometry)  # -> Planar, Plane, Deviation
move_10 = Move(Geometry=project.Geometry, Motion=unit_y_2)  # -> Geometry, Transform
panel_7 = Panel(planar.Planar)
cutter_curve = Curve(move_10.Geometry)

# ----
# Side Cutter Volume
cutter_curve_2 = Curve(cutter_curve)
panel_8 = Panel(cutter_curve_2)
unit_y_3 = UnitY(Factor="60")
boundary_surfaces = BoundarySurfaces(Edges=cutter_curve_2)
extrude = Extrude(Base=boundary_surfaces, Direction=unit_y_3)
side_cutter_surface = Surface(boundary_surfaces)
side_cutter_volume = Brep(extrude)

# ----
# Splint Body
preform_tube_brep = Brep(finger_model_rotate.Geometry)
solid_intersection = SolidIntersection(BrepsA=preform_tube_brep, BrepsB=side_cutter_volume)
splint_body = Brep(solid_intersection)

# ---- group: splint-nub
# Direction
# Indicator
tip_top_band_3 = Curve(tip_top_band)
splint_body_2 = Brep(splint_body)
midpoint_4 = Midpoint(Curve=tip_top_band_3)
nub_radius = Panel("1.5")
brep_closest_point = BrepClosestPoint(Point=midpoint_4, Brep=splint_body_2)  # -> Point, Normal, Distance
sphere_5 = Sphere(Base=midpoint_4, Radius=nub_radius)
line_13 = Line(StartPoint=midpoint_4, EndPoint=brep_closest_point.Point)
multiplication_3 = Multiplication(A=nub_radius, B=Slider(0.6, range=0..1))
extend_curve = ExtendCurve(Curve=line_13, Type=0, Start=0, End=multiplication_3)
end_points_8 = EndPoints(Curve=extend_curve)  # -> Start, End
move_to_point_2 = MoveToPoint(Geometry=sphere_5, PointA=midpoint_4, PointB=end_points_8.End)  # -> Moved, Vector, Transform
splint_nub = Brep(move_to_point_2.Moved)

# ----
# Final Joining
# And Smoothing
# Bake Me
solid_union = SolidUnion(Breps=[splint_body, splint_nub])
shrinkwrap = ShrinkWrap(
    Geometry=solid_union,
    EdgeLength=Slider(0.12, range=0.05..0.2),
    Offset=0,
    Smoothing=Slider(8, range=0..10),
    Optimization=10,
    FillHoles=True)
final_smooth_splint = Mesh(shrinkwrap)

# ----
# Preview Steps
side_cutter_volume_2 = Brep(side_cutter_volume)
inner_finger_form = Brep(inner_barrel_transform)
side_cutter_surface_2 = Surface(side_cutter_surface)
splint_body_sharp = Brep(splint_body)
preform_barrel = Brep(finger_model_rotate.Geometry)
splint_body_smooth = Mesh(final_smooth_splint)
merge_7 = Merge(Data1=preform_barrel, Data2=side_cutter_surface_2)  # -> flatten(Result)
merge_8 = Merge(Data1=preform_barrel, Data2=side_cutter_volume_2)  # -> flatten(Result)
merge_9 = Merge(Data1=splint_body_smooth)  # -> flatten(Result)
merge_10 = Merge(Data1=splint_body_sharp)  # -> flatten(Result)
move_11 = Move(Geometry=inner_finger_form, Motion="60, 0, 0")  # -> Geometry, Transform
move_12 = Move(Geometry=merge_7, Motion="120, 0, 0")  # -> Geometry, Transform
move_13 = Move(Geometry=merge_8, Motion="180, 0, 0")  # -> Geometry, Transform
move_14 = Move(Geometry=merge_9, Motion="300, 0, 0")  # -> Geometry, Transform
move_15 = Move(Geometry=merge_10, Motion="240, 0, 0")  # -> Geometry, Transform
merge_11 = Merge(Data1=move_11.Geometry, Data2=move_12.Geometry, Data3=move_13.Geometry, Data4=move_15.Geometry, Data5=move_14.Geometry)  # -> flatten(Result)
random_color = RandomColor(Data=merge_11, Seed=2, FastMode=False)
custom_preview = CustomPreview(Geometry=merge_11, Material=random_color)

# ==== cluster CylinderCl
center_line = ClusterInput()
radius = ClusterInput()
radius_2 = ClusterInput()
center_line_2 = Curve(center_line)
perp_frame = PerpFrame(Curve=center_line_2, Parameter="1")
perp_frame_2 = PerpFrame(Curve=center_line_2, Parameter="0")
circle = Circle(Plane=perp_frame, Radius=radius_2)
circle_2 = Circle(Plane=perp_frame_2, Radius=radius)
merge = Merge(Data1=circle_2, Data2=circle)  # -> flatten(Result)
loft = Loft(Curves=merge, Options={Adjust=False, Closed=False, LoftEnds=0, LoftSimp=0, LoftType=0, Rebuild=10, Refit=0.01})
cap_holes = CapHoles(Brep=loft)
deconstruct_brep = DeconstructBrep(Brep=cap_holes)  # -> Faces, Edges, Vertices
panel = Panel(cap_holes)
parameter_point_on_surface = ParameterPointOnSurface(Surface=deconstruct_brep.Faces, ParameterU="0.5", ParameterV="0.5")  # -> Point, Normal
line_sdl = LineSDL(Start=parameter_point_on_surface.Point, Direction=parameter_point_on_surface.Normal, Length="10")
brep = ClusterOutput(cap_holes)
facenormals = ClusterOutput(line_sdl)
