# Grasshopper definition stax_splint_v1.gh (Grasshopper 1.0.9)
# plug-ins: Pufferfish, Bowerbird2, Wombat

# NOTE: Flexion: Positive flexion curls down towards palm
# 
# Negative curls upwards away from palm
example_devdata = Panel("""    "distal_phalange_l_mm": 25.0,
    "middle_phalange_l_mm": 29.2,
    "tip_circumference_mm": 47.0,
    "dip_circumference_mm": 48.0,
    "mid_phalange_circumference_mm": 47.0,
    "pip_circumference_mm": 48.0,
    "flexion_degrees": -5.0,""")
# Positive flexion curls down towards palm
# 
# Negative curls upwards away from palm
example_devdata_2 = Panel("""    "distal_phalange_l_mm": 25.0,
    "middle_phalange_l_mm": 29.2,
    "tip_circumference_mm": 47.0,
    "dip_circumference_mm": 48.0,
    "mid_phalange_circumference_mm": 47.0,
    "pip_circumference_mm": 48.0,
    "flexion_degrees": -5.0""")  # disabled
note = Panel("""ADD
Lateral Curve!!!""")
axial_band_thickness_mm = Panel("3.25")
axial_band_thickness_mm_2 = Panel("1.5")
axial_band_thickness_mm_3 = Panel("2.20")
axial_band_thickness_mm_4 = Panel("3.25")  # disabled
axial_band_thickness_mm_5 = Panel("1.5")  # disabled
axial_band_thickness_mm_6 = Panel("2.20")  # disabled
# Stax Splint
is_production_mode = BooleanToggle(False)
output_dir_test = Panel("/Users/jon/Desktop/gh_output/")
root_filename = Panel("staxsplint_test")
geo_algorithm_name = Panel("stax_splint_v1")
# Stax Splint
is_production_mode_2 = BooleanToggle(False)  # disabled
axial_band_thickness_mm_7 = Panel("1.75")
output_dir_test_2 = Panel("/Users/jon/Desktop/gh_output/")  # disabled

# ---- group: Internal Parameters
bottom_band_strap_width_mm = Panel("7.0")
top_band_strap_width_mm = Panel("5.0")
mid_joint_rise_factor = Panel("1.0")

# ----
root_filename_2 = Panel("staxsplint_test")  # disabled
geo_algorithm_name_2 = Panel("stax_splint_v1")  # disabled

# ---- group: Internal Parameters
bottom_band_strap_width_mm_2 = Panel("7.0")  # disabled
top_band_strap_width_mm_2 = Panel("5.0")  # disabled
mid_joint_rise_factor_2 = Panel("1.0")  # disabled
axial_band_thickness_mm_8 = Panel("1.75")  # disabled

# ----
toggle_job = BooleanToggle(False)
toggle_job_2 = BooleanToggle(False)  # disabled
factoryautomatorpy = Python3Script(
    is_production_mode=is_production_mode,
    geo_algorithm_name=geo_algorithm_name,
    root_filename=root_filename,
    output_dir=output_dir_test,
    toggleJob=toggle_job)  # -> out, distal_phalange_l_mm, middle_phalange_l_mm, tip_circumference_mm, dip_circumference_mm, mid_phalange_circumference_mm, pip_circumference_mm, flexion_degrees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; inputs is_production_mode: Boolean, root_filename: String, toggleJob: Boolean
# ---------- factoryautomatorpy: Python ----------
from pathlib import Path
import sys
from importlib import reload #FOR DEV ONLY
import time

ghFileDir = str(Path.joinpath(Path(ghenv.Component.OnPingDocument().FilePath).resolve().parents[0], "src"))
print(f"{ghFileDir=}")

if ghFileDir not in sys.path:
    print("ghFileDir needed to be included")
    sys.path.append(ghFileDir)

import splintcommon
reload(splintcommon) #FOR DEV ONLY

import Rhino
print(f"{Rhino.RhinoDoc.ActiveDoc.ModelAbsoluteTolerance}")
Rhino.RhinoDoc.ActiveDoc.ModelAbsoluteTolerance = 0.00001
print(f"{Rhino.RhinoDoc.ActiveDoc.ModelAbsoluteTolerance}")


splintcommon.log(f'FactoryAutomatorPY Running at: ({time.strftime("%H:%M:%S", time.localtime())})')

jobname = "LocalDev"
objectID = "LOCL"


    # "distal_phalange_l_mm": 25.0,
    # "middle_phalange_l_mm": 29.2,
    # "tip_circumference_mm": 47.0,
    # "dip_circumference_mm": 48.0,
    # "mid_phalange_circumference_mm": 47.0,
    # "pip_circumference_mm": 48.0,
    # "flexion_degrees": -5.0

# Let's use this dev data as pseudo schema. We DO have the actual schema on the server, but this enforces that local dev matches the server in one sense
devData: dict = splintcommon.load_dev_data(geo_algorithm_name)
print(f"{devData=}")

devKeys = devData.keys()
print(f"{devKeys=}")



if not is_production_mode:
    print("Passing along local data only")    
    
    splintcommon.log(f"Received dev data={devData}")

    distal_phalange_l_mm = devData["distal_phalange_l_mm"]
    middle_phalange_l_mm = devData["middle_phalange_l_mm"]
    tip_circumference_mm = devData["tip_circumference_mm"]
    dip_circumference_mm = devData["dip_circumference_mm"]
    mid_phalange_circumference_mm = devData["mid_phalange_circumference_mm"]
    pip_circumference_mm = devData["pip_circumference_mm"]
    flexion_degrees = devData["flexion_degrees"]

    root_filename_out = root_filename
    output_dir_out = output_dir

else:
    # We start hunting for files to see if work needs to be done.
    splintcommon.log("Looking for available job data...")

    job_data = splintcommon.get_next_geo_job(geo_algorithm_name)
    splintcommon.log(f"{job_data=}")

    if job_data is None:
        splintcommon.log("No Job Data Available")
        objectID = "NONE"
    else:
 
        # WORK TO DO! This mapping must match the schema of the data in the DB for this geometry type

        distal_phalange_l_mm = job_data["distal_phalange_l_mm"]
        middle_phalange_l_mm = job_data["middle_phalange_l_mm"]
        tip_circumference_mm = job_data["tip_circumference_mm"]
        dip_circumference_mm = job_data["dip_circumference_mm"]
        mid_phalange_circumference_mm = job_data["mid_phalange_circumference_mm"]
        pip_circumference_mm = job_data["pip_circumference_mm"]
        flexion_degrees = job_data["flexion_degrees"]
                
        jobname = job_data["jobname"]
        objectID = job_data["objectID"]

        root_filename_out = jobname
        output_dir_out = splintcommon.splint_outbox_dir

splintcommon.log(f"{locals()=}")

# splintcommon.log(f"Result data {=} {objectID=} {interPhalangeDistanceMM_out=} {rootCircumferenceMM_out=} {midCircumferenceMM_out=} {tipCircumferenceMM_out=} {flexionDegrees_out=}")
# ---------- end factoryautomatorpy ----------
factoryautomatorpy_2 = Python3Script(
    is_production_mode=is_production_mode_2,
    geo_algorithm_name=geo_algorithm_name_2,
    root_filename=root_filename_2,
    output_dir=output_dir_test_2,
    toggleJob=toggle_job_2)  # -> out, distal_phalange_l_mm, middle_phalange_l_mm, tip_circumference_mm, dip_circumference_mm, mid_phalange_circumference_mm, pip_circumference_mm, flexion_degrees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; inputs is_production_mode: Boolean, root_filename: String, toggleJob: Boolean; disabled
# ---------- factoryautomatorpy_2: Python ----------
from pathlib import Path
import sys
from importlib import reload #FOR DEV ONLY
import time

ghFileDir = str(Path.joinpath(Path(ghenv.Component.OnPingDocument().FilePath).resolve().parents[0], "src"))
print(f"{ghFileDir=}")

if ghFileDir not in sys.path:
    print("ghFileDir needed to be included")
    sys.path.append(ghFileDir)

import splintcommon
reload(splintcommon) #FOR DEV ONLY

splintcommon.log(f'FactoryAutomatorPY Running at: ({time.strftime("%H:%M:%S", time.localtime())})')

jobname = "LocalDev"
objectID = "LOCL"


    # "distal_phalange_l_mm": 25.0,
    # "middle_phalange_l_mm": 29.2,
    # "tip_circumference_mm": 47.0,
    # "dip_circumference_mm": 48.0,
    # "mid_phalange_circumference_mm": 47.0,
    # "pip_circumference_mm": 48.0,
    # "flexion_degrees": -5.0

# Let's use this dev data as pseudo schema. We DO have the actual schema on the server, but this enforces that local dev matches the server in one sense
devData: dict = splintcommon.load_dev_data(geo_algorithm_name)
print(f"{devData=}")

devKeys = devData.keys()
print(f"{devKeys=}")



if not is_production_mode:
    print("Passing along local data only")    
    
    splintcommon.log(f"Received dev data={devData}")

    distal_phalange_l_mm = devData["distal_phalange_l_mm"]
    middle_phalange_l_mm = devData["middle_phalange_l_mm"]
    tip_circumference_mm = devData["tip_circumference_mm"]
    dip_circumference_mm = devData["dip_circumference_mm"]
    mid_phalange_circumference_mm = devData["mid_phalange_circumference_mm"]
    pip_circumference_mm = devData["pip_circumference_mm"]
    flexion_degrees = devData["flexion_degrees"]

    root_filename_out = root_filename
    output_dir_out = output_dir

else:
    # We start hunting for files to see if work needs to be done.
    splintcommon.log("Looking for available job data...")

    job_data = splintcommon.get_next_geo_job(geo_algorithm_name)
    splintcommon.log(f"{job_data=}")

    if job_data is None:
        splintcommon.log("No Job Data Available")
        objectID = "NONE"
    else:
 
        # WORK TO DO! This mapping must match the schema of the data in the DB for this geometry type

        distal_phalange_l_mm = job_data["distal_phalange_l_mm"]
        middle_phalange_l_mm = job_data["middle_phalange_l_mm"]
        tip_circumference_mm = job_data["tip_circumference_mm"]
        dip_circumference_mm = job_data["dip_circumference_mm"]
        mid_phalange_circumference_mm = job_data["mid_phalange_circumference_mm"]
        pip_circumference_mm = job_data["pip_circumference_mm"]
        flexion_degrees = job_data["flexion_degrees"]
                
        jobname = job_data["jobname"]
        objectID = job_data["objectID"]

        root_filename_out = jobname
        output_dir_out = splintcommon.splint_outbox_dir

splintcommon.log(f"{locals()=}")

# splintcommon.log(f"Result data {=} {objectID=} {interPhalangeDistanceMM_out=} {rootCircumferenceMM_out=} {midCircumferenceMM_out=} {tipCircumferenceMM_out=} {flexionDegrees_out=}")
# ---------- end factoryautomatorpy_2 ----------
panel = Panel(factoryautomatorpy_2.out)  # disabled
panel_2 = Panel(factoryautomatorpy.out)

# ----
# Central Finger Line Geometry
# The segment distance and top band strap width are added to each other to account for one half of the strap hanging off of each sidge of the inter phalange distance
addition = Addition(A=factoryautomatorpy_2.distal_phalange_l_mm, B=top_band_strap_width_mm_2)  # disabled
panel_3 = Panel("2")  # disabled
xy_plane = XYPlane(Origin=Point(0, 0, 0))  # disabled
division = Division(A=addition, B=panel_3)  # disabled
unit_x = UnitX(Factor=1)  # disabled
xz_plane = XZPlane(Origin=Point(0, 0, 0))  # disabled
line_sdl = LineSDL(Start=xy_plane, Direction=unit_x, Length=division)  # disabled
rotate = Rotate(Geometry=unit_x, Angle=expr("-x", degrees(factoryautomatorpy_2.mid_phalange_circumference_mm)), Plane=xz_plane)  # -> Geometry, Transform; disabled
first_segment_end_points = EndPoints(Curve=line_sdl)  # -> Start, End; disabled
line_sdl_2 = LineSDL(Start=first_segment_end_points.End, Direction=rotate.Geometry, Length=division)  # disabled
second_segment_end_points = EndPoints(Curve=line_sdl_2)  # -> Start, End; disabled
firstsegmentdirection = Vector(unit_x)  # disabled
firstsegmentline = Line(line_sdl)  # disabled
secondsegmentline = Line(line_sdl_2)  # disabled
firstsegmentstart = Point(first_segment_end_points.Start)  # disabled
firstsegmentend = Point(first_segment_end_points.End)  # disabled
secondsegmentend = Point(second_segment_end_points.End)  # disabled

# ---- group: Prep Circumference Values
circ2radius_py = Python3Script(c=factoryautomatorpy_2.dip_circumference_mm)  # -> r; inputs c: Double; disabled
# ---------- circ2radius_py: Python ----------
import math


r = (c/math.pi)/2
# ---------- end circ2radius_py ----------
circ2radius_py_2 = Python3Script(c=factoryautomatorpy_2.middle_phalange_l_mm)  # -> r; inputs c: Double; disabled; same code as circ2radius_py
circ2radius_py_3 = Python3Script(c=factoryautomatorpy_2.tip_circumference_mm)  # -> r; inputs c: Double; disabled; same code as circ2radius_py
radius_mid = Number(circ2radius_py_3)  # disabled
radius_tip = Number(circ2radius_py)  # disabled
radius_root = Number(circ2radius_py_2)  # disabled

c2r_py = Python3Script(c=factoryautomatorpy.mid_phalange_circumference_mm)  # -> r; inputs c: Double; same code as circ2radius_py
c2r_py_2 = Python3Script(c=factoryautomatorpy.tip_circumference_mm)  # -> r; inputs c: Double; same code as circ2radius_py
c2r_py_3 = Python3Script(c=factoryautomatorpy.pip_circumference_mm)  # -> r; inputs c: Double; same code as circ2radius_py
c2r_py_4 = Python3Script(c=factoryautomatorpy.dip_circumference_mm)  # -> r; inputs c: Double; same code as circ2radius_py
radius_tip_2 = Number(c2r_py_2)
radius_dip = Number(c2r_py_4)
radius_mid_2 = Number(c2r_py)
radius_pip = Number(c2r_py_3)

# ----
flexion_degrees = Number(factoryautomatorpy.flexion_degrees)

wall_thickness = Number(axial_band_thickness_mm_7)
l_distal = Number(factoryautomatorpy.distal_phalange_l_mm)
addition_2 = Addition(A=radius_tip_2, B=wall_thickness)
addition_3 = Addition(A=radius_mid_2, B=wall_thickness)
addition_4 = Addition(A=radius_pip, B=wall_thickness)
addition_5 = Addition(A=radius_dip, B=wall_thickness)
addition_6 = Addition(A=l_distal, B=wall_thickness)
radius_tip_shell = Number(addition_2)
radius_mid_3 = Number(addition_3)
radius_dip_2 = Number(addition_5)
radius_pip_2 = Number(addition_4)
l_distal_2 = Number(addition_6)

objectid = Text(factoryautomatorpy.objectID)
root_filename_out = Text(factoryautomatorpy.root_filename_out)
wall_thickness_2 = Number(axial_band_thickness_mm_8)  # disabled
output_dir_out = Text(factoryautomatorpy.output_dir_out)
objectid_2 = Text(factoryautomatorpy_2.objectID)  # disabled
root_filename_out_2 = Text(factoryautomatorpy_2.root_filename_out)  # disabled
output_dir_out_2 = Text(factoryautomatorpy_2.output_dir_out)  # disabled
addition_7 = Addition(A=flexion_degrees, B=Slider(0, range=-20..30))

# ----
# Finger Preform Solid
# Outer Finger Preform
# Inner Finger Preform
awial_band_thickness_mm = Number(axial_band_thickness_mm_8)  # disabled
production_mode = Panel(is_production_mode_2)  # disabled
outer_root_extend = Panel("6")  # disabled
inner_root_extend = Panel("10.3")  # disabled
radius_root_2 = Number(radius_root)  # disabled
addition_8 = Addition(A=radius_root_2, B=awial_band_thickness_mm)  # disabled
firstsegmentend_2 = Point(firstsegmentend)  # disabled
secondsegmentline_2 = Line(secondsegmentline)  # disabled
firstsegmentline_2 = Line(firstsegmentline)  # disabled
secondsegmentend_2 = Point(secondsegmentend)  # disabled
radius_mid_4 = Number(radius_mid)  # disabled
addition_9 = Addition(A=radius_mid_4, B=awial_band_thickness_mm)  # disabled
radius_tip_3 = Number(radius_tip)  # disabled
addition_10 = Addition(A=radius_tip_3, B=awial_band_thickness_mm)  # disabled
radius_outer_tip = Number(addition_10)  # disabled
radius_outer_mid = Number(addition_9)  # disabled
radius_outer_root = Number(addition_8)  # disabled
cylinder_cl = CylinderCl(begin_r=radius_mid_4, center_line=secondsegmentline_2, end_r=radius_tip_3)  # -> brep, facenormals; disabled
cylinder_cl_2 = CylinderCl(begin_extend_mm=inner_root_extend, begin_r=radius_root_2, center_line=firstsegmentline_2, end_r=radius_mid_4)  # -> brep, facenormals; disabled
cylinder_cl_3 = CylinderCl(begin_extend_mm=outer_root_extend, begin_r=radius_outer_root, center_line=firstsegmentline_2, end_r=radius_outer_mid)  # -> brep, facenormals; disabled
sphere = Sphere(Base=firstsegmentend_2, Radius=radius_outer_mid)  # disabled
cylinder_cl_4 = CylinderCl(begin_r=radius_outer_mid, center_line=secondsegmentline_2, end_r=radius_outer_tip)  # -> brep, facenormals; disabled
sphere_2 = Sphere(Base=secondsegmentend_2, Radius=radius_tip_3)  # disabled
sphere_3 = Sphere(Base=firstsegmentend_2, Radius=radius_mid_4)  # disabled
sphere_4 = Sphere(Base=secondsegmentend_2, Radius=radius_outer_tip)  # disabled
solid_union = SolidUnion(Breps=[cylinder_cl_2.brep, sphere_3])  # disabled
solid_union_2 = SolidUnion(Breps=[cylinder_cl_3.brep, sphere])  # disabled
solid_union_3 = SolidUnion(Breps=[solid_union, cylinder_cl.brep])  # disabled
solid_union_4 = SolidUnion(Breps=[solid_union_2, cylinder_cl_4.brep])  # disabled
solid_union_5 = SolidUnion(Sphere=[solid_union_3, sphere_2])  # disabled
solid_union_6 = SolidUnion(Sphere=[solid_union_4, sphere_4])  # disabled
outer_shell_brep = Brep(solid_union_6)  # disabled
inner_shell_brep = Brep(solid_union_5)  # disabled
solid_difference = SolidDifference(BrepsA=outer_shell_brep, BrepsB=inner_shell_brep)  # disabled
material_shell_brep = Brep(solid_difference)  # disabled

enable_jiggle = BooleanToggle(False)  # disabled
run_it_toggle = BooleanToggle(True)  # disabled
allowable_jiggle = Panel("0.1, 0.0, 0.1")  # disabled
max_jiggle_cycles = Panel("3")  # disabled
bool_jig_union_py = Python3Script(jiggleToleranceVector=allowable_jiggle, maxAttempts=max_jiggle_cycles, enableJiggle=enable_jiggle, x=run_it_toggle)  # -> out, unionedBrep, jiggleCount, testedPoints; inputs breps: list of Brep, jiggleToleranceVector: Vector3d, maxAttempts: Int32, enableJiggle: Boolean; disabled
# ---------- bool_jig_union_py: Python ----------
from pathlib import Path
import sys
from importlib import reload #FOR DEV ONLY
import time

ghFileDir = str(Path.joinpath(Path(ghenv.Component.OnPingDocument().FilePath).resolve().parents[0], "src"))
print(f"{ghFileDir=}")

if ghFileDir not in sys.path:
    print("ghFileDir needed to be included")
    sys.path.append(ghFileDir)

import cmpJiggleUnion
reload(cmpJiggleUnion) #FOR DEV ONLY

#inputs
# breps - breps to union together
# jiggleToleranceVector - 3D vector specifying the amount of allowed motion in a single jiggle in each direction
# maxAttempts - How many times to loop through the whole list of breps nudging them randomly
# enableJiggle - sometimes for development just doing the normal union and returning is desirable

print(f"jiggle {maxAttempts=} X={jiggleToleranceVector.X}, Y={jiggleToleranceVector.Y}, Z={jiggleToleranceVector.Z}")
jigUnion = cmpJiggleUnion.cmpJiggleUnion(breps, jiggleToleranceVector, maxAttempts, enableJiggle)
unionedBrep, jiggleCount, testedPoints = jigUnion.run();
# ---------- end bool_jig_union_py ----------

# ----
# Preform
# Orientation
# Adjustment
firstsegmentdirection_2 = Vector(firstsegmentdirection)  # disabled
secondsegmentline_3 = Line(secondsegmentline)  # disabled
firstsegmentstart_2 = Point(firstsegmentstart)  # disabled
firstsegmentend_3 = Point(firstsegmentend)  # disabled
firstsegmentline_3 = Line(firstsegmentline)  # disabled
secondsegmentend_3 = Point(secondsegmentend)  # disabled
material_shell_brep_2 = Brep(material_shell_brep)  # disabled
inner_shell_brep_2 = Brep(inner_shell_brep)  # disabled
outer_shell_brep_2 = Brep(outer_shell_brep)  # disabled
line = Line(StartPoint=firstsegmentstart_2, EndPoint=secondsegmentend_3)  # disabled
xz_plane_2 = XZPlane(Origin=Point(0, 0, 0))  # disabled
angle = Angle(VectorA=line, VectorB=firstsegmentdirection_2, Plane=xz_plane_2)  # -> Angle, Reflex; disabled
finger_model_rotate = Rotate(Geometry=material_shell_brep_2, Angle=angle.Angle, Plane=xz_plane_2)  # -> Geometry, Transform; disabled
outer_barrel_transform = Transform(Geometry=outer_shell_brep_2, Transform=finger_model_rotate.Transform)  # disabled
inner_barrel_transform = Transform(Geometry=inner_shell_brep_2, Transform=finger_model_rotate.Transform)  # disabled
center_line_transform = Transform(Geometry=line, Transform=finger_model_rotate.Transform)  # disabled
root_line_transform = Transform(Geometry=firstsegmentline_3, Transform=finger_model_rotate.Transform)  # disabled
tip_line_transform = Transform(Geometry=secondsegmentline_3, Transform=finger_model_rotate.Transform)  # disabled
first_orientation_shift_transform = Transform(finger_model_rotate.Transform)  # disabled
firstsegmentline_4 = Line(root_line_transform)  # disabled
secondsegmentline_4 = Line(tip_line_transform)  # disabled

inner_shell_brep_3 = Brep(inner_barrel_transform)  # disabled

# ----
# Bottom Center Band Creation
ref_nudge = Panel("-75")  # disabled
bottom_band_width_mm = Panel(bottom_band_strap_width_mm_2)  # disabled
curve_middle = CurveMiddle(Curve=center_line_transform)  # disabled
unit_z = UnitZ(Factor=ref_nudge)  # disabled
unit_y = UnitY(Factor=ref_nudge)  # disabled
move = Move(Geometry=curve_middle, Motion=unit_z)  # -> Geometry, Transform; disabled
point = Point(move.Geometry)  # disabled
move_2 = Move(Geometry=point, Motion=unit_y)  # -> Geometry, Transform; disabled
point_2 = Point(move_2.Geometry)  # disabled
merge = Merge(Data1=curve_middle, Data2=point, Data3=point_2)  # -> flatten(Result); disabled
plane_fit = PlaneFit(Points=merge)  # -> Plane, Deviation; disabled
brep_plane = BrepPlane(Brep=finger_model_rotate.Geometry, Plane=plane_fit.Plane)  # -> Curves, Points; disabled
panel_4 = Panel(brep_plane.Curves)  # disabled
length = Length(Curve=brep_plane.Curves)  # disabled
sort_list = SortList(Keys=length, ValuesValuesA=brep_plane.Curves)  # -> Keys, ValuesValuesA; disabled
unit_x_2 = UnitX(Factor=1)  # disabled
xy_plane_2 = XYPlane(Origin=Point(0, 0, 0))  # disabled
panel_5 = Panel("-1")  # disabled
list_item = ListItem(List=sort_list.ValuesValuesA, Index=panel_5, Wrap=True)  # disabled
line_sdl_3 = LineSDL(Start=xy_plane_2, Direction=unit_x_2, Length=bottom_band_width_mm)  # disabled
curve_closest_point = CurveClosestPoint(Point=point, Curve=list_item)  # -> Point, Parameter, Distance; disabled
curve_middle_2 = CurveMiddle(Curve=line_sdl_3)  # disabled
line_2 = Line(StartPoint=curve_middle_2, EndPoint=curve_closest_point.Point)  # disabled
move_3 = Move(Geometry=line_sdl_3, Motion=line_2)  # -> Geometry, Transform; disabled
bottom_band_line = Curve(move_3.Geometry)  # disabled
panel_6 = Panel("0")  # disabled
perp_frame = PerpFrame(Curve=bottom_band_line, Parameter=panel_6)  # disabled
end_points = EndPoints(Curve=bottom_band_line)  # -> Start, End; disabled
brep_plane_2 = BrepPlane(Brep=finger_model_rotate.Geometry, Plane=perp_frame)  # -> Curves, Points; disabled
length_2 = Length(Curve=brep_plane_2.Curves)  # disabled
panel_7 = Panel(brep_plane_2.Curves)  # disabled
sort_list_2 = SortList(Keys=length_2, ValuesValuesA=brep_plane_2.Curves)  # -> Keys, ValuesValuesA; disabled
panel_8 = Panel("-1")  # disabled
list_item_2 = ListItem(List=sort_list_2.ValuesValuesA, Index=panel_8, Wrap=True)  # disabled
curve_closest_point_2 = CurveClosestPoint(Point=end_points.Start, Curve=list_item_2)  # -> Point, Parameter, Distance; disabled
panel_9 = Panel("-1.5")  # disabled
multiplication = Multiplication(A=curve_closest_point_2.Distance, B=panel_9)  # disabled
unit_z_2 = UnitZ(Factor=multiplication)  # disabled
move_4 = Move(Geometry=bottom_band_line, Motion=unit_z_2)  # -> Geometry, Transform; disabled
bottom_band = Curve(move_4.Geometry)  # disabled

# ----
# Top Band Creation
# 1. Move the top bands into place
# 2. Connect the ends of the top bands to create a v shaped mask to intersect with the preform
center_line_curve = Curve(center_line_transform)  # disabled
outer_shell_brep_3 = Brep(outer_barrel_transform)  # disabled
top_band_width_mm = Panel(top_band_strap_width_mm_2)  # disabled
end_points_2 = EndPoints(Curve=center_line_curve)  # -> Start, End; disabled
panel_10 = Panel("-1")  # disabled
unit_x_3 = UnitX(Factor=panel_10)  # disabled
unit_x_4 = UnitX(Factor=1)  # disabled
nudge = Panel("50")  # disabled
left_band_guide = LineSDL(Start=end_points_2.Start, Direction=unit_x_4, Length=top_band_width_mm)  # disabled
right_band_guide = LineSDL(Start=end_points_2.End, Direction=unit_x_3, Length=top_band_width_mm)  # disabled
unit_z_3 = UnitZ(Factor=nudge)  # disabled
move_5 = Move(Geometry=left_band_guide, Motion=unit_z_3)  # -> Geometry, Transform; disabled
move_6 = Move(Geometry=right_band_guide, Motion=unit_z_3)  # -> Geometry, Transform; disabled
xz_plane_3 = XZPlane(Origin=Point(0, 0, 0))  # disabled
end_points_3 = EndPoints(Curve=move_6.Geometry)  # -> Start, End; disabled
panel_11 = Panel("0")  # disabled
panel_12 = Panel("1.0")  # disabled
panel_13 = Panel("0")  # disabled
panel_14 = Panel("1.0")  # disabled
brep_plane_3 = BrepPlane(Brep=outer_shell_brep_3, Plane=xz_plane_3)  # -> Curves, Points; disabled
perp_frame_2 = PerpFrame(Curve=move_6.Geometry, Parameter=panel_11)  # disabled
perp_frame_3 = PerpFrame(Curve=move_6.Geometry, Parameter=panel_12)  # disabled
end_points_4 = EndPoints(Curve=move_5.Geometry)  # -> Start, End; disabled
perp_frame_4 = PerpFrame(Curve=move_5.Geometry, Parameter=panel_13)  # disabled
perp_frame_5 = PerpFrame(Curve=move_5.Geometry, Parameter=panel_14)  # disabled
brep_plane_4 = BrepPlane(Brep=outer_shell_brep_3, Plane=perp_frame_3)  # -> Curves, Points; disabled
brep_plane_5 = BrepPlane(Brep=outer_shell_brep_3, Plane=perp_frame_2)  # -> Curves, Points; disabled
brep_plane_6 = BrepPlane(Brep=outer_shell_brep_3, Plane=perp_frame_4)  # -> Curves, Points; disabled
brep_plane_7 = BrepPlane(Brep=outer_shell_brep_3, Plane=perp_frame_5)  # -> Curves, Points; disabled
curve_closest_point_3 = CurveClosestPoint(Point=end_points_3.End, Curve=brep_plane_4.Curves)  # -> Point, Parameter, Distance; disabled
curve_closest_point_4 = CurveClosestPoint(Point=end_points_4.End, Curve=brep_plane_7.Curves)  # -> Point, Parameter, Distance; disabled
curve_closest_point_5 = CurveClosestPoint(Point=end_points_4.Start, Curve=brep_plane_6.Curves)  # -> Point, Parameter, Distance; disabled
curve_closest_point_6 = CurveClosestPoint(Point=end_points_3.Start, Curve=brep_plane_5.Curves)  # -> Point, Parameter, Distance; disabled
merge_2 = Merge(Data1=curve_closest_point_6.Distance, Data2=curve_closest_point_3.Distance)  # disabled
merge_3 = Merge(Data1=curve_closest_point_5.Distance, Data2=curve_closest_point_4.Distance)  # disabled
sort_list_3 = SortList(Keys=merge_2, ValuesValuesA=merge_2)  # -> Keys, ValuesValuesA; disabled
sort_list_4 = SortList(Keys=merge_3, ValuesValuesA=merge_3)  # -> Keys, ValuesValuesA; disabled
panel_15 = Panel("0")  # disabled
panel_16 = Panel("0")  # disabled
list_item_3 = ListItem(List=sort_list_3.ValuesValuesA, Index=panel_15, Wrap=True)  # disabled
list_item_4 = ListItem(List=sort_list_4.ValuesValuesA, Index=panel_16, Wrap=True)  # disabled
unit_z_4 = UnitZ(Factor=expr("-x", list_item_3))  # disabled
unit_z_5 = UnitZ(Factor=expr("-x", list_item_4))  # disabled
move_7 = Move(Geometry=move_6.Geometry, Motion=unit_z_4)  # -> Geometry, Transform; disabled
move_8 = Move(Geometry=move_5.Geometry, Motion=unit_z_5)  # -> Geometry, Transform; disabled
root_top_band = Curve(move_8.Geometry)  # disabled
tip_top_band = Curve(move_7.Geometry)  # disabled

construct_domain = ConstructDomain(DomainStart="0", DomainEnd="1")
unit_x_5 = UnitX(Factor=1)
item_in_direction_cl = ItemInDirectionCL(selection_direction_v=unit_x_5)
point_3 = Point(end_points_4.End)  # disabled
point_4 = Point(end_points_3.End)  # disabled
output_geometry = Geometry(item_in_direction_cl)
surface = Surface(output_geometry)

# ----
# Side Cutter Profile
bottom_band_width_mm_2 = Panel(bottom_band_strap_width_mm_2)  # disabled
mid_joint_rise_factor_3 = Panel(mid_joint_rise_factor_2)  # disabled
root_top_band_2 = Curve(root_top_band)  # disabled
tip_top_band_2 = Curve(tip_top_band)  # disabled
bottom_band_2 = Curve(bottom_band)  # disabled
multiplication_2 = Multiplication(A=bottom_band_width_mm_2, B=mid_joint_rise_factor_3)  # disabled
midpoint = Midpoint(Curve=bottom_band_2)  # disabled
unit_z_6 = UnitZ(Factor=multiplication_2)  # disabled
move_9 = Move(Geometry=midpoint, Motion=unit_z_6)  # -> Geometry, Transform; disabled
end_points_5 = EndPoints(Curve=bottom_band_2)  # -> Start, End; disabled
end_points_6 = EndPoints(Curve=root_top_band_2)  # -> Start, End; disabled
end_points_7 = EndPoints(Curve=tip_top_band_2)  # -> Start, End; disabled
top_right_band_right_pt = Point(end_points_7.Start)  # disabled
bottom_left_pt = Point(end_points_5.Start)  # disabled
top_right_band_left_pt = Point(end_points_7.End)  # disabled
bottom_right_pt = Point(end_points_5.End)  # disabled
top_left_band_left_pt = Point(end_points_6.Start)  # disabled
top_left_band_right_pt = Point(end_points_6.End)  # disabled
central_pt = Point(move_9.Geometry)  # disabled
line_3 = Line(StartPoint=top_left_band_right_pt, EndPoint=central_pt)  # disabled
line_4 = Line(StartPoint=central_pt, EndPoint=top_right_band_left_pt)  # disabled
midpoint_2 = Midpoint(Curve=line_3)  # disabled
midpoint_3 = Midpoint(Curve=line_4)  # disabled
line_5 = Line(StartPoint=bottom_right_pt, EndPoint=bottom_left_pt)  # disabled
line_6 = Line(StartPoint=bottom_left_pt, EndPoint=top_left_band_left_pt)  # disabled
line_7 = Line(StartPoint=top_left_band_left_pt, EndPoint=top_left_band_right_pt)  # disabled
tip_slant_line = Line(StartPoint=top_right_band_right_pt, EndPoint=bottom_right_pt)  # disabled
line_8 = Line(StartPoint=top_left_band_right_pt, EndPoint=midpoint_2)  # disabled
line_9 = Line(StartPoint=top_right_band_left_pt, EndPoint=top_right_band_right_pt)  # disabled
line_10 = Line(StartPoint=midpoint_3, EndPoint=top_right_band_left_pt)  # disabled
merge_4 = Merge(Data1=line_5, Data2=line_6, Data3=line_7, Data4=line_8, Data6=line_10, Data7=line_9, Data8=tip_slant_line)  # -> flatten(Result); disabled
number_slider = Slider(0.6, range=0..2)  # disabled
join_curves = JoinCurves(Curves=merge_4, Preserve=False)  # disabled
connect_curves = ConnectCurves(Curves=join_curves, Continuity=2, Close=True, Bulge=number_slider)  # disabled
close_curve = CloseCurve(Curve=connect_curves, Tolerance=0)  # disabled
xz_plane_4 = XZPlane(Origin=Point(0, 0, 0))  # disabled
panel_17 = Panel("-30")  # disabled
unit_y_2 = UnitY(Factor=panel_17)  # disabled
project = Project(Geometry=close_curve, Plane=xz_plane_4)  # -> Geometry, Transform; disabled
planar = Planar(Curve=project.Geometry)  # -> Planar, Plane, Deviation; disabled
move_10 = Move(Geometry=project.Geometry, Motion=unit_y_2)  # -> Geometry, Transform; disabled
panel_18 = Panel(planar.Planar)  # disabled
cutter_curve = Curve(move_10.Geometry)  # disabled

# ----
# Side Cutter Volume
cutter_curve_2 = Curve(cutter_curve)  # disabled
panel_19 = Panel(cutter_curve_2)  # disabled
panel_20 = Panel("60")  # disabled
unit_y_3 = UnitY(Factor=panel_20)  # disabled
boundary_surfaces = BoundarySurfaces(Edges=cutter_curve_2)  # disabled
extrude = Extrude(Base=boundary_surfaces, Direction=unit_y_3)  # disabled
side_cutter_surface = Surface(boundary_surfaces)  # disabled
side_cutter_volume = Brep(extrude)  # disabled

# ----
# Splint Body
preform_tube_brep = Brep(finger_model_rotate.Geometry)  # disabled
solid_intersection = SolidIntersection(BrepsA=preform_tube_brep, BrepsB=side_cutter_volume)  # disabled
splint_body = Brep(solid_intersection)  # disabled

# ---- group: splint-nub
# Direction
# Indicator
ball_r_to_wall_ratio = Slider(0.65, range=0.6..1)  # disabled
splint_body_2 = Brep(splint_body)  # disabled
wall_thickness_3 = Number(wall_thickness_2)  # disabled
tip_top_band_3 = Curve(tip_top_band)  # disabled
midpoint_4 = Midpoint(Curve=tip_top_band_3)  # disabled
multiplication_3 = Multiplication(A=wall_thickness_3, B=ball_r_to_wall_ratio)  # disabled
nub_radius = Panel(multiplication_3)  # disabled
brep_closest_point = BrepClosestPoint(Point=midpoint_4, Brep=splint_body_2)  # -> Point, Normal, Distance; disabled
sphere_5 = Sphere(Base=midpoint_4, Radius=nub_radius)  # disabled
surface_sinking_ratio = Slider(0.4, range=0..1)  # disabled
line_11 = Line(StartPoint=midpoint_4, EndPoint=brep_closest_point.Point)  # disabled
multiplication_4 = Multiplication(A=nub_radius, B=surface_sinking_ratio)  # disabled
extend_curve = ExtendCurve(Curve=line_11, Type=0, Start=0, End=multiplication_4)  # disabled
end_points_8 = EndPoints(Curve=extend_curve)  # -> Start, End; disabled
move_to_point = MoveToPoint(Geometry=sphere_5, PointA=midpoint_4, PointB=end_points_8.End)  # -> Moved, Vector, Transform; disabled
splint_nub = Brep(move_to_point.Moved)  # disabled
solid_union_7 = SolidUnion(Breps=[splint_body, splint_nub])  # disabled
finishedsplint = Brep(solid_union_7)  # disabled

# ----
panel_21 = Panel("0.8")  # disabled
dev_activate_toggle = BooleanToggle(True)  # disabled
kill_on_completion = BooleanToggle(False)  # disabled
root_filename_out_3 = Text(root_filename_out_2)  # disabled
output_dir_out_3 = Text(output_dir_out_2)  # disabled

# ----
# Shell Formation
outer_shell_cl = FingerCL(
    l_middle=factoryautomatorpy.middle_phalange_l_mm,
    l_distal=l_distal_2,
    flexion_degrees=addition_7,
    radius_tip=radius_tip_shell,
    radius_dip=radius_dip_2,
    radius_mid=radius_mid_3,
    radius_pip=radius_pip_2)  # -> mid_line_5, distal_line_5, pip_hoop_3, mid_hoop_3, mid_dip_hoop_3, dip_sphere_3, distal_dip_hoop_3, tip_sphere_3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
finger_cl = FingerCL(
    l_middle=factoryautomatorpy.middle_phalange_l_mm,
    l_distal=factoryautomatorpy.distal_phalange_l_mm,
    flexion_degrees=addition_7,
    radius_tip=radius_tip_2,
    radius_dip=radius_dip,
    radius_mid=radius_mid_2,
    radius_pip=radius_pip)  # -> mid_line_5, distal_line_5, pip_hoop_3, mid_hoop_3, mid_dip_hoop_3, dip_sphere_3, distal_dip_hoop_3, tip_sphere_3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
unit_x_6 = UnitX(Factor="-0.1")
move_11 = Move(Geometry=finger_cl.whole_finger, Motion=unit_x_6)  # -> Geometry, Transform
outer_shell_brep_4 = Brep(outer_shell_cl.whole_finger)

finger_analog = Brep(move_11.Geometry)

solid_difference_2 = SolidDifference(BrepsA=outer_shell_brep_4, BrepsB=finger_analog)
splint_shell = Brep(solid_difference_2)

# ----
# Feature Identification
panel_22 = Panel("-1")
up_z = UnitZ(Factor=1)
shell_shaped_tip_hoop = Curve(outer_shell_cl.shaped_tip_hoop_3)
up_x = UnitX(Factor=1)
shell_mid_dip_hoop = Curve(outer_shell_cl.mid_dip_hoop_3)
down_z = UnitZ(Factor=panel_22)
splint_shell_2 = Brep(splint_shell)
shell_pip_hoop = Curve(outer_shell_cl.pip_hoop_3)
shell_tip_shaped = Brep(outer_shell_cl.tip_shaped_3)
pt_in_dir = PTInDir(curve=shell_pip_hoop, search_dir_v=up_z)
pt_in_dir_2 = PTInDir_2(curve=shell_shaped_tip_hoop, search_dir_v=up_z)
pt_in_dir_3 = PTInDir_2(curve=shell_mid_dip_hoop, search_dir_v=up_z)
pt_in_dir_4 = PTInDir_2(curve=shell_shaped_tip_hoop, search_dir_v=down_z)
pt_in_dir_brep = PTInDirBrep(brep=splint_shell_2, search_dir_v=up_x)
pt_in_dir_5 = PTInDir_2(curve=shell_mid_dip_hoop, search_dir_v=down_z)
locate_pt_on_brep = LocatePTOnBrep(start_pt=pt_in_dir, end_pt=pt_in_dir_3, param="0.2", brep=splint_shell_2)
locate_pt_on_brep_2 = LocatePTOnBrep_2(start_pt=pt_in_dir_5, end_pt=pt_in_dir_4, param="0.1", brep=splint_shell_2)
splint_low_rear_pt = Point(locate_pt_on_brep_2)
splint_high_rear_pt = Point(locate_pt_on_brep)
high_dip_pt = Point(pt_in_dir_3)
tip_pt = Point(pt_in_dir_brep)
high_root_pt = Point(pt_in_dir)

# ----
# NOTE: The Mid and distal planes here are derived in preparation for lateral curvature of a finger
# Trim Planes
extrusion_plane_offset = Panel("100")
mid_pts = Merge(Data1=high_dip_pt, Data2=splint_low_rear_pt, Data3=splint_low_rear_pt)  # -> flatten(Result)
distal_pts = Merge(Data1=splint_low_rear_pt, Data2=high_dip_pt, Data3=tip_pt)  # -> flatten(Result)
distal_average = Average(Input=distal_pts)
distal_plane_fit = PlaneFit(Points=distal_pts)  # -> Plane, Deviation
distal_plane_fit_2 = PlaneFit(Points=mid_pts)  # -> Plane, Deviation
deconstruct_plane = DeconstructPlane(Plane=distal_plane_fit.Plane)  # -> Origin, XAxis, YAxis, ZAxis
deconstruct_plane_2 = DeconstructPlane(Plane=distal_plane_fit_2.Plane)  # -> Origin, XAxis, YAxis, ZAxis
multiplication_5 = Multiplication(A=deconstruct_plane.ZAxis, B=extrusion_plane_offset)
multiplication_6 = Multiplication(A=deconstruct_plane_2.ZAxis, B=extrusion_plane_offset)
move_12 = Move(Geometry=distal_plane_fit.Plane, Motion=multiplication_5)  # -> Geometry, Transform
move_13 = Move(Geometry=distal_plane_fit_2.Plane, Motion=multiplication_6)  # -> Geometry, Transform

# ----
# Cutting Surfaces
# DISTAL
# MID
line_12 = Line(StartPoint=splint_high_rear_pt, EndPoint=splint_low_rear_pt)
distal_average_point = Point(distal_average)
merge_5 = Merge(Data1=tip_pt, Data2=distal_average_point, Data3=high_dip_pt)  # -> flatten(Result)
nurbs_curve = NurbsCurve(Vertices=merge_5, Degree="2", Periodic=False)  # -> Curve, Length, Domain
extend_curve_2 = ExtendCurve(Curve=line_12, Type=0, Start="20", End="20")
extend_curve_3 = ExtendCurve(Curve=nurbs_curve.Curve, Type=0, Start="20", End="20")
extrusion_plane_offset_2 = Panel(extrusion_plane_offset)
multiplication_7 = Multiplication(A=extrusion_plane_offset_2, B="-2")
distal_cutting_curve = Curve(extend_curve_3)
cutting_extrusion = Panel(multiplication_7)
transform = Transform(Geometry=distal_cutting_curve, Transform=move_12.Transform)
multiplication_8 = Multiplication(A=deconstruct_plane.ZAxis, B=cutting_extrusion)
multiplication_9 = Multiplication(A=deconstruct_plane_2.ZAxis, B=cutting_extrusion)
distal_2d_extrude = Extrude(Base=transform, Direction=multiplication_8)

rebuild_curve = RebuildCurve(Curve=extend_curve_2, Count="10", Domain=construct_domain, EndTangents=False)

mid_cutting_curve = Curve(rebuild_curve)
transform_2 = Transform(Geometry=mid_cutting_curve, Transform=move_13.Transform)
mid_2d_extrude = Extrude(Base=transform_2, Direction=multiplication_9)

# ----
# Solid Forming
area = Area(Geometry=distal_2d_extrude)  # -> Area, Centroid
distal_average_point_2 = Point(distal_average)
splint_shell_3 = Brep(splint_shell)
high_dip_pt_2 = Point(pt_in_dir_3)
area_2 = Area(Geometry=mid_2d_extrude)  # -> Area, Centroid
line_13 = Line(StartPoint=distal_average_point_2, EndPoint=area.Centroid)
line_14 = Line(StartPoint=high_dip_pt_2, EndPoint=area_2.Centroid)
unit_vector = UnitVector(Vector=line_13)
unit_vector_2 = UnitVector(Vector=line_14)
line_sdl_4 = LineSDL(Start=distal_average_point_2, Direction=unit_vector, Length="50")
line_sdl_5 = LineSDL(Start=high_dip_pt_2, Direction=unit_vector_2, Length="50")
extrude_2 = Extrude(Base=distal_2d_extrude, Direction=line_sdl_4)
extrude_3 = Extrude(Base=mid_2d_extrude, Direction=line_sdl_5)
solid_difference_3 = SolidDifference(BrepsA=splint_shell_3, BrepsB=extrude_2)
solid_difference_4 = SolidDifference(BrepsA=solid_difference_3, BrepsB=extrude_3)

# ----
# ID Gun
finishedsplintbrep = Brep(finishedsplint)  # disabled
wall_thickness_4 = Number(wall_thickness_2)  # disabled
objectid_3 = Text(objectid_2)  # disabled
text_size = Slider(3.3, range=2.5..6)  # disabled
boolean_toggle = BooleanToggle(True)  # disabled
xz_plane_5 = XZPlane(Origin=Point(0, 0, 0))  # disabled
to = Volume(Geometry=finishedsplintbrep)  # -> Volume, Centroid; disabled
bb_text = BBText(Location=xz_plane_5, Text=objectid_3, Size=text_size, Bold=boolean_toggle, HorizontalAlignment=0, VerticalAlignment=0)  # disabled
bounding_box = BoundingBox(Content=bb_text, Plane=PlaneXY(0, 0, 0), UnionBox=True)  # -> Box, Box_2; disabled
from = Volume(Geometry=bounding_box.Box)  # -> Volume, Centroid; disabled
line_15 = Line(StartPoint=from.Centroid, EndPoint=to.Centroid)  # disabled
side_projection_angle = Slider(-28, range=-90..90)  # disabled
boundary_surfaces_2 = BoundarySurfaces(Edges=bb_text)  # disabled
unit_y_4 = UnitY(Factor=1)  # disabled
yz_plane = YZPlane(Origin=Point(0, 0, 0))  # disabled
move_14 = Move(Geometry=boundary_surfaces_2, Motion=line_15)  # -> Geometry, Transform; disabled
rotate_2 = Rotate(Geometry=unit_y_4, Angle=degrees(side_projection_angle), Plane=yz_plane)  # -> Geometry, Transform; disabled
transform_3 = Transform(Geometry=move_14.Geometry, Transform=rotate_2.Transform)  # -> flatten(Geometry); disabled
finishedsplintbrep_2 = Brep(finishedsplintbrep)  # disabled
area_3 = Area(Geometry=transform_3)  # -> Area, Centroid; disabled
text_projection_vector = Vector(rotate_2.Geometry)  # disabled
vector_display = VectorDisplay(Anchor=to.Centroid, Vector=text_projection_vector)  # disabled
wall_thickness_5 = Number(wall_thickness_4)  # disabled
project_point = ProjectPoint(Point=area_3.Centroid, Direction=text_projection_vector, Geometry=finishedsplintbrep_2)  # -> Point, Index; disabled
multiplication_10 = Multiplication(A=text_projection_vector, B=wall_thickness_5, C=panel_21)  # disabled

extrude_4 = Extrude(Base=transform_3, Direction=multiplication_10)  # -> flatten(Extrusion); disabled
volume = Volume(Geometry=extrude_4)  # -> Volume, Centroid; disabled
line_16 = Line(StartPoint=volume.Centroid, EndPoint=project_point.Point)  # disabled

move_to_point_2 = MoveToPoint(Geometry=extrude_4, PointA=volume.Centroid, PointB=project_point.Point)  # -> Moved, Vector, Transform; disabled
solid_difference_5 = SolidDifference(BrepsA=finishedsplintbrep_2, BrepsB=move_to_point_2.Moved)  # disabled
splint_w_id = Brep(solid_difference_5)  # disabled

# ----
# Orienting To Build Plate
# Tip Slant Line, describes the angle necessary to bring the front cut line of the splint down to the build platform.
tip_slant_line_2 = Line(tip_slant_line)  # disabled
finishedsplint_2 = Brep(splint_w_id)  # disabled
X = UnitX(Factor=1)  # disabled
flip = FlipCurve(Curve=tip_slant_line_2)  # -> Curve, Flag; disabled
xz = XZPlane(Origin=Point(0, 0, 0))  # disabled
end = EndPoints(Curve=flip.Curve)  # -> Start, End; disabled
angle_2 = Angle(VectorA=flip.Curve, VectorB=X, Plane=xz)  # -> Angle, Reflex; disabled
neg = Negative(Value=angle_2.Angle)  # disabled
pt = Point(end.Start)  # disabled
pt_2 = Point(end.End)  # disabled
pl_origin = PlaneOrigin(Base=xz, Origin=pt)  # disabled
rotate_3 = Rotate(Geometry=finishedsplint_2, Angle=angle_2.Angle, Plane=pl_origin)  # -> Geometry, Transform; disabled
orientedsplint = Brep(rotate_3.Geometry)  # disabled

# ----
# Final Joining
# And Smoothing
number_slider_2 = Slider(0.12, range=0.05..0.2)  # disabled
orientedsplint_2 = Brep(orientedsplint)  # disabled
number_slider_3 = Slider(8, range=0..10)  # disabled
shrinkwrap = ShrinkWrap(
    Geometry=orientedsplint_2,
    EdgeLength=number_slider_2,
    Offset=0,
    Smoothing=number_slider_3,
    Optimization=10,
    FillHoles=True)  # disabled
final_smooth_splint = Mesh(shrinkwrap)  # disabled

# ----
# Preview Steps
side_cutter_volume_2 = Brep(side_cutter_volume)  # disabled
inner_finger_form = Brep(inner_barrel_transform)  # disabled
side_cutter_surface_2 = Surface(side_cutter_surface)  # disabled
splint_body_sharp = Brep(splint_body)  # disabled
preform_barrel = Brep(finger_model_rotate.Geometry)  # disabled
splint_body_smooth = Mesh(final_smooth_splint)  # disabled
panel_23 = Panel("60, 0, 0")  # disabled
merge_6 = Merge(Data1=preform_barrel, Data2=side_cutter_surface_2)  # -> flatten(Result); disabled
merge_7 = Merge(Data1=preform_barrel, Data2=side_cutter_volume_2)  # -> flatten(Result); disabled
merge_8 = Merge(Data1=splint_body_smooth)  # -> flatten(Result); disabled
merge_9 = Merge(Data1=splint_body_sharp)  # -> flatten(Result); disabled
panel_24 = Panel("120, 0, 0")  # disabled
panel_25 = Panel("180, 0, 0")  # disabled
panel_26 = Panel("300, 0, 0")  # disabled
panel_27 = Panel("240, 0, 0")  # disabled
move_15 = Move(Geometry=inner_finger_form, Motion=panel_23)  # -> Geometry, Transform; disabled
move_16 = Move(Geometry=merge_6, Motion=panel_24)  # -> Geometry, Transform; disabled
move_17 = Move(Geometry=merge_7, Motion=panel_25)  # -> Geometry, Transform; disabled
move_18 = Move(Geometry=merge_8, Motion=panel_26)  # -> Geometry, Transform; disabled
move_19 = Move(Geometry=merge_9, Motion=panel_27)  # -> Geometry, Transform; disabled
merge_10 = Merge(Data1=move_15.Geometry, Data2=move_16.Geometry, Data3=move_17.Geometry, Data4=move_19.Geometry, Data5=move_18.Geometry)  # -> flatten(Result); disabled
random_color = RandomColor(Data=merge_10, Seed=2, FastMode=False)  # disabled
custom_preview = CustomPreview(Geometry=merge_10, Material=random_color)  # disabled

savemeshpy = Python3Script(
    geo_input=final_smooth_splint,
    output_file_dir=output_dir_out_3,
    jobname=root_filename_out_3,
    bool_activate=dev_activate_toggle,
    is_kill_on_completion=kill_on_completion)  # -> out; inputs geo_input: Mesh; disabled
# ---------- savemeshpy: Python ----------
# See: https://discourse.mcneel.com/t/how-to-optimise-ghpython-obj-export/87598/76

# Start standard gh python imports
from pathlib import Path
import sys
from importlib import reload #FOR DEV ONLY

ghFileDir = str(Path.joinpath(Path(ghenv.Component.OnPingDocument().FilePath).resolve().parents[0], "src"))
if ghFileDir not in sys.path:
    print("ghFileDir needed to be included")
    sys.path.append(ghFileDir)
import splintcommon
reload(splintcommon)
# End standard gh python imports

import time
splintcommon.log(f'Save Mesh Running at: ({time.strftime("%H:%M:%S", time.localtime())})')

import scriptcontext as sc
# import rhinoscriptsyntax as rs
import System
import Rhino
import random
import string
import os
import traceback

def add_layer(layer_name=None, layer_color=None):
    """Adds a new layer to the active Rhino document.
    
    Args:
      layer_name (str): An optional layer name.
      layer_color (System.Drawing.Color): An optional layer color.
    Returns:
      The index of the new layer.
    """
    sc.doc = Rhino.RhinoDoc.ActiveDoc
    if layer_name != None:
        # Check whether the layer name is valid
        if not Rhino.DocObjects.Layer.IsValidName(layer_name):
            raise ValueError("{} is not a valid layer name."\
                .format(layer_name))
        # Check whether a layer with the same name already exists
        layer_index = sc.doc.Layers.Find(layer_name, True)
        if layer_index >= 0:
            raise ValueError("A layer with the name {} already exists."\
                .format(layer_name))
    else:
        layer_name = sc.doc.Layers.GetUnusedLayerName(False)
    
    # Check whether the layer color is valid
    if layer_color != None:
        if not isinstance(layer_color, System.Drawing.Color):
            raise ValueError("{} is not a valid layer color."\
                .format(layer_color))
    else:
        layer_color = System.Drawing.Color.Black # default layer color
    
    # Add a new layer to the active document
    layer_index = sc.doc.Layers.Add(layer_name, layer_color)
    if layer_index < 0:
        raise ValueError("Unable to add layer {} to document."\
            .format(layer_name))
    return layer_index
    

def delete_layer(layer):
    """Deletes an existing layer from the active Rhino document. 
    The layer to be removed cannot be the current layer and 
    it will be deleted even if it contains objects.
    
    Args:
      layer (str\id): A name or id of an existing layer.
    Returns:
      True or False, indicating success or failure.
    """
    sc.doc = Rhino.RhinoDoc.ActiveDoc
    layer_index = sc.doc.Layers.Find(layer, True)
    if layer_index < 0:
        raise ValueError("The layer {} does not exist.".format(layer))
    rc = sc.doc.Layers.Purge(layer_index, True)
    sc.doc.Views.Redraw()
    return rc
    

def bake_mesh(layer, mesh, mesh_name=None):
    """Bakes a mesh object to the active Rhino document.
    
    Args:
      layer (str\id): The name or id of an existing layer.
      mesh (Rhino.Geometry.Mesh): A mesh object to bake.
      mesh_name (str): An optional mesh object name.
    Returns:
      The GUID of the baked mesh.
    """

    splintcommon.log(f"mesh type:{type(mesh)}")
    # mesh = rs.coercemesh(mesh)
    # splintcommon.log(f"mesh type:{type(mesh)}")

    sc.doc = Rhino.RhinoDoc.ActiveDoc
    # Check whether the mesh is a mesh object
    if mesh.ObjectType != Rhino.DocObjects.ObjectType.Mesh:
        raise ValueError("{} is not a mesh.".format(mesh))
    # Create the mesh object attributes
    attr = Rhino.DocObjects.ObjectAttributes()
    # Set the mesh object layer index attribute
    layer_index = sc.doc.Layers.Find(layer, True)
    if layer_index < 0:
        if layer == "Default":
            raise ValueError("The layer {} can't be baked to.".format(layer))
        else:
            raise ValueError("The layer {} does not exist.".format(layer))    
    else:
        attr.LayerIndex = layer_index
    # Set the mesh object name attribute
    if mesh_name != None:
        attr.Name = mesh_name
    # Bake the mesh to the active Rhino documemnt
    mesh_id = sc.doc.Objects.AddMesh(mesh, attr)
    return mesh_id

def get_obj_settings():
    splintcommon.log("Using OBJ mesh settings")
    """Returns the settings for the OBJ export command as a string."""
    # Formatting options
    cfg = "_Geometry=_Mesh "
    cfg += "_EndOfLine=CRLF "
    cfg += "_ExportRhinoObjectNames=_ExportObjectsAsOBJGroups "
    cfg += "_ExportMeshTextureCoordinates=_Yes "
    cfg += "_ExportMeshVertexNormals=_Yes "
    cfg += "_ExportMeshVertexColors=_Yes "
    cfg += "_CreateNGons=_No "
    cfg += "_ExportMaterialDefinitions=_No "
    cfg += "_YUp=_Yes "
    cfg += "_WrapLongLines=_No "
    cfg += "_VertexWelding=_Unmodified "
    cfg += "_WritePrecision=4 "
    cfg += "_Enter "
    # Detailed options
    cfg += "_DetailedOptions "
    cfg += "_JaggedSeams=_No "
    cfg += "_PackTextures=_No "
    cfg += "_Refine=_No "
    cfg += "_SimplePlane=_No "
    # Advanced options
    cfg += "_AdvancedOptions "
    cfg += "_Angle=0 "
    cfg += "_AspectRatio=0 "
    cfg += "_Distance=0.0 "
    cfg += "_Density=0.5 "
    cfg += "_Grid=0 "
    cfg += "_MaxEdgeLength=0 "
    cfg += "_MinEdgeLength=0.0001 "
    cfg += "_Enter _Enter" # remove the last _Enter to check if density is set
    return cfg, "obj"

def get_stl_settings_default():
    #[ANGLE,ASPECT RATIO,MAX DIST TO SRF,GRID,DENSITY,MAX EDGE LEN,MIN EDGE LEN]
    #Change list below as needed
    setting_list=[15,0,0.01,16,0,0,0.001]   
    return get_stl_settings(*setting_list)

def get_stl_settings(ang,ar,dist,grid,den,maxL=0,minL=.0001):
    splintcommon.log("Using STL mesh settings")
    e_str = "_ExportFileAs=_Binary "
    e_str+= "_ExportUnfinishedObjects=_Yes "
    e_str+= "_UseSimpleDialog=_No "
    e_str+= "_Enter _DetailedOptions "
    e_str+= "_JaggedSeams=_No "
    e_str+= "_PackTextures=_No "
    e_str+= "_Refine=_Yes "
    e_str+= "_SimplePlane=_Yes "
    # e_str+= "_AdvancedOptions "
    # e_str+= "_Angle={} ".format(ang)
    # e_str+= "_AspectRatio={} ".format(ar)
    # e_str+= "_Distance={} ".format(dist)
    # e_str+= "_Density={} ".format(den)
    # e_str+= "_Grid={} ".format(grid)
    # e_str+= "_MaxEdgeLength={} ".format(maxL)
    # e_str+= "_MinEdgeLength={} ".format(minL)
    e_str+= "_Enter _Enter"
    return e_str, "stl"

def export_mesh_files(meshes, path, filename, debug=False, asObj=True):
    """Exports a collection of meshes to an OBJ file.
    
    Args:
      meshes (list): A list of Rhino.Geometry.Mesh objects.
      path (str): An absolute path pointing to a directory.
      filename (str): A filename (without extension).
      debug (bool): Optional True to print debug information.
    Returns:
      True or False, indicating success or failure.
    """

    sc.doc = Rhino.RhinoDoc.ActiveDoc
    sc.doc.Views.RedrawEnabled = True # JG - False
    if debug: 
        now = time.process_time()
        elapsed = 0.0
        
    # Create a temporary layer
    splintcommon.log(f"export_mesh_files: Creating temp layer")
    layer = "".join(random.choice(string.ascii_uppercase) for _ in range(9))
    layer_index = add_layer(layer)
    if debug: 
        then, now = now, time.process_time()
        elapsed += now - then
        splintcommon.log("Creating temporary layer: {0:.4f} seconds".format(now-then))
        
    # Bake the temporary mesh(es)
    splintcommon.log(f"export_mesh_files: Baking temp mesh(es)")
    mesh_ids = [bake_mesh(layer, mesh) for mesh in meshes]
    if debug: 
        then, now = now, time.process_time()
        elapsed += now - then
        splintcommon.log("Creating temporary mesh(es): {0:.4f} seconds".format(now-then))
    
    # Unselect all objects in the scene
    sc.doc.Objects.UnselectAll()
    # Select the baked mesh object(s)
    for mid in mesh_ids:
        sc.doc.Objects.Select(mid)
    if debug: 
        then, now = now, time.process_time()
        elapsed += now - then
        splintcommon.log("Unselecting and selecting: {0:.4f} seconds".format(now-then))
    
    # Export the selected mesh object(s) to mesh file
    splintcommon.log(f"export_mesh_files: exporting to file")
    export_config, export_extension = get_obj_settings() if asObj else get_stl_settings_default()
    export_fname = "{}.{}".format(filename, export_extension)
    export_fpath = Path(os.path.join(path, export_fname))
    splintcommon.log(f"export_mesh_files: Export Values: {export_fname=} {export_fpath=}")
    
    if export_fpath.exists():
        splintcommon.log(f"export_mesh_files: REMOVING EXISTING MESH FILE: {export_fpath}")
        export_fpath.unlink()
        time.sleep(1.0)
        splintcommon.log(f"export_mesh_files: testing... MeshStillExists:{export_fpath.exists()}")

    splintcommon.log(f"export_mesh_files: exporting to file")

    cmd = '_-Export _Pause "{}" {} _Enter'.format(export_fpath, export_config) # _Enter
    # see: https://discourse.mcneel.com/t/export-command-line-options/87537/5
    splintcommon.log(f"export_mesh_files: RUNNING cmd: '{cmd}'")
    
    #start = Rhino.DocObjects.RhinoObject.NextRuntimeSerialNumber
    rc = Rhino.RhinoApp.RunScript(cmd, True)

    splintcommon.log(f"export_mesh_files: Completion {rc=}")

    #end = Rhino.DocObjects.RhinoObject.NextRuntimeSerialNumber
    #global __command_serial_numbers
    #__command_serial_numbers = None
    #if start != end:
        #__command_serial_numbers = (start, end)
    
    if debug: 
        then, now = now, time.process_time()
        elapsed += now - then
        splintcommon.log("Exporting Mesh Result: {0:.4f} seconds result={1}".format(now-then, rc))
    
    # Delete the temporary layer and meshes
    splintcommon.log(f"export_mesh_files: cleaning up temp layer")
    delete_layer(layer)
    
    if debug: 
        then, now = now, time.process_time()
        elapsed += now - then
        splintcommon.log("Cleaning up: {0:.4f} seconds\n".format(now-then))
        splintcommon.log("Total elapsed: {0:.4f} seconds".format(elapsed))

    sc.doc.Views.RedrawEnabled = True

    splintcommon.log(f"export_mesh_files: Returning result: {rc=}")

    return rc

def saveMeshToFile(inputMesh, directory, rootFilename):
    try:
        splintcommon.log(f"inputMesh type: {inputMesh}")
        splintcommon.log(f"{directory=}")
        splintcommon.log(f"{rootFilename=}")
        
        if inputMesh is None or directory is None or rootFilename is None:        
            raise ValueError("Missing required inputs for saving file")

        #TODO, Validate the path more completely
        if "." in directory or "." in rootFilename:
            raise ValueError(f"Path must not contain dot character: {directory}")

        result = export_mesh_files([inputMesh], directory, rootFilename, True, False)

        if not result:
            raise ValueError(f"FAIL: mesh export failed. {result=}")
        else:
            splintcommon.log(f'SUCCESS: Saved to {rootFilename} in {directory}')
            splintcommon.confirm_job_is_processed_and_exit(jobname, True, "mesh exported normally", is_kill_on_completion)

    except Exception as e:
        errMsg = f"Exception: {traceback.format_exc()}"
        splintcommon.log(errMsg)
        splintcommon.confirm_job_is_processed_and_exit(jobname, False, errMsg, is_kill_on_completion)

if geo_input is None:
    message = f"No mesh input To Process {geo_input=}"
    splintcommon.log(message)
    splintcommon.confirm_job_is_processed_and_exit(jobname, False, message, is_kill_on_completion)
else:
    saveMeshToFile(geo_input, output_file_dir, jobname)
# ---------- end savemeshpy ----------
panel_28 = Panel(savemeshpy)  # disabled

# ==== cluster CylinderCl
begin_extend_mm = ClusterInput()
begin_r = ClusterInput()
center_line = ClusterInput()
end_r = ClusterInput()
begin_extend_mm_2 = Number(begin_extend_mm)
begin_r_2 = Number(begin_r)
center_line_2 = Curve(center_line)
original_center_line = Curve(center_line_2)
default_number = Number("0")
combine_data = CombineData(Input0=begin_extend_mm_2, Input1=default_number)  # -> Result, Index
begin_extend_mm_3 = Number(combine_data.Result)
begin_extend_mm_4 = Number(begin_extend_mm_3)
panel = Panel(combine_data.Result)
extend_curve = ExtendCurve(Curve=original_center_line, Type=0, Start=begin_extend_mm_4, End="0")
reparameterize_curve = ReparameterizeCurve(Curve=extend_curve)  # -> Reparameterized, Original
length = Length(Curve=original_center_line)
panel_2 = Panel("r diff towards begin")
subtraction = Subtraction(A=begin_r_2, B=end_r)
length_2 = Length(Curve=reparameterize_curve.Reparameterized)
# change for extended l
panel_3 = Panel("change over l")
radius_begin_end_ratio = Division(A=subtraction, B=length)
multiplication = Multiplication(A=radius_begin_end_ratio, B=length_2)
panel_4 = Panel("new begin r")
addition = Addition(A=multiplication, B=end_r)
augmented_center_line = Curve(reparameterize_curve.Reparameterized)
augmented_begin_r = Number(addition)
augmented_begin_r_2 = Number(augmented_begin_r)
perp_frame = PerpFrame(Curve=augmented_center_line, Parameter="1")
perp_frame_2 = PerpFrame(Curve=augmented_center_line, Parameter="0")
circle = Circle(Plane=perp_frame_2, BeginR=augmented_begin_r_2)
circle_2 = Circle(Plane=perp_frame, Radius=end_r)

# ---- group: Non-Augmented-RealityCheck
perp_frame_3 = PerpFrame(Curve=original_center_line, Parameter="0")
circle_3 = Circle(Plane=perp_frame_3, BeginR=begin_r_2)

# ----
merge = Merge(Data1=circle, Data2=circle_2)  # -> flatten(Result)
loft = Loft(Curves=merge, Options={Adjust=False, Closed=False, LoftEnds=0, LoftSimp=0, LoftType=0, Rebuild=10, Refit=0.01})
cap_holes = CapHoles(Brep=loft)
panel_5 = Panel(cap_holes)
deconstruct_brep = DeconstructBrep(Brep=cap_holes)  # -> Faces, Edges, Vertices
parameter_point_on_surface = ParameterPointOnSurface(Surface=deconstruct_brep.Faces, ParameterU="0.5", ParameterV="0.5")  # -> Point, Normal
line_sdl = LineSDL(Start=parameter_point_on_surface.Point, Direction=parameter_point_on_surface.Normal, Length="10")
facenormals = ClusterOutput(line_sdl)
brep = ClusterOutput(cap_holes)

# ==== cluster ItemInDirectionCL
selection_direction_v = ClusterInput()
input_geometries = ClusterInput()
input_geometries_2 = Geometry(input_geometries)
selection_direction_v_2 = Vector(selection_direction_v)
bounding_box = BoundingBox(Content=input_geometries_2, Plane=PlaneXY(0, 0, 0), UnionBox=True)  # -> Box, Box_2
bounding_box_2 = BoundingBox(Content=input_geometries_2, Plane=PlaneXY(0, 0, 0))  # -> Box, Box_2
volume = Volume(Geometry=bounding_box.Box)  # -> Volume, Centroid
line_sdl = LineSDL(Start=volume.Centroid, Direction=selection_direction_v_2, Length="1")
volume_2 = Volume(Geometry=bounding_box_2.Box)  # -> Volume, Centroid
sort_along_curve = SortAlongCurve(Points=volume_2.Centroid, Curve=line_sdl)  # -> Points, Indices
list_item = ListItem(List=sort_along_curve.Indices, Index="-1", Wrap=True)
list_item_2 = ListItem(List=input_geometries_2, Index=list_item, Wrap=True)
output_geometry = Geometry(list_item_2)
output_geometry_2 = ClusterOutput(output_geometry)

# ==== cluster FingerCL
flexion_degrees = ClusterInput()
radius_tip = ClusterInput()
radius_mid = ClusterInput()
radius_dip = ClusterInput()
radius_pip = ClusterInput()
l_middle = ClusterInput()
l_distal = ClusterInput()
unit_x = UnitX(Factor="-1")

# ----
# Skeleton Geometry
# Note: Subtraction is necessary because the distal length includes the tip radius
flexion_degrees_2 = Number(flexion_degrees)
radius_tip_2 = Number(radius_tip)
radius_mid_2 = Number(radius_mid)
radius_dip_2 = Number(radius_dip)
radius_pip_2 = Number(radius_pip)
unit_x_2 = UnitX(Factor=1)
l_middle_2 = Number(l_middle)
l_distal_2 = Number(l_distal)
xz_plane = XZPlane(Origin=Point(0, 0, 0))
mid_line = LineSDL(Start=xz_plane, Direction=unit_x_2, Length=l_middle_2)
end_points = EndPoints(Curve=mid_line)  # -> Start, End
perc_slider = Slider(1.03, range=0.1..1.2)
subtraction = Subtraction(A=l_distal_2, B=radius_tip_2)
multiplication = Multiplication(A=radius_mid_2, B="1.0")
pip_sph = Sphere(Base=end_points.Start, Radius=radius_pip_2)
dip_sph = Sphere(Base=end_points.End, Radius=radius_dip_2)
mid_line_2 = Line(mid_line)
_0_mid_frame = PerpFrame(Curve=mid_line_2, Parameter="0.5")
_0_mid_frame_2 = PerpFrame(Curve=mid_line_2, Parameter="0")
_1_mid_frame = PerpFrame(Curve=mid_line_2, Parameter="1")
circle_cnr = CircleCNR(Center=_0_mid_frame, Normal=_0_mid_frame, Radius=multiplication)
dip_hoop_seg0 = BrepPlane(Brep=dip_sph, Plane=_1_mid_frame)  # -> Curves, Points
pip_hoop_seg0 = BrepPlane(Brep=pip_sph, Plane=_0_mid_frame_2)  # -> Curves, Points
list_item = ListItem(List=dip_hoop_seg0.Curves, Index=0, Wrap=True)
list_item_2 = ListItem(List=pip_hoop_seg0.Curves, Index=0, Wrap=True)
flip_curve = FlipCurve(Curve=circle_cnr, Guide=list_item_2)  # -> Curve, Flag
pip_hoop = Curve(list_item_2)
mid_hoop = Curve(flip_curve.Curve)

multiplication_2 = Multiplication(A=flexion_degrees_2, B="-1")

rotate = Rotate(Geometry=unit_x_2, Angle=degrees(multiplication_2), Plane=xz_plane)  # -> Geometry, Transform
distal_line = LineSDL(Start=end_points.End, Direction=rotate.Geometry, Length=subtraction)
end_points_2 = EndPoints(Curve=distal_line)  # -> Start, End
tip_sph = Sphere(Base=end_points_2.End, Radius=radius_tip_2)
distal_line_2 = Line(distal_line)
_0_distal_frame = PerpFrame(Curve=distal_line_2, Parameter="0")
dip_hoop_seg1 = BrepPlane(Brep=dip_sph, Plane=_0_distal_frame)  # -> Curves, Points
list_item_3 = ListItem(List=dip_hoop_seg1.Curves, Index=0, Wrap=True)

radius_mid_3 = Number(radius_mid)
mid_line_3 = Line(mid_line_2)
unit_z = UnitZ(Factor=radius_mid_3)
move = Move(Geometry=mid_line_3, Motion=unit_z)  # -> Geometry, Transform
extend_curve = ExtendCurve(Curve=move.Geometry, Type=0, Start="1000", End="1000")
reparameterize_curve = ReparameterizeCurve(Curve=extend_curve)  # -> Reparameterized, Original
seam_alignment_line = Line(reparameterize_curve.Reparameterized)

tip_sphere = Brep(tip_sph)
distal_dip_hoop = Curve(list_item_3)
mid_dip_hoop = Curve(list_item)
dip_sphere = Brep(dip_sph)
distal_line_3 = Line(distal_line_2)

# ----
# Tip Shaping
tip_taper_percent = Slider(0.7, range=0..1)
tip_angle = Slider(10, range=-20..20)
distal_line_4 = Line(distal_line_3)
radius_tip_3 = Number(radius_tip)
tip_sphere_2 = Brep(tip_sphere)
brep_line = BrepLine(Brep=tip_sphere_2, Line=distal_line_4, LimitToFirst=False)  # -> Curves, Points
list_item_4 = ListItem(List=brep_line.Points, Index="0", Wrap=True)
list_item_5 = ListItem(List=brep_line.Points, Index="1", Wrap=True)
line = Line(StartPoint=list_item_4, EndPoint=list_item_5)
curve_middle = CurveMiddle(Curve=line)
multiplication_3 = Multiplication(A=radius_tip_3, B=tip_taper_percent)
xz_plane_2 = XZPlane(Origin=curve_middle)
flatten_tip = BooleanToggle(True)
rotate_2 = Rotate(Geometry=line, Angle=degrees(tip_angle), Plane=xz_plane_2)  # -> Geometry, Transform
taper = Taper(
    Geometry=tip_sphere_2,
    Axis=rotate_2.Geometry,
    Start=radius_tip_3,
    End=multiplication_3,
    Flat=flatten_tip,
    Infinite=False,
    Rigid=False)
_1_distal_frame = PerpFrame(Curve=distal_line_4, Parameter="1")
tip_shaped = Brep(taper)
tip_hoop_seg1 = BrepPlane(Brep=tip_shaped, Plane=_1_distal_frame)  # -> Curves, Points
list_item_6 = ListItem(List=tip_hoop_seg1.Curves, Index=0, Wrap=True)
tip_hoop = Curve(list_item_6)

mid_line_4 = Line(mid_line_2)

# ----
# Distal Phalange
distal_dip_hoop_2 = Curve(distal_dip_hoop)
tip_hoop_2 = Curve(tip_hoop)
seam_alignment_line_2 = Line(seam_alignment_line)
merge = Merge(Data1=distal_dip_hoop_2, Data2=tip_hoop_2)  # -> flatten(Result)
refit = BooleanToggle(True)
closed = BooleanToggle(False)
curve_align_curve_seams = CurveAlignCurveSeams(Curves=merge, Guide=seam_alignment_line_2, Snap=False)  # -> Aligned, Points, ResultBoolean
loft_options = LoftOptions(Closed=closed, Adjust=refit, Rebuild="15", Refit=0, Type="5")
point = Point(curve_align_curve_seams.Points)
loft = Loft(Curves=curve_align_curve_seams.Aligned, Options=loft_options)
cap_holes = CapHoles(Brep=loft)
distal_phalange = Brep(cap_holes)

seam_alignment_line_3 = Line(seam_alignment_line)

# ----
# Mid Phalange
pip_hoop_2 = Curve(pip_hoop)
mid_dip_hoop_2 = Curve(mid_dip_hoop)
mid_hoop_2 = Curve(mid_hoop)
merge_2 = Merge(Data1=pip_hoop_2, Data2=mid_hoop_2, Data3=mid_dip_hoop_2)  # -> flatten(Result)
closed_2 = BooleanToggle(False)
curve_align_curve_seams_2 = CurveAlignCurveSeams(Curves=merge_2, Guide=seam_alignment_line_3, Snap=False)  # -> Aligned, Points, ResultBoolean
loft_options_2 = LoftOptions(Closed=closed_2, Adjust=False, Rebuild="15", Refit=0, Type="5")
point_2 = Point(curve_align_curve_seams_2.Points)
loft_2 = Loft(Curves=curve_align_curve_seams_2.Aligned, Options=loft_options_2)
cap_holes_2 = CapHoles(Brep=loft_2)
mid_phalange = Brep(cap_holes_2)

tip_shaped_2 = Brep(tip_shaped)
dip_sphere_2 = Brep(dip_sphere)
shaped_tip_hoop = Curve(tip_hoop)
reliable_union_cl = ReliableUnionCL(brep1=mid_phalange, brep2=dip_sphere_2, seam_alignment_line=seam_alignment_line, join_axis_vector=unit_x)
reliable_union_cl_2 = ReliableUnionCL(brep1=distal_phalange, brep2=tip_shaped_2, seam_alignment_line=seam_alignment_line, join_axis_vector=unit_x)
divide_curve = DivideCurve(Curve=shaped_tip_hoop, Count=10, Kinks=False)  # -> Points, Tangents, Parameters
# Note:: The Tip hoop has to be re-derived because the joining union above may create a surface that does not exactly match the original tip shaped hoop
plane_fit = PlaneFit(Points=flatten(divide_curve.Points))  # -> Plane, Deviation
reliable_union_cl_3 = ReliableUnionCL(brep1=reliable_union_cl, brep2=reliable_union_cl_2, seam_alignment_line=seam_alignment_line, join_axis_vector=unit_x)
brep_plane = BrepPlane(Brep=reliable_union_cl_3, Plane=plane_fit.Plane)  # -> Curves, Points
list_item_7 = ListItem(List=brep_plane.Curves, Index=0, Wrap=True)
shaped_tip_hoop_2 = Curve(list_item_7)
tip_shaped_3 = ClusterOutput(tip_shaped)
tip_sphere_3 = ClusterOutput(tip_sphere)
shaped_tip_hoop_3 = ClusterOutput(shaped_tip_hoop_2)
whole_finger = ClusterOutput(reliable_union_cl_3)
mid_line_5 = ClusterOutput(mid_line_4)
distal_line_5 = ClusterOutput(distal_line_3)
pip_hoop_3 = ClusterOutput(pip_hoop)
mid_hoop_3 = ClusterOutput(mid_hoop)
dip_sphere_3 = ClusterOutput(dip_sphere)
mid_dip_hoop_3 = ClusterOutput(mid_dip_hoop)
distal_dip_hoop_3 = ClusterOutput(distal_dip_hoop)

# ==== cluster PTInDir
curve = ClusterInput()
search_dir_v = ClusterInput()
search_dir_v_2 = Vector(search_dir_v)
curve_2 = Curve(curve)
area = Area(Geometry=curve_2)  # -> Area, Centroid
multiplication = Multiplication(A=search_dir_v_2)
move = Move(Geometry=area.Centroid, Motion=multiplication)  # -> Geometry, Transform
curve_closest_point = CurveClosestPoint(Point=move.Geometry, Curve=curve_2)  # -> Point, Parameter, Distance
point = ClusterOutput(curve_closest_point.Point)

# ==== cluster PTInDir_2
search_dir_v = ClusterInput()
curve = ClusterInput()
search_dir_v_2 = Vector(search_dir_v)
curve_2 = Curve(curve)
area = Area(Geometry=curve_2)  # -> Area, Centroid
multiplication = Multiplication(A=search_dir_v_2)
move = Move(Geometry=area.Centroid, Motion=multiplication)  # -> Geometry, Transform
curve_closest_point = CurveClosestPoint(Point=move.Geometry, Curve=curve_2)  # -> Point, Parameter, Distance
point = ClusterOutput(curve_closest_point.Point)

# ==== cluster LocatePTOnBrep
param = ClusterInput()
start_pt = ClusterInput()
end_pt = ClusterInput()
brep = ClusterInput()
end_pt_2 = Point(end_pt)
param_2 = Number(param)
brep_2 = Brep(brep)
start_pt_2 = Point(start_pt)
line = Line(StartPoint=start_pt_2, EndPoint=end_pt_2)
reparameterize_curve = ReparameterizeCurve(Curve=line)  # -> Reparameterized, Original
evaluate_curve = EvaluateCurve(Curve=reparameterize_curve.Reparameterized, Parameter=param_2)  # -> Point, Tangent, Angle
brep_closest_point = BrepClosestPoint(Point=evaluate_curve.Point, Brep=brep_2)  # -> Point, Normal, Distance
point = ClusterOutput(brep_closest_point.Point)

# ==== cluster LocatePTOnBrep_2
end_pt = ClusterInput()
param = ClusterInput()
brep = ClusterInput()
start_pt = ClusterInput()
end_pt_2 = Point(end_pt)
param_2 = Number(param)
brep_2 = Brep(brep)
start_pt_2 = Point(start_pt)
line = Line(StartPoint=start_pt_2, EndPoint=end_pt_2)
reparameterize_curve = ReparameterizeCurve(Curve=line)  # -> Reparameterized, Original
evaluate_curve = EvaluateCurve(Curve=reparameterize_curve.Reparameterized, Parameter=param_2)  # -> Point, Tangent, Angle
brep_closest_point = BrepClosestPoint(Point=evaluate_curve.Point, Brep=brep_2)  # -> Point, Normal, Distance
point = ClusterOutput(brep_closest_point.Point)

# ==== cluster PTInDirBrep
brep = ClusterInput()
search_dir_v = ClusterInput()
search_dir_v_2 = Vector(search_dir_v)
brep_2 = Brep(brep)
volume = Volume(Geometry=brep_2)  # -> Volume, Centroid
line_sdl = LineSDL(Start=volume.Centroid, Direction=search_dir_v_2, Length="1000")
end_points = EndPoints(Curve=line_sdl)  # -> Start, End
brep_closest_point = BrepClosestPoint(Point=end_points.End, Brep=brep_2)  # -> Point, Normal, Distance
point = ClusterOutput(brep_closest_point.Point)

# ==== cluster ReliableUnionCL
seam_alignment_line = ClusterInput()
join_axis_vector = ClusterInput()
brep1 = ClusterInput()
# Trim Solid is not always working
brep2 = ClusterInput()
brep1_2 = Brep(brep1)
brep2_2 = Brep(brep2)
seam_alignment_line_2 = Line(seam_alignment_line)
python_3_script = Python3Script(x=brep1_2, y=brep2_2)  # -> out, a
# ---------- python_3_script: Python ----------
import Rhino
print(f"{Rhino.RhinoDoc.ActiveDoc.ModelAbsoluteTolerance}")
Rhino.RhinoDoc.ActiveDoc.ModelAbsoluteTolerance = 0.00001
print(f"{Rhino.RhinoDoc.ActiveDoc.ModelAbsoluteTolerance}")
# ---------- end python_3_script ----------
join_axis_vector_2 = Vector(join_axis_vector)
reverse = Reverse(Vector=join_axis_vector_2)
merge = Merge(Data1=brep1_2, Data2=brep2_2)  # -> flatten(Result)
solid_union = SolidUnion(Breps=merge)
checkexist = Python3Script(geo=solid_union)  # -> out, doesExist, doesntExist; inputs geo: GeometryBase
# ---------- checkexist: Python ----------
print(f"{geo=} type={type(geo)}")

isExisting = False

if geo is None:
    print("geo is None (root)")
    isExisting = False
else:
    if geo[0] is None:
        print(f"geo[0] is None len={len(geo)}")
        isExisting = False
    else:
        isExisting = len(geo) > 0
        print("geo is list of more than 0 len")

doesExist = isExisting
doesntExist = not isExisting
print(f"{doesExist=} {doesntExist=}")
# ---------- end checkexist ----------
python_3_script_2 = Python3Script(passItems=checkexist.doesntExist, brep1=brep1_2, brep2=brep2_2)  # -> out, out_brep1, out_brep2; inputs brep1: Brep, brep2: Brep
# ---------- python_3_script_2: Python ----------
if passItems:
    out_brep1 = brep1
    out_brep2 = brep2
else:
    out_brep1 = None
    out_brep2 = None
# ---------- end python_3_script_2 ----------
deconstruct_brep = DeconstructBrep(Brep=python_3_script_2.out_brep1)  # -> Faces, Edges, Vertices
deconstruct_brep_2 = DeconstructBrep(Brep=python_3_script_2.out_brep2)  # -> Faces, Edges, Vertices
brep_join = BrepJoin(Breps=deconstruct_brep_2.Faces)  # -> Breps, Closed
brep_join_2 = BrepJoin(Breps=deconstruct_brep.Faces)  # -> Breps, Closed
merge_2 = Merge(Data1=brep_join_2.Breps, Data2=brep_join.Breps)  # -> flatten(Result)
solid_union_2 = SolidUnion(Breps=merge_2)
loft_options = LoftOptions(Closed=False, Adjust=False, Rebuild=0, Refit=0, Type=0)
panel = Panel(checkexist.out)
pick_n_choose = PickNChoose(Pattern=checkexist.doesntExist, Stream0=solid_union, Stream1=solid_union_2)
checkexist_2 = Python3Script(geo=pick_n_choose)  # -> out, doesExist, doesntExist; inputs geo: GeometryBase; same code as checkexist
python_3_script_3 = Python3Script(passItems=checkexist_2.doesntExist, brep1=brep1_2, brep2=brep2_2)  # -> out, out_brep1, out_brep2; inputs brep1: Brep, brep2: Brep; same code as python_3_script_2
trim_solid = TrimSolid(Shape=python_3_script_3.out_brep2, Cutters=python_3_script_3.out_brep1)
trim_solid_2 = TrimSolid(Shape=python_3_script_3.out_brep1, Cutters=python_3_script_3.out_brep2)
list_item = ListItem(List=trim_solid, Index=Slider(0, range=0..1), Wrap=True)
directional_trim = DirectionalTrim(single_opening_brep=trim_solid_2, trim_shift_vector=join_axis_vector_2)  # -> trimmed_brep_2, naked_curve
directional_trim_2 = DirectionalTrim(single_opening_brep=list_item, trim_shift_vector=reverse)  # -> flatten(trimmed_brep_2), naked_curve
curve = Curve(directional_trim.naked_curve)
curve_2 = Curve(directional_trim_2.naked_curve)
flip_curve = FlipCurve(Curve=curve_2, Guide=curve)  # -> Curve, Flag
trimmed_brep = Brep(directional_trim_2.trimmed_brep_2)
merge_3 = Merge(Data1=curve, Data2=flip_curve.Curve)  # -> flatten(Result)
trimmed_brep_2 = Brep(directional_trim.trimmed_brep_2)
curve_align_curve_seams = CurveAlignCurveSeams(Curves=merge_3, Guide=seam_alignment_line_2, Snap=False)  # -> Aligned, Points, ResultBoolean
loft = Loft(Curves=curve_align_curve_seams.Aligned, Options=loft_options)
merge_4 = Merge(Data1=trimmed_brep_2, Data2=loft, Data3=trimmed_brep)  # -> flatten(Result)
brep_join_3 = BrepJoin(Breps=merge_4)  # -> Breps, Closed
list_item_2 = ListItem(List=brep_join_3.Breps, Index=0, Wrap=True)
pick_n_choose_2 = PickNChoose(Pattern=checkexist_2.doesntExist, Stream0=pick_n_choose, Stream1=list_item_2)
result = ClusterOutput(pick_n_choose_2)

# ==== cluster DirectionalTrim
trim_shift_vector = ClusterInput()
single_opening_brep = ClusterInput()
single_opening_brep_2 = Brep(single_opening_brep)
trim_shift_vector_2 = Vector(trim_shift_vector)
brep_edges = BrepEdges(Brep=single_opening_brep_2)  # -> Naked, Interior, NonManifold
unit_vector = UnitVector(Vector=trim_shift_vector_2)
reverse = Reverse(Vector=unit_vector)
curve = Curve(flatten(brep_edges.Naked))
join_curves = JoinCurves(Curves=curve, Preserve=False)
point = Point("0, 0, 0")
multiplication = Multiplication(A=reverse, B="1000")
multiplication_2 = Multiplication(A=unit_vector, B="1000")
move = Move(Geometry=point, Motion=multiplication)  # -> Geometry, Transform
reparameterize_curve = ReparameterizeCurve(Curve=join_curves)  # -> Reparameterized, Original
line = Line(StartPoint=multiplication, EndPoint=multiplication_2)
divide_curve = DivideCurve(Curve=reparameterize_curve.Reparameterized, Count="10", Kinks=False)  # -> flatten(Points), Tangents, Parameters
plane_fit = PlaneFit(Points=divide_curve.Points)  # -> Plane, Deviation
move_2 = Move(Geometry=plane_fit.Plane, Motion=trim_shift_vector_2)  # -> Geometry, Transform
brep_plane = BrepPlane(Brep=single_opening_brep_2, Plane=move_2.Geometry)  # -> Curves, Points
split_brep = SplitBrep(Brep=single_opening_brep_2, Cutter=brep_plane.Curves)
bounding_box = BoundingBox(Content=split_brep, Plane=PlaneXY(0, 0, 0))  # -> Box, Box_2
volume = Volume(Geometry=bounding_box.Box)  # -> Volume, Centroid
sort_along_curve = SortAlongCurve(Points=volume.Centroid, Curve=line)  # -> Points, Indices
list_item = ListItem(List=sort_along_curve.Indices, Index="-1", Wrap=Toggle(True))
list_item_2 = ListItem(List=split_brep, Index=list_item, Wrap=True)
trimmed_brep = Brep(list_item_2)
brep_edges_2 = BrepEdges(Brep=trimmed_brep)  # -> Naked, Interior, NonManifold
join_curves_2 = JoinCurves(Curves=brep_edges_2.Naked, Preserve=False)
naked_curve = ClusterOutput(join_curves_2)
trimmed_brep_2 = ClusterOutput(trimmed_brep)
